# Grasshopper definition WikiHouse_WREN_(v4.3).gh (Grasshopper 0.9.76)
# Copyright: MPL v.2.0
# Copyright: Clayton Prest & Architecture 00
# plug-ins: Human, EleFront, MetaHopper, Google Drive for GH 
# Developed by Architecture00.
# This file and it's subcomponents are licensed under Mozilla Public Licence (MPL) version 2.0. For full legal terms of this licence visit: https://www.mozilla.org/en-US/MPL/2.0/

# Authenticate to your
# G-drive account
toggle = BooleanToggle(True)
gauth = GoogleAuthenticator(Authenticate=toggle, ClearCredentials=Toggle(True))
spreadsheetlist = SpreadsheetList(Token=gauth, Refresh=Toggle(True))
# Spreadsheet Input:
# 
# This uses the Leafcutter plugin to pull in dimensional data from a google sheet spreadsheet. There's a template engine included with this Grasshopper file that links into this parametric script.
# Select your Project Engine file here:
item_no = Slider(2, range=0..29)
panel = Panel(spreadsheetlist)
# Correct name for your
# 'Dashboard' worksheet:
panel_2 = Panel("Dashboard")
refresh_spreadsheet_data = BooleanToggle(False)
item = ListItem(List=spreadsheetlist, Index=item_no, Wrap=False)
data = Data(panel_2)
readspreadsheet = ReadFromSpreadsheet(
    Token=gauth,
    Name=item,
    Worksheet=data,
    IncludeBlankCells=False,
    OrganizeByRowsOrColumns=False,
    ReadFormulasOrValues=False,
    Refresh=refresh_spreadsheet_data)  # -> Values, CellAddresses, SheetInfo
branch = TreeBranch(Tree=readspreadsheet.Values, Path="0;2", MaintainPaths=True)
branch_2 = TreeBranch(Tree=readspreadsheet.Values, Path="0;2", MaintainPaths=True)
branch_3 = TreeBranch(Tree=readspreadsheet.Values, Path="0;2", MaintainPaths=True)

# ----
# TERMS OF USE
# By downloading these files or information you agree to the following terms and conditions.
# 
# Information is shared without any kind of warranty or guarantee All Information is provided ‘as is’. No representations or warranties express or implied are made regarding the Wikihouse Info, its accuracy, completeness, functionality or fitness for a particular use in a particular location.
# 
# You are solely responsible for the use of the information By using this information you assume full responsibility for any loss resulting from use or inability to use the Wikihouse Info, and forever releases WikiHouse Foundation or other WikiHouse users from any liability for such loss; including but not limited to loss of profits, goodwill or assets.
# 
# You are responsible for meeting local codes and legislation Users must satisfy themselves regarding the application of statutory requirements, local building regulations, codes, insurance certification or other requirements or recommendations relevant to the location where and materials with which they plan to build. Where required you should always seek the advice of a relevant qualified professional.
# 
# You are responsible for using the information in a safe way Users are responsible for ensuring that information they use or cause to be used is used in a way which is safe, and is not likely to cause harm during or after manufacturing, construction, use or disassembly.
# LICENCE
panel_3 = Panel("""Mozilla Public License
Version 2.0 (https://www.mozilla.org/en-US/MPL/2.0/)

1. Definitions

1.1. “Contributor”
means each individual or legal entity that creates, contributes to the creation of, or owns Covered Software.

1.2. “Contributor Version”
means the combination of the Contributions of others (if any) used by a Contributor and that particular Contributor’s Contribution.

1.3. “Contribution”
means Covered Software of a particular Contributor.

1.4. “Covered Software”
means Source Code Form to which the initial Contributor has attached the notice in Exhibit A, the Executable Form of such Source Code Form, and Modifications of such Source Code Form, in each case including portions thereof.

1.5. “Incompatible With Secondary Licenses”
means

that the initial Contributor has attached the notice described in Exhibit B to the Covered Software; or

that the Covered Software was made available under the terms of version 1.1 or earlier of the License, but not also under the terms of a Secondary License.

1.6. “Executable Form”
means any form of the work other than Source Code Form.

1.7. “Larger Work”
means a work that combines Covered Software with other material, in a separate file or files, that is not Covered Software.

1.8. “License”
means this document.

1.9. “Licensable”
means having the right to grant, to the maximum extent possible, whether at the time of the initial grant or subsequently, any and all of the rights conveyed by this License.

1.10. “Modifications”
means any of the following:

any file in Source Code Form that results from an addition to, deletion from, or modification of the contents of Covered Software; or

any new file in Source Code Form that contains any Covered Software.

1.11. “Patent Claims” of a Contributor
means any patent claim(s), including without limitation, method, process, and apparatus claims, in any patent Licensable by such Contributor that would be infringed, but for the grant of the License, by the making, using, selling, offering for sale, having made, import, or transfer of either its Contributions or its Contributor Version.

1.12. “Secondary License”
means either the GNU General Public License, Version 2.0, the GNU Lesser General Public License, Version 2.1, the GNU Affero General Public License, Version 3.0, or any later versions of those licenses.

1.13. “Source Code Form”
means the form of the work preferred for making modifications.

1.14. “You” (or “Your”)
means an individual or a legal entity exercising rights under this License. For legal entities, “You” includes any entity that controls, is controlled by, or is under common control with You. For purposes of this definition, “control” means (a) the power, direct or indirect, to cause the direction or management of such entity, whether by contract or otherwise, or (b) ownership of more than fifty percent (50%) of the outstanding shares or beneficial ownership of such entity.

2. License Grants and Conditions

2.1. Grants

Each Contributor hereby grants You a world-wide, royalty-free, non-exclusive license:

under intellectual property rights (other than patent or trademark) Licensable by such Contributor to use, reproduce, make available, modify, display, perform, distribute, and otherwise exploit its Contributions, either on an unmodified basis, with Modifications, or as part of a Larger Work; and

under Patent Claims of such Contributor to make, use, sell, offer for sale, have made, import, and otherwise transfer either its Contributions or its Contributor Version.

2.2. Effective Date

The licenses granted in Section 2.1 with respect to any Contribution become effective for each Contribution on the date the Contributor first distributes such Contribution.

2.3. Limitations on Grant Scope

The licenses granted in this Section 2 are the only rights granted under this License. No additional rights or licenses will be implied from the distribution or licensing of Covered Software under this License. Notwithstanding Section 2.1(b) above, no patent license is granted by a Contributor:

for any code that a Contributor has removed from Covered Software; or

for infringements caused by: (i) Your and any other third party’s modifications of Covered Software, or (ii) the combination of its Contributions with other software (except as part of its Contributor Version); or

under Patent Claims infringed by Covered Software in the absence of its Contributions.

This License does not grant any rights in the trademarks, service marks, or logos of any Contributor (except as may be necessary to comply with the notice requirements in Section 3.4).

2.4. Subsequent Licenses

No Contributor makes additional grants as a result of Your choice to distribute the Covered Software under a subsequent version of this License (see Section 10.2) or under the terms of a Secondary License (if permitted under the terms of Section 3.3).

2.5. Representation

Each Contributor represents that the Contributor believes its Contributions are its original creation(s) or it has sufficient rights to grant the rights to its Contributions conveyed by this License.

2.6. Fair Use

This License is not intended to limit any rights You have under applicable copyright doctrines of fair use, fair dealing, or other equivalents.

2.7. Conditions

Sections 3.1, 3.2, 3.3, and 3.4 are conditions of the licenses granted in Section 2.1.

3. Responsibilities

3.1. Distribution of Source Form

All distribution of Covered Software in Source Code Form, including any Modifications that You create or to which You contribute, must be under the terms of this License. You must inform recipients that the Source Code Form of the Covered Software is governed by the terms of this License, and how they can obtain a copy of this License. You may not attempt to alter or restrict the recipients’ rights in the Source Code Form.

3.2. Distribution of Executable Form

If You distribute Covered Software in Executable Form then:

such Covered Software must also be made available in Source Code Form, as described in Section 3.1, and You must inform recipients of the Executable Form how they can obtain a copy of such Source Code Form by reasonable means in a timely manner, at a charge no more than the cost of distribution to the recipient; and

You may distribute such Executable Form under the terms of this License, or sublicense it under different terms, provided that the license for the Executable Form does not attempt to limit or alter the recipients’ rights in the Source Code Form under this License.

3.3. Distribution of a Larger Work

You may create and distribute a Larger Work under terms of Your choice, provided that You also comply with the requirements of this License for the Covered Software. If the Larger Work is a combination of Covered Software with a work governed by one or more Secondary Licenses, and the Covered Software is not Incompatible With Secondary Licenses, this License permits You to additionally distribute such Covered Software under the terms of such Secondary License(s), so that the recipient of the Larger Work may, at their option, further distribute the Covered Software under the terms of either this License or such Secondary License(s).

3.4. Notices

You may not remove or alter the substance of any license notices (including copyright notices, patent notices, disclaimers of warranty, or limitations of liability) contained within the Source Code Form of the Covered Software, except that You may alter any license notices to the extent required to remedy known factual inaccuracies.

3.5. Application of Additional Terms

You may choose to offer, and to charge a fee for, warranty, support, indemnity or liability obligations to one or more recipients of Covered Software. However, You may do so only on Your own behalf, and not on behalf of any Contributor. You must make it absolutely clear that any such warranty, support, indemnity, or liability obligation is offered by You alone, and You hereby agree to indemnify every Contributor for any liability incurred by such Contributor as a result of warranty, support, indemnity or liability terms You offer. You may include additional disclaimers of warranty and limitations of liability specific to any jurisdiction.

4. Inability to Comply Due to Statute or Regulation

If it is impossible for You to comply with any of the terms of this License with respect to some or all of the Covered Software due to statute, judicial order, or regulation then You must: (a) comply with the terms of this License to the maximum extent possible; and (b) describe the limitations and the code they affect. Such description must be placed in a text file included with all distributions of the Covered Software under this License. Except to the extent prohibited by statute or regulation, such description must be sufficiently detailed for a recipient of ordinary skill to be able to understand it.

5. Termination

5.1. The rights granted under this License will terminate automatically if You fail to comply with any of its terms. However, if You become compliant, then the rights granted under this License from a particular Contributor are reinstated (a) provisionally, unless and until such Contributor explicitly and finally terminates Your grants, and (b) on an ongoing basis, if such Contributor fails to notify You of the non-compliance by some reasonable means prior to 60 days after You have come back into compliance. Moreover, Your grants from a particular Contributor are reinstated on an ongoing basis if such Contributor notifies You of the non-compliance by some reasonable means, this is the first time You have received notice of non-compliance with this License from such Contributor, and You become compliant prior to 30 days after Your receipt of the notice.

5.2. If You initiate litigation against any entity by asserting a patent infringement claim (excluding declaratory judgment actions, counter-claims, and cross-claims) alleging that a Contributor Version directly or indirectly infringes any patent, then the rights granted to You by any and all Contributors for the Covered Software under Section 2.1 of this License shall terminate.

5.3. In the event of termination under Sections 5.1 or 5.2 above, all end user license agreements (excluding distributors and resellers) which have been validly granted by You or Your distributors under this License prior to termination shall survive termination.

6. Disclaimer of Warranty

Covered Software is provided under this License on an “as is” basis, without warranty of any kind, either expressed, implied, or statutory, including, without limitation, warranties that the Covered Software is free of defects, merchantable, fit for a particular purpose or non-infringing. The entire risk as to the quality and performance of the Covered Software is with You. Should any Covered Software prove defective in any respect, You (not any Contributor) assume the cost of any necessary servicing, repair, or correction. This disclaimer of warranty constitutes an essential part of this License. No use of any Covered Software is authorized under this License except under this disclaimer.

7. Limitation of Liability

Under no circumstances and under no legal theory, whether tort (including negligence), contract, or otherwise, shall any Contributor, or anyone who distributes Covered Software as permitted above, be liable to You for any direct, indirect, special, incidental, or consequential damages of any character including, without limitation, damages for lost profits, loss of goodwill, work stoppage, computer failure or malfunction, or any and all other commercial damages or losses, even if such party shall have been informed of the possibility of such damages. This limitation of liability shall not apply to liability for death or personal injury resulting from such party’s negligence to the extent applicable law prohibits such limitation. Some jurisdictions do not allow the exclusion or limitation of incidental or consequential damages, so this exclusion and limitation may not apply to You.

8. Litigation

Any litigation relating to this License may be brought only in the courts of a jurisdiction where the defendant maintains its principal place of business and such litigation shall be governed by laws of that jurisdiction, without reference to its conflict-of-law provisions. Nothing in this Section shall prevent a party’s ability to bring cross-claims or counter-claims.

9. Miscellaneous

This License represents the complete agreement concerning the subject matter hereof. If any provision of this License is held to be unenforceable, such provision shall be reformed only to the extent necessary to make it enforceable. Any law or regulation which provides that the language of a contract shall be construed against the drafter shall not be used to construe this License against a Contributor.

10. Versions of the License

10.1. New Versions

Mozilla Foundation is the license steward. Except as provided in Section 10.3, no one other than the license steward has the right to modify or publish new versions of this License. Each version will be given a distinguishing version number.

10.2. Effect of New Versions

You may distribute the Covered Software under the terms of the version of the License under which You originally received the Covered Software, or under the terms of any subsequent version published by the license steward.

10.3. Modified Versions

If you create software not governed by this License, and you want to create a new license for such software, you may create and use a modified version of this License if you rename the license and remove any references to the name of the license steward (except to note that such modified license differs from this License).

10.4. Distributing Source Code Form that is Incompatible With Secondary Licenses

If You choose to distribute Source Code Form that is Incompatible With Secondary Licenses under the terms of this version of the License, the notice described in Exhibit B of this License must be attached.

Exhibit A - Source Code Form License Notice

This Source Code Form is subject to the terms of the Mozilla Public License, v. 2.0. If a copy of the MPL was not distributed with this file, You can obtain one at https://mozilla.org/MPL/2.0/.

If it is not possible or desirable to put the notice in a particular file, then You may include the notice in a location (such as a LICENSE file in a relevant directory) where a recipient would be likely to look for such a notice.

You may add additional accurate notices of copyright ownership.

Exhibit B - “Incompatible With Secondary Licenses” Notice

This Source Code Form is “Incompatible With Secondary Licenses”, as defined by the Mozilla Public License, v. 2.0.""")

# ----
# SHEET PARAMETERS
number_slider = Slider(0, range=0..81)
item_2 = ListItem(List=branch, Index=number_slider, Wrap=True)
item_3 = ListItem(List=branch, Index=Slider(2, range=0..81), Wrap=True)
item_4 = ListItem(List=branch, Index=Slider(3, range=0..81), Wrap=True)
item_5 = ListItem(List=branch, Index=Slider(4, range=0..81), Wrap=True)
item_6 = ListItem(List=branch, Index=Slider(5, range=0..81), Wrap=True)
item_7 = ListItem(List=branch, Index=Slider(6, range=0..81), Wrap=True)
item_8 = ListItem(List=branch, Index=Slider(7, range=0..81), Wrap=True)
item_9 = ListItem(List=branch, Index=Slider(8, range=0..81), Wrap=True)
item_10 = ListItem(List=branch, Index=Slider(9, range=0..81), Wrap=True)
item_11 = ListItem(List=branch_2, Index=Slider(11, range=0..81), Wrap=True)
item_12 = ListItem(List=branch_2, Index=Slider(12, range=0..81), Wrap=True)
item_13 = ListItem(List=branch_2, Index=Slider(13, range=0..81), Wrap=True)
item_14 = ListItem(List=branch_2, Index=Slider(14, range=0..81), Wrap=True)
item_15 = ListItem(List=branch_3, Index=Slider(16, range=0..81), Wrap=True)
item_16 = ListItem(List=branch_3, Index=Slider(17, range=0..81), Wrap=True)
item_17 = ListItem(List=branch_3, Index=Slider(18, range=0..81), Wrap=True)
item_18 = ListItem(List=branch_3, Index=Slider(19, range=0..81), Wrap=True)
item_19 = ListItem(List=branch_3, Index=Slider(20, range=0..81), Wrap=True)
item_20 = ListItem(List=branch_3, Index=Slider(21, range=0..81), Wrap=True)
item_21 = ListItem(List=branch_3, Index=Slider(22, range=0..81), Wrap=True)
item_22 = ListItem(List=branch_3, Index=Slider(23, range=0..81), Wrap=True)
item_23 = ListItem(List=branch_3, Index=Slider(24, range=0..81), Wrap=True)
item_24 = ListItem(List=branch_3, Index=Slider(25, range=0..81), Wrap=True)
item_25 = ListItem(List=branch_3, Index=Slider(26, range=0..81), Wrap=True)
item_26 = ListItem(List=branch_3, Index=Slider(27, range=0..81), Wrap=True)
item_27 = ListItem(List=branch_3, Index=Slider(28, range=0..81), Wrap=True)
item_28 = ListItem(List=branch_3, Index=Slider(29, range=0..81), Wrap=True)
panel_4 = Panel(item_4)
panel_5 = Panel(item_3)
panel_6 = Panel(item_5)
panel_7 = Panel(item_6)
panel_8 = Panel(item_7)
panel_9 = Panel(item_8)
panel_10 = Panel(item_9)
panel_11 = Panel(item_2)
panel_12 = Panel(item_10)
gauge = Slider(600, range=0..8000)
panel_13 = Panel(item_15)
panel_14 = Panel(item_16)
panel_15 = Panel(item_17)
panel_16 = Panel(item_11)
panel_17 = Panel(item_12)
panel_18 = Panel(item_18)
panel_19 = Panel(item_13)
panel_20 = Panel(item_14)
panel_21 = Panel(item_19)
panel_22 = Panel(item_20)
panel_23 = Panel(item_21)
panel_24 = Panel(item_22)
panel_25 = Panel(item_23)
panel_26 = Panel(item_24)
panel_27 = Panel(item_25)
panel_28 = Panel(item_26)
panel_29 = Panel(item_27)
panel_30 = Panel(item_28)
connector_slot_length_wall = Number(panel_21)
connector_grip_length = Number(panel_15)
connector_slot_length_floor = Number(panel_18)
no_of_roof_points = Number(panel_16)
column_location = Number(panel_10)
_1st_floor_height = Number(panel_12)
left_wall = Number(panel_6)
right_wall = Number(panel_7)
roof_height = Number(panel_8)
frame_grip_length = Number(panel_23)
length = Number(panel_4)
mezzanine = Boolean(panel_20)
sheet_length = Number(panel_26)
width = Number(panel_5)
ply_thickness = Number(panel_25)
_2nd_floor = Boolean(panel_19)
split = TextSplit(Text=panel_11, Separators=" ")
sheet_width = Number(panel_27)
roof_offset = Number(panel_9)
beam_width = Number(panel_14)
column = Boolean(panel_17)
fin_depth = Number(panel_22)
bays = Number(panel_13)
spacing = Number(panel_28)
tolerance = Number(panel_29)
gauge_2 = Number(panel_24)
tool_size = Number(panel_30)
item_29 = ListItem(List=split, Index=1, Wrap=True)
# SLIDER INPUTS
#       (optional)
unit_type = Data(item_29)

# ----
# BUILDING SIZE
# These values set out the size and shape of the building section in millimetres as centrelines of the frames.
wall_height_left = Slider(2400, range=1200..6000)
wall_height_right = Slider(2400, range=0..6000)
roof_height_2 = Slider(3900, range=0..6600)
roof_offset_from_centre = Slider(0, range=-3300..3300)
column_location_from_left = Slider(4200, range=0..6000)
_1st_floor_height_2 = Slider(2700, range=0..6000)
length_2 = Slider(6000, range=1600..8000)
width_2 = Slider(3900, range=1600..8000)

# ----
# FORM OPTIONS
# These toggles are settings that control the building's form. Will the design have a pitched or monoslope roof? Is a supporting column required? Do I want a two-storey house?
central_columns = BooleanToggle(False)
mezzanine_2 = BooleanToggle(False)
two_storey = BooleanToggle(False)

no_of_roof_points_2 = Slider(1, range=0..81)
# Overrride Sliders
# with Spreadsheet
override_with_spreadsheet = BooleanToggle(False)

# ----
# KEY PARAMETERS
# These are the parameter controls for the engineering and fabrication aspects of the WikiHouse.
gauge_3 = Slider(1200, range=0..8000)
connector_slot_wall = Slider(60, range=0..200)
bays_2 = Slider(2, range=0..10)
beam_width_2 = Slider(150, range=0..200)
connector_slot_floor = Slider(60, range=0..200)
fin_depth_2 = Slider(250, range=0..500)
frame_grip_length_2 = Slider(180, range=0..3600)
ply_thickness_2 = Slider(18, range=0..200)
sheet_width_2 = Slider(1200, range=0..2400)
slot_spacing = Slider(300, range=0..1200)
tolerance_2 = Slider(0, range=-1..5)
tool_size_2 = Slider(10, range=-1..15)
sheet_length_2 = Slider(2400, range=0..3600)

connector_grip_length_2 = Slider(60, range=0..200)
sheet = Dispatch(List=width, DispatchPattern=override_with_spreadsheet)  # -> ListA, ListB
slider = Dispatch(List=width_2, DispatchPattern=override_with_spreadsheet)  # -> ListA, ListB
sheet_2 = Dispatch(List=length, DispatchPattern=override_with_spreadsheet)  # -> ListA, ListB
slider_2 = Dispatch(List=length_2, DispatchPattern=override_with_spreadsheet)  # -> ListA, ListB
sheet_3 = Dispatch(List=left_wall, DispatchPattern=override_with_spreadsheet)  # -> ListA, ListB
slider_3 = Dispatch(List=wall_height_left, DispatchPattern=override_with_spreadsheet)  # -> ListA, ListB
sheet_4 = Dispatch(List=right_wall, DispatchPattern=override_with_spreadsheet)  # -> ListA, ListB
slider_4 = Dispatch(List=wall_height_right, DispatchPattern=override_with_spreadsheet)  # -> ListA, ListB
sheet_5 = Dispatch(List=roof_height, DispatchPattern=override_with_spreadsheet)  # -> ListA, ListB
slider_5 = Dispatch(List=roof_height_2, DispatchPattern=override_with_spreadsheet)  # -> ListA, ListB
sheet_6 = Dispatch(List=roof_offset, DispatchPattern=override_with_spreadsheet)  # -> ListA, ListB
slider_6 = Dispatch(List=roof_offset_from_centre, DispatchPattern=override_with_spreadsheet)  # -> ListA, ListB
sheet_7 = Dispatch(List=column_location, DispatchPattern=override_with_spreadsheet)  # -> ListA, ListB
slider_7 = Dispatch(List=column_location_from_left, DispatchPattern=override_with_spreadsheet)  # -> ListA, ListB
sheet_8 = Dispatch(List=_1st_floor_height, DispatchPattern=override_with_spreadsheet)  # -> ListA, ListB
slider_8 = Dispatch(List=_1st_floor_height_2, DispatchPattern=override_with_spreadsheet)  # -> ListA, ListB
sheet_9 = Dispatch(List=no_of_roof_points, DispatchPattern=override_with_spreadsheet)  # -> ListA, ListB
slider_9 = Dispatch(List=no_of_roof_points_2, DispatchPattern=override_with_spreadsheet)  # -> ListA, ListB
sheet_10 = Dispatch(List=column, DispatchPattern=override_with_spreadsheet)  # -> ListA, ListB
slider_10 = Dispatch(List=central_columns, DispatchPattern=override_with_spreadsheet)  # -> ListA, ListB
sheet_11 = Dispatch(List=_2nd_floor, DispatchPattern=override_with_spreadsheet)  # -> ListA, ListB
slider_11 = Dispatch(List=two_storey, DispatchPattern=override_with_spreadsheet)  # -> ListA, ListB
sheet_12 = Dispatch(List=mezzanine, DispatchPattern=override_with_spreadsheet)  # -> ListA, ListB
slider_12 = Dispatch(List=mezzanine_2, DispatchPattern=override_with_spreadsheet)  # -> ListA, ListB
sheet_13 = Dispatch(List=bays, DispatchPattern=override_with_spreadsheet)  # -> ListA, ListB
slider_13 = Dispatch(List=bays_2, DispatchPattern=override_with_spreadsheet)  # -> ListA, ListB
sheet_14 = Dispatch(List=beam_width, DispatchPattern=override_with_spreadsheet)  # -> ListA, ListB
slider_14 = Dispatch(List=beam_width_2, DispatchPattern=override_with_spreadsheet)  # -> ListA, ListB
sheet_15 = Dispatch(List=connector_grip_length, DispatchPattern=override_with_spreadsheet)  # -> ListA, ListB
slider_15 = Dispatch(List=connector_grip_length_2, DispatchPattern=override_with_spreadsheet)  # -> ListA, ListB
sheet_16 = Dispatch(List=connector_slot_length_floor, DispatchPattern=override_with_spreadsheet)  # -> ListA, ListB
slider_16 = Dispatch(List=connector_slot_floor, DispatchPattern=override_with_spreadsheet)  # -> ListA, ListB
sheet_17 = Dispatch(List=connector_slot_length_wall, DispatchPattern=override_with_spreadsheet)  # -> ListA, ListB
slider_17 = Dispatch(List=connector_slot_wall, DispatchPattern=override_with_spreadsheet)  # -> ListA, ListB
sheet_18 = Dispatch(List=fin_depth, DispatchPattern=override_with_spreadsheet)  # -> ListA, ListB
slider_18 = Dispatch(List=fin_depth_2, DispatchPattern=override_with_spreadsheet)  # -> ListA, ListB
sheet_19 = Dispatch(List=frame_grip_length, DispatchPattern=override_with_spreadsheet)  # -> ListA, ListB
slider_19 = Dispatch(List=frame_grip_length_2, DispatchPattern=override_with_spreadsheet)  # -> ListA, ListB
sheet_20 = Dispatch(List=gauge_2, DispatchPattern=override_with_spreadsheet)  # -> ListA, ListB
slider_20 = Dispatch(List=gauge_3, DispatchPattern=override_with_spreadsheet)  # -> ListA, ListB
sheet_21 = Dispatch(List=ply_thickness, DispatchPattern=override_with_spreadsheet)  # -> ListA, ListB
slider_21 = Dispatch(List=ply_thickness_2, DispatchPattern=override_with_spreadsheet)  # -> ListA, ListB
sheet_22 = Dispatch(List=sheet_length, DispatchPattern=override_with_spreadsheet)  # -> ListA, ListB
slider_22 = Dispatch(List=sheet_length_2, DispatchPattern=override_with_spreadsheet)  # -> ListA, ListB
sheet_23 = Dispatch(List=sheet_width, DispatchPattern=override_with_spreadsheet)  # -> ListA, ListB
slider_23 = Dispatch(List=sheet_width_2, DispatchPattern=override_with_spreadsheet)  # -> ListA, ListB
sheet_24 = Dispatch(List=spacing, DispatchPattern=override_with_spreadsheet)  # -> ListA, ListB
slider_24 = Dispatch(List=slot_spacing, DispatchPattern=override_with_spreadsheet)  # -> ListA, ListB
sheet_25 = Dispatch(List=tolerance, DispatchPattern=override_with_spreadsheet)  # -> ListA, ListB
slider_25 = Dispatch(List=tolerance_2, DispatchPattern=override_with_spreadsheet)  # -> ListA, ListB
sheet_26 = Dispatch(List=tool_size, DispatchPattern=override_with_spreadsheet)  # -> ListA, ListB
slider_26 = Dispatch(List=tool_size_2, DispatchPattern=override_with_spreadsheet)  # -> ListA, ListB

# ----
# ESTIMATED
# MATERIAL COST
# INPUTS
# 2D PROFILE
convert_to_2d_surface = BooleanToggle(True)

# ----
# 3D CHASSIS
array_3d_frames = BooleanToggle(False)

# ----
# 3D FRAME
convert_to_3d_brep = BooleanToggle(True)

connector_grip_length_3 = Number([sheet_15.ListA, slider_15.ListB])
c_slot_length_wall = Number([sheet_17.ListA, slider_17.ListB])
c_slot_length_floor = Number([sheet_16.ListA, slider_16.ListB])
frame_grip_length_3 = Number([sheet_19.ListA, slider_19.ListB])
sheet_length_3 = Number([sheet_22.ListA, slider_22.ListB])
ply_thickness_3 = Number([sheet_21.ListA, slider_21.ListB])
sheet_width_3 = Number([sheet_23.ListA, slider_23.ListB])
beam_width_3 = Number([sheet_14.ListA, slider_14.ListB])
fin_depth_3 = Number([sheet_18.ListA, slider_18.ListB])
no_of_roof_points_3 = Number([sheet_9.ListA, slider_9.ListB])
column_position = Number([sheet_7.ListA, slider_7.ListB])
_1st_floor_height_3 = Number([sheet_8.ListA, slider_8.ListB])
mezzanine_3 = Boolean([sheet_12.ListA, slider_12.ListB])
gauge_4 = Number([sheet_20.ListA, slider_20.ListB])
tolerance_3 = Number([sheet_25.ListA, slider_25.ListB])
tool_size_3 = Number([sheet_26.ListA, slider_26.ListB])
bays_3 = Number([sheet_13.ListA, slider_13.ListB])
_2nd_floor_2 = Boolean([sheet_11.ListA, slider_11.ListB])
spacing_2 = Number([sheet_24.ListA, slider_24.ListB])
roof_height_3 = Number([sheet_5.ListA, slider_5.ListB])
roof_offset_2 = Number([sheet_6.ListA, slider_6.ListB])
column_2 = Boolean([sheet_10.ListA, slider_10.ListB])
right_wall_2 = Number([sheet_4.ListA, slider_4.ListB])
left_wall_2 = Number([sheet_3.ListA, slider_3.ListB])
width_3 = Number([sheet.ListA, slider.ListB])
length_3 = Number([sheet_2.ListA, slider_2.ListB])
clean = CleanTree(RemoveNulls=True, RemoveInvalid=True, RemoveEmpty=True, Tree=c_slot_length_wall)
clean_2 = CleanTree(RemoveNulls=True, RemoveInvalid=True, RemoveEmpty=True, Tree=c_slot_length_floor)
clean_3 = CleanTree(RemoveNulls=True, RemoveInvalid=True, RemoveEmpty=True, Tree=fin_depth_3)
clean_4 = CleanTree(RemoveNulls=True, RemoveInvalid=True, RemoveEmpty=True, Tree=frame_grip_length_3)
clean_5 = CleanTree(RemoveNulls=True, RemoveInvalid=True, RemoveEmpty=True, Tree=gauge_4)
clean_6 = CleanTree(RemoveNulls=True, RemoveInvalid=True, RemoveEmpty=True, Tree=ply_thickness_3)
clean_7 = CleanTree(RemoveNulls=True, RemoveInvalid=True, RemoveEmpty=True, Tree=bays_3)
clean_8 = CleanTree(RemoveNulls=True, RemoveInvalid=True, RemoveEmpty=True, Tree=beam_width_3)
clean_9 = CleanTree(RemoveNulls=True, RemoveInvalid=True, RemoveEmpty=True, Tree=connector_grip_length_3)
clean_10 = CleanTree(RemoveNulls=True, RemoveInvalid=True, RemoveEmpty=True, Tree=sheet_length_3)
clean_11 = CleanTree(RemoveNulls=True, RemoveInvalid=True, RemoveEmpty=True, Tree=width_3)
clean_12 = CleanTree(RemoveNulls=True, RemoveInvalid=True, RemoveEmpty=True, Tree=length_3)
clean_13 = CleanTree(RemoveNulls=True, RemoveInvalid=True, RemoveEmpty=True, Tree=left_wall_2)
clean_14 = CleanTree(RemoveNulls=True, RemoveInvalid=True, RemoveEmpty=True, Tree=right_wall_2)
clean_15 = CleanTree(RemoveNulls=True, RemoveInvalid=True, RemoveEmpty=True, Tree=roof_height_3)
clean_16 = CleanTree(RemoveNulls=True, RemoveInvalid=True, RemoveEmpty=True, Tree=roof_offset_2)
clean_17 = CleanTree(RemoveNulls=True, RemoveInvalid=True, RemoveEmpty=True, Tree=column_position)
clean_18 = CleanTree(RemoveNulls=True, RemoveInvalid=True, RemoveEmpty=True, Tree=_1st_floor_height_3)
clean_19 = CleanTree(RemoveNulls=True, RemoveInvalid=True, RemoveEmpty=True, Tree=no_of_roof_points_3)
clean_20 = CleanTree(RemoveNulls=True, RemoveInvalid=True, RemoveEmpty=True, Tree=column_2)
clean_21 = CleanTree(RemoveNulls=True, RemoveInvalid=True, RemoveEmpty=True, Tree=_2nd_floor_2)
clean_22 = CleanTree(RemoveNulls=True, RemoveInvalid=True, RemoveEmpty=True, Tree=mezzanine_3)
clean_23 = CleanTree(RemoveNulls=True, RemoveInvalid=True, RemoveEmpty=True, Tree=spacing_2)
clean_24 = CleanTree(RemoveNulls=True, RemoveInvalid=True, RemoveEmpty=True, Tree=sheet_width_3)
clean_25 = CleanTree(RemoveNulls=True, RemoveInvalid=True, RemoveEmpty=True, Tree=tolerance_3)
clean_26 = CleanTree(RemoveNulls=True, RemoveInvalid=True, RemoveEmpty=True, Tree=tool_size_3)
# Building Profile:
# 
# This cluster sets out a wireframe of the the building section based on the dimension parameters. The profile is drawn on the centrelines of the structure.
# 
# Current script limitations:
# - Max 2 storeys
# - Vertical walls only
# - Max 1 internal column
# - Max internal span 3.6m
building_section_profile = BuildingSectionProfile(
    width=clean_11,
    left_wall=clean_13,
    right_wall=clean_14,
    roof_height=clean_15,
    roof_offset=clean_16,
    column_position=clean_17,
    _1st_floor_height=clean_18,
    column=clean_20,
    two_storey=clean_21,
    no_of_roof_points=clean_19)  # -> master_profile_curve_2, column_profile_curve_2, _1st_floor_profile_curve_2, base_pts_2, column_pt_2
geo = Geometry(building_section_profile.master_profile_curve_2)
geo_2 = Geometry([building_section_profile.master_profile_curve_2, building_section_profile.column_profile_curve_2, building_section_profile._1st_floor_profile_curve_2])

# ----
# OFFSET PROFILE BY DEPTH
# Offsets the centreline structural profile by the depth of the frames
division = Division(A=clean_3, B=2)
crv = Curve(flatten(geo))
xz = XZPlane(Origin=Point(0, 0, 0))
division_2 = Division(A=division, B=-1)
inner_curve = Offset(Curve=crv, Distance=division_2, Plane=xz, Corners=1)
outer_curve = Offset(Curve=crv, Distance=division, Plane=xz, Corners=1)

# ----
# Setting out Points:
# 
# This sets out the key connection points along the building profile. The main structural principle is the individual floor, wall and roof spans are divided into points by the set out multiple (nominally 300mm) from the corners inwards, allowing any extra or irregular length in the dimensions to be taken up in the centre of each span.
divide_profile_into_points = DivideProfileIntoPoints(
    column=building_section_profile.column_profile_curve_2,
    floor=building_section_profile._1st_floor_profile_curve_2,
    outer_curve=building_section_profile.master_profile_curve_2)  # -> column_floor_int, profile_column, profile_2nd_floor, column_tab_points, column_tab_tangent, grips_2nd_floor_pt, grips_2nd_floor_vec, space_invader_2nd_floor_points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
vec = Vector([divide_profile_into_points.column_tab_tangent, divide_profile_into_points.grips_2nd_floor_vec])
# SET OUT SLOTS & GRIPS
geo_3 = Geometry([divide_profile_into_points.column_tab_points, divide_profile_into_points.grips_2nd_floor_pt])
geo_4 = Geometry([divide_profile_into_points.connector_pts_1st_floor, divide_profile_into_points.connector_pts_grnd_floor])
geo_5 = Geometry([divide_profile_into_points.space_invader_2nd_floor_points, divide_profile_into_points.space_invader_grnd_floor_points, divide_profile_into_points.space_invader_column_pt, divide_profile_into_points.space_invader_points])
geo_6 = Geometry(divide_profile_into_points.second_floor_end_pts)
geo_7 = Geometry([divide_profile_into_points.corner_tab_points_3, divide_profile_into_points.tab_points_5, divide_profile_into_points.pt_7])

# ----
# CREATE FRAME GRIPS
# Component that creates the frame grips which get populated around the structural frame. These are used to key into sheathing and floor panels once the frames have been raised.
frame_grip = FrameGrip(ply_thickness=clean_6, slot_spacing=clean_23)  # -> centre_point, geometry, tab_width_2
division_3 = Division(FinDepth=clean_3, B=2)
join = JoinCurves(Curves=frame_grip.geometry, Preserve=False)
Z = UnitZ(Factor=division_3)
move = Move(Geometry=join, Motion=Z)  # -> Geometry, Transform
xy = XYPlane(Origin=Point(0, 0, 0))
mirror = Mirror(Geometry=move.Geometry, Plane=xy)  # -> Geometry, Transform
geo_8 = Geometry([move.Geometry, mirror.Geometry])

# ----
# GRIPS & SLOTS
# These are all the building block components of the Wren system. Each of the individual slots and grip types can be modified and adjusted, or swapped in and out.
slot_length = Slider(135, range=0..200)
slot_length_2 = Slider(40, range=0..200)
slot_length_3 = Slider(60, range=0..200)
tab_width = Slider(60, range=0..100)
rail_width = Slider(82, range=0..200)
rail_depth = Slider(36, range=0..200)
rail_slot = RailSlot(
    ply_thickness=clean_6,
    tolerance=clean_25,
    rail_thickness=rail_width,
    rail_depth=rail_depth,
    fin_depth=clean_3,
    slot_spacing=clean_23)  # -> centre_pt, rail_corner_slot_right, rail_corner_slot_left, rail_centre_slot
connector_slot_wall_2 = ConnectorSlotWall(tolerance=clean_25, ply_thickness=clean_6)  # -> roof_connector_slot_right, roof_c_centre, roof_connector_slot_left, centre_pt, geometry, slot_length_2
connector_slot_floor_2 = ConnectorSlotFloor(tolerance=clean_25, ply_thickness=clean_6, slot_length=slot_length_3)  # -> centre_pt, geometry, slot_length_3
spacer_slot = SpacerSlot(tab_width=tab_width, fin_depth=clean_3, ply_thickness=clean_6, tolerance=clean_25)  # -> tie_offset, geometry, beam_tie_spacing, centre_point
double_peg_slot = DoublePegSlot(tab_width=slot_length, ply_thickness=clean_6, tolerance=clean_25)  # -> geometry, centre_point
space_invdr_slot = SpaceInvdrSlot(tab_width=slot_length_2, ply_thickness=clean_6, tolerance=clean_25)  # -> plug_slot, geometry, centre_point

crv_2 = Curve(outer_curve)
disc = Discontinuity(Curve=crv_2, Level=1)  # -> Points, Parameters
pitched_roof = BooleanToggle(True)
shatter = Shatter(Curve=crv_2, Parameters=disc.Parameters)
eval = EvaluateCurve(Curve=crv_2, Parameter=disc.Parameters)  # -> Point, Tangent, Angle
_1st_floor_points_pts = Point(flatten(divide_profile_into_points.second_floor_end_pts))
dispatch = Dispatch(List=shatter, DispatchPattern=pitched_roof)  # -> ListA, ListB
pdecon = Deconstruct(Point=eval.Point)  # -> XComponent, YComponent, ZComponent
peg_slot_height = Slider(14, range=0..200)
eval_2 = EvaluateLength(Curve=dispatch.ListA, Length=0.5, Normalized=True)  # -> Point, Tangent, Parameter
internal_profile = Geometry(inner_curve)
sort = SortList(Keys=pdecon.ZComponent, ValuesA=eval.Point)  # -> Keys, ValuesA
sort_2 = SortList(Keys=pdecon.ZComponent, ValuesA=eval.Tangent)  # -> Keys, ValuesA
item_30 = ListItem(List=divide_profile_into_points.corner_points, Index=[0, 1], Wrap=True)
pdecon_2 = Deconstruct(Point=eval_2.Point)  # -> XComponent, YComponent, ZComponent
lng = ListLength(List=_1st_floor_points_pts)
crv_3 = Curve(geo)
lng_2 = ListLength(List=sort_2.ValuesA)
disc_2 = Discontinuity(Curve=internal_profile, Level=1)  # -> Points, Parameters
sort_3 = SortList(Keys=pdecon_2.ZComponent, ValuesA=eval_2.Tangent)  # -> Keys, ValuesA
sort_4 = SortList(Keys=pdecon_2.ZComponent, ValuesA=eval_2.Point)  # -> Keys, ValuesA
subtraction = Subtraction(A=lng, B=1)
disc_3 = Discontinuity(Curve=crv_3, Level=1)  # -> Points, Parameters
pt = Point(divide_profile_into_points.connector_pts_1st_floor)
division_4 = Division(A=clean_3, B=2)
division_5 = Division(A=slot_length, B=2)
fin_depth_4 = Number(clean_3)
subtraction_2 = Subtraction(A=lng_2, B=1)
pdecon_3 = Deconstruct(Point=disc_2.Points)  # -> XComponent, YComponent, ZComponent
cull_i = CullIndex(List=_1st_floor_points_pts, Indices=subtraction, Wrap=True)
shatter_2 = Shatter(Curve=crv_3, Parameters=disc_3.Parameters)
item_31 = ListItem(List=sort_3.ValuesA, Index=4, Wrap=False)
item_32 = ListItem(List=sort_3.ValuesA, Index=3, Wrap=False)
item_33 = ListItem(List=sort_3.ValuesA, Index=0, Wrap=False)
sort_5 = SortList(Keys=pdecon_3.ZComponent, ValuesA=disc_2.Points)  # -> Keys, ValuesA
item_34 = ListItem(List=sort.ValuesA, Index=4, Wrap=False)
item_35 = ListItem(List=sort_2.ValuesA, Index=subtraction_2, Wrap=False)
lng_3 = ListLength(List=pt)
addition = Addition(A=division_5, B=peg_slot_height)
division_6 = Division(A=fin_depth_4, B=2)
division_7 = Division(A=clean_6, B=2)
pt_2 = Point([cull_i, item_30])
devec = DeconstructVector(Vector=item_31)  # -> XComponent, YComponent, ZComponent
devec_2 = DeconstructVector(Vector=item_32)  # -> XComponent, YComponent, ZComponent
cull_i_2 = CullIndex(List=sort_5.ValuesA, Indices=[0, 1], Wrap=True)
subtraction_3 = Subtraction(A=lng_3, B=2)
devec_3 = DeconstructVector(Vector=item_35)  # -> XComponent, YComponent, ZComponent
X = UnitX(Factor=division_6)
subtraction_4 = Subtraction(A=division_4, B=division_7)
Z_2 = UnitZ(Factor=subtraction_4)
neg = Negative(Value=division_7)
addition_2 = Addition(A=division_7, B=addition)
cull_i_3 = CullIndex(List=shatter_2, Indices=0, Wrap=True)
move_2 = Move(Geometry=pt_2, Motion=Z_2)  # -> Geometry, Transform
avr = Average(Input=[devec_2.ZComponent, devec.ZComponent])
neg_2 = Negative(Value=X)
item_36 = ListItem(List=pt, Index=0, Wrap=True)
item_37 = ListItem(List=pt, Index=subtraction_3, Wrap=True)
pdecon_4 = Deconstruct(Point=cull_i_2)  # -> XComponent, YComponent, ZComponent
lng_4 = ListLength(List=cull_i_2)
addition_3 = Addition(A=subtraction_4, B=neg)
join_2 = JoinCurves(Curves=cull_i_3, Preserve=False)
cp = ClosestPoint(Point=move_2.Geometry, Cloud=divide_profile_into_points.corner_tab_points_3)  # -> ClosestPoint, CPIndex, Distance
vec_2 = VectorXYZ(XComponent=devec_3.XComponent, YComponent=devec_3.YComponent, ZComponent=avr)  # -> Vector, Length

xz_2 = XZPlane(Origin=Point(0, 0, 0))
geo_9 = Geometry(connector_slot_wall_2.roof_connector_slot_right)
rotate = Rotate(Geometry=geo_9, Angle=degrees(-90), Plane=xz_2)  # -> Geometry, Transform
orient_apex_slot = OrientDirection(
    Geometry=rotate.Geometry,
    PointA=connector_slot_wall_2.centre_pt,
    DirectionA=Vector(0, 0, 1),
    PointB=flatten(item_34),
    DirectionB=flatten(Vector(0, 0, 1)))  # -> Geometry, Transform

angle = Angle(VectorA=vec_2.Vector, VectorB=item_33)  # -> Angle, Reflex
sort_6 = SortList(Keys=pdecon_4.XComponent, ValuesA=cull_i_2)  # -> Keys, ValuesA
subtraction_5 = Subtraction(A=lng_4, B=1)
Z_3 = UnitZ(Factor=addition_2)
Z_4 = UnitZ(Factor=addition_3)
crv_cp = CurveClosestPoint(Point=cp.ClosestPoint, Curve=join_2)  # -> Point, Parameter, Distance
move_3 = Move(Geometry=item_37, Motion=X)  # -> Geometry, Transform
move_4 = Move(Geometry=item_36, Motion=neg_2)  # -> Geometry, Transform
Z_5 = UnitZ(Factor=1)

# ----
# FRAME GRIPS
X_2 = UnitX(Factor=1)
grips_column = OrientDirection(
    Geometry=geo_8,
    PointA=frame_grip.centre_point,
    DirectionA=X_2,
    PointB=graft(divide_profile_into_points.column_tab_points),
    DirectionB=graft(divide_profile_into_points.column_tab_tangent))  # -> Geometry, Transform
grips_1st_floor = OrientDirection(
    Geometry=geo_8,
    PointA=frame_grip.centre_point,
    DirectionA=X_2,
    PointB=graft(divide_profile_into_points.grips_2nd_floor_pt),
    DirectionB=graft(divide_profile_into_points.grips_2nd_floor_vec))  # -> Geometry, Transform
grips = OrientDirection(
    Geometry=geo_8,
    PointA=frame_grip.centre_point,
    DirectionA=X_2,
    PointB=graft(divide_profile_into_points.tab_points_5),
    DirectionB=graft(divide_profile_into_points.tab_tangent))  # -> Geometry, Transform
grips_floor = OrientDirection(
    Geometry=geo_8,
    PointA=frame_grip.centre_point,
    DirectionA=X_2,
    PointB=graft(divide_profile_into_points.pt_7),
    DirectionB=graft(divide_profile_into_points.vec_9))  # -> Geometry, Transform
corner_grips = OrientDirection(
    Geometry=mirror.Geometry,
    PointA=frame_grip.centre_point,
    DirectionA=X_2,
    PointB=graft(divide_profile_into_points.corner_tab_points_3),
    DirectionB=graft(divide_profile_into_points.corner_tab_vector_2))  # -> Geometry, Transform

item_38 = ListItem(List=spacer_slot.geometry, Index=0, Wrap=True)
deg = Degrees(Radians=angle.Angle)
X_3 = UnitX(Factor=1)
item_39 = ListItem(List=divide_profile_into_points.corner_points, Index=1, Wrap=True)
item_40 = ListItem(List=sort_6.ValuesA, Index=0, Wrap=False)
item_41 = ListItem(List=divide_profile_into_points.corner_points, Index=0, Wrap=True)
X_4 = UnitX(Factor=1)
Z_6 = UnitZ(Factor=1)
move_5 = Move(Geometry=flatten(cull_i), Motion=Z_4)  # -> Geometry, Transform
X_5 = UnitX(Factor=1)
X_6 = UnitX(Factor=1)
move_6 = Move(Geometry=flatten(item_30), Motion=Z_3)  # -> Geometry, Transform
X_7 = UnitX(Factor=1)
item_42 = ListItem(List=sort_6.ValuesA, Index=subtraction_5, Wrap=False)
pt_3 = Point([move_4.Geometry, move_3.Geometry])
eval_3 = EvaluateCurve(Curve=join_2, Parameter=crv_cp.Parameter)  # -> Point, Tangent, Angle
X_8 = UnitX(Factor=1)
xz_3 = XZPlane(Origin=item_34)
subtraction_6 = Subtraction(A=deg, B=180)

# ----
# CONNECTOR SLOTS
orient_connector = OrientDirection(
    Geometry=connector_slot_floor_2.geometry,
    PointA=connector_slot_floor_2.centre_pt,
    DirectionA=Z_5,
    ConnectorPts=graft([divide_profile_into_points.connector_pts_1st_floor, divide_profile_into_points.connector_pts_grnd_floor]),
    ConnectorVec=graft(Z_5))  # -> Geometry, Transform
orient_si_slots = OrientDirection(
    Geometry=space_invdr_slot.geometry,
    CentrePt=connector_slot_wall_2.centre_pt,
    DirectionA=Vector(0, 0, 1),
    PointB=graft([divide_profile_into_points.space_invader_points, divide_profile_into_points.space_invader_2nd_floor_points, divide_profile_into_points.space_invader_grnd_floor_points, divide_profile_into_points.space_invader_column_pt]),
    DirectionB=graft([divide_profile_into_points.space_invader_tangent, divide_profile_into_points.space_invader_floor_t, divide_profile_into_points.space_invader_grnd_floor_t, divide_profile_into_points.space_invader_column_t]))  # -> Geometry, Transform
orient_peg_slots = OrientDirection(
    Geometry=double_peg_slot.geometry,
    PointA=double_peg_slot.centre_point,
    DirectionA=Vector(0, 0, 1),
    PointB=graft([move_6.Geometry, move_5.Geometry]),
    DirectionB=graft(Vector(0, 0, 1)))  # -> Geometry, Transform
wall_connectors = OrientDirection(
    Geometry=connector_slot_floor_2.geometry,
    PointA=connector_slot_wall_2.centre_pt,
    DirectionA=X_8,
    PointB=graft(eval_3.Point),
    DirectionB=graft(Vector(0, 0, 1)))  # -> Geometry, Transform

spacer_slots = OrientDirection(
    Geometry=spacer_slot.geometry,
    CentrePt=spacer_slot.centre_point,
    DirectionA=X_3,
    GripPts=graft(geo_3),
    DirectionB=graft(vec))  # -> Geometry, Transform
corner_spacer_slots = OrientDirection(
    Geometry=space_invdr_slot.plug_slot,
    CentrePt=spacer_slot.centre_point,
    DirectionA=X_3,
    GripPts=graft([move_4.Geometry, move_3.Geometry]),
    DirectionB=graft(Vector(0, 0, 1)))  # -> Geometry, Transform

# ----
# SPACER SLOTS
corner_spacer_slots_2 = OrientDirection(
    Geometry=item_38,
    CentrePt=spacer_slot.centre_point,
    DirectionA=X_3,
    GripPts=graft(divide_profile_into_points.corner_tab_points_3),
    DirectionB=graft(divide_profile_into_points.corner_tab_vector_2))  # -> Geometry, Transform
spacer_slots_2 = OrientDirection(
    Geometry=spacer_slot.geometry,
    CentrePt=spacer_slot.centre_point,
    DirectionA=X_3,
    GripPts=graft([divide_profile_into_points.tab_points_5, geo_3, divide_profile_into_points.pt_7]),
    DirectionB=graft([divide_profile_into_points.tab_tangent, vec, divide_profile_into_points.vec_9]))  # -> Geometry, Transform

# ----
# RAIL SLOTS
orient = OrientDirection(
    Geometry=rail_slot.rail_centre_slot,
    PointA=rail_slot.centre_pt,
    DirectionA=X_4,
    PointB=divide_profile_into_points.column_floor_int,
    DirectionB=X_7)  # -> Geometry, Transform
orient_2 = OrientDirection(Geometry=rail_slot.rail_corner_slot_right, PointA=rail_slot.centre_pt, DirectionA=X_4, PointB=item_39, DirectionB=X_6)  # -> Geometry, Transform
orient_3 = OrientDirection(Geometry=rail_slot.rail_corner_slot_left, PointA=rail_slot.centre_pt, DirectionA=X_4, PointB=item_41, DirectionB=X_5)  # -> Geometry, Transform

orient_4 = OrientDirection(
    Geometry=connector_slot_wall_2.roof_connector_slot_left,
    PointA=connector_slot_wall_2.roof_c_centre,
    DirectionA=Vector(0, 0, 1),
    PointB=item_40,
    DirectionB=Z_6)  # -> Geometry, Transform
orient_5 = OrientDirection(
    Geometry=connector_slot_wall_2.roof_connector_slot_right,
    PointA=connector_slot_wall_2.roof_c_centre,
    DirectionA=Vector(0, 0, 1),
    PointB=item_42,
    DirectionB=Z_6)  # -> Geometry, Transform
rotate_2 = Rotate(Geometry=orient_apex_slot.Geometry, Angle=degrees(subtraction_6), Plane=xz_3)  # -> Geometry, Transform
crv_4 = Curve([orient_3.Geometry, orient_2.Geometry, orient.Geometry])
ccx = CurveCurve(CurveA=crv_2, CurveB=rotate_2.Geometry)  # -> Points, ParamsA, ParamsB
end = EndPoints(Curve=rotate_2.Geometry)  # -> Start, End
eval_4 = EvaluateLength(Curve=[orient_4.Geometry, orient_5.Geometry], Length=0.5, Normalized=True)  # -> Point, Tangent, Parameter
colmm = CollisionManyMany(Colliders=flatten(corner_spacer_slots_2.Geometry))  # -> Collision, Indices
item_43 = ListItem(List=ccx.Points, Index=0, Wrap=True)
crv_cp_2 = CurveClosestPoint(Point=eval_4.Point, Curve=geo)  # -> Point, Parameter, Distance
dispatch_2 = Dispatch(List=flatten(corner_spacer_slots_2.Geometry), DispatchPattern=colmm.Collision)  # -> ListA, ListB
dist = Distance(PointA=item_43, PointB=end.Start)
neg_3 = Negative(Value=dist)
Z_7 = UnitZ(Factor=neg_3)
move_7 = Move(Geometry=orient_apex_slot.Geometry, Motion=Z_7)  # -> Geometry, Transform
rotate_3 = Rotate(Geometry=move_7.Geometry, Angle=degrees(subtraction_6), Plane=xz_3)  # -> Geometry, Transform
connector_slots = Curve(flatten([orient_connector.Geometry, orient_peg_slots.Geometry, orient_si_slots.Geometry, wall_connectors.Geometry, corner_spacer_slots.Geometry]))
connector_slots_2 = Curve(flatten([orient_connector.Geometry, orient_si_slots.Geometry, corner_spacer_slots.Geometry]))
corner_slots = Geometry(flatten([wall_connectors.Geometry, orient_peg_slots.Geometry]))
pt_4 = Point(eval_3.Point)
vec_3 = Vector(eval_3.Tangent)
geo_10 = Geometry(dispatch_2.ListA)
ext = ExtendCurve(Curve=rotate_3.Geometry, Type=0, Start=dist, End=dist)
spacer_slots_3 = Curve(flatten([spacer_slots_2.Geometry, dispatch_2.ListB]))
ccx_2 = CurveCurve(CurveA=crv_2, CurveB=ext)  # -> Points, ParamsA, ParamsB
disc_4 = Discontinuity(Curve=ext, Level=1)  # -> Points, Parameters
lng_5 = ListLength(List=disc_4.Points)
_0 = Number(0)
subtraction_7 = Subtraction(A=lng_5, B=1)
item_44 = ListItem(List=ccx_2.Points, Index=0, Wrap=True)
item_45 = ListItem(List=ccx_2.Points, Index=1, Wrap=True)
cull_i_4 = CullIndex(List=disc_4.Points, Indices=flatten([_0, subtraction_7]), Wrap=False)
entwine = Entwine(Branch00=item_44, Branch01=cull_i_4, Branch02=item_45, FlattenInputs=True)  # -> flatten(Result)
ext_intrusions = Curve(flatten(crv_4))
pline = PolyLine(Vertices=entwine, Closed=False)
int_intrusions = Curve(flatten([orient_4.Geometry, orient_5.Geometry, pline]))
wren_frame_builder = WRENFrameBuilder(
    column_grips=grips_column.Geometry,
    fin_depth=clean_3,
    spacing=clean_23,
    grip_length=frame_grip.tab_width_2,
    floor_grips=grips_1st_floor.Geometry,
    column_profile=building_section_profile.column_profile_curve_2,
    floor_profile=building_section_profile._1st_floor_profile_curve_2,
    frame_grips=[corner_grips.Geometry, grips_floor.Geometry, grips.Geometry],
    external_profile=outer_curve,
    internal_profile=inner_curve,
    intrusions=int_intrusions,
    ext_intrusions=ext_intrusions)  # -> external_grip_profile, internal_grip_profile, internal_profile_stairs, external_curve, internal_curves
geo_11 = Geometry([wren_frame_builder.external_grip_profile, wren_frame_builder.internal_grip_profile])
wren_d_joint_placer = WRENDJointPlacer(
    external_crv=wren_frame_builder.external_grip_profile,
    inernal_crv=wren_frame_builder.internal_grip_profile,
    internal_crv_stairs=wren_frame_builder.internal_profile_stairs,
    profile_ext=divide_profile_into_points.profile_ext,
    fin_depth=clean_3,
    spacing_ratio=clean_23,
    profile_ground_floor=divide_profile_into_points.profile_grnd_floor,
    ply_thickness=clean_6,
    geo=divide_profile_into_points.profile_column,
    sheet_length=clean_10,
    sheet_width=clean_24,
    profile_2nd_floor=divide_profile_into_points.profile_2nd_floor)  # -> C_2, C, points_for_labelling_2, external_points_2, grnd_floor_points_2, column_points_2, _1st_floor_points_2
geo_12 = Geometry(wren_d_joint_placer.C_2)
geo_13 = Geometry(spacer_slots_3)
# FINAL 2D FIN PROFILE
join_3 = JoinCurves(Curves=flatten(geo_12), Preserve=False)

space_invader_slot_length = Slider(49, range=25..301)
connector_grip_length_4 = Slider(80, range=0..600)
bay_number = Slider(0, range=0..1)

# ----
# BATCH BAKE ALL SHEATHING
panel_34 = Panel("C:\Desktop\HereEast unit models")
run_batch_bake = BooleanToggle(False)
bslider = BatchSlider(BatchVariable=bay_number, Steps=7)
batchdriver = BatchDriver(Run=run_batch_bake, FilePath=panel_34, Name="Batch-test", ValuesA=bslider)  # -> Path, ValuesA
bay_no = Number(batchdriver.ValuesA)

geo_14 = Geometry(flatten([connector_slots, join_3, geo_13]))
# LAY OUT SECTION PROFILE
_2d_frame_geo = Geometry(geo_14)
panel_35 = Panel(batchdriver.Path)

# ----
# 2D PROFILE
subtraction_8 = Subtraction(A=clean_7, B=1)
selobj = GetSelectedObjects(AllObjects_Object=bay_number)  # -> ComponentObjects, ParamObjects, OtherObjects
dom = ConstructDomain(DomainStart=0, DomainEnd=subtraction_8)
# 3D ASSEMBLY
set_slider = SetSliderProperties(Slider=selobj.ParamObjects, Range=dom, Type=1)

# ----
# LABELLING FRAME PARTS
join_4 = JoinCurves(Curves=geo_14, Preserve=False)  # -> simplify(Curves)
dispatch_3 = Dispatch(List=join_4, DispatchPattern=convert_to_2d_surface)  # -> ListA, ListB
wren_labelling_for_nesting = WRENLabellingForNesting(
    unit_type=unit_type,
    profile_curve=geo,
    _2d_frame_geo=dispatch_3.ListA,
    _2nd_storey=Toggle(False),
    _1st_floor_profile=building_section_profile._1st_floor_profile_curve_2,
    possible_points=wren_d_joint_placer.points_for_labelling_2,
    f_curves=join_3)  # -> a_f_components_geo, _2d_frame_geo_2, attributes, x_f_components_geo
division_8 = Division(A=clean_3, B=-2)
division_9 = Division(A=clean_6, B=2)
X_9 = UnitX(Factor=50)
X_10 = UnitX(Factor=division_8)
X_11 = UnitX(Factor=-50)
Z_8 = UnitZ(Factor=division_9)
Z_9 = UnitZ(Factor=1)
Z_10 = UnitZ(Factor=1)
X_12 = UnitX(Factor=1)
pt_5 = Point([divide_profile_into_points.space_invader_points, divide_profile_into_points.space_invader_2nd_floor_points, divide_profile_into_points.space_invader_grnd_floor_points, divide_profile_into_points.space_invader_column_pt])
pt_6 = Point(pt_3)
multiplication = Multiplication(A=clean_6, B=2)
move_8 = Move(Geometry=item_42, Motion=X_9)  # -> Geometry, Transform
move_9 = Move(Geometry=item_40, Motion=X_11)  # -> Geometry, Transform
subtraction_9 = Subtraction(A=clean_8, B=multiplication)
crv_cp_3 = CurveClosestPoint(Point=move_8.Geometry, Curve=geo)  # -> Point, Parameter, Distance
crv_cp_4 = CurveClosestPoint(Point=move_9.Geometry, Curve=geo)  # -> Point, Parameter, Distance
division_10 = Division(A=subtraction_9, B=2)
Z_11 = UnitZ(Factor=1)
multiplication_2 = Multiplication(A=clean_3, B=3)
X_13 = UnitX(Factor=1)
Z_12 = UnitZ(Factor=1)
X_14 = UnitX(Factor=1)
subtraction_10 = Subtraction(A=division_10, B=clean_6)
addition_4 = Addition(A=multiplication_2, B=clean_15)
multiplication_3 = Multiplication(A=addition_4, B=2)
Y = UnitY(Factor=multiplication_3)
Y_2 = UnitY(Factor=division_10)
Y_3 = UnitY(Factor=subtraction_10)

division_11 = Division(A=clean_8, B=2)
Y_4 = UnitY(Factor=clean_6)
# 3D FINS
dispatch_4 = Dispatch(
    List=[wren_labelling_for_nesting.a_f_components_geo, wren_labelling_for_nesting.x_f_components_geo],
    DispatchPattern=convert_to_3d_brep)  # -> ListA, ListB
subtraction_11 = Subtraction(A=division_11, B=clean_6)
Y_5 = UnitY(Factor=division_11)
Y_6 = UnitY(Factor=subtraction_11)
extr = Extrude(Base=dispatch_4.ListA, Direction=Y_4)
neg_4 = Negative(Value=Y_5)
move_10 = Move(Geometry=extr, Motion=Y_6)  # -> Geometry, Transform
move_11 = Move(Geometry=extr, Motion=neg_4)  # -> Geometry, Transform

Y_7 = UnitY(Factor=addition_4)
neg_5 = Negative(Value=Y_2)
division_12 = Division(A=clean_5, B=2)
Y_8 = UnitY(Factor=division_12)
bake = BooleanToggle(False)
multiplication_4 = Multiplication(A=clean_3, B=1.5)
# DATA EXPORT
neg_6 = Negative(Value=multiplication_4)
addition_5 = Addition(A=clean_5)
Y_9 = UnitY(Factor=neg_6)
neg_7 = Negative(Value=addition_5)
addition_6 = Addition(A=clean_7, B=1)
multiplication_5 = Multiplication(A=neg_7, B=2)
addition_7 = Addition(A=clean_7, B=1)
addition_8 = Addition(A=clean_7, B=1)
Y_10 = UnitY(Factor=neg_7)
Y_11 = UnitY(Factor=multiplication_5)
addition_9 = Addition(A=clean_7, B=1)
multiplication_6 = Multiplication(A=addition_8, B=2)
number_slider_2 = Slider(400, range=0..3001)
space_invader_quantity = Number(addition_6)
number_slider_3 = Slider(300, range=0..3001)
spacer_quantity = Number(addition_7)
reinforcer_quantity = Number(multiplication_6)
sheathing_quantity = Number(clean_7)
frame_quantity = Number(addition_9)
frame_parts = Geometry(wren_labelling_for_nesting._2d_frame_geo_2)
X_15 = UnitX(Factor=number_slider_2)
X_16 = UnitX(Factor=number_slider_3)

spreadsheet_name = Text(item)
bake_2 = BooleanToggle(False)

ply_thickness_4 = Number(clean_6)
batten_cavity = Slider(75, range=0..121)
gauge_5 = Number(clean_5)
addition_10 = Addition(A=ply_thickness_4, B=batten_cavity)

ungroup = Ungroup(Group=frame_parts)
tmatch = MatchText(Text=ungroup, RegEx="Text", Case=True)  # -> simplify(Match)
dispatch_5 = Dispatch(List=ungroup, DispatchPattern=tmatch)  # -> ListA, ListB
txt = Text(dispatch_5.ListA)
cnc_parts_bake = CNCPartsBake(bool=bake_2, geo=frame_parts, multiple_count=frame_quantity)
split_2 = TextSplit(Text=txt, Separators=":")
item_46 = ListItem(List=split_2, Index=1, Wrap=True)
frame_multiplier = Text(frame_quantity)
frame_names = Text(item_46)
tstat = TreeStatistics(Tree=frame_names)  # -> Paths, Length, Count
addition_11 = Addition(A="52", B=tstat.Count)
concat = Concatenate(FragmentA="B", FragmentB="92")
concat_2 = Concatenate(FragmentA="B", FragmentB="52")
writespreadsheet = WriteToSpreadsheet(
    Token=gauth,
    Name=spreadsheet_name,
    Worksheet=data,
    OrganizeByRowsOrColumns=True,
    Address=concat_2,
    Data=frame_names,
    Write=bake_2,
    createNewSpreadsheets=False)
writespreadsheet_2 = WriteToSpreadsheet(
    Token=gauth,
    Name=spreadsheet_name,
    Worksheet=data,
    OrganizeByRowsOrColumns=True,
    Address=concat,
    Data=frame_multiplier,
    Write=bake_2,
    createNewSpreadsheets=False)

xz_4 = XZPlane(Origin=Point(0, 0, 0))

# ----
# SCREW COUNTER
pt_7 = Point(flatten(wren_d_joint_placer.points_for_labelling_2))
lng_6 = ListLength(List=pt_7)
multiplication_7 = Multiplication(A=lng_6, B=2)
screws_per_fin = Panel(multiplication_7)
multiplication_8 = Multiplication(A=multiplication_7, B=2)
screws_per_box_frame = Panel(multiplication_8)
multiplication_9 = Multiplication(A=multiplication_8, B=clean_7)
total_screws_in_chassis = Panel(multiplication_9)

# ---- group: Weight Calculator (kg)
# WEIGHT CALCULATOR - END WALLS
volume = Volume()  # -> Volume, Centroid
convunit = UnitConversion(x=volume.Volume, Ufrom="mm^3", Uto="m^3")  # -> out, factor, val; inputs x: list of Double, Ufrom: String, Uto: String
# ---------- convunit: C# ----------
    ConvFact = ConversionFactors();
    int fromExp;
    int toExp;
    double fromFactor = getFactor(Ufrom, out fromExp);
    double toFactor = getFactor(Uto, out toExp);
    double finalRatio;
    if(fromExp == toExp){
      finalRatio = fromFactor / toFactor;
    } else {
      Print("Cannot convert between units with different exponents.");
      finalRatio = 0;
    }

    factor = finalRatio;
    List<double> valuesOut = new List<double>();
    if(x.Count != 0){
      foreach(double n in x){
        valuesOut.Add(n * finalRatio);

      }
      val = valuesOut;
    } else {
      Print("list has 0 items, no values to return");
    }
# ---------- convunit: C# additional code ----------
  private double getFactor(string input, out int exponentValue){
    string UnitName = "";
    string exponent = "1";
    double output = 1.0;
    if(input.IndexOf('^') == -1){
      UnitName = input;
    } else {
      string[] splitResults = input.Split('^');
      UnitName = splitResults[0];
      exponent = splitResults[1];
    }
    exponentValue = Convert.ToInt32(exponent);
    double unitFactor;
    if(ConvFact.TryGetValue(UnitName, out unitFactor)){
      output = Math.Pow(unitFactor, exponentValue);
    } else {
      Print("Unit not found. Use a form similar to mm^2");
      Print(Convert.ToString(unitFactor));
    }

    return output;
  }




  Dictionary<string,double> ConvFact;
  private Dictionary<string,double> ConversionFactors(){
    Dictionary<string,double> ConvFact = new Dictionary<string,double>();
    ConvFact.Add("mm", 1.0);
    ConvFact.Add("cm", 10.0);
    ConvFact.Add("m", 1000.0);
    ConvFact.Add("in", 25.4);
    ConvFact.Add("ft", 304.8);
    ConvFact.Add("yd", 914.4);
    return ConvFact;
  }
# ---------- end convunit ----------
ma = MassAddition(Input=convunit.val)  # -> Result, PartialResults
multiplication_10 = Multiplication(A=ma.Result, B=2)
total_volume = Panel(multiplication_10)

# ----
# FLOOR AREA CALCULATOR
dispatch_6 = Dispatch(DispatchPattern=[True, False])  # -> ListA, ListB
multiplication_11 = Multiplication(A=dispatch_6.ListA, B=2)
multiplication_12 = Multiplication(A=clean_5, B=clean_7)
multiplication_13 = Multiplication(A=clean_11, B=multiplication_12)
convert_to_m2 = Division(A=multiplication_13, B="1000000")
ground_floor_area = Panel(convert_to_m2)

gauge_6 = Number(clean_5)

# ----
# INSULATION VOLUME
external_frame = Geometry(flatten(outer_curve))
internal_frame = Geometry(flatten(inner_curve))
area = Area(Geometry=internal_frame)  # -> Area, Centroid
area_2 = Area(Geometry=external_frame)  # -> Area, Centroid
multiplication_14 = Multiplication(A=area.Area, B=2)
subtraction_12 = Subtraction(A=area_2.Area, B=area.Area)
frame_insulation_area = Number(subtraction_12)
end_walls_insulation_area = Number(multiplication_14)
subtraction_13 = Subtraction(A=gauge_6, B=0)
multiplication_15 = Multiplication(A=frame_insulation_area, B=subtraction_13)
multiplication_16 = Multiplication(A=end_walls_insulation_area, B=clean_3)
x_bays = Multiplication(A=multiplication_15, B=clean_7)
convunit_2 = UnitConversion(x=multiplication_16, Ufrom="mm^3", Uto="m^3")  # -> out, factor, val; inputs x: list of Double, Ufrom: String, Uto: String; same code as convunit
convunit_3 = UnitConversion(x=x_bays, Ufrom="mm^3", Uto="m^3")  # -> out, factor, val; inputs x: list of Double, Ufrom: String, Uto: String; same code as convunit
end_walls_insulation_volume_m3 = Panel(convunit_2.val)
frame_insulation_volume_m3 = Panel(convunit_3.val)

bays_4 = Number(clean_7)
subtraction_14 = Subtraction(A=gauge_5, B=0)

export_to_spreadsheet = BooleanToggle(False)
spreadsheet_name_2 = Text(item)
worksheet_name = Text(data)
refresh = Boolean(export_to_spreadsheet)

addition_12 = Addition(A=frame_insulation_volume_m3, B=end_walls_insulation_volume_m3)
plywood_volume = Text(total_volume)
external_insulation_volume = Number(addition_12)
no_of_screws = Text(multiplication_9)
writespreadsheet_3 = WriteToSpreadsheet(
    Token=gauth,
    Name=spreadsheet_name_2,
    Worksheet=data,
    OrganizeByRowsOrColumns=False,
    Address="H25",
    Data=external_insulation_volume,
    Write=refresh,
    createNewSpreadsheets=False)
writespreadsheet_4 = WriteToSpreadsheet(
    Token=gauth,
    Name=spreadsheet_name_2,
    Worksheet=data,
    OrganizeByRowsOrColumns=False,
    Address="H24",
    Data=no_of_screws,
    Write=refresh,
    createNewSpreadsheets=False)
writespreadsheet_5 = WriteToSpreadsheet(
    Token=gauth,
    Name=spreadsheet_name_2,
    Worksheet=data,
    OrganizeByRowsOrColumns=False,
    Address="H20",
    Data=plywood_volume,
    Write=refresh,
    createNewSpreadsheets=False)

# ----
# COMPONENTS
# Clusters which contain the geometry for all the main hardware components of the Wren system (with exception of the F-parts).
crv_5 = Curve(divide_profile_into_points.profile_grnd_floor)
pt_8 = Point(flatten([geo_4, pt_4]))
division_13 = Division(A=connector_slot_wall_2.slot_length_2, B=2)
wren_space_invader_2 = WRENSpaceInvader2(
    spacer_slot_length=space_invader_slot_length,
    beam_width=clean_8,
    invader_slot_length=slot_length_2,
    fin_depth=clean_3,
    material_thickness=clean_6)  # -> si_2d_geo, _3d_geo, centre_point, plug_2d_geo, space_invader_plug_3d
wren_reinforcers = WRENReinforcers(
    external_pts=wren_d_joint_placer.external_points_2,
    grnd_floor=wren_d_joint_placer.grnd_floor_points_2,
    _1st_floor_pts=wren_d_joint_placer._1st_floor_points_2,
    column_pts=wren_d_joint_placer.column_points_2,
    point_locations=wren_d_joint_placer.points_for_labelling_2,
    frame_ext=wren_frame_builder.external_grip_profile,
    frame_int=wren_frame_builder.internal_grip_profile,
    fin_depth=clean_3,
    curve=geo,
    profile_ext=[divide_profile_into_points.profile_ext, divide_profile_into_points.profile_grnd_floor],
    unit_type=unit_type,
    connector_slot_geo=connector_slots_2,
    profile_ground_floor=crv_5,
    corner_slot_geo=corner_slots,
    peg_slot_locations=pt_4,
    material_thickness=clean_6,
    tolerance=clean_25,
    tab_slot_geo=geo_13,
    profile_column=divide_profile_into_points.profile_column,
    profile_floor=divide_profile_into_points.profile_2nd_floor)  # -> reinforcer_pts_external, reinforcer_pts_1st_floor, reinforcer_pts_column, _2d_profile, edges, new_edges, attributes, E, _2d_geo
wren_connector_01 = WRENConnector01(
    connector_grip_length=connector_grip_length_4,
    tolerance=clean_25,
    fin_depth=clean_3,
    ply_thickness=clean_6,
    gauge=clean_5,
    beam_width=clean_8,
    slot_width_wall=connector_slot_wall_2.slot_length_2,
    slot_width_floor=connector_slot_floor_2.slot_length_3,
    tool_size=clean_26)  # -> tab_length_2, centre_point, profile_1st_floor_c_02, _3d_brep_type_1, c_2_attributes, surface, profile_grnd_floor_c_01, _3d_brep_type2, c1_attributes
wren_connector_02 = WRENConnector02(tolerance=clean_25, fin_depth=clean_3, ply_thickness=clean_6, gauge=clean_5, beam_width=clean_8, slot_length=division_13)  # -> _2d_profile, attributes, centre_point, _3d_solid

geo_15 = Geometry(wren_connector_02._2d_profile)
geo_16 = Geometry(wren_reinforcers.edges)

wren_spacers = WRENSpacers(
    tolerance=clean_25,
    si_slot_length=space_invader_slot_length,
    tab_slot_width=tab_width,
    sheet_length=clean_10,
    unit_type=unit_type,
    space_invader_slot_points_int=divide_profile_into_points.space_invader_2nd_floor_points,
    space_invader_slot_points_ext=divide_profile_into_points.space_invader_points,
    space_invader_pts_floor=divide_profile_into_points.space_invader_grnd_floor_points,
    tab_slot_points=[divide_profile_into_points.tab_points_5, divide_profile_into_points.pt_7],
    tab_points_corner=divide_profile_into_points.corner_tab_points_3,
    beam_width=clean_8,
    material_thickness=clean_6,
    profile_curve=geo,
    intrusions=ext_intrusions,
    profile_column=divide_profile_into_points.profile_column,
    fin_depth=clean_3,
    profile_1st_floor=divide_profile_into_points.profile_2nd_floor,
    reinforcer_edges=geo_16,
    space_invader_slot_points_int_2=divide_profile_into_points.space_invader_column_pt,
    space_invader_slot_points_int_3=divide_profile_into_points.space_invader_2nd_floor_points,
    tab_column_points=divide_profile_into_points.column_tab_points,
    tab_1st_floor_points=divide_profile_into_points.grips_2nd_floor_pt)  # -> _3d_geo, attributes, _2d_geo
wren_sheathing = WRENSheathing(
    _1st_floor_height=clean_18,
    beam_width=clean_8,
    connector_grip_length=connector_grip_length_4,
    connector_tab_length=wren_connector_01.tab_length_2,
    fin_depth=clean_3,
    gauge=clean_5,
    grip_tab_length=clean_4,
    ply_thickness=clean_6,
    sheet_width=clean_24,
    sheet_length=clean_10,
    si_slot_length=space_invader_slot_length,
    spacing=clean_23,
    tolerance=clean_25,
    tool_size=clean_26,
    count=clean_7,
    gutters_rails=crv_4,
    outer_curve=outer_curve,
    inner_curve=inner_curve,
    roof_connectors=crv_cp_2.Point,
    _2nd_floor_curve=building_section_profile._1st_floor_profile_curve_2,
    connector_points=pt_8,
    space_invader_points=geo_5,
    ext_grip_points=geo_7,
    central_column=building_section_profile.column_profile_curve_2,
    int_grip_points=geo_3,
    centre_curve=geo,
    reinforcer_edges=geo_16,
    bay_number=bay_no,
    google_token=gauth,
    spreadsheet=item,
    worksheet=data,
    unit_type=unit_type)  # -> opening_profiles, int_2d_profiles, bay_guide, _3d_geo_ext, attributes_2

geo_17 = Geometry(wren_connector_01.profile_1st_floor_c_02)
geo_18 = Geometry(wren_connector_01.profile_grnd_floor_c_01)
join_5 = JoinCurves(Curves=wren_space_invader_2.plug_2d_geo, Preserve=False)
move_12 = Move(Geometry=wren_connector_02._3d_solid, Motion=X_10)  # -> Geometry, Transform
orient_6 = OrientDirection(
    Geometry=wren_space_invader_2._3d_geo,
    PointA=wren_space_invader_2.centre_point,
    DirectionA=Z_9,
    PointB=pt_5,
    DirectionB=[divide_profile_into_points.space_invader_tangent, divide_profile_into_points.space_invader_floor_t, divide_profile_into_points.space_invader_grnd_floor_t, divide_profile_into_points.space_invader_column_t])  # -> Geometry, Transform
orient_7 = OrientDirection(
    Geometry=wren_space_invader_2.space_invader_plug_3d,
    PointA=wren_space_invader_2.centre_point,
    DirectionA=Z_10,
    PointB=pt_6,
    DirectionB=X_12)  # -> Geometry, Transform
panels_with_openings = Geometry(wren_sheathing.opening_profiles)
geo_19 = Geometry(wren_spacers._3d_geo)
geo_20 = Geometry(wren_spacers._2d_geo)
geo_21 = Geometry(join_5)
cnc_profile_geo = Geometry(wren_sheathing.int_2d_profiles)
sheathing_3d_geo = Geometry(wren_sheathing._3d_geo_ext)
mirror_2 = Mirror(Geometry=wren_connector_02._3d_solid, Plane=PlaneYZ(0, 0, 0))  # -> Geometry, Transform
move_13 = Move(Geometry=move_12.Geometry, Motion=Z_8)  # -> Geometry, Transform
geo_22 = Geometry(wren_reinforcers.E)
orient_8 = OrientDirection(
    Geometry=wren_connector_01._3d_brep_type_1,
    PointA=wren_connector_01.centre_point,
    DirectionA=Z_12,
    PointB=graft(pt_4),
    DirectionB=graft(vec_3))  # -> Geometry, Transform
orient_9 = OrientDirection(
    Geometry=wren_connector_01._3d_brep_type_1,
    PointA=wren_connector_01.centre_point,
    DirectionA=Vector(0, 0, 1),
    PointB=graft(divide_profile_into_points.connector_pts_1st_floor),
    DirectionB=graft(X_13))  # -> Geometry, Transform
orient_10 = OrientDirection(
    Geometry=wren_connector_01._3d_brep_type2,
    PointA=wren_connector_01.centre_point,
    DirectionA=Vector(0, 0, 1),
    PointB=graft(divide_profile_into_points.connector_pts_grnd_floor),
    DirectionB=graft(X_14))  # -> Geometry, Transform
orient_11 = OrientDirection(
    Geometry=wren_connector_02._3d_solid,
    PointA=wren_connector_02.centre_point,
    DirectionA=Z_11,
    PointB=flatten(crv_cp_4.Point),
    DirectionB=flatten(Vector(0, 0, 1)))  # -> Geometry, Transform
orient_12 = OrientDirection(
    Geometry=mirror_2.Geometry,
    PointA=wren_connector_02.centre_point,
    DirectionA=Z_11,
    PointB=flatten(crv_cp_3.Point),
    DirectionB=flatten(Vector(0, 0, 1)))  # -> Geometry, Transform
orient_13 = OrientDirection(
    Geometry=move_13.Geometry,
    PointA=wren_connector_02.centre_point,
    DirectionA=Z_11,
    PointB=flatten(item_34),
    DirectionB=flatten(vec_2.Vector))  # -> Geometry, Transform
clean_27 = CleanTree(RemoveNulls=True, RemoveInvalid=True, RemoveEmpty=True, Tree=panels_with_openings)  # -> flatten(Tree)
dispatch_7 = Dispatch(List=sheathing_3d_geo, DispatchPattern=run_batch_bake)  # -> ListA, ListB
dispatch_8 = Dispatch(List=cnc_profile_geo, DispatchPattern=run_batch_bake)  # -> ListA, ListB
move_14 = Move(Geometry=geo_20, Motion=Y)  # -> Geometry, Transform
spacer_geo = Entwine(Branch00=orient_6.Geometry, Branch01=orient_7.Geometry, Branch02=geo_19, FlattenInputs=True)
spacer_att = Entwine(Branch02=wren_spacers.attributes, FlattenInputs=True)
rotate_4 = Rotate(Geometry=orient_13.Geometry, Angle=degrees(subtraction_6), Plane=xz_3)  # -> Geometry, Transform
geo_23 = Geometry(dispatch_8.ListB)
null = NullItem(Item=clean_27)  # -> NullFlags, InvalidFlags, Description
geo_24 = Geometry(dispatch_7.ListA)
move_15 = Move(Geometry=geo_22, Motion=Y_3)  # -> Geometry, Transform
move_16 = Move(Geometry=geo_22, Motion=neg_5)  # -> Geometry, Transform
move_17 = Move(Geometry=wren_reinforcers._2d_geo, Motion=Y_7)  # -> Geometry, Transform
dispatch_9 = Dispatch(List=geo_23, DispatchPattern=null.NullFlags)  # -> ListA, ListB
move_18 = Move(Geometry=rotate_4.Geometry, Motion=Z_7)  # -> Geometry, Transform
c1_attributes = DataDescription(wren_connector_01.c1_attributes)
c2_attributes = DataDescription(wren_connector_01.c_2_attributes)
c3_attributes = DataDescription(wren_connector_02.attributes)
c2_geo = Geometry([orient_9.Geometry, orient_8.Geometry])
c1_geo = Geometry(orient_10.Geometry)
c3_geo = Geometry(flatten([orient_12.Geometry, orient_11.Geometry, move_18.Geometry]))
entwine_2 = Entwine(Branch00=move_15.Geometry, Branch01=move_16.Geometry, FlattenInputs=True)
entwine_3 = Entwine(Branch00=wren_reinforcers.attributes, Branch01=wren_reinforcers.attributes, FlattenInputs=True)
dispatch_10 = Dispatch(List=run_batch_bake, DispatchPattern=null.NullFlags)  # -> ListA, ListB
geo_25 = Geometry(dispatch_9.ListB)
dispatch_11 = Dispatch(List=Toggle(True), DispatchPattern=null.NullFlags)  # -> ListA, ListB
bake_3 = BakeObjects(Geometry=geo_24, Bake=Toggle(True))
move_19 = Move(Geometry=c2_geo, Motion=flatten(Y_8))  # -> Geometry, Transform
bake_4 = BakeObjects(Geometry=panels_with_openings, Bake=dispatch_11.ListB)
bake_5 = BakeObjects(Geometry=geo_25, Bake=dispatch_10.ListB)
move_20 = Move(Geometry=c1_geo, Motion=flatten(Y_8))  # -> Geometry, Transform
move_21 = Move(Geometry=c3_geo, Motion=flatten(Y_8))  # -> Geometry, Transform
_3d_geo = Entwine(Branch00=move_19.Geometry, Branch01=move_20.Geometry, Branch02=move_21.Geometry, FlattenInputs=True)
attributes = Entwine(Branch00=c2_attributes, Branch01=c1_attributes, Branch02=c3_attributes, FlattenInputs=True)
connector_3d_geo = Geometry(_3d_geo)
connector_attributes = Data(attributes)
reinforcer_3d_geo = Geometry(entwine_2)
reinforcer_2d_geo = Geometry(move_17.Geometry)
spacer_attributes = Data(spacer_att)
sheathing_3d_geo_2 = Geometry(wren_sheathing._3d_geo_ext)
spacer_3d_geo = Geometry(spacer_geo)
reinforcer_attributes = Data(entwine_3)
sheathing_attributes = Data(wren_sheathing.attributes_2)
sheathing_2d_geo = Geometry(cnc_profile_geo)
spacer_2d_geo = Geometry(move_14.Geometry)
c3_2d_geo = Geometry(geo_15)
c1_2d_geo = Geometry(geo_18)
c2_2d_geo = Geometry(geo_17)
connector_attributes_2 = Data(connector_attributes)
sheathing_attributes_2 = Data(sheathing_attributes)

# ----
# FINAL 3D FRAME
spacer_attributes_2 = Data(spacer_attributes)
spacer_3d_geo_2 = Geometry(spacer_3d_geo)
bake_6 = BooleanToggle(False)
frame_att = Entwine(
    Branch00=wren_labelling_for_nesting.attributes,
    Branch01=wren_labelling_for_nesting.attributes,
    Branch02=reinforcer_attributes,
    Branch03=spacer_attributes_2,
    FlattenInputs=True)
frame_3d = Entwine(
    Branch00=move_10.Geometry,
    Branch01=move_11.Geometry,
    Branch02=reinforcer_3d_geo,
    Branch03=spacer_3d_geo_2,
    FlattenInputs=True)
bake_7 = BakeGeometry(Bake=bake_6, Geometry=simplify(frame_3d), Attributes=simplify(frame_att))
frame = Geometry(flatten(frame_3d))

_3d_frame_geo = Geometry(frame)
connectors = Geometry(connector_3d_geo)
sheathing = Geometry(sheathing_3d_geo_2)
sheathing_3d = Entwine(Branch00=sheathing, Branch01=connectors, FlattenInputs=True)
sheathing_att = Entwine(Branch00=sheathing_attributes_2, FlattenInputs=True)
bake_8 = BakeGeometry(Bake=bake, Geometry=simplify(sheathing_3d), Attributes=simplify(sheathing_att))
clean_28 = CleanTree(RemoveNulls=True, RemoveInvalid=True, RemoveEmpty=True, Tree=flatten(orient_6.Geometry))
clean_29 = CleanTree(RemoveNulls=True, RemoveInvalid=True, RemoveEmpty=True, Tree=flatten(orient_7.Geometry))
clean_30 = CleanTree(RemoveNulls=True, RemoveInvalid=True, RemoveEmpty=True, Tree=flatten(orient_10.Geometry))
clean_31 = CleanTree(RemoveNulls=True, RemoveInvalid=True, RemoveEmpty=True, Tree=flatten(c2_geo))
lng_7 = ListLength(List=flatten(clean_28))
lng_8 = ListLength(List=flatten(clean_29))
lng_9 = ListLength(List=flatten(clean_30))
lng_10 = ListLength(List=flatten(clean_31))

# ----
# 3D FRAME ARRAY
dispatch_12 = Dispatch(List=flatten(frame), DispatchPattern=array_3d_frames)  # -> ListA, ListB
subtraction_15 = Subtraction(A=clean_7, B=1)
Y_12 = UnitY(Factor=clean_5)
frame_array = LinearArray(Geometry=dispatch_12.ListA, Direction=Y_12, Count=clean_7)  # -> Geometry, Transform

_3d_chassis_geo = Geometry(frame_array.Geometry)
move_22 = Move(Geometry=flatten([wren_space_invader_2.si_2d_geo, geo_21]), Motion=flatten(Y_9))  # -> Geometry, Transform
multiplication_17 = Multiplication(A=lng_9, B=clean_7)
multiplication_18 = Multiplication(A=lng_10, B=clean_7)
multiplication_19 = Multiplication(A=lng_7, B=addition_6)
move_23 = Move(Geometry=c1_2d_geo, Motion=Y_10)  # -> Geometry, Transform
move_24 = Move(Geometry=c2_2d_geo, Motion=Y_11)  # -> Geometry, Transform
move_25 = Move(Geometry=c3_2d_geo, Motion=Y_10)  # -> Geometry, Transform
entwine_4 = Entwine(Branch00=lng_7, Branch01=lng_8, FlattenInputs=True)  # -> simplify(Result)
space_invader_parts = Geometry(simplify(graft(move_22.Geometry)))
reinforcer_parts = Geometry(flatten(move_17.Geometry))
spacer_parts = Geometry(spacer_2d_geo)
sheathing_parts = Geometry(flatten(cnc_profile_geo))
connector_2_quantity = Number(multiplication_18)
connector_1_parts = Geometry(move_23.Geometry)
connector_2_parts = Geometry(move_24.Geometry)
connector_1_quantity = Number(multiplication_17)
connector_3_parts = Geometry(move_25.Geometry)
lng_11 = ListLength(List=flatten(c3_geo))
arrlinear = LinearArray(Geometry=space_invader_parts, Direction=X_15, Count=entwine_4)  # -> Geometry, Transform
arrlinear_2 = LinearArray(Geometry=connector_1_parts, Direction=X_16, Count=lng_9)  # -> Geometry, Transform
arrlinear_3 = LinearArray(Geometry=connector_3_parts, Direction=X_16, Count=lng_11)  # -> Geometry, Transform
arrlinear_4 = LinearArray(Geometry=connector_2_parts, Direction=X_16, Count=lng_10)  # -> Geometry, Transform
lng_12 = ListLength(List=flatten(arrlinear.Geometry))
lng_13 = ListLength(List=flatten(arrlinear_2.Geometry))
lng_14 = ListLength(List=flatten(arrlinear_3.Geometry))
lng_15 = ListLength(List=flatten(arrlinear_4.Geometry))
multiplication_20 = Multiplication(A=lng_12, B=number_slider_2)
multiplication_21 = Multiplication(A=lng_13, B=number_slider_3)
multiplication_22 = Multiplication(A=lng_15, B=number_slider_3)
multiplication_23 = Multiplication(A=lng_14, B=number_slider_3)
division_14 = Division(A=multiplication_20, B=-2)
division_15 = Division(A=multiplication_21, B=-2)
division_16 = Division(A=multiplication_22, B=-2)
subtraction_16 = Subtraction(A=division_15, B=multiplication_23)
X_17 = UnitX(Factor=division_14)
X_18 = UnitX(Factor=division_15)
X_19 = UnitX(Factor=division_16)
X_20 = UnitX(Factor=subtraction_16)
move_26 = Move(Geometry=arrlinear.Geometry, Motion=X_17)  # -> Geometry, Transform
move_27 = Move(Geometry=arrlinear_2.Geometry, Motion=X_18)  # -> Geometry, Transform
move_28 = Move(Geometry=arrlinear_3.Geometry, Motion=X_20)  # -> Geometry, Transform
move_29 = Move(Geometry=arrlinear_4.Geometry, Motion=X_19)  # -> Geometry, Transform
preview_cutting_files = Merge(
    Data1=move_26.Geometry,
    Data2=spacer_parts,
    Data3=reinforcer_parts,
    Data4=sheathing_parts,
    Data5=frame_parts,
    Data6=move_29.Geometry,
    Data7=move_27.Geometry,
    Data8=move_28.Geometry)
clean_32 = CleanTree(RemoveNulls=True, RemoveInvalid=True, RemoveEmpty=True, Tree=sheathing_parts)
connectors_2 = Geometry(connector_3d_geo)
sheathing_2 = Geometry(flatten(sheathing_3d_geo_2))

ungroup_2 = Ungroup(Group=space_invader_parts)
tmatch_2 = MatchText(Text=ungroup_2, RegEx="Text", Case=True)  # -> simplify(Match)
dispatch_13 = Dispatch(List=ungroup_2, DispatchPattern=tmatch_2)  # -> ListA, ListB
txt_2 = Text(dispatch_13.ListA)
cnc_parts_bake_2 = CNCPartsBake(bool=bake_2, geo=move_26.Geometry, multiple_count=space_invader_quantity)
split_3 = TextSplit(Text=txt_2, Separators=":")
item_47 = ListItem(List=split_3, Index=1, Wrap=True)
si_multiplier = Text(space_invader_quantity)
si_names = Text("SI-1")
tstat_2 = TreeStatistics(Tree=si_names)  # -> Paths, Length, Count
addition_13 = Addition(A="52", B=tstat_2.Count)
concat_3 = Concatenate(FragmentA="D", FragmentB="92")
concat_4 = Concatenate(FragmentA="D", FragmentB="52")
writespreadsheet_6 = WriteToSpreadsheet(
    Token=gauth,
    Name=spreadsheet_name,
    Worksheet=data,
    OrganizeByRowsOrColumns=True,
    Address=concat_4,
    Data=si_names,
    Write=bake_2,
    createNewSpreadsheets=False)
writespreadsheet_7 = WriteToSpreadsheet(
    Token=gauth,
    Name=spreadsheet_name,
    Worksheet=data,
    OrganizeByRowsOrColumns=True,
    Address=concat_3,
    Data=si_multiplier,
    Write=bake_2,
    createNewSpreadsheets=False)

ungroup_3 = Ungroup(Group=spacer_parts)
tmatch_3 = MatchText(Text=ungroup_3, RegEx="Text", Case=True)  # -> simplify(Match)
dispatch_14 = Dispatch(List=ungroup_3, DispatchPattern=tmatch_3)  # -> ListA, ListB
txt_3 = Text(dispatch_14.ListA)
cnc_parts_bake_3 = CNCPartsBake(bool=bake_2, geo=spacer_parts, multiple_count=spacer_quantity)
split_4 = TextSplit(Text=txt_3, Separators=":")
item_48 = ListItem(List=split_4, Index=1, Wrap=True)
spacer_multiplier = Text(spacer_quantity)
spacer_names = Text(item_48)
tstat_3 = TreeStatistics(Tree=spacer_names)  # -> Paths, Length, Count
addition_14 = Addition(A="52", B=tstat_3.Count)
concat_5 = Concatenate(FragmentA="C", FragmentB="92")
concat_6 = Concatenate(FragmentA="C", FragmentB="52")
writespreadsheet_8 = WriteToSpreadsheet(
    Token=gauth,
    Name=spreadsheet_name,
    Worksheet=data,
    OrganizeByRowsOrColumns=True,
    Address=concat_6,
    Data=spacer_names,
    Write=bake_2,
    createNewSpreadsheets=False)
writespreadsheet_9 = WriteToSpreadsheet(
    Token=gauth,
    Name=spreadsheet_name,
    Worksheet=data,
    OrganizeByRowsOrColumns=True,
    Address=concat_5,
    Data=spacer_multiplier,
    Write=bake_2,
    createNewSpreadsheets=False)

ungroup_4 = Ungroup(Group=move_29.Geometry)
tmatch_4 = MatchText(Text=ungroup_4, RegEx="Text", Case=True)  # -> simplify(Match)
dispatch_15 = Dispatch(List=ungroup_4, DispatchPattern=tmatch_4)  # -> ListA, ListB
txt_4 = Text(dispatch_15.ListA)
cnc_parts_bake_4 = CNCPartsBake(bool=bake_2, geo=move_27.Geometry, multiple_count=connector_1_quantity)
split_5 = TextSplit(Text=txt_4, Separators=":")
item_49 = ListItem(List=split_5, Index=1, Wrap=True)
connector_multiplier = Text(connector_1_quantity)
connector_names = Text(item_49)
tstat_4 = TreeStatistics(Tree=connector_names)  # -> Paths, Length, Count
addition_15 = Addition(A="52", B=tstat_4.Count)
concat_7 = Concatenate(FragmentA="F", FragmentB="92")
concat_8 = Concatenate(FragmentA="F", FragmentB="52")
writespreadsheet_10 = WriteToSpreadsheet(
    Token=gauth,
    Name=spreadsheet_name,
    Worksheet=data,
    OrganizeByRowsOrColumns=True,
    Address=concat_8,
    Data=connector_names,
    Write=bake_2,
    createNewSpreadsheets=False)
writespreadsheet_11 = WriteToSpreadsheet(
    Token=gauth,
    Name=spreadsheet_name,
    Worksheet=data,
    OrganizeByRowsOrColumns=True,
    Address=concat_7,
    Data=connector_multiplier,
    Write=bake_2,
    createNewSpreadsheets=False)

ungroup_5 = Ungroup(Group=connector_1_parts)
tmatch_5 = MatchText(Text=ungroup_5, RegEx="Text", Case=True)  # -> simplify(Match)
dispatch_16 = Dispatch(List=ungroup_5, DispatchPattern=tmatch_5)  # -> ListA, ListB
txt_5 = Text(dispatch_16.ListA)
cnc_parts_bake_5 = CNCPartsBake(bool=bake_2, geo=move_27.Geometry, multiple_count=connector_1_quantity)
split_6 = TextSplit(Text=txt_5, Separators=":")
item_50 = ListItem(List=split_6, Index=1, Wrap=True)
connector_multiplier_2 = Text(connector_1_quantity)
connector_names_2 = Text(item_50)
tstat_5 = TreeStatistics(Tree=connector_names_2)  # -> Paths, Length, Count
addition_16 = Addition(A="52", B=tstat_5.Count)
concat_9 = Concatenate(FragmentA="F", FragmentB="92")
concat_10 = Concatenate(FragmentA="F", FragmentB="52")
writespreadsheet_12 = WriteToSpreadsheet(
    Token=gauth,
    Name=spreadsheet_name,
    Worksheet=data,
    OrganizeByRowsOrColumns=True,
    Address=concat_10,
    Data=connector_names_2,
    Write=bake_2,
    createNewSpreadsheets=False)
writespreadsheet_13 = WriteToSpreadsheet(
    Token=gauth,
    Name=spreadsheet_name,
    Worksheet=data,
    OrganizeByRowsOrColumns=True,
    Address=concat_9,
    Data=connector_multiplier_2,
    Write=bake_2,
    createNewSpreadsheets=False)

# ---- group: Weight Calculator (kg)
# WEIGHT CALCULATOR - FRAME
volume_2 = Volume(Geometry=flatten(frame))  # -> Volume, Centroid
convunit_4 = UnitConversion(x=volume_2.Volume, Ufrom="mm^3", Uto="m^3")  # -> out, factor, val; inputs x: list of Double, Ufrom: String, Uto: String; same code as convunit
ma_2 = MassAddition(Input=convunit_4.val)  # -> Result, PartialResults
addition_17 = Addition(A=clean_7, B=1)
multiplication_24 = Multiplication(A=ma_2.Result, B=addition_17)
total_volume_2 = Panel(multiplication_24)

# ----
volume_3 = Volume(Geometry=flatten(sheathing_2))  # -> Volume, Centroid
plywood_volume_2 = Text(total_volume_2)
writespreadsheet_14 = WriteToSpreadsheet(
    Token=gauth,
    Name=spreadsheet_name_2,
    Worksheet=data,
    OrganizeByRowsOrColumns=False,
    Address="H18",
    Data=plywood_volume_2,
    Write=refresh,
    createNewSpreadsheets=False)

# ----
# CLADDING VOLUME
external_frame_2 = Geometry(flatten(outer_curve))
subtraction_17 = Subtraction(A=gauge_5, B=0)

disc_5 = Discontinuity(Curve=external_frame_2, Level=1)  # -> Points, Parameters
shatter_3 = Shatter(Curve=external_frame_2, Parameters=disc_5.Parameters)
eval_5 = EvaluateLength(Curve=shatter_3, Length=0.5, Normalized=True)  # -> Point, Tangent, Parameter
pdecon_5 = Deconstruct(Point=eval_5.Point)  # -> XComponent, YComponent, ZComponent
sort_7 = SortList(Keys=pdecon_5.ZComponent, ValuesA=shatter_3)  # -> Keys, ValuesA
cull_i_5 = CullIndex(List=sort_7.ValuesA, Indices=0, Wrap=True)
cull_i_6 = CullIndex(List=cull_i_5, Indices=[0, 1], Wrap=True)
item_51 = ListItem(List=cull_i_5, Index=[0, 1], Wrap=True)
join_6 = JoinCurves(Curves=cull_i_6, Preserve=False)
join_7 = JoinCurves(Curves=item_51, Preserve=False)
offset = Offset(Curve=join_7, Distance=addition_10, Plane=xz_4, Corners=1)
offset_2 = Offset(Curve=join_6, Distance=addition_10, Plane=xz_4, Corners=1)
len = Length(Curve=offset)
ma_3 = MassAddition(Input=flatten(len))  # -> Result, PartialResults
len_2 = Length(Curve=offset_2)
multiplication_25 = Multiplication(A=len_2, B=subtraction_14)
x_bays_2 = Multiplication(A=multiplication_25, B=clean_7)
multiplication_26 = Multiplication(A=ply_thickness_4, B=x_bays_2)
convunit_5 = UnitConversion(x=multiplication_26, Ufrom="mm^3", Uto="m^3")  # -> out, factor, flatten(val); inputs x: list of Double, Ufrom: String, Uto: String; same code as convunit
mm2_to_m2 = Division(A=x_bays_2, B=1000000)  # -> flatten(Result)
roofing_area_m2 = Panel(mm2_to_m2)
roofing_volume_m3 = Panel(convunit_5.val)
roofing_area = Number(roofing_area_m2)
writespreadsheet_15 = WriteToSpreadsheet(
    Token=gauth,
    Name=spreadsheet_name_2,
    Worksheet=data,
    OrganizeByRowsOrColumns=False,
    Address="H26",
    Data=roofing_area,
    Write=refresh,
    createNewSpreadsheets=False)

# ----
# EXTERNAL AREA
offset_3 = Offset(Curve=outer_curve, Distance=1, Plane=PlaneXY(0, 0, 0), Corners=1)
area_3 = Area(Geometry=offset_3)  # -> Area, Centroid
multiplication_27 = Multiplication(A=area_3.Area, B=2)
gauge_7 = Number(clean_5)

disc_6 = Discontinuity(Curve=offset_3, Level=1)  # -> Points, Parameters
shatter_4 = Shatter(Curve=offset_3, Parameters=disc_6.Parameters)
cull_i_7 = CullIndex(List=shatter_4, Indices=0, Wrap=True)
join_8 = JoinCurves(Curves=shatter_4, Preserve=False)
join_9 = JoinCurves(Curves=cull_i_7, Preserve=False)
len_3 = Length(Curve=join_9)
multiplication_28 = Multiplication(A=len_3, B=gauge_7)
x_bays_3 = Multiplication(A=multiplication_28, B=clean_7)
addition_18 = Addition(A=x_bays_3, B=multiplication_27)
convunit_6 = UnitConversion(x=addition_18, Ufrom="mm^2", Uto="m^2")  # -> out, factor, flatten(val); inputs x: list of Double, Ufrom: String, Uto: String; same code as convunit
membrane_area_m2 = Panel(convunit_6.val)
external_membrane_area = Text(membrane_area_m2)
writespreadsheet_16 = WriteToSpreadsheet(
    Token=gauth,
    Name=spreadsheet_name_2,
    Worksheet=data,
    OrganizeByRowsOrColumns=False,
    Address="H27",
    Data=external_membrane_area,
    Write=refresh,
    createNewSpreadsheets=False)

# ----
# INTERNAL AREA
neg_8 = Negative(Value=clean_6)
offset_4 = Offset(Curve=inner_curve, Distance=neg_8, Plane=PlaneXY(0, 0, 0), Corners=1)
lining_ply_thickness = Number(Slider(9, range=0..21))
gauge_8 = Number(clean_5)

disc_7 = Discontinuity(Curve=offset_4, Level=1)  # -> Points, Parameters
shatter_5 = Shatter(Curve=offset_4, Parameters=disc_7.Parameters)
item_52 = ListItem(List=shatter_5, Index=[2, 3], Wrap=True)
area_4 = Area(Geometry=offset_4)  # -> Area, Centroid
cull_i_8 = CullIndex(List=shatter_5, Indices=[0, 2, 3], Wrap=True)
join_10 = JoinCurves(Curves=shatter_5, Preserve=False)
len_4 = Length(Curve=cull_i_8)
multiplication_29 = Multiplication(A=area_4.Area, B=2)
len_5 = Length(Curve=item_52)
multiplication_30 = Multiplication(A=len_4, B=gauge_8)
multiplication_31 = Multiplication(A=len_5, B=gauge_8)
x_bays_4 = Multiplication(A=multiplication_30, B=bays_4)
x_bays_5 = Multiplication(A=multiplication_31, B=bays_4)
addition_19 = Addition(A=x_bays_4, B=multiplication_29)
ma_4 = MassAddition(Input=x_bays_5)  # -> Result, PartialResults
ma_5 = MassAddition(Input=addition_19)  # -> Result, PartialResults
convunit_7 = UnitConversion(x=area_4.Area, Ufrom="mm^2", Uto="m^2")  # -> out, factor, flatten(val); inputs x: list of Double, Ufrom: String, Uto: String; same code as convunit
convunit_8 = UnitConversion(x=ma_4.Result, Ufrom="mm^2", Uto="m^2")  # -> out, factor, flatten(val); inputs x: list of Double, Ufrom: String, Uto: String; same code as convunit
convunit_9 = UnitConversion(x=ma_5.Result, Ufrom="mm^2", Uto="m^2")  # -> out, factor, flatten(val); inputs x: list of Double, Ufrom: String, Uto: String; same code as convunit
int_roof_area_m2 = Panel(convunit_8.val)
int_wall_area_m2 = Panel(convunit_9.val)
end_wall_area_m2 = Panel(convunit_7.val)
internal_roof_area = Text(int_roof_area_m2)
internal_wall_area = Text(int_wall_area_m2)
end_wall_area = Text(end_wall_area_m2)
writespreadsheet_17 = WriteToSpreadsheet(
    Token=gauth,
    Name=spreadsheet_name_2,
    Worksheet=data,
    OrganizeByRowsOrColumns=False,
    Address="H6",
    Data=internal_wall_area,
    Write=refresh,
    createNewSpreadsheets=False)
writespreadsheet_18 = WriteToSpreadsheet(
    Token=gauth,
    Name=spreadsheet_name_2,
    Worksheet=data,
    OrganizeByRowsOrColumns=False,
    Address="H7",
    Data=internal_roof_area,
    Write=refresh,
    createNewSpreadsheets=False)
writespreadsheet_19 = WriteToSpreadsheet(
    Token=gauth,
    Name=spreadsheet_name_2,
    Worksheet=data,
    OrganizeByRowsOrColumns=False,
    Address="H9",
    Data=end_wall_area,
    Write=refresh,
    createNewSpreadsheets=False)

ungroup_6 = Ungroup(Group=reinforcer_parts)
tmatch_6 = MatchText(Text=ungroup_6, RegEx="Text", Case=True)  # -> simplify(Match)
dispatch_17 = Dispatch(List=ungroup_6, DispatchPattern=tmatch_6)  # -> ListA, ListB
txt_6 = Text(dispatch_17.ListA)
cnc_parts_bake_6 = CNCPartsBake(bool=bake_2, geo=reinforcer_parts, multiple_count=reinforcer_quantity)
split_7 = TextSplit(Text=txt_6, Separators=":")
item_53 = ListItem(List=split_7, Index=1, Wrap=True)
reinforcer_multiplier = Text(reinforcer_quantity)
concat_11 = Concatenate(FragmentA="E", FragmentB="92")
concat_12 = Concatenate(FragmentA="E", FragmentB="52")
writespreadsheet_20 = WriteToSpreadsheet(
    Token=gauth,
    Name=spreadsheet_name,
    Worksheet=data,
    OrganizeByRowsOrColumns=True,
    Address=concat_11,
    Data=reinforcer_multiplier,
    Write=bake_2,
    createNewSpreadsheets=False)

clean_33 = CleanTree(RemoveNulls=True, RemoveInvalid=True, RemoveEmpty=True, Tree=item_53)

reinforcer_names = Text(clean_33)
tstat_6 = TreeStatistics(Tree=reinforcer_names)  # -> Paths, Length, Count
addition_20 = Addition(A="52", B=tstat_6.Count)
writespreadsheet_21 = WriteToSpreadsheet(
    Token=gauth,
    Name=spreadsheet_name,
    Worksheet=data,
    OrganizeByRowsOrColumns=True,
    Address=concat_12,
    Data=reinforcer_names,
    Write=bake_2,
    createNewSpreadsheets=False)

ungroup_7 = Ungroup(Group=clean_32)
tmatch_7 = MatchText(Text=ungroup_7, RegEx="Text", Case=True)  # -> simplify(Match)
dispatch_18 = Dispatch(List=ungroup_7, DispatchPattern=tmatch_7)  # -> ListA, ListB
txt_7 = Text(dispatch_18.ListA)
cnc_parts_bake_7 = CNCPartsBake(bool=bake_2, geo=sheathing_parts, multiple_count=reinforcer_quantity)
split_8 = TextSplit(Text=txt_7, Separators=":")
item_54 = ListItem(List=split_8, Index=1, Wrap=True)
sheathing_names = Text(item_54)
sheathing_multiplier = Text(sheathing_quantity)
concat_13 = Concatenate(FragmentA="G", FragmentB="92")
concat_14 = Concatenate(FragmentA="G", FragmentB="52")
writespreadsheet_22 = WriteToSpreadsheet(
    Token=gauth,
    Name=spreadsheet_name,
    Worksheet=data,
    OrganizeByRowsOrColumns=True,
    Address=concat_13,
    Data=sheathing_multiplier,
    Write=bake_2,
    createNewSpreadsheets=False)

clean_34 = CleanTree(RemoveNulls=True, RemoveInvalid=True, RemoveEmpty=True, Tree=sheathing_names)

tstat_7 = TreeStatistics(Tree=clean_34)  # -> Paths, Length, Count
addition_21 = Addition(A="52", B=tstat_7.Count)
writespreadsheet_23 = WriteToSpreadsheet(
    Token=gauth,
    Name=spreadsheet_name,
    Worksheet=data,
    OrganizeByRowsOrColumns=True,
    Address=concat_14,
    Data=clean_34,
    Write=bake_2,
    createNewSpreadsheets=False)

# ----
# FLOOR UNDERSIDE PANELS
number_slider_4 = Slider(6, range=0..21)
item_55 = ListItem(List=shatter_4, Index=0, Wrap=True)
gauge_9 = Number(clean_5)
len_6 = Length(Curve=item_55)
lining_ply_thickness_2 = Number(number_slider_4)

subtraction_18 = Subtraction(A=gauge_9, B=clean_8)

multiplication_32 = Multiplication(A=len_6, B=subtraction_18)
x_bays_6 = Multiplication(A=multiplication_32, B=clean_7)
multiplication_33 = Multiplication(A=x_bays_6, B=lining_ply_thickness_2)
convunit_10 = UnitConversion(x=x_bays_6, Ufrom="mm^2", Uto="m^2")  # -> out, factor, flatten(val); inputs x: list of Double, Ufrom: String, Uto: String; same code as convunit
floor_underside_panels_m2 = Panel(convunit_10.val)

floor_underside_panel_area = Text(floor_underside_panels_m2)
writespreadsheet_24 = WriteToSpreadsheet(
    Token=gauth,
    Name=spreadsheet_name_2,
    Worksheet=data,
    OrganizeByRowsOrColumns=False,
    Address="H22",
    Data=floor_underside_panel_area,
    Write=refresh,
    createNewSpreadsheets=False)

# ---- group: Weight Calculator (kg)
# WEIGHT CALCULATOR - SHEATHING
volume_4 = Volume(Geometry=flatten(connectors_2))  # -> Volume, Centroid
list = ValueList({"Spruce Plywood": 510.00, "Plywood": 650.00, "MgO board": 1000.00}, selected="Spruce Plywood")

# ----
ma_6 = MassAddition(Input=[volume_3.Volume, volume_4.Volume])  # -> Result, PartialResults

len_7 = Length(Curve=join_10)
multiplication_34 = Multiplication(A=len_7, B=gauge_8)

x_bays_7 = Multiplication(A=multiplication_34, B=bays_4)
addition_22 = Addition(A=x_bays_7, B=multiplication_29)

multiplication_35 = Multiplication(A=addition_22, B=lining_ply_thickness)
convunit_11 = UnitConversion(x=multiplication_35, Ufrom="mm^3", Uto="m^3")  # -> out, factor, flatten(val); inputs x: list of Double, Ufrom: String, Uto: String; same code as convunit
convunit_12 = UnitConversion(x=addition_22, Ufrom="mm^2", Uto="m^2")  # -> out, factor, flatten(val); inputs x: list of Double, Ufrom: String, Uto: String; same code as convunit
internal_lining_volume_m3 = Panel(convunit_11.val)
internal_surface_area_m2 = Panel(convunit_12.val)

internal_surface_area = Text(internal_surface_area_m2)
writespreadsheet_25 = WriteToSpreadsheet(
    Token=gauth,
    Name=spreadsheet_name_2,
    Worksheet=data,
    OrganizeByRowsOrColumns=False,
    Address="H28",
    Data=internal_surface_area,
    Write=refresh,
    createNewSpreadsheets=False)

len_8 = Length(Curve=join_8)
multiplication_36 = Multiplication(A=len_8, B=gauge_7)

x_bays_8 = Multiplication(A=multiplication_36, B=clean_7)
addition_23 = Addition(A=x_bays_8, B=multiplication_27)

convunit_13 = UnitConversion(x=addition_23, Ufrom="mm^2", Uto="m^2")  # -> out, factor, flatten(val); inputs x: list of Double, Ufrom: String, Uto: String; same code as convunit
external_surface_area_m2 = Panel(convunit_13.val)

external_surface_area = Text(external_surface_area_m2)
writespreadsheet_26 = WriteToSpreadsheet(
    Token=gauth,
    Name=spreadsheet_name_2,
    Worksheet=data,
    OrganizeByRowsOrColumns=False,
    Address="H4",
    Data=external_surface_area,
    Write=refresh,
    createNewSpreadsheets=False)

multiplication_37 = Multiplication(A=ma_3.Result, B=subtraction_17)

x_bays_9 = Multiplication(A=multiplication_37, B=clean_7)
addition_24 = Addition(A=x_bays_9, B=multiplication_27)
multiplication_38 = Multiplication(A=ply_thickness_4, B=x_bays_9)

convunit_14 = UnitConversion(x=multiplication_38, Ufrom="mm^3", Uto="m^3")  # -> out, factor, flatten(val); inputs x: list of Double, Ufrom: String, Uto: String; same code as convunit
cladding_volume_m3 = Panel(convunit_14.val)

mm2_to_m2_2 = Division(A=addition_24, B=1000000)  # -> flatten(Result)
cladding_area_m2 = Panel(mm2_to_m2_2)
cladding_area = Number(cladding_area_m2)
writespreadsheet_27 = WriteToSpreadsheet(
    Token=gauth,
    Name=spreadsheet_name_2,
    Worksheet=data,
    OrganizeByRowsOrColumns=False,
    Address="H23",
    Data=cladding_area,
    Write=refresh,
    createNewSpreadsheets=False)

# ---- group: Weight Calculator (kg) (continued)
convunit_15 = UnitConversion(x=ma_6.Result, Ufrom="mm^3", Uto="m^3")  # -> out, factor, val; inputs x: list of Double, Ufrom: String, Uto: String; same code as convunit

# ----
m3_per_bay = Panel(convunit_15.val)
x_bays_10 = Multiplication(A=m3_per_bay, B=clean_7)
total_volume_m3 = Panel(x_bays_10)
plywood_volume_3 = Text(total_volume_m3)
writespreadsheet_28 = WriteToSpreadsheet(
    Token=gauth,
    Name=spreadsheet_name_2,
    Worksheet=data,
    OrganizeByRowsOrColumns=False,
    Address="H19",
    Data=plywood_volume_3,
    Write=refresh,
    createNewSpreadsheets=False)

# ---- group: Weight Calculator (kg) (continued)
multiplication_39 = Multiplication(A=x_bays_10, B=list)

# ----
ma_7 = MassAddition(Input=multiplication_39)  # -> Result, PartialResults

# ---- group: Weight Calculator (kg) (continued)
total_weight_kg = Panel(ma_7.Result)

# ==== cluster SpacerSlot
pocket_width = Slider(6, range=-0.01..20)
division = Division(A=pocket_width, B=2)
pt = ConstructPoint(XCoordinate=0, YCoordinate=0, ZCoordinate=0)
multiplication = Multiplication(A=division, B=-1)
multiplication_2 = Multiplication(A=division, B=-1)
X = UnitX(Factor=[division, multiplication])
Z = UnitZ(Factor=[division, multiplication_2])
move = Move(Geometry=graft(pt), Motion=flatten(X))  # -> Geometry, Transform
move_2 = Move(Geometry=graft(move.Geometry), Motion=flatten(Z))  # -> Geometry, Transform
pt_2 = Point(flatten(move_2.Geometry))
ply_thickness = ClusterInput()
tolerance = ClusterInput()
division_2 = Division(A=ply_thickness, B=2)
addition = Addition(A=division_2, B=tolerance)
multiplication_3 = Multiplication(A=addition, B=-1)
xy = XYPlane(Origin=Point(0, 0, 0))
Z_2 = UnitZ(Factor=multiplication_3)
Z_3 = UnitZ(Factor=addition)
yz = YZPlane(Origin=Point(0, 0, 0))
tab_width = ClusterInput()
panel = Panel(tab_width)
division_3 = Division(A=tab_width, B=2)
points = PointList()
multiplication_4 = Multiplication(A=division_3, B=-1)
X_2 = UnitX(Factor=multiplication_4)
X_3 = UnitX(Factor=division_3)
xz = XZPlane(Origin=Point(0, 0, 0))
centre_point = ClusterOutput(pt)

# ---- group: Points to Polyline
avr = Average(Input=pt_2)
xz_2 = XZPlane(Origin=avr)
vec2pt = Vector2Pt(PointA=avr, PointB=pt_2, Unitize=False)  # -> Vector, Length
pcomp = PlaneComponents(Plane=xz_2)  # -> Origin, XAxis, YAxis, ZAxis
angle = Angle(VectorA=vec2pt.Vector, VectorB=pcomp.XAxis, Plane=xz_2)  # -> Angle, Reflex

# ----
xz_3 = XZPlane(Origin=flatten(avr))
sort = SortList(Keys=angle.Angle, ValuesA=pt_2)  # -> Keys, ValuesA
rotate = Rotate(Geometry=pt, Angle=degrees("45"), Plane=xz_3)  # -> Geometry, Transform
mirror = Mirror(Geometry=rotate.Geometry, Plane=xy)  # -> Geometry, Transform
move_3 = Move(Geometry=rotate.Geometry, Motion=Z_2)  # -> Geometry, Transform
move_4 = Move(Geometry=mirror.Geometry, Motion=Z_3)  # -> Geometry, Transform

# ---- group: Points to Polyline (continued)
pt_3 = Point(sort.ValuesA)
pline = PolyLine(Vertices=pt_3, Closed="false")

# ----
crv = Curve(pline)
mirror_2 = Mirror(Geometry=[move_4.Geometry, move_3.Geometry], Plane=yz)  # -> Geometry, Transform
move_5 = Move(Geometry=graft([move_4.Geometry, move_3.Geometry]), Motion=flatten(X_2))  # -> Geometry, Transform
move_6 = Move(Geometry=graft(mirror_2.Geometry), Motion=flatten(X_3))  # -> Geometry, Transform
item = ListItem(List=flatten(move_5.Geometry), Index=1, Wrap=True)
item_2 = ListItem(List=flatten(move_6.Geometry), Index=0, Wrap=True)
rec_2pt = Rectangle2Pt(Plane=xz, PointA=item, PointB=item_2, Radius=0)  # -> Rectangle, Length

fin_depth = ClusterInput()
beamtie_offset = Slider(0, range=0..100)
division_4 = Division(A=ply_thickness, B=2)
division_5 = Division(A=fin_depth, B=2)
addition_2 = Addition(A=beamtie_offset, B=division_4)
subtraction = Subtraction(A=division_5, B=addition_2)
beamtie_offset_2 = Slider(0, range=0..100)
multiplication_5 = Multiplication(A=subtraction, B=-1)
Z_4 = UnitZ(Factor=subtraction)
Z_5 = UnitZ(Factor=multiplication_5)
beam_tie_spacing = ClusterOutput(subtraction)
move_7 = Move(Geometry=graft(rec_2pt.Rectangle), Motion=Z_4)  # -> Geometry, Transform
move_8 = Move(Geometry=graft(rec_2pt.Rectangle), Motion=Z_5)  # -> Geometry, Transform
division_6 = Division(A=beamtie_offset_2, B=2)
X_4 = UnitX(Factor=division_6)
multiplication_6 = Multiplication(A=X_4, B=-1)
tie_offset = ClusterOutput(division_6)
move_9 = Move(Geometry=graft(move_7.Geometry), Motion=X_4)  # -> Geometry, Transform
move_10 = Move(Geometry=graft(move_8.Geometry), Motion=multiplication_6)  # -> Geometry, Transform
crv_2 = Curve(flatten([move_10.Geometry, move_9.Geometry]))

geometry = ClusterOutput(crv_2)

# ==== cluster ConnectorSlotWall
ply_thickness = ClusterInput()
tolerance = ClusterInput()
pt = ConstructPoint(XCoordinate=0, YCoordinate=0, ZCoordinate=0)
panel = Panel(ply_thickness)
dog_bone_pocket = DogBonePocket(point=pt)  # -> pt_5, tool_size_2
points = PointList(Points=dog_bone_pocket.pt_5)

tab_width = Slider(80, range=25..301)
division = Division(A=tab_width, B=2)
Y = UnitY(Factor=division)
move = Move(Geometry=dog_bone_pocket.pt_5, Motion=Y)  # -> Geometry, Transform
move_2 = Move(Motion=Y)  # -> Geometry, Transform
X = UnitX(Factor=ply_thickness)
move_3 = Move(Geometry=move_2.Geometry, Motion=X)  # -> Geometry, Transform
move_4 = Move(Motion=X)  # -> Geometry, Transform
xz = XZPlane(Origin=Point(0, 0, 0))
pline = PolyLine(Vertices=[move_4.Geometry, move_3.Geometry, move.Geometry], Closed=False)
mirror = Mirror(Geometry=pline, Plane=xz)  # -> Geometry, Transform
join = JoinCurves(Curves=[pline, mirror.Geometry], Preserve=False)

pt_2 = ConstructPoint(XCoordinate=0, YCoordinate=0, ZCoordinate=0)

slot_length = Slider(90, range=25..301)
division_2 = Division(A=ply_thickness, B=2)
addition = Addition(A=division_2, B=tolerance)
multiplication = Multiplication(A=addition, B=-1)
division_3 = Division(A=slot_length, B=2)
pt_3 = ConstructPoint(XCoordinate=0, YCoordinate=0, ZCoordinate=0)
X_2 = UnitX(Factor=multiplication)
addition_2 = Addition(A=tolerance, B=division_3)
multiplication_2 = Multiplication(A=addition_2, B=-1)
Y_2 = UnitY(Factor=multiplication_2)
move_5 = Move(Geometry=dog_bone_pocket.pt_5, Motion=X_2)  # -> Geometry, Transform
move_6 = Move(Geometry=pt_3, Motion=X_2)  # -> Geometry, Transform
move_7 = Move(Geometry=move_5.Geometry, Motion=Y_2)  # -> Geometry, Transform
move_8 = Move(Geometry=pt_3, Motion=Y_2)  # -> Geometry, Transform
geo = Geometry(flatten([move_8.Geometry, move_7.Geometry, move_6.Geometry]))
pline_2 = PolyLine(Vertices=geo, Closed=False)
xz_2 = XZPlane(Origin=Point(0, 0, 0))
mirror_2 = Mirror(Geometry=pline_2, Plane=xz_2)  # -> Geometry, Transform
join_2 = JoinCurves(Curves=[pline_2, mirror_2.Geometry], Preserve=False)
mirror_3 = Mirror(Geometry=join_2, Plane=PlaneYZ(0, 0, 0))  # -> Geometry, Transform
join_3 = JoinCurves(Curves=[mirror_3.Geometry, join_2], Preserve=False)
cp = ControlPoints(Curve=join_3)  # -> Points, Weights, Knots
pline_3 = PolyLine(Vertices=cp.Points, Closed=True)

num = Number(slot_length)
slot_length_2 = ClusterOutput(num)
mirror_4 = Mirror(Geometry=mirror_2.Geometry, Plane=PlaneYZ(0, 0, 0))  # -> Geometry, Transform
join_4 = JoinCurves(Curves=flatten([mirror_2.Geometry, mirror_4.Geometry]), Preserve=False)
yz = YZPlane(Origin=Point(0, 0, 0))
rotate = Rotate(Geometry=pline_3, Angle=1.570796327, Plane=yz)  # -> Geometry, Transform
rotate_2 = Rotate(Geometry=join_4, Angle=1.570796327, Plane=yz)  # -> Geometry, Transform
cpoly = ControlPolygon(Curve=flatten(rotate.Geometry))  # -> Polygon, Points
xz_3 = XZPlane(Origin=Point(0, 0, 0))
avr = Average(Input=flatten(cpoly.Points))
rotate_3 = Rotate(Geometry=rotate_2.Geometry, Angle=1.570796327, Plane=xz_3)  # -> Geometry, Transform
area = Area(Geometry=cpoly.Polygon)  # -> Area, Centroid
mirror_5 = Mirror(Geometry=rotate_3.Geometry, Plane=PlaneYZ(0, 0, 0))  # -> Geometry, Transform
end = EndPoints(Curve=rotate_3.Geometry)  # -> Start, End
centre_pt = ClusterOutput(area.Centroid)
roof_connector_slot_left = ClusterOutput(rotate_3.Geometry)
geometry = ClusterOutput(rotate.Geometry)
pt_4 = Point(end.Start)
roof_connector_slot_right = ClusterOutput(mirror_5.Geometry)
roof_c_centre = ClusterOutput(pt_4)

# ==== cluster RailSlot
rail_thickness = ClusterInput()
ply_thickness = ClusterInput()
rail_depth = ClusterInput()
slot_spacing = ClusterInput()
tolerance = ClusterInput()
pt = ConstructPoint(XCoordinate=0, YCoordinate=0, ZCoordinate=0)
panel = Panel(rail_thickness)
dog_bone_pocket = DogBonePocket_2(point=pt)  # -> pt_5, size
points = PointList(Points=dog_bone_pocket.pt_5)
rotate = Rotate(Geometry=dog_bone_pocket.pt_5, Angle=degrees(90), Plane=PlaneXY(0, 0, 0))  # -> Geometry, Transform
neg = Negative(Value=ply_thickness)
xz = XZPlane(Origin=Point(0, 0, 0))
mirror = Mirror(Geometry=rotate.Geometry, Plane=xz)  # -> Geometry, Transform
Y = UnitY(Factor=neg)
move = Move(Geometry=pt, Motion=Y)  # -> Geometry, Transform
weave = Weave(Pattern=[0, 1], Stream0=move.Geometry, Stream1=mirror.Geometry, NullGaps=False)

division = Division(A=rail_thickness, B=2)
addition = Addition(A=division, B=tolerance)
multiplication = Multiplication(A=addition, B=-1)
pt_2 = ConstructPoint(XCoordinate=0, YCoordinate=0, ZCoordinate=0)
X = UnitX(Factor=multiplication)
addition_2 = Addition(A=tolerance, B=rail_depth)
multiplication_2 = Multiplication(A=addition_2, B=-1)
Y_2 = UnitY(Factor=multiplication_2)
move_2 = Move(Geometry=dog_bone_pocket.pt_5, Motion=X)  # -> Geometry, Transform
move_3 = Move(Geometry=pt_2, Motion=X)  # -> Geometry, Transform
move_4 = Move(Geometry=move_2.Geometry, Motion=Y_2)  # -> Geometry, Transform
move_5 = Move(Geometry=pt_2, Motion=Y_2)  # -> Geometry, Transform
geo = Geometry(flatten([move_5.Geometry, move_4.Geometry, move_3.Geometry]))
pline = PolyLine(Vertices=geo, Closed=False)
xz_2 = XZPlane(Origin=Point(0, 0, 0))
mirror_2 = Mirror(Geometry=pline, Plane=xz_2)  # -> Geometry, Transform
mirror_3 = Mirror(Geometry=mirror_2.Geometry, Plane=PlaneYZ(0, 0, 0))  # -> Geometry, Transform
join = JoinCurves(Curves=flatten([mirror_3.Geometry, mirror_2.Geometry]), Preserve=False)

fin_depth = ClusterInput()
yz = YZPlane(Origin=Point(0, 0, 0))
division_2 = Division(A=slot_spacing, B=2)
yz_2 = YZPlane(Origin=Point(0, 0, 0))
centre_pt = ClusterOutput(pt)
division_3 = Division(A=fin_depth, B=-2)
division_4 = Division(A=fin_depth, B=2)
subtraction = Subtraction(A=division_2, B=addition)
rotate_2 = Rotate(Geometry=join, Angle=1.570796327, Plane=yz_2)  # -> Geometry, Transform
Z = UnitZ(Factor=division_3)
end = EndPoints(Curve=rotate_2.Geometry)  # -> Start, End
X_2 = UnitX(Factor=subtraction)
neg_2 = Negative(Value=X_2)
move_6 = Move(Geometry=end.Start, Motion=neg_2)  # -> Geometry, Transform
move_7 = Move(Geometry=end.End, Motion=X_2)  # -> Geometry, Transform
ln = Line(StartPoint=move_6.Geometry, EndPoint=end.Start)
ln_2 = Line(StartPoint=end.End, EndPoint=move_7.Geometry)
join_2 = JoinCurves(Curves=[ln, rotate_2.Geometry, ln_2], Preserve=False)
move_8 = Move(Geometry=join_2, Motion=Z)  # -> Geometry, Transform
rail_centre_slot = ClusterOutput(move_8.Geometry)

tab_width = Slider(40, range=25..301)
division_5 = Division(A=tab_width, B=-1)

X_3 = UnitX(Factor=division_5)
addition_3 = Addition(A=tab_width, B=dog_bone_pocket.size)
addition_4 = Addition(A=addition_3, B=addition)
subtraction_2 = Subtraction(A=division_4, B=addition_4)
neg_3 = Negative(Value=subtraction_2)
X_4 = UnitX(Factor=neg_3)

move_9 = Move(Geometry=weave, Motion=X_3)  # -> flatten(Geometry), Transform

pline_2 = PolyLine(Vertices=move_9.Geometry, Closed=False)
points_2 = PointList(Points=move_9.Geometry)
weave_2 = Weave(Pattern=[0, 1, 2], Stream0=pt, Stream1=move.Geometry, Stream2=move_9.Geometry, NullGaps=False)

pline_3 = PolyLine(Vertices=weave_2, Closed=False)
join_3 = JoinCurves(Curves=pline_3, Preserve=False)

move_10 = Move(Geometry=join_3, Motion=X)  # -> Geometry, Transform
join_4 = JoinCurves(Curves=flatten([join, move_10.Geometry]), Preserve=False)
rotate_3 = Rotate(Geometry=join_4, Angle=1.570796327, Plane=yz)  # -> Geometry, Transform
end_2 = EndPoints(Curve=rotate_3.Geometry)  # -> Start, End
move_11 = Move(Geometry=end_2.Start, Motion=X_4)  # -> Geometry, Transform
ln_3 = Line(StartPoint=move_11.Geometry, EndPoint=end_2.Start)
join_5 = JoinCurves(Curves=[ln_3, rotate_3.Geometry], Preserve=False)
move_12 = Move(Geometry=join_5, Motion=Z)  # -> Geometry, Transform
mirror_4 = Mirror(Geometry=move_12.Geometry, Plane=PlaneYZ(0, 0, 0))  # -> Geometry, Transform
rail_corner_slot_right = ClusterOutput(mirror_4.Geometry)
rail_corner_slot_left = ClusterOutput(move_12.Geometry)

# ==== cluster DoublePegSlot
pocket_width = Slider(6, range=-0.01..20)
division = Division(A=pocket_width, B=2)
pt = ConstructPoint(XCoordinate=0, YCoordinate=0, ZCoordinate=0)
multiplication = Multiplication(A=division, B=-1)
multiplication_2 = Multiplication(A=division, B=-1)
X = UnitX(Factor=[division, multiplication])
Z = UnitZ(Factor=[division, multiplication_2])
move = Move(Geometry=graft(pt), Motion=flatten(X))  # -> Geometry, Transform
move_2 = Move(Geometry=graft(move.Geometry), Motion=flatten(Z))  # -> Geometry, Transform
pt_2 = Point(flatten(move_2.Geometry))
ply_thickness = ClusterInput()
tolerance = ClusterInput()
division_2 = Division(A=ply_thickness, B=2)
addition = Addition(A=division_2, B=tolerance)
multiplication_3 = Multiplication(A=addition, B=-1)
xy = XYPlane(Origin=Point(0, 0, 0))
Z_2 = UnitZ(Factor=multiplication_3)
Z_3 = UnitZ(Factor=addition)
yz = YZPlane(Origin=Point(0, 0, 0))
tab_width = ClusterInput()
division_3 = Division(A=tab_width, B=2)
xz = XZPlane(Origin=Point(0, 0, 0))
neg = Negative(Value=division_2)
multiplication_4 = Multiplication(A=division_3, B=-1)
X_2 = UnitX(Factor=neg)
rectangle = Rectangle(Plane=xz, XSize=ply_thickness, YSize=tab_width, Radius=0)  # -> Rectangle, Length
X_3 = UnitX(Factor=multiplication_4)
X_4 = UnitX(Factor=division_3)
neg_2 = Negative(Value=division_3)
move_3 = Move(Geometry=rectangle.Rectangle, Motion=X_2)  # -> Geometry, Transform
Z_4 = UnitZ(Factor=neg_2)
move_4 = Move(Geometry=move_3.Geometry, Motion=Z_4)  # -> Geometry, Transform
crv = Curve(move_4.Geometry)
xz_2 = XZPlane(Origin=Point(0, 0, 0))
geometry = ClusterOutput(crv)
centre_point = ClusterOutput(pt)

# ---- group: Points to Polyline
avr = Average(Input=pt_2)
xz_3 = XZPlane(Origin=avr)
vec2pt = Vector2Pt(PointA=avr, PointB=pt_2, Unitize=False)  # -> Vector, Length
pcomp = PlaneComponents(Plane=xz_3)  # -> Origin, XAxis, YAxis, ZAxis
angle = Angle(VectorA=vec2pt.Vector, VectorB=pcomp.XAxis, Plane=xz_3)  # -> Angle, Reflex

# ----
xz_4 = XZPlane(Origin=flatten(avr))
sort = SortList(Keys=angle.Angle, ValuesA=pt_2)  # -> Keys, ValuesA

# ---- group: Points to Polyline (continued)
pt_3 = Point(sort.ValuesA)
pline = PolyLine(Vertices=pt_3, Closed="false")

# ----
crv_2 = Curve(pline)
rotate = Rotate(Geometry=crv_2, Angle=degrees("45"), Plane=xz_4)  # -> Geometry, Transform
mirror = Mirror(Geometry=rotate.Geometry, Plane=xy)  # -> Geometry, Transform
move_5 = Move(Geometry=rotate.Geometry, Motion=Z_2)  # -> Geometry, Transform
move_6 = Move(Geometry=mirror.Geometry, Motion=Z_3)  # -> Geometry, Transform
cp = ControlPoints(Curve=move_5.Geometry)  # -> Points, Weights, Knots
cp_2 = ControlPoints(Curve=[move_6.Geometry, move_5.Geometry])  # -> Points, Weights, Knots
avr_2 = Average(Input=flatten(cp_2.Points))
mirror_2 = Mirror(Geometry=[move_6.Geometry, move_5.Geometry], Plane=yz)  # -> Geometry, Transform
cps = ClosestPoints(Point=avr_2, Cloud=flatten(cp_2.Points), Count="2")  # -> ClosestPoint, CPIndex, Distance
pline_2 = PolyLine(Vertices=cps.ClosestPoint, Closed=False)
move_7 = Move(Geometry=graft([pline_2, move_6.Geometry, move_5.Geometry]), Motion=flatten(X_3))  # -> Geometry, Transform
move_8 = Move(Geometry=graft([mirror_2.Geometry, pline_2]), Motion=flatten(X_4))  # -> Geometry, Transform
cp_3 = ControlPoints(Curve=[move_7.Geometry, move_8.Geometry])  # -> Points, Weights, Knots
points = PointList(Points=cp_3.Points)
avr_3 = Average(Input=flatten(cp_3.Points))
cps_2 = ClosestPoints(Point=avr_3, Cloud=flatten(cp_3.Points), Count="4")  # -> ClosestPoint, CPIndex, Distance
split = SplitList(List=cps_2.ClosestPoint, Index="2")  # -> ListA, ListB
split_2 = SplitList(List=split.ListA, Index="1")  # -> ListA, ListB
split_3 = SplitList(List=split.ListB, Index="1")  # -> ListA, ListB
pline_3 = PolyLine(Vertices=[split_3.ListA, split_2.ListB], Closed=False)
pline_4 = PolyLine(Vertices=[split_2.ListA, split_3.ListB], Closed=False)
crv_3 = Curve(flatten([move_7.Geometry, move_8.Geometry, pline_4, pline_3]))
cpoly = ControlPolygon(Curve=crv_3)  # -> Polygon, Points
pline_5 = PolyLine(Vertices=cpoly.Points, Closed=False)
points_2 = PointList(Points=cpoly.Points)
pline_6 = PolyLine(Vertices=cps_2.ClosestPoint, Closed=True)
join = JoinCurves(Curves=flatten(pline_5), Preserve=False)
rotate_2 = Rotate(Geometry=pline_6, Angle=degrees(90), Plane=xz_2)  # -> Geometry, Transform

# ==== cluster SpaceInvdrSlot
pocket_width = Slider(6, range=-0.01..20)
pocket_width_2 = Slider(6, range=-0.01..20)
division = Division(A=pocket_width, B=2)
pt = ConstructPoint(XCoordinate=0, YCoordinate=0, ZCoordinate=0)
multiplication = Multiplication(A=division, B=-1)
multiplication_2 = Multiplication(A=division, B=-1)
X = UnitX(Factor=[division, multiplication])
Z = UnitZ(Factor=[division, multiplication_2])
move = Move(Geometry=graft(pt), Motion=flatten(X))  # -> Geometry, Transform
move_2 = Move(Geometry=graft(move.Geometry), Motion=flatten(Z))  # -> Geometry, Transform
pt_2 = Point(flatten(move_2.Geometry))
ply_thickness = ClusterInput()
tolerance = ClusterInput()
division_2 = Division(A=ply_thickness, B=2)
addition = Addition(A=ply_thickness, B=tolerance)
addition_2 = Addition(A=division_2, B=tolerance)
multiplication_3 = Multiplication(A=addition_2, B=-1)
xy = XYPlane(Origin=Point(0, 0, 0))
Z_2 = UnitZ(Factor=multiplication_3)
Z_3 = UnitZ(Factor=addition_2)
tab_width = ClusterInput()
yz = YZPlane(Origin=Point(0, 0, 0))
xz = XZPlane(Origin=Point(0, 0, 0))
rectangle = Rectangle(Plane=xz, XSize=addition, YSize=tab_width, Radius=0)  # -> Rectangle, Length
division_3 = Division(A=addition, B=2)
pcen = PolygonCenter(Polyline=rectangle.Rectangle)  # -> CenterV, CenterE, CenterA
division_4 = Division(A=tab_width, B=2)
pt_3 = ConstructPoint(XCoordinate=0, YCoordinate=0, ZCoordinate=0)
X_2 = UnitX(Factor=division_3)
orient = OrientDirection(Geometry=rectangle.Rectangle, PointA=pcen.CenterA, DirectionA=Vector(0, 0, 1), PointB=pt_3, DirectionB=Vector(0, 0, 1))  # -> Geometry, Transform
move_3 = Move(Geometry=pt_3, Motion=X_2)  # -> Geometry, Transform
multiplication_4 = Multiplication(A=division_4, B=-1)
xz_2 = XZPlane(Origin=move_3.Geometry)
X_3 = UnitX(Factor=multiplication_4)
X_4 = UnitX(Factor=division_4)
arc = Arc(Plane=xz_2, Radius=pocket_width, Angle=Domain(0, 3.141592654))  # -> Arc, Length
rotate = Rotate(Geometry=arc.Arc, Angle=degrees(-90), Plane=xz_2)  # -> Geometry, Transform
mirror = Mirror(Geometry=rotate.Geometry, Plane=PlaneYZ(0, 0, 0))  # -> Geometry, Transform
end = EndPoints(Curve=[rotate.Geometry, mirror.Geometry])  # -> Start, End
crv_cp = CurveClosestPoint(Point=[end.Start, end.End], Curve=orient.Geometry)  # -> Point, Parameter, Distance
shatter = Shatter(Curve=orient.Geometry, Parameters=crv_cp.Parameter)
dispatch = Dispatch(List=shatter, DispatchPattern=[True, False])  # -> ListA, ListB
geo = Geometry([dispatch.ListA, rotate.Geometry, mirror.Geometry])
join = JoinCurves(Curves=flatten(geo), Preserve=False)
xz_3 = XZPlane(Origin=Point(0, 0, 0))
xz_4 = XZPlane(Origin=Point(0, 0, 0))
rotate_2 = Rotate(Geometry=orient.Geometry, Angle=degrees(90), Plane=xz_3)  # -> Geometry, Transform
rotate_3 = Rotate(Geometry=join, Angle=degrees(90), Plane=xz_4)  # -> Geometry, Transform
geometry = ClusterOutput(rotate_2.Geometry)
plug_slot = ClusterOutput(rotate_3.Geometry)
centre_point = ClusterOutput(pt)

# ---- group: Points to Polyline
avr = Average(Input=pt_2)
xz_5 = XZPlane(Origin=avr)
vec2pt = Vector2Pt(PointA=avr, PointB=pt_2, Unitize=False)  # -> Vector, Length
pcomp = PlaneComponents(Plane=xz_5)  # -> Origin, XAxis, YAxis, ZAxis
angle = Angle(VectorA=vec2pt.Vector, VectorB=pcomp.XAxis, Plane=xz_5)  # -> Angle, Reflex

# ----
xz_6 = XZPlane(Origin=flatten(avr))
sort = SortList(Keys=angle.Angle, ValuesA=pt_2)  # -> Keys, ValuesA

# ---- group: Points to Polyline (continued)
pt_4 = Point(sort.ValuesA)
pline = PolyLine(Vertices=pt_4, Closed="false")

# ----
crv = Curve(pline)
rotate_4 = Rotate(Geometry=crv, Angle=degrees("45"), Plane=xz_6)  # -> Geometry, Transform
mirror_2 = Mirror(Geometry=rotate_4.Geometry, Plane=xy)  # -> Geometry, Transform
move_4 = Move(Geometry=rotate_4.Geometry, Motion=Z_2)  # -> Geometry, Transform
move_5 = Move(Geometry=mirror_2.Geometry, Motion=Z_3)  # -> Geometry, Transform
cp = ControlPoints(Curve=move_4.Geometry)  # -> Points, Weights, Knots
cp_2 = ControlPoints(Curve=[move_5.Geometry, move_4.Geometry])  # -> Points, Weights, Knots
avr_2 = Average(Input=flatten(cp_2.Points))
mirror_3 = Mirror(Geometry=[move_5.Geometry, move_4.Geometry], Plane=yz)  # -> Geometry, Transform
cps = ClosestPoints(Point=avr_2, Cloud=flatten(cp_2.Points), Count="2")  # -> ClosestPoint, CPIndex, Distance
pline_2 = PolyLine(Vertices=cps.ClosestPoint, Closed=False)
move_6 = Move(Geometry=graft([pline_2, move_5.Geometry, move_4.Geometry]), Motion=flatten(X_3))  # -> Geometry, Transform
move_7 = Move(Geometry=graft([mirror_3.Geometry, pline_2]), Motion=flatten(X_4))  # -> Geometry, Transform
cp_3 = ControlPoints(Curve=[move_6.Geometry, move_7.Geometry])  # -> Points, Weights, Knots
points = PointList(Points=cp_3.Points)
avr_3 = Average(Input=flatten(cp_3.Points))
cps_2 = ClosestPoints(Point=avr_3, Cloud=flatten(cp_3.Points), Count="4")  # -> ClosestPoint, CPIndex, Distance
split = SplitList(List=cps_2.ClosestPoint, Index="2")  # -> ListA, ListB
split_2 = SplitList(List=split.ListA, Index="1")  # -> ListA, ListB
split_3 = SplitList(List=split.ListB, Index="1")  # -> ListA, ListB
pline_3 = PolyLine(Vertices=[split_3.ListA, split_2.ListB], Closed=False)
pline_4 = PolyLine(Vertices=[split_2.ListA, split_3.ListB], Closed=False)
crv_2 = Curve(flatten([move_6.Geometry, move_7.Geometry, pline_4, pline_3]))
cpoly = ControlPolygon(Curve=crv_2)  # -> Polygon, Points
pline_5 = PolyLine(Vertices=cpoly.Points, Closed=False)
pline_6 = PolyLine(Vertices=cps_2.ClosestPoint, Closed=True)
points_2 = PointList(Points=cpoly.Points)
join_2 = JoinCurves(Curves=flatten(pline_5), Preserve=False)

# ==== cluster WRENSpacers
profile_curve = ClusterInput()
intrusions = ClusterInput()
sheet_length = ClusterInput()
space_invader_slot_points_int = ClusterInput()
space_invader_slot_points_ext = ClusterInput()
space_invader_pts_floor = ClusterInput()
tab_slot_points = ClusterInput()
tab_points_corner = ClusterInput()
beam_width = ClusterInput()
material_thickness = ClusterInput()
profile_column = ClusterInput()
profile_1st_floor = ClusterInput()
reinforcer_edges = ClusterInput()
space_invader_slot_points_int_2 = ClusterInput()
space_invader_slot_points_int_3 = ClusterInput()
tab_column_points = ClusterInput()
tab_1st_floor_points = ClusterInput()
fin_depth = ClusterInput()
geo = Geometry(intrusions)
join = JoinCurves(Curves=flatten(profile_curve), Preserve=False)
tab_slot_width = ClusterInput()
tolerance = ClusterInput()
si_slot_length = ClusterInput()
pt = Point(flatten(tab_slot_points))
pt_2 = Point(flatten(tab_points_corner))
cullpt = CullDuplicates(Points=flatten(space_invader_slot_points_ext), Tolerance=0.1, CullMode=3)  # -> Points, Indices, Valence
cullpt_2 = CullDuplicates(Points=flatten(space_invader_slot_points_int), Tolerance=0.1, CullMode=3)  # -> Points, Indices, Valence
cullpt_3 = CullDuplicates(Points=flatten(space_invader_pts_floor), Tolerance=0.1, CullMode=3)  # -> Points, Indices, Valence
cullpt_4 = CullDuplicates(Points=flatten(space_invader_slot_points_int_2), Tolerance=0.1, CullMode=3)  # -> Points, Indices, Valence
pt_3 = Point(flatten(tab_column_points))
cullpt_5 = CullDuplicates(Points=flatten(space_invader_slot_points_int_3), Tolerance=0.1, CullMode=3)  # -> Points, Indices, Valence
crv = Curve(reinforcer_edges)
pt_4 = Point(flatten(tab_1st_floor_points))
disc = Discontinuity(Curve=join, Level=1)  # -> Points, Parameters
join_2 = JoinCurves(Curves=flatten(profile_1st_floor), Preserve=False)
multiplication = Multiplication(A=material_thickness, B=2)
join_3 = JoinCurves(Curves=flatten(profile_column), Preserve=False)
subtraction = Subtraction(A=beam_width, B=multiplication)
clean = CleanTree(RemoveNulls=True, RemoveInvalid=True, RemoveEmpty=True, Tree=cullpt_4.Points)  # -> flatten(Tree)
cullpt_6 = CullDuplicates(Points=pt_3, Tolerance=0.1, CullMode=3)  # -> Points, Indices, Valence
cullpt_7 = CullDuplicates(Points=pt_4, Tolerance=0.1, CullMode=3)  # -> Points, Indices, Valence
sheet_length_2 = Data(sheet_length)
clean_2 = CleanTree(RemoveNulls=True, RemoveInvalid=True, RemoveEmpty=True, Tree=cullpt_5.Points)  # -> flatten(Tree)
shatter = Shatter(Curve=join, Parameters=flatten(disc.Parameters))
pt_5 = Point(flatten([cullpt.Points, cullpt_3.Points]))
cull_i = CullIndex(List=cullpt_6.Points, Indices=0, Wrap=True)  # -> simplify(flatten(List))
item = ListItem(List=cullpt_6.Points, Index=0, Wrap=True)  # -> flatten(Item)
panel = Panel(item)
clean_3 = CleanTree(RemoveNulls=True, RemoveInvalid=True, RemoveEmpty=True, Tree=cull_i)
addition = Addition(A=material_thickness)
division = Division(A=fin_depth, B=2)
division_2 = Division(A=addition, B=2)
division_3 = Division(A=fin_depth, B=-2)
subtraction_2 = Subtraction(A=division, B=division_2)
addition_2 = Addition(A=division_3, B=division_2)
xz = XZPlane(Origin=Point(0, 0, 0))
inner = Offset(Curve=join, Distance=addition_2, Plane=xz, Corners=1)
outer = Offset(Curve=join, Distance=subtraction_2, Plane=xz, Corners=1)
neg = Negative(Value=division_2)
offset = Offset(Curve=outer, Distance=division_2, Plane=PlaneXY(0, 0, 0), Corners=1)
offset_2 = Offset(Curve=inner, Distance=neg, Plane=PlaneXY(0, 0, 0), Corners=1)
division_4 = Division(A=fin_depth, B=2)

disc_2 = Discontinuity(Curve=inner, Level=1)  # -> Points, Parameters
pdecon = Deconstruct(Point=disc_2.Points)  # -> XComponent, YComponent, ZComponent
sort = SortList(Keys=pdecon.ZComponent, ValuesA=disc_2.Points)  # -> Keys, ValuesA
lng = ListLength(List=sort.ValuesA)
item_2 = ListItem(List=sort.ValuesA, Index=[0, 1], Wrap=True)
subtraction_3 = Subtraction(A=lng, B=1)
crv_cp = CurveClosestPoint(Point=item_2, Curve=inner)  # -> Point, Parameter, Distance
item_3 = ListItem(List=sort.ValuesA, Index=subtraction_3, Wrap=True)
shatter_2 = Shatter(Curve=inner, Parameters=crv_cp.Parameter)
cull_i_2 = CullIndex(List=shatter_2, Indices=0, Wrap=True)
crv_cp_2 = CurveClosestPoint(Point=item_3, Curve=cull_i_2)  # -> Point, Parameter, Distance
shatter_3 = Shatter(Curve=cull_i_2, Parameters=crv_cp_2.Parameter)
item_4 = ListItem(List=shatter_3, Index=1, Wrap=True)
item_5 = ListItem(List=shatter_3, Index=0, Wrap=True)
item_6 = ListItem(List=shatter_2, Index=0, Wrap=True)
disc_3 = Discontinuity(Curve=item_4, Level=1)  # -> Points, Parameters
disc_4 = Discontinuity(Curve=item_5, Level=1)  # -> Points, Parameters
shatter_4 = Shatter(Curve=item_4, Parameters=flatten(disc_3.Parameters))
shatter_5 = Shatter(Curve=item_5, Parameters=flatten(disc_4.Parameters))
flip = FlipCurve(Curve=shatter_5)  # -> Curve, Flag
merge = Merge(Data1=item_6, Data2=flip.Curve, Data3=shatter_4)  # -> flatten(Result)
internal_centreline = Curve(merge)

disc_5 = Discontinuity(Curve=offset_2, Level=1)  # -> Points, Parameters
pdecon_2 = Deconstruct(Point=disc_5.Points)  # -> XComponent, YComponent, ZComponent
sort_2 = SortList(Keys=pdecon_2.ZComponent, ValuesA=disc_5.Points)  # -> Keys, ValuesA
lng_2 = ListLength(List=sort_2.ValuesA)
item_7 = ListItem(List=sort_2.ValuesA, Index=[0, 1], Wrap=True)
subtraction_4 = Subtraction(A=lng_2, B=1)
crv_cp_3 = CurveClosestPoint(Point=item_7, Curve=offset_2)  # -> Point, Parameter, Distance
item_8 = ListItem(List=sort_2.ValuesA, Index=subtraction_4, Wrap=True)
shatter_6 = Shatter(Curve=offset_2, Parameters=crv_cp_3.Parameter)
cull_i_3 = CullIndex(List=shatter_6, Indices=0, Wrap=True)
crv_cp_4 = CurveClosestPoint(Point=item_8, Curve=cull_i_3)  # -> Point, Parameter, Distance
shatter_7 = Shatter(Curve=cull_i_3, Parameters=crv_cp_4.Parameter)
item_9 = ListItem(List=shatter_7, Index=1, Wrap=True)
item_10 = ListItem(List=shatter_7, Index=0, Wrap=True)
item_11 = ListItem(List=shatter_6, Index=0, Wrap=True)
disc_6 = Discontinuity(Curve=item_9, Level=1)  # -> Points, Parameters
disc_7 = Discontinuity(Curve=item_10, Level=1)  # -> Points, Parameters
shatter_8 = Shatter(Curve=item_9, Parameters=flatten(disc_6.Parameters))
shatter_9 = Shatter(Curve=item_10, Parameters=flatten(disc_7.Parameters))
flip_2 = FlipCurve(Curve=shatter_9)  # -> Curve, Flag
merge_2 = Merge(Data1=item_11, Data2=flip_2.Curve, Data3=shatter_8)  # -> flatten(Result)
internal_centreline_2 = Curve(merge_2)

colom = CollisionOneMany(Collider=pt_5, Obstacles=graft(shatter))  # -> Collision, Index
colom_2 = CollisionOneMany(Collider=pt, Obstacles=graft(shatter))  # -> Collision, Index
colom_3 = CollisionOneMany(Collider=pt_2, Obstacles=graft(shatter))  # -> Collision, Index

disc_8 = Discontinuity(Curve=outer, Level=1)  # -> Points, Parameters
pdecon_3 = Deconstruct(Point=disc_8.Points)  # -> XComponent, YComponent, ZComponent
sort_3 = SortList(Keys=pdecon_3.ZComponent, ValuesA=disc_8.Points)  # -> Keys, ValuesA
lng_3 = ListLength(List=sort_3.ValuesA)
item_12 = ListItem(List=sort_3.ValuesA, Index=[0, 1], Wrap=True)
subtraction_5 = Subtraction(A=lng_3, B=1)
crv_cp_5 = CurveClosestPoint(Point=item_12, Curve=outer)  # -> Point, Parameter, Distance
item_13 = ListItem(List=sort_3.ValuesA, Index=subtraction_5, Wrap=True)
shatter_10 = Shatter(Curve=outer, Parameters=crv_cp_5.Parameter)
cull_i_4 = CullIndex(List=shatter_10, Indices=0, Wrap=True)
crv_cp_6 = CurveClosestPoint(Point=item_13, Curve=cull_i_4)  # -> Point, Parameter, Distance
shatter_11 = Shatter(Curve=cull_i_4, Parameters=crv_cp_6.Parameter)
item_14 = ListItem(List=shatter_10, Index=0, Wrap=True)
item_15 = ListItem(List=shatter_11, Index=0, Wrap=True)
item_16 = ListItem(List=shatter_11, Index=1, Wrap=True)
disc_9 = Discontinuity(Curve=item_16, Level=1)  # -> Points, Parameters
disc_10 = Discontinuity(Curve=item_15, Level=1)  # -> Points, Parameters
shatter_12 = Shatter(Curve=item_15, Parameters=flatten(disc_10.Parameters))
shatter_13 = Shatter(Curve=item_16, Parameters=flatten(disc_9.Parameters))
flip_3 = FlipCurve(Curve=shatter_13)  # -> Curve, Flag
merge_3 = Merge(Data1=item_14, Data2=shatter_12, Data3=flip_3.Curve)  # -> flatten(Result)
external_centreline = Curve(merge_3)

disc_11 = Discontinuity(Curve=offset, Level=1)  # -> Points, Parameters
pdecon_4 = Deconstruct(Point=disc_11.Points)  # -> XComponent, YComponent, ZComponent
sort_4 = SortList(Keys=pdecon_4.ZComponent, ValuesA=disc_11.Points)  # -> Keys, ValuesA
lng_4 = ListLength(List=sort_4.ValuesA)
item_17 = ListItem(List=sort_4.ValuesA, Index=[0, 1], Wrap=True)
subtraction_6 = Subtraction(A=lng_4, B=1)
crv_cp_7 = CurveClosestPoint(Point=item_17, Curve=offset)  # -> Point, Parameter, Distance
item_18 = ListItem(List=sort_4.ValuesA, Index=subtraction_6, Wrap=True)
shatter_14 = Shatter(Curve=offset, Parameters=crv_cp_7.Parameter)
cull_i_5 = CullIndex(List=shatter_14, Indices=0, Wrap=True)
crv_cp_8 = CurveClosestPoint(Point=item_18, Curve=cull_i_5)  # -> Point, Parameter, Distance
shatter_15 = Shatter(Curve=cull_i_5, Parameters=crv_cp_8.Parameter)
item_19 = ListItem(List=shatter_15, Index=1, Wrap=True)
item_20 = ListItem(List=shatter_15, Index=0, Wrap=True)
item_21 = ListItem(List=shatter_14, Index=0, Wrap=True)
disc_12 = Discontinuity(Curve=item_19, Level=1)  # -> Points, Parameters
disc_13 = Discontinuity(Curve=item_20, Level=1)  # -> Points, Parameters
shatter_16 = Shatter(Curve=item_19, Parameters=flatten(disc_12.Parameters))
shatter_17 = Shatter(Curve=item_20, Parameters=flatten(disc_13.Parameters))
flip_4 = FlipCurve(Curve=shatter_16)  # -> Curve, Flag
merge_4 = Merge(Data1=item_21, Data2=shatter_17, Data3=flip_4.Curve)  # -> flatten(Result)
external_centreline_2 = Curve(merge_4)

dispatch = Dispatch(List=pt, DispatchPattern=colom_2.Collision)  # -> simplify(ListA), ListB
dispatch_2 = Dispatch(List=pt_2, DispatchPattern=colom_3.Collision)  # -> simplify(ListA), ListB
dispatch_3 = Dispatch(List=pt_5, DispatchPattern=colom.Collision)  # -> simplify(ListA), ListB
neg_2 = Negative(Value=division_4)
xz_2 = XZPlane(Origin=Point(0, 0, 0))
neg_3 = Negative(Value=subtraction_2)
corner_tab_pts = Point(dispatch_2.ListA)
spacer_tab_pts = Point(dispatch.ListA)
space_invader_pts = Point(dispatch_3.ListA)
offset_3 = Offset(Curve=join_2, Distance=subtraction_2, Plane=xz_2, Corners=1)
offset_4 = Offset(Curve=join_2, Distance=neg_3, Plane=xz_2, Corners=1)
offset_5 = Offset(Curve=join_2, Distance=division_4, Plane=xz_2, Corners=1)
offset_6 = Offset(Curve=join_2, Distance=neg_2, Plane=xz_2, Corners=1)

num = Number(division)
xz_3 = XZPlane(Origin=Point(0, 0, 0))
neg_4 = Negative(Value=num)
offset_7 = Offset(Curve=join_3, Distance=neg_4, Plane=xz_3, Corners=1)
offset_8 = Offset(Curve=join_3, Distance=num, Plane=xz_3, Corners=1)
ccx = CurveCurve(CurveA=offset_2, CurveB=offset_7)  # -> Points, ParamsA, ParamsB
ccx_2 = CurveCurve(CurveA=offset_2, CurveB=offset_8)  # -> Points, ParamsA, ParamsB
item_22 = ListItem(List=ccx.Points, Index=[0, 1], Wrap=True)
pline = PolyLine(Vertices=ccx_2.Points, Closed=False)
pline_2 = PolyLine(Vertices=item_22, Closed=False)
ccx_3 = CurveCurve(CurveA=pline, CurveB=[offset_5, offset_6])  # -> Points, ParamsA, ParamsB
ccx_4 = CurveCurve(CurveA=pline_2, CurveB=flatten([offset_5, offset_6]))  # -> Points, ParamsA, ParamsB
crv_cp_9 = CurveClosestPoint(Point=ccx_3.Points, Curve=pline)  # -> Point, Parameter, Distance
crv_cp_10 = CurveClosestPoint(Point=ccx_4.Points, Curve=pline_2)  # -> Point, Parameter, Distance
shatter_18 = Shatter(Curve=pline, Parameters=flatten(crv_cp_9.Parameter))
shatter_19 = Shatter(Curve=pline_2, Parameters=flatten(crv_cp_10.Parameter))
null = NullItem(Item=ccx_4.Points)  # -> NullFlags, InvalidFlags, Description
null_2 = NullItem(Item=ccx_3.Points)  # -> NullFlags, InvalidFlags, Description
dispatch_4 = Dispatch(List=pline, DispatchPattern=null_2.NullFlags)  # -> ListA, ListB
dispatch_5 = Dispatch(List=shatter_19, DispatchPattern=[True, False])  # -> ListA, ListB
dispatch_6 = Dispatch(List=shatter_18, DispatchPattern=[True, False])  # -> ListA, ListB
dispatch_7 = Dispatch(List=pline_2, DispatchPattern=null.NullFlags)  # -> ListA, ListB
geo_2 = Geometry(flatten([dispatch_6.ListA, dispatch_4.ListA]))
geo_3 = Geometry(flatten([dispatch_5.ListA, dispatch_7.ListA]))
merge_5 = Merge(Data1=pline_2, Data2=pline)  # -> flatten(Result)
half_ply = Number(division_2)
neg_5 = Negative(Value=half_ply)
xz_4 = XZPlane(Origin=Point(0, 0, 0))
offset_9 = Offset(Curve=geo_3, Distance=flatten(neg_5), Plane=flatten(xz_4), Corners=1)  # -> flatten(Curve)
offset_10 = Offset(Curve=geo_2, Distance=flatten(half_ply), Plane=flatten(xz_4), Corners=1)  # -> flatten(Curve)

ccx_5 = CurveCurve(CurveA=offset_4, CurveB=inner)  # -> Points, ParamsA, ParamsB
ccx_6 = CurveCurve(CurveA=inner, CurveB=offset_3)  # -> Points, ParamsA, ParamsB
pline_3 = PolyLine(Vertices=ccx_5.Points, Closed=False)
pline_4 = PolyLine(Vertices=ccx_6.Points, Closed=False)
merge_6 = Merge(Data1=pline_4, Data2=pline_3)  # -> flatten(Result)
merge_7 = Merge(Data1=offset_9, Data2=offset_10)  # -> flatten(Result)
merge_8 = Merge(Data1=geo_3, Data2=geo_2)  # -> flatten(Result)
internal_centreline_3 = Curve(simplify(graft(internal_centreline_2)))
internal_centreline_4 = Curve(simplify(graft(internal_centreline)))
lng_5 = ListLength(List=flatten(internal_centreline_3))
subtraction_7 = Subtraction(A=lng_5, B=1)
int = Integer(Slider(1, range=0..4))
merge_9 = Merge(Data1=subtraction_7, Data2=int)
concat = Concatenate(FragmentA="{", FragmentB=merge_9)
concat_2 = Concatenate(FragmentA=concat, FragmentB="}")
split = SplitTree(Data=internal_centreline_3, Masks=flatten(concat_2))  # -> Positive, Negative
split_2 = SplitTree(Data=internal_centreline_4, Masks=flatten(concat_2))  # -> Positive, Negative
number_slider = Slider(250, range=0..1001)
flip_5 = FlipCurve(Curve=split.Positive)  # -> Curve, Flag
flip_6 = FlipCurve(Curve=split_2.Positive)  # -> Curve, Flag
ext = ExtendCurve(Curve=flip_5.Curve, Type=0, Start=number_slider, End=0)
ext_2 = ExtendCurve(Curve=flip_6.Curve, Type=0, Start=number_slider, End=0)
external_centreline_3 = Curve(simplify(graft(external_centreline_2)))
extternal_centreline = Curve(simplify(graft(external_centreline)))
merge_10 = Merge(Data1=ext, Data2=split.Negative)
merge_11 = Merge(Data1=ext_2, Data2=split_2.Negative)
column_profile = Geometry(simplify(graft(merge_6)))
internal_centreline_5 = Curve(simplify(merge_10))
column_profile_2 = Geometry(simplify(graft(merge_8)))
column_profile_3 = Geometry(simplify(graft(merge_7)))
# 2nd FLOOR SPACERS
space_invader_pts_2 = Geometry(clean_2)
internal_centreline_6 = Curve(simplify(merge_11))
space_invader_points = Geometry(space_invader_pts)
# COLUMN SPACERS
space_invader_pts_3 = Geometry(clean)
tab_pts = Geometry(cullpt_7.Points)
# INTERNAL SPACERS
space_invader_points_2 = Geometry(space_invader_pts)
# EXTERNAL SPACERS
intrusions_2 = Geometry(geo)
regular_tab_pts = Point(spacer_tab_pts)
corner_tab_pts_2 = Point(corner_tab_pts)
top_tab = Geometry(item)
regular_tab_pts_2 = Point(spacer_tab_pts)
tab_pts_2 = Geometry(cull_i)
end = EndPoints(Curve=intrusions_2)  # -> Start, End
ccx_7 = CurveCurve(CurveA=crv, CurveB=column_profile)  # -> Points, ParamsA, ParamsB
ccx_8 = CurveCurve(CurveA=crv, CurveB=external_centreline_3)  # -> Points, ParamsA, ParamsB
merge_12 = Merge(Data1=corner_tab_pts_2, Data2=regular_tab_pts)
ccx_9 = CurveCurve(CurveA=crv, CurveB=internal_centreline_5)  # -> Points, ParamsA, ParamsB
ccx_10 = CurveCurve(CurveA=crv, CurveB=column_profile_2)  # -> Points, ParamsA, ParamsB
clean_4 = CleanTree(RemoveNulls=True, RemoveInvalid=True, RemoveEmpty=True, Tree=ccx_7.Points)
clean_5 = CleanTree(RemoveNulls=True, RemoveInvalid=True, RemoveEmpty=True, Tree=ccx_8.Points)
clean_6 = CleanTree(RemoveNulls=True, RemoveInvalid=True, RemoveEmpty=True, Tree=ccx_10.Points)
crv_cp_11 = CurveClosestPoint(Point=space_invader_pts_2, Curve=column_profile)  # -> Point, Parameter, Distance
crv_cp_12 = CurveClosestPoint(Point=tab_pts, Curve=column_profile)  # -> Point, Parameter, Distance
eval = EvaluateLength(Curve=column_profile, Length=0.5, Normalized=True)  # -> Point, Tangent, Parameter
unit_type = ClusterInput()
eval_2 = EvaluateLength(Curve=column_profile, Length=0.5, Normalized=True)  # -> Point, Tangent, Parameter
len = Length(Curve=column_profile)
multiplication_2 = Multiplication(A=flatten(material_thickness), B=1)
crv_cp_13 = CurveClosestPoint(Point=space_invader_pts_3, Curve=column_profile_2)  # -> Point, Parameter, Distance
crv_cp_14 = CurveClosestPoint(Point=[tab_pts_2, top_tab], Curve=column_profile_2)  # -> Point, Parameter, Distance
eval_3 = EvaluateLength(Curve=column_profile_2, Length=0.5, Normalized=True)  # -> Point, Tangent, Parameter
len_2 = Length(Curve=column_profile_2)
eval_4 = EvaluateLength(Curve=column_profile_3, Length=0.5, Normalized=True)  # -> Point, Tangent, Parameter
clean_7 = CleanTree(RemoveNulls=True, RemoveInvalid=True, RemoveEmpty=True, Tree=ccx_9.Points)
len_3 = Length(Curve=external_centreline_3)
crv_cp_15 = CurveClosestPoint(Point=space_invader_points, Curve=external_centreline_3)  # -> Point, Parameter, Distance
crv_cp_16 = CurveClosestPoint(Point=merge_12, Curve=external_centreline_3)  # -> Point, Parameter, Distance
eval_5 = EvaluateLength(Curve=external_centreline_3, Length=0.5, Normalized=True)  # -> Point, Tangent, Parameter
crv_cp_17 = CurveClosestPoint(Point=space_invader_points_2, Curve=internal_centreline_5)  # -> Point, Parameter, Distance
crv_cp_18 = CurveClosestPoint(Point=regular_tab_pts_2, Curve=internal_centreline_5)  # -> Point, Parameter, Distance
eval_6 = EvaluateLength(Curve=internal_centreline_5, Length=0.5, Normalized=True)  # -> Point, Tangent, Parameter
crv_cp_19 = CurveClosestPoint(Point=eval_6.Point, Curve=internal_centreline_6)  # -> Point, Parameter, Distance
crv_cp_20 = CurveClosestPoint(Point=eval_5.Point, Curve=extternal_centreline)  # -> Point, Parameter, Distance
multiplication_3 = Multiplication(A=flatten(material_thickness), B=1)
len_4 = Length(Curve=internal_centreline_5)
path_mapper = PathMapper(clean_4, source="{A;B}", target="{A}")
pframe = PerpFrame(Curve=column_profile, Parameter=eval.Parameter)
path_mapper_2 = PathMapper(clean_6, source="{A;B}", target="{A}")
path_mapper_3 = PathMapper(clean_5, source="{A;B}", target="{A}")
pframe_2 = PerpFrame(Curve=column_profile_2, Parameter=eval_3.Parameter)
path_mapper_4 = PathMapper(clean_7, source="{A;B}", target="{A}")
xy = XYPlane(Origin=Point(0, 0, 0))
eval_7 = EvaluateCurve(Curve=internal_centreline_6, Parameter=crv_cp_19.Parameter)  # -> Point, Tangent, Angle
pframe_3 = PerpFrame(Curve=external_centreline_3, Parameter=eval_5.Parameter)
pframe_4 = PerpFrame(Curve=internal_centreline_5, Parameter=eval_6.Parameter)
path = ConstructPath(Indices=Slider(0, range=0..4))
split_3 = SplitTree(Data=external_centreline_3, Masks=flatten(path))  # -> Positive, Negative
crv_cp_21 = CurveClosestPoint(Point=[end.Start, end.End], Curve=split_3.Positive)  # -> Point, Parameter, Distance
clean_8 = CleanTree(RemoveNulls=True, RemoveInvalid=True, RemoveEmpty=True, Tree=crv_cp_21.Point)
split_4 = SplitTree(Data=pframe_3, Masks=flatten(path))  # -> Positive, Negative
xy_2 = XYPlane(Origin=Point(0, 0, 0))
unit_type_2 = Data(unit_type)
xy_3 = XYPlane(Origin=Point(0, 0, 0))
eval_8 = EvaluateCurve(Curve=extternal_centreline, Parameter=crv_cp_20.Parameter)  # -> Point, Tangent, Angle
xy_4 = XYPlane(Origin=Point(0, 0, 0))
dispatch_8 = Dispatch(List=split_4.Negative, DispatchPattern=False)  # -> ListA, ListB
subtraction_8 = Subtraction(A=len, B=multiplication_2)
subtraction_9 = Subtraction(A=len_2, B=multiplication_3)
orient = Orient(Geometry=crv_cp_12.Point, Source=pframe, Target=xy)  # -> Geometry, Transform
orient_2 = Orient(Geometry=crv_cp_11.Point, Source=pframe, Target=xy)  # -> Geometry, Transform
orient_3 = Orient(Geometry=path_mapper, Source=pframe, Target=xy)  # -> Geometry, Transform
orient_4 = Orient(Geometry=crv_cp_14.Point, Source=pframe_2, Target=xy_2)  # -> Geometry, Transform
orient_5 = Orient(Geometry=crv_cp_13.Point, Source=pframe_2, Target=xy_2)  # -> Geometry, Transform
orient_6 = Orient(Geometry=path_mapper_2, Source=pframe_2, Target=xy_2)  # -> Geometry, Transform
orient_7 = Orient(Geometry=clean_8, Source=split_4.Positive, Target=xy_3)  # -> Geometry, Transform
orient_8 = Orient(Geometry=crv_cp_16.Point, Source=pframe_3, Target=xy_3)  # -> Geometry, Transform
orient_9 = Orient(Geometry=crv_cp_15.Point, Source=pframe_3, Target=xy_3)  # -> Geometry, Transform
orient_10 = Orient(Geometry=path_mapper_3, Source=pframe_3, Target=xy_3)  # -> Geometry, Transform
orient_11 = Orient(Geometry=crv_cp_18.Point, Source=pframe_4, Target=xy_4)  # -> Geometry, Transform
orient_12 = Orient(Geometry=crv_cp_17.Point, Source=pframe_4, Target=xy_4)  # -> Geometry, Transform
orient_13 = Orient(Geometry=path_mapper_4, Source=pframe_4, Target=xy_4)  # -> Geometry, Transform
xz_5 = XZPlane(Origin=Point(0, 0, 0))
xz_6 = XZPlane(Origin=Point(0, 0, 0))
merge_13 = Merge(Data1=orient_7.Geometry, Data2=dispatch_8.ListA)
xz_7 = XZPlane(Origin=Point(0, 0, 0))
xz_8 = XZPlane(Origin=Point(0, 0, 0))
rotate = Rotate(Geometry=orient_3.Geometry, Angle=degrees(-90), Plane=xz_5)  # -> Geometry, Transform
rotate_2 = Rotate(Geometry=orient.Geometry, Angle=degrees(-90), Plane=xz_5)  # -> Geometry, Transform
split_5 = SplitTree(Data=len_3, Masks=flatten(path))  # -> Positive, Negative
rotate_3 = Rotate(Geometry=orient_2.Geometry, Angle=degrees(-90), Plane=xz_5)  # -> Geometry, Transform
rotate_4 = Rotate(Geometry=orient_6.Geometry, Angle=degrees(-90), Plane=xz_6)  # -> Geometry, Transform
rotate_5 = Rotate(Geometry=orient_4.Geometry, Angle=degrees(-90), Plane=xz_6)  # -> Geometry, Transform
rotate_6 = Rotate(Geometry=orient_5.Geometry, Angle=degrees(-90), Plane=xz_6)  # -> Geometry, Transform
multiplication_4 = Multiplication(A=fin_depth, B=2)
multiplication_5 = Multiplication(A=material_thickness, B=2)
rotate_7 = Rotate(Geometry=orient_10.Geometry, Angle=degrees(-90), Plane=xz_7)  # -> Geometry, Transform
rotate_8 = Rotate(Geometry=orient_8.Geometry, Angle=degrees(-90), Plane=xz_7)  # -> Geometry, Transform
rotate_9 = Rotate(Geometry=orient_9.Geometry, Angle=degrees(-90), Plane=xz_7)  # -> Geometry, Transform
rotate_10 = Rotate(Geometry=orient_13.Geometry, Angle=degrees(-90), Plane=xz_8)  # -> Geometry, Transform
rotate_11 = Rotate(Geometry=merge_13, Angle=degrees(-90), Plane=xz_7)  # -> Geometry, Transform
rotate_12 = Rotate(Geometry=orient_11.Geometry, Angle=degrees(-90), Plane=xz_8)  # -> Geometry, Transform
rotate_13 = Rotate(Geometry=orient_12.Geometry, Angle=degrees(-90), Plane=xz_8)  # -> Geometry, Transform
clean_9 = CleanTree(RemoveNulls=True, RemoveInvalid=True, RemoveEmpty=True, Tree=rotate.Geometry)
subtraction_10 = Subtraction(A=multiplication_4, B=multiplication_5)
clean_10 = CleanTree(RemoveNulls=True, RemoveInvalid=True, RemoveEmpty=True, Tree=rotate_4.Geometry)
clean_11 = CleanTree(RemoveNulls=True, RemoveInvalid=True, RemoveEmpty=True, Tree=rotate_7.Geometry)
clean_12 = CleanTree(RemoveNulls=True, RemoveInvalid=True, RemoveEmpty=True, Tree=rotate_10.Geometry)
split_6 = SplitTree(Data=rotate_8.Geometry, Masks=flatten(path))  # -> Positive, Negative
subtraction_11 = Subtraction(A=split_5.Positive, B=subtraction_10)  # -> flatten(Result)
cull_i_6 = CullIndex(List=split_6.Positive, Indices=[0, 1], Wrap=True)  # -> flatten(List)
merge_14 = Merge(Data1=simplify(subtraction_11), Data2=split_5.Negative)  # -> simplify(Result)
merge_15 = Merge(Data1=simplify(cull_i_6), Data2=split_6.Negative)  # -> simplify(Result)
tab_pts_3 = Entwine(Branch0X=merge_15, FlattenInputs=False)
r_edges = Entwine(Branch0X=clean_11, FlattenInputs=False)
space_inv = Entwine(Branch0X=rotate_9.Geometry, FlattenInputs=False)
r_edges_2 = Entwine(Branch0X=clean_9, FlattenInputs=False)
curve_length = Entwine(Branch0X=merge_14, FlattenInputs=False)
curve_length_2 = Entwine(Branch0X=subtraction_8, FlattenInputs=False)
tab_pts_4 = Entwine(Branch0X=rotate_2.Geometry, FlattenInputs=False)
space_inv_2 = Entwine(Branch0X=rotate_3.Geometry, FlattenInputs=False)
tab_pts_5 = Entwine(Branch0X=rotate_12.Geometry, FlattenInputs=False)
r_edges_3 = Entwine(Branch0X=clean_12, FlattenInputs=False)
intrusions_3 = Geometry(rotate_11.Geometry)
space_inv_3 = Entwine(Branch0X=rotate_13.Geometry, FlattenInputs=False)
curve_length_3 = Entwine(Branch0X=len_4, FlattenInputs=False)
r_edges_4 = Entwine(Branch0X=clean_10, FlattenInputs=False)
tab_pts_6 = Entwine(Branch0X=rotate_5.Geometry, FlattenInputs=False)
space_inv_4 = Entwine(Branch0X=rotate_6.Geometry, FlattenInputs=False)
curve_length_4 = Entwine(Branch0X=subtraction_9, FlattenInputs=False)
X = UnitX(Factor=1)
X_2 = UnitX(Factor=1)
X_3 = UnitX(Factor=1)
X_4 = UnitX(Factor=1)
pt_6 = ConstructPoint(XCoordinate=0, YCoordinate=0, ZCoordinate=0)
Y = UnitY(Factor=Slider(211, range=0..1001))
split_7 = SplitTree()  # -> Positive, BRight
xy_5 = XYPlane(Origin=Point(0, 0, 0))
side_b = Geometry(split_7.BRight)
side_a = Geometry(split_7.Positive)
mirror = Mirror(Geometry=side_a, Plane=xy_5)  # -> Geometry, Transform
merge_16 = Merge(Data1=mirror.Geometry, Data2=side_b)

division_5 = Division(A=material_thickness, B=2)
addition_3 = Addition(A=division_5, B=tolerance)
multiplication_6 = Multiplication(A=addition_3, B=-1)
addition_4 = Addition(B=si_slot_length)
X_5 = UnitX(Factor=multiplication_6)
pt_7 = ConstructPoint(XCoordinate=0, YCoordinate=0, ZCoordinate=0)
multiplication_7 = Multiplication(A=addition_4, B=-1)
Y_2 = UnitY(Factor=multiplication_7)
move = Move(Geometry=pt_7, Motion=X_5)  # -> Geometry, Transform
move_2 = Move(Geometry=pt_7, Motion=Y_2)  # -> Geometry, Transform
division_6 = Division(A=material_thickness, B=2)
xz_9 = XZPlane(Origin=Point(0, 0, 0))
addition_5 = Addition(A=tolerance, B=division_6)
Y_3 = UnitY(Factor=addition_5)
xz_10 = XZPlane(Origin=Point(0, 0, 0))

pt_8 = ConstructPoint(XCoordinate=0, YCoordinate=0, ZCoordinate=0)
dog_bone_pocket = DogBonePocket(point=pt_8)  # -> pt_5, tool_size_2
chamfer = Slider(3, range=0..11)
division_7 = Division(A=tab_slot_width, B=2)
Y_4 = UnitY(Factor=division_7)
move_3 = Move(Geometry=pt_8, Motion=Y_4)  # -> Geometry, Transform
multiplication_8 = Multiplication(A=chamfer, B=-1)
X_6 = UnitX(Factor=material_thickness)
X_7 = UnitX(Factor=multiplication_8)
Y_5 = UnitY(Factor=multiplication_8)
move_4 = Move(Geometry=pt_8, Motion=X_6)  # -> Geometry, Transform
move_5 = Move(Geometry=move_3.Geometry, Motion=X_6)  # -> Geometry, Transform
move_6 = Move(Geometry=move_5.Geometry, Motion=Y_5)  # -> Geometry, Transform
move_7 = Move(Geometry=move_5.Geometry, Motion=X_7)  # -> Geometry, Transform
xz_11 = XZPlane(Origin=Point(0, 0, 0))

rev = ReverseList(List=dog_bone_pocket.pt_5)

division_8 = Division(A=tab_slot_width, B=2)
Y_6 = UnitY(Factor=division_8)
multiplication_9 = Multiplication(A=chamfer, B=-1)
move_8 = Move(Geometry=rev, Motion=Y_6)  # -> Geometry, Transform
X_8 = UnitX(Factor=multiplication)
X_9 = UnitX(Factor=multiplication_9)
Y_7 = UnitY(Factor=multiplication_9)
move_9 = Move(Geometry=pt_8, Motion=X_8)  # -> Geometry, Transform
move_10 = Move(Geometry=move_3.Geometry, Motion=X_8)  # -> Geometry, Transform
move_11 = Move(Geometry=move_10.Geometry, Motion=Y_7)  # -> Geometry, Transform
move_12 = Move(Geometry=move_10.Geometry, Motion=X_9)  # -> Geometry, Transform
pline_5 = PolyLine(Vertices=flatten([move_8.Geometry, move_12.Geometry, move_11.Geometry, move_9.Geometry]), Closed=False)
xz_12 = XZPlane(Origin=Point(0, 0, 0))
mirror_2 = Mirror(Geometry=pline_5, Plane=xz_12)  # -> Geometry, Transform
join_4 = JoinCurves(Curves=[pline_5, mirror_2.Geometry], Preserve=False)
rotate_14 = Rotate(Geometry=join_4, Angle=1.570796327, Plane=PlaneXY(0, 0, 0))  # -> Geometry, Transform

move_13 = Move(Geometry=rev, Motion=Y_4)  # -> Geometry, Transform
pline_6 = PolyLine(Vertices=flatten([move_13.Geometry, move_7.Geometry, move_6.Geometry, move_4.Geometry]), Closed=False)
mirror_3 = Mirror(Geometry=pline_6, Plane=xz_11)  # -> Geometry, Transform
join_5 = JoinCurves(Curves=[pline_6, mirror_3.Geometry], Preserve=False)
rotate_15 = Rotate(Geometry=join_5, Angle=1.570796327, Plane=PlaneXY(0, 0, 0))  # -> Geometry, Transform

move_14 = Move(Geometry=dog_bone_pocket.pt_5, Motion=X_5)  # -> Geometry, Transform
move_15 = Move(Geometry=move_14.Geometry, Motion=Y_2)  # -> Geometry, Transform
geo_4 = Geometry(flatten([move_2.Geometry, move_15.Geometry, move.Geometry]))
pline_7 = PolyLine(Vertices=geo_4, Closed=False)
mirror_4 = Mirror(Geometry=pline_7, Plane=xz_9)  # -> Geometry, Transform
move_16 = Move(Geometry=move_4.Geometry, Motion=Y_3)  # -> Geometry, Transform
mirror_5 = Mirror(Geometry=mirror_4.Geometry, Plane=PlaneYZ(0, 0, 0))  # -> Geometry, Transform
join_6 = JoinCurves(Curves=flatten([mirror_4.Geometry, mirror_5.Geometry]), Preserve=False)
pline_8 = PolyLine(Vertices=flatten([move_13.Geometry, move_7.Geometry, move_6.Geometry, move_16.Geometry]), Closed=False)
mirror_6 = Mirror(Geometry=pline_8, Plane=xz_10)  # -> Geometry, Transform
rotate_16 = Rotate(Geometry=join_6, Angle=1.570796327, Plane=PlaneXY(0, 0, 0))  # -> Geometry, Transform
move_17 = Move(Geometry=rotate_16.Geometry, Motion=X_6)  # -> Geometry, Transform
join_7 = JoinCurves(Curves=flatten([pline_8, move_17.Geometry, mirror_6.Geometry]), Preserve=False)
rotate_17 = Rotate(Geometry=join_7, Angle=1.570796327, Plane=PlaneXY(0, 0, 0))  # -> Geometry, Transform

_2nd_floor_spacers = ExternalSpacers(
    regular_tab=rotate_15.Geometry,
    reinforcer_tab=rotate_14.Geometry,
    space_invader_tab=rotate_17.Geometry,
    unit_type=unit_type_2,
    sub_labels=" / FL",
    curve_length=curve_length_2,
    space_invader_pts=space_inv_2,
    regular_tab_pts=tab_pts_4,
    reinforcer_edges=r_edges_2,
    ply_thickness=material_thickness,
    beam_width=beam_width,
    sheet_length=sheet_length_2)  # -> _2d_geo, attributes, _3d
column_spacers = ExternalSpacers(
    regular_tab=rotate_15.Geometry,
    reinforcer_tab=rotate_14.Geometry,
    space_invader_tab=rotate_17.Geometry,
    unit_type=unit_type_2,
    sub_labels=" / COL",
    curve_length=curve_length_4,
    space_invader_pts=space_inv_4,
    regular_tab_pts=tab_pts_6,
    reinforcer_edges=r_edges_4,
    ply_thickness=material_thickness,
    beam_width=beam_width,
    sheet_length=sheet_length_2)  # -> _2d_geo, attributes, _3d
internal_spacers = ExternalSpacers(
    regular_tab=rotate_15.Geometry,
    reinforcer_tab=rotate_14.Geometry,
    space_invader_tab=rotate_17.Geometry,
    unit_type=unit_type_2,
    sub_labels=" / IN",
    curve_length=curve_length_3,
    space_invader_pts=space_inv_3,
    regular_tab_pts=tab_pts_5,
    reinforcer_edges=r_edges_3,
    ply_thickness=material_thickness,
    beam_width=beam_width,
    sheet_length=sheet_length_2)  # -> _2d_geo, attributes, _3d
external_spacers = ExternalSpacers(
    intrusions=intrusions_3,
    regular_tab=rotate_15.Geometry,
    reinforcer_tab=rotate_14.Geometry,
    space_invader_tab=rotate_17.Geometry,
    unit_type=unit_type_2,
    sub_labels=" / EX",
    curve_length=curve_length,
    space_invader_pts=space_inv,
    regular_tab_pts=tab_pts_3,
    reinforcer_edges=r_edges,
    ply_thickness=material_thickness,
    beam_width=beam_width,
    sheet_length=sheet_length_2)  # -> _2d_geo, attributes, _3d
orient_14 = OrientDirection(Geometry=_2nd_floor_spacers._3d, PointA=Point(0, 0, 0), DirectionA=X, PointB=eval_2.Point, DirectionB=eval_2.Tangent)  # -> Geometry, Transform
orient_15 = OrientDirection(Geometry=column_spacers._3d, PointA=Point(0, 0, 0), DirectionA=X_2, PointB=eval_4.Point, DirectionB=eval_4.Tangent)  # -> Geometry, Transform
orient_16 = OrientDirection(Geometry=external_spacers._3d, PointA=Point(0, 0, 0), DirectionA=X_3, PointB=eval_8.Point, DirectionB=eval_8.Tangent)  # -> Geometry, Transform
orient_17 = OrientDirection(Geometry=internal_spacers._3d, PointA=Point(0, 0, 0), DirectionA=X_4, PointB=eval_7.Point, DirectionB=eval_7.Tangent)  # -> Geometry, Transform
entwine = Entwine(
    Branch00=orient_17.Geometry,
    Branch01=orient_16.Geometry,
    Branch02=orient_15.Geometry,
    Branch03=orient_14.Geometry,
    FlattenInputs=True)
entwine_2 = Entwine(
    Branch00=internal_spacers.attributes,
    Branch01=external_spacers.attributes,
    Branch02=column_spacers.attributes,
    Branch03=_2nd_floor_spacers.attributes,
    FlattenInputs=True)
geo_5 = Geometry(internal_spacers._2d_geo)
geo_6 = Geometry(_2nd_floor_spacers._2d_geo)
geo_7 = Geometry(column_spacers._2d_geo)
geo_8 = Geometry(entwine)
bake = BakeGeometry(Bake=Toggle(False), Geometry=entwine, Attributes=entwine_2)
geo_9 = Geometry(external_spacers._2d_geo)
geo_10 = Geometry([geo_9, geo_5, geo_7, geo_6])
lng_6 = ListLength(List=geo_10)
arrlinear = LinearArray(Geometry=pt_6, Direction=Y, Count=lng_6)  # -> Geometry, Transform
orient_18 = OrientDirection(Geometry=geo_10, PointA=pt_6, DirectionA=Vector(0, 0, 1), PointB=arrlinear.Geometry, DirectionB=Vector(0, 0, 1))  # -> Geometry, Transform
geo_11 = Geometry(orient_18.Geometry)
_3d_geo = ClusterOutput(geo_8)
attributes = ClusterOutput(entwine_2)
_2d_geo = ClusterOutput(geo_11)

# ==== cluster WRENReinforcers
corner_to_reinforcing_end = Slider(680, range=0..800)
sheet = Slider(1200, range=0..2500)
sheet_2 = Slider(2400, range=0..2500)
sheet_length = Number(sheet_2)
sheet_width = Number(sheet)
point_locations = ClusterInput()
frame_ext = ClusterInput()
frame_int = ClusterInput()
fin_depth = ClusterInput()
curve = ClusterInput()
profile_ext = ClusterInput()
profile_ground_floor = ClusterInput()
spreader_depth = ClusterInput()
profile_column = ClusterInput()
profile_floor = ClusterInput()
external_pts = ClusterInput()
grnd_floor = ClusterInput()
_1st_floor_pts = ClusterInput()
column_pts = ClusterInput()
merge = Merge(Data1=external_pts, Data2=grnd_floor)
gantry_base_offset = Number(spreader_depth)
join = JoinCurves(Curves=flatten(profile_ext), Preserve=False)
split = SplitTree(Data=profile_ext, Masks=flatten(["{0;0;0;0}", "{0;0;0;0;0}", "{0;0;0;0;1}"]))  # -> Positive, Negative
disc = Discontinuity(Curve=join, Level=1)  # -> Points, Parameters
item = ListItem(List=split.Positive, Index=1, Wrap=True)
item_2 = ListItem(List=split.Positive, Index=0, Wrap=True)
end = EndPoints(Curve=flatten([item, item_2]))  # -> Start, End
avr = Average(Input=flatten([end.Start, end.End]))
len = Length(Curve=item)
xz = XZPlane(Origin=avr)
subtraction = Subtraction(A=len, B=100)
cir = Circle(Plane=xz, Radius=subtraction)
size = Slider(0, range=0..800)
size_2 = Slider(300, range=0..800)
null = NullItem(Item=profile_column)  # -> NullFlags, InvalidFlags, Description
dispatch = Dispatch(List=size_2, DispatchPattern=null.NullFlags)  # -> ListA, ListB
dispatch_2 = Dispatch(List=size, DispatchPattern=null.NullFlags)  # -> ListA, ListB
pt = Point(point_locations)

join_2 = JoinCurves(Curves=flatten(profile_floor), Preserve=False)
join_3 = JoinCurves(Curves=flatten(profile_column), Preserve=False)
end_2 = EndPoints(Curve=join_3)  # -> Start, End
end_3 = EndPoints(Curve=join_2)  # -> Start, End
corner_to_reinforcing_end_2 = Slider(680, range=0..800)
corner_to_reinforcing_end_3 = Slider(600, range=0..800)
corner_to_reinforcing_end_4 = Slider(389, range=0..800)
pt_2 = Point([end_2.Start, end_2.End])
ccx = CurveCurve(CurveA=join_3, CurveB=join_2)  # -> Points, ParamsA, ParamsB
pt_3 = Point([end_3.Start, end_3.End])
size_3 = Slider(300, range=0..800)
crv = Curve(profile_floor)
crv_2 = Curve(profile_column)
item_3 = ListItem(List=crv_2, Index=1, Wrap=True)
item_4 = ListItem(List=crv, Index=1, Wrap=True)
item_5 = ListItem(List=crv_2, Index=0, Wrap=True)
item_6 = ListItem(List=crv, Index=0, Wrap=True)
flip = FlipCurve(Curve=item_3)  # -> Curve, Flag
item_7 = ListItem(List=flip.Curve, Index=0, Wrap=True)
flip_2 = FlipCurve(Curve=item_4)  # -> Curve, Flag
branch = TreeBranch(Tree=flip.Curve, Path="{0;1}", MaintainPaths=True)
branch_2 = TreeBranch(Tree=flip.Curve, Path="{0;0}", MaintainPaths=True)
len_2 = Length(Curve=flip_2.Curve)
len_3 = Length(Curve=item_5)
len_4 = Length(Curve=item_6)
len_5 = Length(Curve=branch)
len_6 = Length(Curve=branch_2)
division = Division(A=corner_to_reinforcing_end_2, B=len_3)
division_2 = Division(A=corner_to_reinforcing_end, B=len_4)
division_3 = Division(A=corner_to_reinforcing_end, B=len_2)
division_4 = Division(A=corner_to_reinforcing_end_3, B=len_5)
division_5 = Division(A=corner_to_reinforcing_end_3, B=len_6)
eval = EvaluateLength(Curve=item_5, Length=division, Normalized=True)  # -> Point, Tangent, Parameter
eval_2 = EvaluateLength(Curve=item_6, Length=division_2, Normalized=True)  # -> Point, Tangent, Parameter
eval_3 = EvaluateLength(Curve=flip_2.Curve, Length=division_3, Normalized=True)  # -> Point, Tangent, Parameter
eval_4 = EvaluateLength(Curve=branch, Length=division_4, Normalized=True)  # -> Point, Tangent, Parameter
eval_5 = EvaluateLength(Curve=branch_2, Length=division_5, Normalized=True)  # -> Point, Tangent, Parameter
dispatch_3 = Dispatch(List=flatten(eval_2.Point), DispatchPattern=[True, False])  # -> ListA, ListB
dispatch_4 = Dispatch(List=flatten(eval_3.Point), DispatchPattern=[True, False])  # -> ListA, ListB
cp = ClosestPoint(Point=[eval.Point, eval_4.Point, eval_5.Point], Cloud=flatten(pt))  # -> ClosestPoint, CPIndex, Distance
amp = Amplitude(Vector=eval_3.Tangent, Amplitude=size_3)
amp_2 = Amplitude(Vector=eval_2.Tangent, Amplitude=size_3)
crv_cp = CurveClosestPoint(Point=cp.ClosestPoint, Curve=crv_2)  # -> Point, Parameter, Distance
move = Move(Geometry=dispatch_4.ListA, Motion=Vector(0, 0, 10))  # -> Geometry, Transform
ln = Line(StartPoint=dispatch_3.ListA, EndPoint=move.Geometry)
move_2 = Move(Geometry=dispatch_3.ListB, Motion=Vector(0, 0, 10))  # -> Geometry, Transform
ln_2 = Line(StartPoint=dispatch_4.ListB, EndPoint=move_2.Geometry)
larger = LargerThan(FirstNumber=[ln, ln_2], SecondNumber=sheet_length)  # -> LargerThan, OrEqualTo
dispatch_5 = Dispatch(List=[ln, ln_2], DispatchPattern=larger.LargerThan)  # -> ListA, ListB
cp_2 = ClosestPoint(Point=[dispatch_4.ListB, dispatch_3.ListA, move.Geometry, move_2.Geometry], Cloud=flatten(pt))  # -> ClosestPoint, CPIndex, Distance
eval_6 = EvaluateLength(Curve=dispatch_5.ListA, Length=0.5, Normalized=True)  # -> Point, Tangent, Parameter
amp_3 = Amplitude(Vector=eval_6.Tangent, Amplitude=corner_to_reinforcing_end_4)
rev = Reverse(Vector=amp_3)
crv_cp_2 = CurveClosestPoint(Point=flatten(cp_2.ClosestPoint), Curve=join_2)  # -> Point, Parameter, Distance
move_3 = Move(Geometry=eval_6.Point, Motion=rev)  # -> Geometry, Transform
move_4 = Move(Geometry=eval_6.Point, Motion=amp_3)  # -> Geometry, Transform
shatter = Shatter(Curve=join_3, Parameters=flatten(crv_cp.Parameter))
cp_3 = ClosestPoint(Point=[move_4.Geometry, move_3.Geometry], Cloud=flatten(pt))  # -> ClosestPoint, CPIndex, Distance; disabled
dispatch_6 = Dispatch(List=shatter, DispatchPattern=[True, False])  # -> ListA, ListB
crv_cp_3 = CurveClosestPoint(Point=cp_3.ClosestPoint, Curve=join_2)  # -> Point, Parameter, Distance
shatter_2 = Shatter(Curve=join_2, Parameters=flatten([crv_cp_2.Parameter, crv_cp_3.Parameter]))
dispatch_7 = Dispatch(List=shatter_2, DispatchPattern=[True, False])  # -> ListA, ListB
division_6 = Division(A=fin_depth, B=2)
division_7 = Division(A=fin_depth, B=2)
crv_3 = Curve(dispatch_7.ListA)
crv_4 = Curve(dispatch_6.ListA)
avr_2 = Average(Input=crv_cp_3.Point)
xz_2 = XZPlane(Origin=Point(0, 0, 0))
xz_3 = XZPlane(Origin=Point(0, 0, 0))
neg = Negative(Value=division_6)
neg_2 = Negative(Value=division_7)
offset = Offset(Curve=crv_3, Distance=neg, Plane=xz_2, Corners=1)
offset_2 = Offset(Curve=crv_3, Distance=division_6, Plane=xz_2, Corners=1)
offset_3 = Offset(Curve=crv_4, Distance=neg_2, Plane=xz_3, Corners=1)
offset_4 = Offset(Curve=crv_4, Distance=division_7, Plane=xz_3, Corners=1)
end_4 = EndPoints(Curve=[offset_2, offset])  # -> Start, End
end_5 = EndPoints(Curve=[offset_4, offset_3])  # -> Start, End
pline = PolyLine(Vertices=end_4.End, Closed=False)
pline_2 = PolyLine(Vertices=end_4.Start, Closed=False)
pline_3 = PolyLine(Vertices=end_5.End, Closed=False)
pline_4 = PolyLine(Vertices=end_5.Start, Closed=False)
lng = ListLength(List=flatten(pline))
lng_2 = ListLength(List=flatten(pline_3))
subtraction_2 = Subtraction(A=lng, B=1)
subtraction_3 = Subtraction(A=lng_2, B=1)
cull_i = CullIndex(List=flatten(pline), Indices=subtraction_2, Wrap=True)
cull_i_2 = CullIndex(List=flatten(pline_2), Indices=0, Wrap=True)
cull_i_3 = CullIndex(List=flatten(pline_3), Indices=subtraction_3, Wrap=True)
cull_i_4 = CullIndex(List=flatten(pline_4), Indices=0, Wrap=True)
geo = Geometry(flatten([cull_i_4, cull_i_3, cull_i_2, cull_i]))

colom = CollisionOneMany(Collider=profile_ext, Obstacles=join_2)  # -> Collision, Index
null_2 = NullItem(Item=colom.Collision)  # -> NullFlags, InvalidFlags, Description
dispatch_8 = Dispatch(List=profile_ext, DispatchPattern=colom.Collision)  # -> ListA, ListB
dispatch_9 = Dispatch(List=profile_ext, DispatchPattern=null_2.NullFlags)  # -> ListA, ListB

size_4 = Slider(300, range=0..800)
end_6 = EndPoints(Curve=join_3)  # -> Start, End; disabled
end_7 = EndPoints(Curve=join_2)  # -> Start, End
xz_4 = XZPlane(Origin=[end_6.Start, end_6.End, end_7.Start, end_7.End])
cir_2 = Circle(Plane=xz_4, Radius=size_4)
pt_4 = Point([end_6.Start, end_6.End, end_7.Start, end_7.End])
colom_2 = CollisionOneMany(Collider=split.Negative, Obstacles=cir_2)  # -> Collision, Index
corner_to_reinforcing_end_5 = Slider(200, range=0..800)
dispatch_10 = Dispatch(List=split.Negative, DispatchPattern=colom_2.Collision)  # -> ListA, ListB
crv_5 = Curve(dispatch_10.ListA)
dispatch_11 = Dispatch(List=flatten(dispatch_10.ListA), DispatchPattern=[False, True])  # -> ListA, ListB
join_4 = JoinCurves(Curves=flatten(crv_5), Preserve=False)
flip_3 = FlipCurve(Curve=dispatch_11.ListB)  # -> Curve, Flag
len_7 = Length(Curve=dispatch_11.ListA)
len_8 = Length(Curve=flip_3.Curve)
subtraction_4 = Subtraction(A=corner_to_reinforcing_end, B=corner_to_reinforcing_end_5)
subtraction_5 = Subtraction(A=corner_to_reinforcing_end, B=corner_to_reinforcing_end_5)
division_8 = Division(A=subtraction_4, B=len_8)
division_9 = Division(A=subtraction_5, B=len_7)
eval_7 = EvaluateLength(Curve=flip_3.Curve, Length=division_8, Normalized=True)  # -> Point, Tangent, Parameter
eval_8 = EvaluateLength(Curve=dispatch_11.ListA, Length=division_9, Normalized=True)  # -> Point, Tangent, Parameter
neg_3 = Negative(Value=corner_to_reinforcing_end_5)
cps = ClosestPoints(Point=pt_4, Cloud=flatten([eval_8.Point, eval_7.Point]), Count=2)  # -> ClosestPoint, CPIndex, Distance
Z = UnitZ(Factor=neg_3)
sort_pt = SortPoints(Points=cps.ClosestPoint)  # -> Points, Indices
size_5 = Slider(90, range=0..800)
item_8 = ListItem(List=flatten([eval_8.Tangent, eval_7.Tangent]), Index=cps.CPIndex, Wrap=True)
item_9 = ListItem(List=sort_pt.Points, Index=1, Wrap=True)
xz_5 = XZPlane(Origin=cps.ClosestPoint)
item_10 = ListItem(List=sort_pt.Points, Index=0, Wrap=True)
size_6 = Slider(100, range=0..800)
move_5 = Move(Geometry=item_10, Motion=Z)  # -> Geometry, Transform
vrot = Rotate(Vector=item_8, Axis=xz_5, Angle=degrees(size_5))
merge_2 = Merge(Data1=item_9, Data2=move_5.Geometry)
cp_4 = ClosestPoint(Point=merge_2, Cloud=flatten(pt))  # -> ClosestPoint, CPIndex, Distance
amp_4 = Amplitude(Vector=vrot, Amplitude=size_6)
neg_4 = Negative(Value=amp_4)
move_6 = Move(Geometry=cp_4.ClosestPoint, Motion=amp_4)  # -> Geometry, Transform
move_7 = Move(Geometry=cp_4.ClosestPoint, Motion=neg_4)  # -> Geometry, Transform
ln_3 = Line(StartPoint=move_7.Geometry, EndPoint=move_6.Geometry)
ccx_2 = CurveCurve(CurveA=join_4, CurveB=flatten(ln_3))  # -> Points, ParamsA, ParamsB
crv_cp_4 = CurveClosestPoint(Point=simplify(cp_4.ClosestPoint), Curve=graft(join_4))  # -> Point, Parameter, Distance
shatter_3 = Shatter(Curve=join_4, Parameters=flatten(crv_cp_4.Parameter))
dispatch_12 = Dispatch(List=shatter_3, DispatchPattern=[True, False])  # -> ListA, ListB
division_10 = Division(A=fin_depth, B=2)
crv_6 = Curve(dispatch_12.ListB)
xz_6 = XZPlane(Origin=Point(0, 0, 0))
neg_5 = Negative(Value=division_10)
offset_5 = Offset(Curve=crv_6, Distance=neg_5, Plane=xz_6, Corners=1)
offset_6 = Offset(Curve=crv_6, Distance=division_10, Plane=xz_6, Corners=1)
end_8 = EndPoints(Curve=[offset_6, offset_5])  # -> Start, End
pline_5 = PolyLine(Vertices=end_8.End, Closed=False)
pline_6 = PolyLine(Vertices=end_8.Start, Closed=False)

geo_2 = Geometry([dispatch_8.ListB, dispatch_9.ListA])
crv_7 = Curve(geo_2)
colom_3 = CollisionOneMany(Collider=crv_7, Obstacles=flatten(cir))  # -> Collision, Index
dispatch_13 = Dispatch(List=crv_7, DispatchPattern=colom_3.Collision)  # -> ListA, ListB
crv_8 = Curve(dispatch_13.ListB)
item_11 = ListItem(List=crv_8, Index=0, Wrap=True)
item_12 = ListItem(List=crv_8, Index=1, Wrap=True)
flip_4 = FlipCurve(Curve=item_12)  # -> Curve, Flag
len_9 = Length(Curve=item_11)
len_10 = Length(Curve=flip_4.Curve)
division_11 = Division(A=corner_to_reinforcing_end, B=len_9)
division_12 = Division(A=corner_to_reinforcing_end, B=len_10)
eval_9 = EvaluateLength(Curve=item_11, Length=division_11, Normalized=True)  # -> Point, Tangent, Parameter
eval_10 = EvaluateLength(Curve=flip_4.Curve, Length=division_12, Normalized=True)  # -> Point, Tangent, Parameter
cp_5 = ClosestPoint(Point=[eval_9.Point, eval_10.Point], Cloud=flatten(pt))  # -> ClosestPoint, CPIndex, Distance
points = PointList(Points=pt)
cullpt = CullDuplicates(Points=flatten(cp_5.ClosestPoint), Tolerance=0.1, CullMode=3)  # -> Points, Indices, Valence
crv_9 = Curve(curve)
crv_cp_5 = CurveClosestPoint(Point=cullpt.Points, Curve=crv_9)  # -> Point, Parameter, Distance
shatter_4 = Shatter(Curve=crv_9, Parameters=flatten(crv_cp_5.Parameter))
crv_10 = Curve(frame_ext)
crv_11 = Curve(frame_int)
dispatch_14 = Dispatch(List=shatter_4, DispatchPattern=[True, False])  # -> ListA, ListB
division_13 = Division(A=fin_depth, B=2)
crv_12 = Curve(dispatch_14.ListA)
xz_7 = XZPlane(Origin=Point(0, 0, 0))
neg_6 = Negative(Value=division_13)
offset_7 = Offset(Curve=crv_12, Distance=neg_6, Plane=xz_7, Corners=1)
offset_8 = Offset(Curve=crv_12, Distance=division_13, Plane=xz_7, Corners=1)
end_9 = EndPoints(Curve=[offset_8, offset_7])  # -> Start, End
pline_7 = PolyLine(Vertices=end_9.End, Closed=False)
pline_8 = PolyLine(Vertices=end_9.Start, Closed=False)
external_pts_2 = Geometry(merge)
_1st_floor_pts_2 = Geometry(_1st_floor_pts)
column_pts_2 = Geometry(column_pts)
item_13 = ListItem(List=crv_11, Index=0, Wrap=False)
item_14 = ListItem(List=crv_11, Index=2, Wrap=False)
item_15 = ListItem(List=crv_11, Index=1, Wrap=False)
item_16 = ListItem(List=crv_11, Index=3, Wrap=False)
connector_slot_geo = ClusterInput()
material_thickness = ClusterInput()
tab_slot_geo = ClusterInput()
corner_slot_geo = ClusterInput()
geo_3 = Geometry(connector_slot_geo)
peg_slot_locations = ClusterInput()
tolerance = ClusterInput()
area = Area(Geometry=geo_3)  # -> Area, Centroid
area_2 = Area(Geometry=tab_slot_geo)  # -> Area, Centroid
peg_cross_slots = PegCrossSlots(
    connectors=connector_slot_geo,
    corner_slots=corner_slot_geo,
    locations=peg_slot_locations,
    ply_thickness=material_thickness,
    tolerance=tolerance)  # -> _2d_geo, C
size_7 = Slider(2, range=0..100)
crv_13 = Curve(dispatch_13.ListB)
crv_14 = Curve(join_2)
join_5 = JoinCurves(Curves=flatten(crv_13), Preserve=False)
null_3 = NullItem(Item=crv_14)  # -> NullFlags, InvalidFlags, Description
dispatch_15 = Dispatch(List=join_5, DispatchPattern=null_3.NullFlags)  # -> ListA, ListB
ccx_3 = CurveCurve(CurveA=dispatch_15.ListB, CurveB=crv_14)  # -> Points, ParamsA, ParamsB
shatter_5 = Shatter(Curve=dispatch_15.ListB, Parameters=flatten(ccx_3.ParamsA))
dispatch_16 = Dispatch(List=shatter_5, DispatchPattern=[True, False])  # -> ListA, ListB
_300000 = Number(300000)
unit_type = ClusterInput()
number_slider = Slider(40, range=0..61)
unit_type_2 = Data(unit_type)
layers = CreateModifyLayers(LayerName="Reinforcers", DeleteLayer=False, enableFullPath=False)  # -> LayerNames, LayerFullPath
Y = UnitY(Factor=material_thickness)
xz_8 = XZPlane(Origin=Point(0, 0, 0))
xy = XYPlane(Origin=Point(0, 0, 0))

join_6 = JoinCurves(Curves=flatten(profile_ground_floor), Preserve=False)
crv_15 = Curve(profile_ground_floor)
item_17 = ListItem(List=crv_15, Index=1, Wrap=True)
item_18 = ListItem(List=crv_15, Index=0, Wrap=True)
flip_5 = FlipCurve(Curve=item_17)  # -> Curve, Flag
len_11 = Length(Curve=flip_5.Curve)
len_12 = Length(Curve=item_18)
division_14 = Division(A=corner_to_reinforcing_end, B=len_12)
division_15 = Division(A=corner_to_reinforcing_end, B=len_11)
eval_11 = EvaluateLength(Curve=item_18, Length=division_14, Normalized=True)  # -> Point, Tangent, Parameter
eval_12 = EvaluateLength(Curve=flip_5.Curve, Length=division_15, Normalized=True)  # -> Point, Tangent, Parameter
dispatch_17 = Dispatch(List=flatten(eval_11.Point), DispatchPattern=[True, False])  # -> ListA, ListB
dispatch_18 = Dispatch(List=flatten(eval_12.Point), DispatchPattern=[True, False])  # -> ListA, ListB
amp_5 = Amplitude(Vector=eval_11.Tangent, Amplitude=[dispatch.ListB, dispatch_2.ListA])
amp_6 = Amplitude(Vector=eval_12.Tangent, Amplitude=[dispatch.ListB, dispatch_2.ListA])
move_8 = Move(Geometry=dispatch_18.ListA, Motion=Vector(0, 0, 10))  # -> Geometry, Transform
move_9 = Move(Geometry=dispatch_17.ListB, Motion=Vector(0, 0, 10))  # -> Geometry, Transform
ln_4 = Line(StartPoint=dispatch_17.ListA, EndPoint=move_8.Geometry)
ln_5 = Line(StartPoint=dispatch_18.ListB, EndPoint=move_9.Geometry)
corner_to_reinforcing_end_6 = Slider(389, range=0..800)
cp_6 = ClosestPoint(Point=[dispatch_18.ListB, dispatch_17.ListA, move_8.Geometry, move_9.Geometry], Cloud=flatten(pt))  # -> ClosestPoint, CPIndex, Distance
larger_2 = LargerThan(FirstNumber=[ln_4, ln_5], SecondNumber=sheet_length)  # -> LargerThan, OrEqualTo
crv_cp_6 = CurveClosestPoint(Point=flatten(cp_6.ClosestPoint), Curve=join_6)  # -> Point, Parameter, Distance
dispatch_19 = Dispatch(List=[ln_4, ln_5], DispatchPattern=larger_2.LargerThan)  # -> ListA, ListB
eval_13 = EvaluateLength(Curve=dispatch_19.ListA, Length=0.5, Normalized=True)  # -> Point, Tangent, Parameter
amp_7 = Amplitude(Vector=eval_13.Tangent, Amplitude=corner_to_reinforcing_end_6)
rev_2 = Reverse(Vector=amp_7)
move_10 = Move(Geometry=eval_13.Point, Motion=rev_2)  # -> Geometry, Transform
move_11 = Move(Geometry=eval_13.Point, Motion=amp_7)  # -> Geometry, Transform
division_16 = Division(A=fin_depth, B=2)
cp_7 = ClosestPoint(Point=[move_11.Geometry, move_10.Geometry], Cloud=flatten(pt))  # -> ClosestPoint, CPIndex, Distance; disabled
xz_9 = XZPlane(Origin=Point(0, 0, 0))
neg_7 = Negative(Value=division_16)
crv_cp_7 = CurveClosestPoint(Point=cp_7.ClosestPoint, Curve=join_6)  # -> Point, Parameter, Distance
shatter_6 = Shatter(Curve=join_6, Parameters=flatten([crv_cp_6.Parameter, crv_cp_7.Parameter]))
dispatch_20 = Dispatch(List=shatter_6, DispatchPattern=[True, False])  # -> ListA, ListB
crv_16 = Curve(dispatch_20.ListA)
offset_9 = Offset(Curve=crv_16, Distance=neg_7, Plane=xz_9, Corners=1)
avr_3 = Average(Input=crv_cp_7.Point)

addition = Addition(A=division_16, B=gantry_base_offset)

offset_10 = Offset(Curve=crv_16, Distance=addition, Plane=xz_9, Corners=1)
end_10 = EndPoints(Curve=[offset_10, offset_9])  # -> Start, End
pline_9 = PolyLine(Vertices=end_10.End, Closed=False)
pline_10 = PolyLine(Vertices=end_10.Start, Closed=False)
lng_3 = ListLength(List=flatten(pline_9))
subtraction_6 = Subtraction(A=lng_3, B=1)
cull_i_5 = CullIndex(List=flatten(pline_9), Indices=subtraction_6, Wrap=True)
cull_i_6 = CullIndex(List=flatten(pline_10), Indices=0, Wrap=True)

crv_17 = Curve([cull_i_6, cull_i_5])
geo_4 = Geometry(flatten([pline_8, pline_7, pline_6, pline_5, geo, crv_17]))

xz_10 = XZPlane(Origin=flatten(avr_3))
xz_11 = XZPlane(Origin=flatten([disc.Points, pt_2, pt_3, avr_2, ccx.Points]))
addition_2 = Addition(A=fin_depth, B=50)
cir_3 = Circle(Plane=xz_10, Radius=fin_depth)
cir_4 = Circle(Plane=xz_11, Radius=addition_2)
geo_5 = Geometry([cir_4, cir_3])

crv_18 = Curve(geo_4)
crv_19 = Curve(geo_4)
new_edges = ClusterOutput(crv_19)
edges = ClusterOutput(crv_18)

item_19 = ListItem(List=crv_12, Index=0, Wrap=True)
cull_i_7 = CullIndex(List=crv_12, Indices=0, Wrap=True)
disc_2 = Discontinuity(Curve=item_19, Level=1)  # -> Points, Parameters
shatter_7 = Shatter(Curve=item_19, Parameters=disc_2.Parameters)
dispatch_21 = Dispatch(List=shatter_7, DispatchPattern=[True, False])  # -> ListA, ListB
geo_6 = Geometry(dispatch_21.ListA)
geo_7 = Geometry([crv_16, crv_4, crv_3, geo_6, cull_i_7])

colom_4 = CollisionOneMany(Collider=external_pts_2, Obstacles=geo_7)  # -> Collision, Index
colom_5 = CollisionOneMany(Collider=_1st_floor_pts_2, Obstacles=geo_7)  # -> Collision, Index
colom_6 = CollisionOneMany(Collider=column_pts_2, Obstacles=geo_7)  # -> Collision, Index
dispatch_22 = Dispatch(List=external_pts_2, DispatchPattern=colom_4.Collision)  # -> simplify(ListA), ListB
dispatch_23 = Dispatch(List=_1st_floor_pts_2, DispatchPattern=colom_5.Collision)  # -> simplify(ListA), ListB
dispatch_24 = Dispatch(List=column_pts_2, DispatchPattern=colom_6.Collision)  # -> simplify(ListA), ListB
external_pts_3 = Geometry(dispatch_22.ListA)
_1st_floor_pts_3 = Geometry(dispatch_23.ListA)
columnl_pts = Geometry(dispatch_24.ListA)
reinforcer_pts_column = ClusterOutput(columnl_pts)
reinforcer_pts_1st_floor = ClusterOutput(_1st_floor_pts_3)
reinforcer_pts_external = ClusterOutput(external_pts_3)

crv_20 = Curve(flatten(item_13))
ccx_4 = CurveCurve(CurveA=graft(geo_4), CurveB=flatten(crv_20))  # -> Points, ParamsA, ParamsB

cullpt_2 = CullDuplicates(Points=flatten(ccx_4.Points), Tolerance=0.1, CullMode=3)  # -> Points, Indices, Valence
item_20 = ListItem(List=flatten(ccx_4.ParamsB), Index=cullpt_2.Indices, Wrap=True)
crv_cp_8 = CurveClosestPoint(Point=cullpt_2.Points, Curve=crv_20)  # -> Point, Parameter, Distance

shatter_8 = Shatter(Curve=flatten(crv_20), Parameters=flatten(crv_cp_8.Parameter))
dispatch_25 = Dispatch(List=shatter_8, DispatchPattern=[True, False])  # -> ListA, ListB
crv_21 = Curve(dispatch_25.ListA)

crv_22 = Curve(dispatch_25.ListB)
join_7 = JoinCurves(Curves=crv_21, Preserve=False)
join_8 = JoinCurves(Curves=crv_22, Preserve=False)
colom_7 = CollisionOneMany(Collider=join_8, Obstacles=geo_5)  # -> Collision, Index
colom_8 = CollisionOneMany(Collider=join_7, Obstacles=geo_5)  # -> Collision, Index
dispatch_26 = Dispatch(List=join_7, DispatchPattern=colom_8.Collision)  # -> ListA, ListB
dispatch_27 = Dispatch(List=join_8, DispatchPattern=colom_7.Collision)  # -> ListA, ListB

crv_23 = Curve(flatten(item_15))
ccx_5 = CurveCurve(CurveA=graft(geo_4), CurveB=flatten(crv_23))  # -> Points, ParamsA, ParamsB

cullpt_3 = CullDuplicates(Points=flatten(ccx_5.Points), Tolerance=0.1, CullMode=3)  # -> Points, Indices, Valence
item_21 = ListItem(List=flatten(ccx_5.ParamsB), Index=cullpt_3.Indices, Wrap=True)
crv_cp_9 = CurveClosestPoint(Point=cullpt_3.Points, Curve=crv_23)  # -> Point, Parameter, Distance

crv_24 = Curve(flatten(item_14))
ccx_6 = CurveCurve(CurveA=graft(geo_4), CurveB=flatten(crv_24))  # -> Points, ParamsA, ParamsB

cullpt_4 = CullDuplicates(Points=flatten(ccx_6.Points), Tolerance=0.1, CullMode=3)  # -> Points, Indices, Valence
item_22 = ListItem(List=flatten(ccx_6.ParamsB), Index=cullpt_4.Indices, Wrap=True)
crv_cp_10 = CurveClosestPoint(Point=cullpt_4.Points, Curve=crv_24)  # -> Point, Parameter, Distance

shatter_9 = Shatter(Curve=flatten(crv_24), Parameters=flatten(crv_cp_10.Parameter))
dispatch_28 = Dispatch(List=shatter_9, DispatchPattern=[True, False])  # -> ListA, ListB
crv_25 = Curve(dispatch_28.ListA)

crv_26 = Curve(flatten(crv_10))
ccx_7 = CurveCurve(CurveA=graft(geo_4), CurveB=flatten(crv_26))  # -> Points, ParamsA, ParamsB

cullpt_5 = CullDuplicates(Points=flatten(ccx_7.Points), Tolerance=0.1, CullMode=3)  # -> Points, Indices, Valence
item_23 = ListItem(List=flatten(ccx_7.ParamsB), Index=cullpt_5.Indices, Wrap=True)
crv_cp_11 = CurveClosestPoint(Point=cullpt_5.Points, Curve=crv_26)  # -> Point, Parameter, Distance

shatter_10 = Shatter(Curve=flatten(crv_26), Parameters=flatten(crv_cp_11.Parameter))
dispatch_29 = Dispatch(List=shatter_10, DispatchPattern=[True, False])  # -> ListA, ListB
crv_27 = Curve(dispatch_29.ListA)

crv_28 = Curve(dispatch_29.ListB)
join_9 = JoinCurves(Curves=crv_27, Preserve=False)
join_10 = JoinCurves(Curves=crv_28, Preserve=False)
colom_9 = CollisionOneMany(Collider=join_10, Obstacles=geo_5)  # -> Collision, Index
colom_10 = CollisionOneMany(Collider=join_9, Obstacles=geo_5)  # -> Collision, Index
dispatch_30 = Dispatch(List=join_9, DispatchPattern=colom_10.Collision)  # -> ListA, ListB
dispatch_31 = Dispatch(List=join_10, DispatchPattern=colom_9.Collision)  # -> ListA, ListB

crv_29 = Curve(flatten(item_16))
ccx_8 = CurveCurve(CurveA=graft(geo_4), CurveB=flatten(crv_29))  # -> Points, ParamsA, ParamsB

cullpt_6 = CullDuplicates(Points=flatten(ccx_8.Points), Tolerance=0.1, CullMode=3)  # -> Points, Indices, Valence
item_24 = ListItem(List=flatten(ccx_8.ParamsB), Index=cullpt_6.Indices, Wrap=True)
crv_cp_12 = CurveClosestPoint(Point=cullpt_6.Points, Curve=crv_29)  # -> Point, Parameter, Distance

shatter_11 = Shatter(Curve=flatten(crv_29), Parameters=flatten(crv_cp_12.Parameter))
dispatch_32 = Dispatch(List=shatter_11, DispatchPattern=[True, False])  # -> ListA, ListB
crv_30 = Curve(dispatch_32.ListA)

shatter_12 = Shatter(Curve=flatten(crv_23), Parameters=flatten(crv_cp_9.Parameter))
dispatch_33 = Dispatch(List=shatter_12, DispatchPattern=[True, False])  # -> ListA, ListB

join_11 = JoinCurves(Curves=dispatch_33.ListA, Preserve=False)
join_12 = JoinCurves(Curves=dispatch_33.ListB, Preserve=False)

crv_31 = Curve([join_11, join_12])

colom_11 = CollisionOneMany(Collider=crv_31, Obstacles=geo_5)  # -> Collision, Index
dispatch_34 = Dispatch(List=crv_31, DispatchPattern=colom_11.Collision)  # -> ListA, ListB
join_13 = JoinCurves(
    Curves=flatten([geo_4, crv_25, crv_30, dispatch_31.ListA, dispatch_30.ListA, dispatch_26.ListA, dispatch_27.ListA, dispatch_34.ListA]),
    Preserve=False)
boundary = BoundarySurfaces(Edges=join_13)
wires = BrepWireframe(Brep=boundary, Density=-1)
join_14 = JoinCurves(Curves=flatten(wires), Preserve=False)
boundary_2 = BoundarySurfaces(Edges=join_14)
wires_2 = BrepWireframe(Brep=boundary_2, Density=-1)
join_15 = JoinCurves(Curves=flatten(wires_2), Preserve=False)
crv_32 = Curve(flatten(join_15))
incurve = PointInCurve(Point=area.Centroid, Curve=graft(crv_32))  # -> Relationship, Point
incurve_2 = PointInCurve(Point=area_2.Centroid, Curve=graft(crv_32))  # -> Relationship, Point
equals = Equality(FirstNumber=incurve.Relationship, SecondNumber=size_7)  # -> Equality, Inequality
equals_2 = Equality(FirstNumber=incurve_2.Relationship, SecondNumber=size_7)  # -> Equality, Inequality
dispatch_35 = Dispatch(List=geo_3, DispatchPattern=equals.Equality)  # -> ListA, ListB
dispatch_36 = Dispatch(List=tab_slot_geo, DispatchPattern=equals_2.Equality)  # -> ListA, ListB
geo_8 = Geometry(flatten([dispatch_36.ListA, crv_32, peg_cross_slots._2d_geo, dispatch_35.ListA]))
boundary_3 = BoundarySurfaces(Edges=geo_8)
_2d_profile = ClusterOutput(boundary_3)
geo_9 = Geometry(boundary_3)
colom_12 = CollisionOneMany(Collider=geo_9, Obstacles=flatten([dispatch_16.ListA, dispatch_15.ListA]))  # -> Collision, Index
dispatch_37 = Dispatch(List=geo_9, DispatchPattern=colom_12.Collision)  # -> ListA, ListB
geo_10 = Geometry(dispatch_37.ListA)
geo_11 = Geometry(dispatch_37.ListB)
colom_13 = CollisionOneMany(Collider=geo_11, Obstacles=flatten([dispatch_16.ListB, dispatch_15.ListA]))  # -> Collision, Index
dispatch_38 = Dispatch(List=geo_11, DispatchPattern=colom_13.Collision)  # -> ListA, ListB
geo_12 = Geometry(dispatch_38.ListB)
area_3 = Area(Geometry=geo_12)  # -> Area, Centroid
smaller = SmallerThan(FirstNumber=area_3.Area, SecondNumber=_300000)  # -> SmallerThan, OrEqualTo
dispatch_39 = Dispatch(List=geo_12, DispatchPattern=smaller.SmallerThan)  # -> ListA, ListB
geo_13 = Geometry(dispatch_38.ListA)
dispatch_40 = Dispatch(List=geo_10, DispatchPattern=[True, False, False, True])  # -> ListA, ListB
geo_14 = Geometry(dispatch_39.ListB)
geo_15 = Geometry(dispatch_39.ListA)
area_4 = Area(Geometry=geo_14)  # -> Area, Centroid
area_5 = Area(Geometry=geo_13)  # -> Area, Centroid
area_6 = Area(Geometry=dispatch_40.ListB)  # -> Area, Centroid
area_7 = Area(Geometry=dispatch_40.ListA)  # -> Area, Centroid
pdecon = Deconstruct(Point=area_4.Centroid)  # -> XComponent, YComponent, ZComponent
crv_cp_13 = CurveClosestPoint(Point=area_5.Centroid, Curve=crv_9)  # -> Point, Parameter, Distance
pdecon_2 = Deconstruct(Point=area_6.Centroid)  # -> XComponent, YComponent, ZComponent
pdecon_3 = Deconstruct(Point=area_5.Centroid)  # -> XComponent, YComponent, ZComponent
# LABELLING COMPONENTS
pdecon_4 = Deconstruct(Point=area_7.Centroid)  # -> XComponent, YComponent, ZComponent
sort = SortList(Keys=pdecon.ZComponent, ValuesA=geo_14)  # -> Keys, ValuesA
sort_2 = SortList(Keys=pdecon_3.ZComponent, ValuesA=geo_13)  # -> Keys, ValuesA
sort_3 = SortList(Keys=pdecon_4.ZComponent, ValuesA=dispatch_40.ListA)  # -> Keys, ValuesA
sort_4 = SortList(Keys=pdecon_2.ZComponent, ValuesA=dispatch_40.ListB)  # -> Keys, ValuesA
area_8 = Area(Geometry=sort.ValuesA)  # -> Area, Centroid
boxprop = BoxProperties(Box=graft(geo_15))  # -> Center, Diagonal, Area, Volume, Degeneracy
area_9 = Area(Geometry=sort_2.ValuesA)  # -> Area, Centroid
boxprop_2 = BoxProperties(Box=sort_3.ValuesA)  # -> Center, Diagonal, Area, Volume, Degeneracy
boxprop_3 = BoxProperties(Box=sort_4.ValuesA)  # -> Center, Diagonal, Area, Volume, Degeneracy
lng_4 = ListLength(List=area_9.Centroid)
wires_3 = BrepWireframe(Brep=sort.ValuesA, Density=-1)
lng_5 = ListLength(List=area_8.Centroid)
wires_4 = BrepWireframe(Brep=sort_2.ValuesA, Density=-1)
lng_6 = ListLength(List=boxprop.Center)
wires_5 = BrepWireframe(Brep=[sort_3.ValuesA, sort_4.ValuesA], Density=-1)
lng_7 = ListLength(List=boxprop_2.Center)
lng_8 = ListLength(List=boxprop_3.Center)
addition_3 = Addition(A=lng_8, B=lng_4)
addition_4 = Addition(A=addition_3, B=lng_5)
addition_5 = Addition(A=addition_4, B=lng_6)
dom = ConstructDomain(DomainStart=addition_3, DomainEnd=addition_4)
dom_2 = ConstructDomain(DomainStart=lng_8, DomainEnd=addition_3)
incurves = PointInCurves(Point=point_locations, Curves=join_15)  # -> Relationship, Index, Point
dom_3 = ConstructDomain(DomainStart=0, DomainEnd=lng_7)
dom_4 = ConstructDomain(DomainStart=addition_3, DomainEnd=addition_5)
dom_5 = ConstructDomain(DomainStart=0, DomainEnd=lng_8)
incurves_2 = PointInCurves(Point=point_locations, Curves=join_15)  # -> Relationship, Index, Point
incurves_3 = PointInCurves(Point=point_locations, Curves=join_15)  # -> Relationship, Index, Point
join_16 = JoinCurves(Curves=wires_3, Preserve=False)
range = Range(Domain=dom, Steps=lng_5)
range_2 = Range(Domain=dom_2, Steps=lng_4)
range_3 = Range(Domain=dom_3, Steps=lng_7)
range_4 = Range(Domain=dom_4, Steps=lng_6)
range_5 = Range(Domain=dom_5, Steps=lng_8)
len_13 = Length(Curve=join_16)
int = Integer(range)
int_2 = Integer(range_2)
int_3 = Integer(range_4)
int_4 = Integer(range_3)
cull_i_8 = CullIndex(List=int, Indices=0, Wrap=True)
int_5 = Integer(range_5)
cull_i_9 = CullIndex(List=int_2, Indices=0, Wrap=True)
group = Group(Objects=join_16)
larger_3 = LargerThan(FirstNumber=len_13, SecondNumber="1000")  # -> LargerThan, OrEqualTo
null_4 = NullItem(Item=sort_2.ValuesA)  # -> NullFlags, InvalidFlags, Description
null_5 = NullItem(Item=sort.ValuesA)  # -> NullFlags, InvalidFlags, Description
cull_i_10 = CullIndex(List=int_3, Indices=0, Wrap=True)
concat = Concatenate(FragmentA="R", FragmentB=cull_i_8)
cull_i_11 = CullIndex(List=int_4, Indices=0, Wrap=True)
concat_2 = Concatenate(FragmentA="R", FragmentB=cull_i_9)
cull_i_12 = CullIndex(List=int_5, Indices=0, Wrap=True)
concat_3 = Concatenate(FragmentA="R", FragmentB=cull_i_11)
concat_4 = Concatenate(FragmentA="R", FragmentB=cull_i_12)
cps_2 = ClosestPoints(Point=area_8.Centroid, Cloud=flatten(incurves_2.Point), Count=1)  # -> flatten(ClosestPoint), CPIndex, Distance
dispatch_41 = Dispatch(List=join_16, DispatchPattern=larger_3.LargerThan)  # -> ListA, ListB
cps_3 = ClosestPoints(Point=area_9.Centroid, Cloud=flatten(incurves_3.Point), Count=1)  # -> flatten(ClosestPoint), CPIndex, Distance
cps_4 = ClosestPoints(Point=boxprop_2.Center, Cloud=flatten(incurves.Point), Count=1)  # -> flatten(ClosestPoint), CPIndex, Distance
tag = TextTag(Location=area_8.Centroid, Text=concat)
tag_2 = TextTag(Location=area_9.Centroid, Text=concat_2)
cps_5 = ClosestPoints(Point=boxprop_3.Center, Cloud=flatten(incurves.Point), Count=1)  # -> flatten(ClosestPoint), CPIndex, Distance
concat_5 = Concatenate(FragmentA="R", FragmentB=cull_i_10)  # -> flatten(Result)
cps_6 = ClosestPoints(Point=boxprop.Center, Cloud=flatten(incurves_2.Point), Count=1)  # -> flatten(ClosestPoint), CPIndex, Distance
dispatch_42 = Dispatch(List=concat, DispatchPattern=null_5.NullFlags)  # -> ListA, ListB
tag_3 = TextTag(Location=boxprop_2.Center, Text=concat_3)
dispatch_43 = Dispatch(List=concat_2, DispatchPattern=null_4.NullFlags)  # -> ListA, ListB
tag_4 = TextTag(Location=boxprop_3.Center, Text=concat_4)
incurves_4 = PointInCurves(Point=cps_2.ClosestPoint, Curves=dispatch_41.ListA)  # -> Relationship, Index, Point
tag_5 = TextTag(Location=boxprop.Center, Text=concat_5)
column_reinforcers = Geometry(sort.ValuesA)
xz_12 = XZPlane(Origin=incurves_4.Point)
outer_reinforcers = Geometry([sort_3.ValuesA, sort_4.ValuesA, sort_2.ValuesA])
xz_13 = XZPlane(Origin=cps_6.ClosestPoint)
xz_14 = XZPlane(Origin=[cps_4.ClosestPoint, cps_5.ClosestPoint, cps_3.ClosestPoint])
column_reinforcers_2 = Geometry(geo_15)
labelling = Labelling_2(unit_type=unit_type_2, wall_label="/ FRM / ", part_label=concat_5, locations=xz_13, text_size=number_slider)
labelling_2 = Labelling_2(unit_type=unit_type_2, wall_label="/ FRM / ", part_label=dispatch_42.ListB, locations=xz_12, text_size=number_slider)
labelling_3 = Labelling_2(
    unit_type=unit_type_2,
    wall_label="/ FRM / ",
    part_label=[concat_3, concat_4, dispatch_43.ListB],
    locations=xz_14,
    text_size=number_slider)
entwine = Entwine(Branch00=outer_reinforcers, Branch01=column_reinforcers, Branch02=column_reinforcers_2, FlattenInputs=True)
entwine_2 = Entwine(Branch00=labelling_3, Branch01=labelling_2, Branch02=labelling, FlattenInputs=True)
clean = CleanTree(RemoveNulls=True, RemoveInvalid=True, RemoveEmpty=True, Tree=entwine_2)  # -> flatten(Tree)
clean_2 = CleanTree(RemoveNulls=True, RemoveInvalid=True, RemoveEmpty=True, Tree=entwine)  # -> flatten(Tree)
wires_6 = BrepWireframe(Brep=column_reinforcers, Density=-1)
data = Data(simplify(clean))
data_2 = Data(simplify(graft(labelling_2)))
data_3 = Data(simplify(graft(labelling)))
data_4 = Data(simplify(graft(labelling_3)))
wires_7 = BrepWireframe(Brep=outer_reinforcers, Density=-1)
join_17 = JoinCurves(Curves=wires_6, Preserve=False)
wires_8 = BrepWireframe(Brep=column_reinforcers_2, Density=-1)
txt = Text(data)
join_18 = JoinCurves(Curves=wires_7, Preserve=False)  # -> simplify(Curves)
split_2 = TextSplit(Text=txt, Separators=":")
join_19 = JoinCurves(Curves=wires_8, Preserve=False)
item_25 = ListItem(List=split_2, Index=1, Wrap=True)  # -> simplify(Item)
merge_3 = Merge(Data1=data_4, Data2=join_18)
merge_4 = Merge(Data1=data_2, Data2=join_17)
merge_5 = Merge(Data1=data_3, Data2=join_19)
createatts = CreateAttributes(Name=item_25, LayerName=layers.LayerNames, enableFullPath=False)
group_2 = Group(Objects=merge_3)  # -> simplify(Group)
group_3 = Group(Objects=merge_4)
group_4 = Group(Objects=merge_5)
data_5 = Data(flatten(createatts))
geo_16 = Geometry(simplify(flatten(clean_2)))
merge_6 = Merge(Data1=group_2, Data2=group_3, Data3=group_4)
extr = Extrude(Base=geo_16, Direction=Y)
bake = BakeGeometry(Bake=Toggle(False), Geometry=geo_16, Attributes=data_5)
orient = Orient(Geometry=merge_6, Source=xz_8, Target=xy)  # -> flatten(Geometry), Transform
attributes = ClusterOutput(data_5)
E = ClusterOutput(extr)
_2d_geo = ClusterOutput(orient.Geometry)

# ==== cluster WRENSpaceInvader2: Space Invader component located between spacers in WikiHouse v4.2 frame structure
invader_slot_length = ClusterInput()
material_thickness = ClusterInput()
fin_depth = ClusterInput()
beam_width = ClusterInput()
chamfer = Slider(30, range=0..41)
multiplication = Multiplication(A=material_thickness, B=2)
subtraction = Subtraction(A=beam_width, B=multiplication)
division = Division(A=subtraction, B=2)
spacer_slot_length = ClusterInput()
Y = UnitY(Factor=material_thickness)
panel = Panel(spacer_slot_length)
subtraction_2 = Subtraction(A=spacer_slot_length, B=material_thickness)
division_2 = Division(A=fin_depth, B=2)
division_3 = Division(A=material_thickness, B=2)
subtraction_3 = Subtraction(A=division_2, B=material_thickness)
addition = Addition(A=subtraction_3, B=division_3)
Y_2 = UnitY(Factor=addition)
Y_3 = UnitY(Factor=subtraction_3)
xz = XZPlane(Origin=Point(0, 0, 0))
subtraction_4 = Subtraction(A=division, B=material_thickness)
X = UnitX(Factor=subtraction_4)
xz_2 = XZPlane(Origin=Point(0, 0, 0))
X_2 = UnitX(Factor=material_thickness)
xz_3 = XZPlane(Origin=Point(0, 0, 0))
Z = UnitZ(Factor=material_thickness)
division_4 = Division(A=Z, B=-2)

pt = ConstructPoint(XCoordinate=0, YCoordinate=0, ZCoordinate=0)
dog_bone_pocket = DogBonePocket(point=pt)  # -> pt_5, tool_size_2
division_5 = Division(A=invader_slot_length, B=2)
chamfer_2 = Slider(3, range=0..11)
Y_4 = UnitY(Factor=division_5)
move = Move(Geometry=dog_bone_pocket.pt_5, Motion=Y_4)  # -> Geometry, Transform
move_2 = Move(Geometry=pt, Motion=Y_4)  # -> Geometry, Transform
multiplication_2 = Multiplication(A=chamfer_2, B=-1)
X_3 = UnitX(Factor=material_thickness)
X_4 = UnitX(Factor=multiplication_2)
Y_5 = UnitY(Factor=multiplication_2)
move_3 = Move(Geometry=pt, Motion=X_3)  # -> Geometry, Transform
move_4 = Move(Geometry=move_2.Geometry, Motion=X_3)  # -> Geometry, Transform
move_5 = Move(Geometry=move_4.Geometry, Motion=X_4)  # -> Geometry, Transform
move_6 = Move(Geometry=move_4.Geometry, Motion=Y_5)  # -> Geometry, Transform
xz_4 = XZPlane(Origin=Point(0, 0, 0))

Y_6 = UnitY(Factor=multiplication_2)
X_5 = UnitX(Factor=multiplication_2)
rev = ReverseList(List=move.Geometry)
merge = Merge(Data1=rev, Data2=move_5.Geometry, Data3=move_6.Geometry, Data4=move_3.Geometry)
pt_2 = Point(flatten(merge))

pline = PolyLine(Vertices=pt_2, Closed=False)
mirror = Mirror(Geometry=pline, Plane=xz_4)  # -> Geometry, Transform
join = JoinCurves(Curves=[pline, mirror.Geometry], Preserve=False)

move_7 = Move(Geometry=pt, Motion=Y_3)  # -> Geometry, Transform
move_8 = Move(Geometry=join, Motion=X)  # -> Geometry, Transform
mirror_2 = Mirror(Geometry=move_7.Geometry, Plane=xz)  # -> Geometry, Transform
move_9 = Move(Geometry=move_7.Geometry, Motion=X)  # -> Geometry, Transform
end = EndPoints(Curve=move_8.Geometry)  # -> Start, End
move_10 = Move(Geometry=mirror_2.Geometry, Motion=X)  # -> Geometry, Transform
ln = Line(StartPoint=move_9.Geometry, EndPoint=end.Start)
ln_2 = Line(StartPoint=end.End, EndPoint=move_10.Geometry)
join_2 = JoinCurves(Curves=flatten([ln, ln_2, move_8.Geometry]), Preserve=False)
geo = Geometry(join_2)
mirror_3 = Mirror(Geometry=join_2, Plane=PlaneYZ(0, 0, 0))  # -> Geometry, Transform
move_11 = Move(Geometry=geo, Motion=X_2)  # -> Geometry, Transform
end_2 = EndPoints(Curve=move_11.Geometry)  # -> Start, End
mirror_4 = Mirror(Geometry=move_11.Geometry, Plane=PlaneYZ(0, 0, 0))  # -> Geometry, Transform
end_3 = EndPoints(Curve=mirror_4.Geometry)  # -> Start, End
end_4 = EndPoints(Curve=join_2)  # -> Start, End
end_5 = EndPoints(Curve=mirror_3.Geometry)  # -> Start, End
ln_3 = Line(StartPoint=end_4.Start, EndPoint=end_5.Start)
ln_4 = Line(StartPoint=end_4.End, EndPoint=end_5.End)
merge_2 = Merge(Data1=ln_3, Data2=join_2, Data3=mirror_3.Geometry, Data4=ln_4)
rotate = Rotate(Geometry=merge_2, Angle=1.570796327, Plane=PlaneXY(0, 0, 0))  # -> Geometry, Transform
boundary = BoundarySurfaces(Edges=rotate.Geometry)
extr = Extrude(Base=boundary, Direction=Z)
move_12 = Move(Geometry=extr, Motion=division_4)  # -> Geometry, Transform
plug_2d_geo = ClusterOutput(rotate.Geometry)
space_invader_plug_3d = ClusterOutput(move_12.Geometry)

pt_3 = ConstructPoint(XCoordinate=0, YCoordinate=0, ZCoordinate=0)
dog_bone_pocket_2 = DogBonePocket(point=pt_3)  # -> pt_5, tool_size_2
division_6 = Division(A=chamfer, B=2)
chamfer_3 = Slider(3, range=0..11)
Y_7 = UnitY(Factor=division_6)
move_13 = Move(Geometry=dog_bone_pocket_2.pt_5, Motion=Y_7)  # -> Geometry, Transform
move_14 = Move(Geometry=pt_3, Motion=Y_7)  # -> Geometry, Transform
multiplication_3 = Multiplication(A=chamfer_3, B=-1)
X_6 = UnitX(Factor=material_thickness)
X_7 = UnitX(Factor=multiplication_3)
Y_8 = UnitY(Factor=multiplication_3)
move_15 = Move(Geometry=pt_3, Motion=X_6)  # -> Geometry, Transform
move_16 = Move(Geometry=move_14.Geometry, Motion=X_6)  # -> Geometry, Transform
move_17 = Move(Geometry=move_16.Geometry, Motion=X_7)  # -> Geometry, Transform
move_18 = Move(Geometry=move_16.Geometry, Motion=Y_8)  # -> Geometry, Transform
xz_5 = XZPlane(Origin=Point(0, 0, 0))

rev_2 = ReverseList(List=move_13.Geometry)
merge_3 = Merge(Data1=rev_2, Data2=move_17.Geometry, Data3=move_18.Geometry, Data4=move_15.Geometry)
pt_4 = Point(flatten(merge_3))

pline_2 = PolyLine(Vertices=pt_4, Closed=False)
mirror_5 = Mirror(Geometry=pline_2, Plane=xz_5)  # -> Geometry, Transform
join_3 = JoinCurves(Curves=[pline_2, mirror_5.Geometry], Preserve=False)

rotate_2 = Rotate(Geometry=join_3, Angle=1.570796327, Plane=PlaneXY(0, 0, 0))  # -> Geometry, Transform
move_19 = Move(Geometry=rotate_2.Geometry, Motion=Y_3)  # -> Geometry, Transform
mirror_6 = Mirror(Geometry=move_19.Geometry, Plane=xz_2)  # -> Geometry, Transform
end_6 = EndPoints(Curve=mirror_6.Geometry)  # -> Start, End
ln_5 = Line(StartPoint=end_3.End, EndPoint=end_6.Start)
ln_6 = Line(StartPoint=end_2.End, EndPoint=end_6.End)
merge_4 = Merge(Data1=ln_5, Data2=mirror_6.Geometry, Data3=ln_6)
join_4 = JoinCurves(Curves=flatten(merge_4), Preserve=False)
mirror_7 = Mirror(Geometry=join_4, Plane=xz_3)  # -> Geometry, Transform
merge_5 = Merge(Data1=join_4, Data2=move_11.Geometry, Data3=mirror_7.Geometry, Data4=mirror_4.Geometry)
join_5 = JoinCurves(Curves=flatten(merge_5), Preserve=False)
rotate_3 = Rotate(Geometry=join_5, Angle=1.570796327, Plane=PlaneXY(0, 0, 0))  # -> Geometry, Transform
boundary_2 = BoundarySurfaces(Edges=rotate_3.Geometry)
area = Area(Geometry=rotate_3.Geometry)  # -> Area, Centroid
extr_2 = Extrude(Base=boundary_2, Direction=Z)
move_20 = Move(Geometry=extr_2, Motion=division_4)  # -> Geometry, Transform
centre_point = ClusterOutput(area.Centroid)
si_2d_geo = ClusterOutput(rotate_3.Geometry)
_3d_geo = ClusterOutput(move_20.Geometry)

division_7 = Division(A=material_thickness, B=2)
Y_9 = UnitY(Factor=division_7)
move_21 = Move(Geometry=pt, Motion=Y_9)  # -> Geometry, Transform
move_22 = Move(Geometry=dog_bone_pocket.pt_5, Motion=Y_9)  # -> Geometry, Transform
X_8 = UnitX(Factor=material_thickness)
move_23 = Move(Geometry=pt, Motion=X_8)  # -> Geometry, Transform
move_24 = Move(Geometry=move_21.Geometry, Motion=X_8)  # -> Geometry, Transform
xz_6 = XZPlane(Origin=Point(0, 0, 0))

move_25 = Move(Geometry=move_21.Geometry, Motion=Y)  # -> Geometry, Transform
move_26 = Move(Geometry=move_24.Geometry, Motion=X_5)  # -> Geometry, Transform
move_27 = Move(Geometry=move_24.Geometry, Motion=Y_6)  # -> Geometry, Transform
merge_6 = Merge(Data1=move_23.Geometry, Data2=move_27.Geometry, Data3=move_26.Geometry, Data4=move_22.Geometry, Data5=move_25.Geometry)  # -> flatten(Result)

pline_3 = PolyLine(Vertices=merge_6, Closed=False)
mirror_8 = Mirror(Geometry=pline_3, Plane=xz_6)  # -> Geometry, Transform
join_6 = JoinCurves(Curves=[pline_3, mirror_8.Geometry], Preserve=False)

move_28 = Move(Geometry=join_6, Motion=Y_2)  # -> Geometry, Transform
mirror_9 = Mirror(Geometry=move_28.Geometry, Plane=xz)  # -> Geometry, Transform

# ==== cluster WRENLabellingForNesting
profile_curve = ClusterInput()
_2d_frame_geo = ClusterInput()
_2nd_storey = ClusterInput()
possible_points = ClusterInput()
f_curves = ClusterInput()
_1st_floor_profile = ClusterInput()
name_tag = ClusterInput()
geo = Geometry(_1st_floor_profile)
geo_2 = Geometry(profile_curve)
pt = ConstructPoint(XCoordinate=0, YCoordinate=0, ZCoordinate=0)
end = EndPoints(Curve=geo)  # -> Start, End
disc = Discontinuity(Curve=geo_2, Level=1)  # -> Points, Parameters
boundary = BoundarySurfaces(Edges=flatten(_2d_frame_geo))
rec_3pt = Rectangle3Pt(PointA=end.Start, PointB=end.End, PointC=pt)  # -> Rectangle, Length
cull_i = CullIndex(List=disc.Points, Indices=[0, 1], Wrap=True)
area = Area(Geometry=boundary)  # -> Area, Centroid
pline = PolyLine(Vertices=cull_i, Closed=False)
boundary_2 = BoundarySurfaces(Edges=rec_3pt.Rectangle)
disc_2 = Discontinuity(Curve=rec_3pt.Rectangle, Level=1)  # -> Points, Parameters
smaller = SmallerThan(FirstNumber=area.Area, SecondNumber=Slider(2030, range=0..11001))  # -> SmallerThan, OrEqualTo
rev = ReverseList(List=disc_2.Points)
dispatch = Dispatch(List=boundary, DispatchPattern=smaller.SmallerThan)  # -> ListA, ListB
pline_2 = PolyLine(Vertices=rev, Closed=True)
geo_3 = Geometry(dispatch.ListB)
crv = Curve(pline_2)
dispatch_2 = Dispatch(List=geo_3, DispatchPattern=_2nd_storey)  # -> ListA, ListB
colom = CollisionOneMany(Collider=dispatch_2.ListA, Obstacles=boundary_2)  # -> Collision, Index
dispatch_3 = Dispatch(List=dispatch_2.ListA, DispatchPattern=colom.Collision)  # -> ListA, ListB
geo_4 = Geometry(dispatch_3.ListA)
geo_5 = Geometry(dispatch_3.ListB)
geo_6 = Geometry(dispatch_2.ListB)
colom_2 = CollisionOneMany(Collider=geo_4, Obstacles=crv)  # -> Collision, Index
dispatch_4 = Dispatch(List=geo_4, DispatchPattern=colom_2.Collision)  # -> ListA, ListB
null = NullItem(Item=dispatch_2.ListA)  # -> NullFlags, InvalidFlags, Description
area_2 = Area(Geometry=[dispatch_4.ListA, geo_6])  # -> Area, Centroid
dispatch_5 = Dispatch(List=area_2.Centroid, DispatchPattern=null.NullFlags)  # -> ListA, ListB
area_3 = Area(Geometry=geo_5)  # -> Area, Centroid
crv_cp = CurveClosestPoint(Point=area_3.Centroid, Curve=pline)  # -> Point, Parameter, Distance
crv_cp_2 = CurveClosestPoint(Point=dispatch_5.ListB, Curve=crv)  # -> Point, Parameter, Distance
crv_cp_3 = CurveClosestPoint(Point=dispatch_5.ListA, Curve=profile_curve)  # -> Point, Parameter, Distance
geo_7 = Geometry(dispatch_4.ListB)
sort = SortList(Keys=crv_cp.Parameter, ValuesA=geo_5)  # -> Keys, flatten(ValuesA)
sort_2 = SortList(Keys=[crv_cp_2.Parameter, crv_cp_3.Parameter], ValuesA=[dispatch_4.ListA, geo_6])  # -> Keys, ValuesA
boxprop = BoxProperties(Box=geo_7)  # -> Center, Diagonal, Area, Volume, Degeneracy
boxprop_2 = BoxProperties(Box=sort_2.ValuesA)  # -> flatten(Center), Diagonal, Area, Volume, Degeneracy
boxprop_3 = BoxProperties(Box=sort.ValuesA)  # -> Center, Diagonal, Area, Volume, Degeneracy
# ADD ATTRIBUTES & LABELS
lng = ListLength(List=boxprop.Center)
incurves = PointInCurves(Point=possible_points, Curves=f_curves)  # -> Relationship, Index, Point
lng_2 = ListLength(List=boxprop_2.Center)
addition = Addition(A=lng_2, B=lng)
lng_3 = ListLength(List=boxprop_3.Center)
dom = ConstructDomain(DomainStart=lng_2, DomainEnd=addition)
pt_2 = Point(incurves.Point)
dom_2 = ConstructDomain(DomainStart=0, DomainEnd=lng_2)
points = PointList(Points=boxprop_2.Center)
dom_3 = ConstructDomain(DomainStart=0, DomainEnd=lng_3)
range = Range(Domain=dom, Steps=lng)
range_2 = Range(Domain=dom_2, Steps=lng_2)
range_3 = Range(Domain=dom_3, Steps=lng_3)
int = Integer(range)
int_2 = Integer(range_2)
int_3 = Integer(range_3)
cull_i_2 = CullIndex(List=int, Indices=0, Wrap=True)
cull_i_3 = CullIndex(List=int_2, Indices=0, Wrap=True)
concat = Concatenate(FragmentA="/ F", FragmentB=cull_i_2)
concat_2 = Concatenate(FragmentA="/ F", FragmentB=cull_i_3)
cull_i_4 = CullIndex(List=int_3, Indices=0, Wrap=True)
concat_3 = Concatenate(FragmentA="/ F", FragmentB=cull_i_4)
cps = ClosestPoints(Point=[boxprop_2.Center, boxprop.Center], Cloud=flatten(incurves.Point), Count=1)  # -> flatten(ClosestPoint), CPIndex, Distance
null_2 = NullItem(Item=geo_7)  # -> NullFlags, InvalidFlags, Description
tag = TextTag(Location=boxprop.Center, Text=concat)
tag_2 = TextTag(Location=boxprop_2.Center, Text=concat_2)
cps_2 = ClosestPoints(Point=boxprop_3.Center, Cloud=flatten(incurves.Point), Count=1)  # -> flatten(ClosestPoint), CPIndex, Distance
tag_3 = TextTag(Location=boxprop_3.Center, Text=concat_3)
dispatch_6 = Dispatch(List=concat, DispatchPattern=null_2.NullFlags)  # -> ListA, ListB
points_2 = PointList(Points=boxprop_2.Center)
number_slider = Slider(40, range=0..61)
points_3 = PointList(Points=cps.ClosestPoint)
unit_type = ClusterInput()
unit_type_2 = Data(unit_type)
xz = XZPlane(Origin=cps_2.ClosestPoint)
xz_2 = XZPlane(Origin=cps.ClosestPoint)
frm_x = Geometry(flatten(geo_5))
labelling = Labelling_3(unit_type=unit_type_2, wall_label="/ FRM", part_label=concat_3, locations=xz, text_size=number_slider)  # -> flatten(G)
labelling_2 = Labelling_3(unit_type=unit_type_2, wall_label="/ FRM", part_label=concat_2, locations=xz_2, text_size=number_slider)  # -> flatten(G)
frm_a = Geometry(flatten([sort_2.ValuesA, geo_7]))
merge = Merge(Data1=labelling_2, Data2=labelling)
wires = BrepWireframe(Brep=frm_x, Density=-1)  # -> simplify(Wireframe)
data = Data(simplify(graft(labelling)))
data_2 = Data(simplify(graft(labelling_2)))
wires_2 = BrepWireframe(Brep=frm_a, Density=-1)  # -> simplify(Wireframe)
clean = CleanTree(RemoveNulls=True, RemoveInvalid=True, RemoveEmpty=False, Tree=merge)
join = JoinCurves(Curves=wires, Preserve=False)  # -> simplify(Curves)
join_2 = JoinCurves(Curves=wires_2, Preserve=False)  # -> simplify(Curves)
data_3 = Data(simplify(graft(clean)))
merge_2 = Merge(Data1=join, Data2=data)
merge_3 = Merge(Data1=join_2, Data2=data_2)
txt = Text(data_3)
clean_2 = CleanTree(RemoveNulls=True, RemoveInvalid=True, RemoveEmpty=True, Tree=merge_2)
split = TextSplit(Text=txt, Separators=":")
clean_3 = CleanTree(RemoveNulls=True, RemoveInvalid=True, RemoveEmpty=True, Tree=merge_3)
panel = Panel(join_2)
group = Group(Objects=clean_2)
item = ListItem(List=split, Index=1, Wrap=True)  # -> simplify(Item)
layers = CreateModifyLayers(LayerName="Frames", DeleteLayer=False, enableFullPath=False)  # -> LayerNames, LayerFullPath
group_2 = Group(Objects=clean_3)
createatts = CreateAttributes(Name=item, LayerName=layers.LayerNames, enableFullPath=False)
merge_4 = Merge(Data1=group_2, Data2=group)
a_f_components_geo = ClusterOutput(frm_a)
x_f_components_geo = ClusterOutput(frm_x)
yz = YZPlane(Origin=Point(0, 0, 0))
data_4 = Data(simplify(flatten(createatts)))
rotate = Rotate(Geometry=merge_4, Angle=degrees(-90), Plane=yz)  # -> flatten(Geometry), Transform
_2d_frame_geo_2 = ClusterOutput(rotate.Geometry)
attributes = ClusterOutput(data_4)

# ==== cluster ConnectorSlotFloor
ply_thickness = ClusterInput()
tolerance = ClusterInput()
slot_length = ClusterInput()
pt = ConstructPoint(XCoordinate=0, YCoordinate=0, ZCoordinate=0)
panel = Panel(ply_thickness)
dog_bone_pocket = DogBonePocket(point=pt)  # -> pt_5, tool_size_2
points = PointList(Points=dog_bone_pocket.pt_5)
slot_length_2 = Number(slot_length)

tab_width = Slider(80, range=25..301)
division = Division(A=tab_width, B=2)
Y = UnitY(Factor=division)
move = Move(Geometry=dog_bone_pocket.pt_5, Motion=Y)  # -> Geometry, Transform
move_2 = Move(Motion=Y)  # -> Geometry, Transform
X = UnitX(Factor=ply_thickness)
move_3 = Move(Geometry=move_2.Geometry, Motion=X)  # -> Geometry, Transform
move_4 = Move(Motion=X)  # -> Geometry, Transform
xz = XZPlane(Origin=Point(0, 0, 0))
pline = PolyLine(Vertices=[move_4.Geometry, move_3.Geometry, move.Geometry], Closed=False)
mirror = Mirror(Geometry=pline, Plane=xz)  # -> Geometry, Transform
join = JoinCurves(Curves=[pline, mirror.Geometry], Preserve=False)

pt_2 = ConstructPoint(XCoordinate=0, YCoordinate=0, ZCoordinate=0)

division_2 = Division(A=ply_thickness, B=2)
addition = Addition(A=division_2, B=tolerance)
multiplication = Multiplication(A=addition, B=-1)
division_3 = Division(A=slot_length_2, B=2)
pt_3 = ConstructPoint(XCoordinate=0, YCoordinate=0, ZCoordinate=0)
X_2 = UnitX(Factor=multiplication)
addition_2 = Addition(A=tolerance, B=division_3)
multiplication_2 = Multiplication(A=addition_2, B=-1)
Y_2 = UnitY(Factor=multiplication_2)
move_5 = Move(Geometry=dog_bone_pocket.pt_5, Motion=X_2)  # -> Geometry, Transform
move_6 = Move(Geometry=pt_3, Motion=X_2)  # -> Geometry, Transform
move_7 = Move(Geometry=move_5.Geometry, Motion=Y_2)  # -> Geometry, Transform
move_8 = Move(Geometry=pt_3, Motion=Y_2)  # -> Geometry, Transform
geo = Geometry(flatten([move_8.Geometry, move_7.Geometry, move_6.Geometry]))
pline_2 = PolyLine(Vertices=geo, Closed=False)
xz_2 = XZPlane(Origin=Point(0, 0, 0))
mirror_2 = Mirror(Geometry=pline_2, Plane=xz_2)  # -> Geometry, Transform
join_2 = JoinCurves(Curves=[pline_2, mirror_2.Geometry], Preserve=False)
mirror_3 = Mirror(Geometry=join_2, Plane=PlaneYZ(0, 0, 0))  # -> Geometry, Transform
join_3 = JoinCurves(Curves=[mirror_3.Geometry, join_2], Preserve=False)
cp = ControlPoints(Curve=join_3)  # -> Points, Weights, Knots
pline_3 = PolyLine(Vertices=cp.Points, Closed=True)

num = Number(slot_length_2)
slot_length_3 = ClusterOutput(num)
yz = YZPlane(Origin=Point(0, 0, 0))
rotate = Rotate(Geometry=pline_3, Angle=1.570796327, Plane=yz)  # -> Geometry, Transform
cpoly = ControlPolygon(Curve=flatten(rotate.Geometry))  # -> Polygon, Points
avr = Average(Input=flatten(cpoly.Points))
area = Area(Geometry=cpoly.Polygon)  # -> Area, Centroid
centre_pt = ClusterOutput(area.Centroid)
geometry = ClusterOutput(rotate.Geometry)

# ==== cluster DivideProfileIntoPoints
set_out_multiple = ClusterInput()
outer_curve = ClusterInput()
column = ClusterInput()
floor = ClusterInput()
crv = Curve(flatten(column))
crv_2 = Curve(flatten(floor))
num = Number(Slider(300, range=0..501))
geo = Geometry(outer_curve)
panel = Panel(num)
clean = CleanTree(RemoveNulls=True, RemoveInvalid=True, RemoveEmpty=False, Tree=crv_2)
disc = Discontinuity(Curve=outer_curve, Level=1)  # -> Points, Parameters
lng = ListLength(List=disc.Points)
subtraction = Subtraction(A=lng, B=1)
cull_i = CullIndex(List=disc.Points, Indices=[0, 1], Wrap=True)
item = ListItem(List=disc.Points, Index=2, Wrap=True)
item_2 = ListItem(List=disc.Points, Index=subtraction, Wrap=True)
item_3 = ListItem(List=disc.Points, Index=[0, 1], Wrap=True)
shatter = Shatter(Curve=outer_curve, Parameters=disc.Parameters)
pdecon = Deconstruct(Point=disc.Points)  # -> XComponent, YComponent, ZComponent
sort = SortList(Keys=pdecon.ZComponent, ValuesA=disc.Points)  # -> Keys, ValuesA
merge = Merge(Data1=item_3, Data2=item, Data3=item_2)  # -> flatten(Result)
# OUTER FRAME
merge_2 = Merge(Data1=cull_i)  # -> flatten(Result)
# CENTRAL COLUMN
crv_3 = Curve(crv)
# FIRST FLOOR
crv_4 = Curve(clean)
ccx = CurveCurve(CurveA=shatter, CurveB=crv_3)  # -> flatten(Points), flatten(ParamsA), ParamsB
corner_points = ClusterOutput(item_3)
lng_2 = ListLength(List=sort.ValuesA)
item_walls_roof = CullIndex(List=shatter, Indices=0, Wrap=True)
subtraction_2 = Subtraction(A=lng_2, B=1)
eval = EvaluateCurve(Curve=geo, Parameter=ccx.ParamsA)  # -> Point, Tangent, Angle
# GROUND FLOOR
item_floor = ListItem(List=shatter, Index=0, Wrap=True)
clean_2 = CleanTree(RemoveNulls=True, RemoveInvalid=True, RemoveEmpty=True, Tree=ccx.ParamsA)
Z = UnitZ(Factor=Slider(50, range=0..1001))
item_4 = ListItem(List=sort.ValuesA, Index=[2, 3], Wrap=True)
item_5 = ListItem(List=sort.ValuesA, Index=subtraction_2, Wrap=True)
item_6 = ListItem(List=sort.ValuesA, Index=[0, 1], Wrap=True)
null = NullItem(Item=flatten(clean_2))  # -> NullFlags, InvalidFlags, Description
panel_2 = Panel(eval.Point)
dispatch = Dispatch(List=clean_2, DispatchPattern=null.NullFlags)  # -> ListA, ListB
dispatch_2 = Dispatch(List=item_walls_roof, DispatchPattern=null.NullFlags)  # -> ListA, ListB
dispatch_3 = Dispatch(List=item_floor, DispatchPattern=null.NullFlags)  # -> ListA, ListB
dispatch_4 = Dispatch(List=clean_2, DispatchPattern=null.NullFlags)  # -> ListA, ListB
neg = Negative(Value=Z)
shatter_2 = Shatter(Curve=item_walls_roof, Parameters=flatten(dispatch.ListB))
cull_i_2 = CullIndex(List=ccx.ParamsA, Indices=0, Wrap=True)
move = Move(Motion=Z)  # -> Geometry, Transform
move_2 = Move(Motion=neg)  # -> Geometry, Transform
shatter_3 = Shatter(Curve=item_floor, Parameters=flatten(dispatch_4.ListB))
ccx_2 = CurveCurve(CurveA=crv_3, CurveB=crv_4)  # -> Points, ParamsA, ParamsB
ccx_3 = CurveCurve(CurveA=[shatter_2, dispatch_2.ListA], CurveB=crv_4)  # -> Points, ParamsA, ParamsB
null_2 = NullItem(Item=flatten(dispatch_2.ListA))  # -> NullFlags, InvalidFlags, Description
ccx_4 = CurveCurve(CurveA=outer_curve, CurveB=crv_4)  # -> Points, ParamsA, ParamsB
clean_3 = CleanTree(RemoveNulls=True, RemoveInvalid=True, RemoveEmpty=True, Tree=ccx_3.ParamsA)
shatter_4 = Shatter(Curve=crv_4, Parameters=ccx_2.ParamsB)  # -> flatten(Segments)
shatter_5 = Shatter(Curve=crv_3, Parameters=ccx_2.ParamsA)  # -> flatten(Segments)
dispatch_5 = Dispatch(List=shatter_2, DispatchPattern=null_2.NullFlags)  # -> ListA, ListB
number_slider = Slider(0, range=0..1001)
null_3 = NullItem(Item=flatten(clean_3))  # -> NullFlags, InvalidFlags, Description
eval_2 = EvaluateCurve(Curve=outer_curve, Parameter=[cull_i_2, ccx_4.ParamsA])  # -> Point, Tangent, Angle
# UNIFORM DIVISION OF
# SEGMENTS FROM CORNERS
null_4 = NullItem(Item=crv_4)  # -> NullFlags, InvalidFlags, Description
null_5 = NullItem(Item=shatter_4)  # -> NullFlags, InvalidFlags, Description
crv_5 = Curve(crv_3)
crv_6 = Curve(crv_4)
dispatch_6 = Dispatch(List=clean_3, DispatchPattern=null_3.NullFlags)  # -> ListA, ListB
dispatch_7 = Dispatch(List=crv_6, DispatchPattern=null_5.NullFlags)  # -> ListA, ListB
dispatch_8 = Dispatch(List=crv_5, DispatchPattern=null_4.NullFlags)  # -> ListA, ListB
shatter_6 = Shatter(Curve=[shatter_2, dispatch_2.ListA], Parameters=flatten(dispatch_6.ListB))
null_6 = NullItem(Item=flatten(shatter_6))  # -> NullFlags, InvalidFlags, Description
null_7 = NullItem(Item=flatten(shatter_6))  # -> NullFlags, InvalidFlags, Description
dispatch_9 = Dispatch(List=dispatch_2.ListA, DispatchPattern=null_6.NullFlags)  # -> ListA, ListB
dispatch_10 = Dispatch(List=dispatch_5.ListA, DispatchPattern=null_7.NullFlags)  # -> ListA, ListB
geo_2 = Geometry([shatter_6, dispatch_10.ListA, dispatch_9.ListA])
len = Length(Curve=geo_2)
subtraction_3 = Subtraction(A=len, B=number_slider)
eval_3 = EvaluateLength(Curve=geo_2, Length=subtraction_3, Normalized=False)  # -> Point, Tangent, Parameter
eval_4 = EvaluateLength(Curve=geo_2, Length=number_slider, Normalized=False)  # -> Point, Tangent, Parameter
eval_5 = EvaluateLength(Curve=[shatter_6, dispatch_9.ListA, dispatch_10.ListA], Length="0.5", Normalized=True)  # -> Point, Tangent, Parameter
eval_6 = EvaluateLength(Curve=[dispatch_3.ListA, shatter_3], Length="0.5", Normalized=True)  # -> Point, Tangent, Parameter
eval_7 = EvaluateLength(Curve=[shatter_4, dispatch_7.ListA], Length="0.5", Normalized=True)  # -> Point, Tangent, Parameter
eval_8 = EvaluateLength(Curve=[shatter_5, dispatch_8.ListA], Length="0.5", Normalized=True)  # -> Point, Tangent, Parameter
shatter_7 = Shatter(Curve=geo_2, Parameters=flatten([eval_4.Parameter, eval_3.Parameter]))
shatter_8 = Shatter(Curve=flatten([shatter_6, dispatch_9.ListA, dispatch_10.ListA]), Parameters=flatten(eval_5.Parameter))
ccx_5 = CurveCurve(CurveA=crv_4, CurveB=crv_3)  # -> Points, ParamsA, ParamsB
shatter_9 = Shatter(Curve=[dispatch_3.ListA, shatter_3], Parameters=flatten(eval_6.Parameter))
shatter_10 = Shatter(Curve=[shatter_4, dispatch_7.ListA], Parameters=flatten(eval_7.Parameter))
shatter_11 = Shatter(Curve=[shatter_5, dispatch_8.ListA], Parameters=flatten(eval_8.Parameter))
dispatch_11 = Dispatch(List=shatter_7, DispatchPattern=[True, False])  # -> ListA, ListB
profile_ext = ClusterOutput(shatter_8)
profile_grnd_floor = ClusterOutput(shatter_9)
pt = Point(flatten([ccx_4.Points, ccx_5.Points]))
geo_3 = Geometry(dispatch_11.ListA)
eval_9 = EvaluateLength(Curve=geo_3, Length="0.5", Normalized=True)  # -> Point, Tangent, Parameter
shatter_12 = Shatter(Curve=flatten(geo_3), Parameters=flatten(eval_9.Parameter))
item_7 = ListItem(List=shatter_12, Index=0, Wrap=True)
item_8 = ListItem(List=shatter_12, Index=1, Wrap=True)
item_9 = ListItem(List=shatter_9, Index=1, Wrap=True)
item_10 = ListItem(List=shatter_9, Index=0, Wrap=True)
flip = FlipCurve(Curve=item_8)  # -> Curve, Flag
item_11 = ListItem(List=shatter_10, Index=0, Wrap=True)
item_12 = ListItem(List=shatter_10, Index=1, Wrap=True)
item_13 = ListItem(List=shatter_11, Index=0, Wrap=True)
item_14 = ListItem(List=shatter_11, Index=1, Wrap=True)
flip_2 = FlipCurve(Curve=item_12)  # -> Curve, Flag
cullpt = CullDuplicates(Points=pt, Tolerance=0.1, CullMode=3)  # -> Points, Indices, Valence
flip_3 = FlipCurve(Curve=item_9)  # -> Curve, Flag
flip_4 = FlipCurve(Curve=item_14)  # -> Curve, Flag
divlength = DivideLength(Curve=item_7, Length=num)  # -> Points, Tangents, Parameters
divlength_2 = DivideLength(Curve=flip.Curve, Length=num)  # -> Points, Tangents, Parameters
divlength_3 = DivideLength(Curve=flip_3.Curve, Length=num)  # -> Points, Tangents, Parameters
divlength_4 = DivideLength(Curve=item_10, Length=num)  # -> Points, Tangents, Parameters
divlength_5 = DivideLength(Curve=flip_2.Curve, Length=num)  # -> Points, Tangents, Parameters
divlength_6 = DivideLength(Curve=item_11, Length=num)  # -> Points, Tangents, Parameters
intersection_pt = Point(flatten(merge_2))
divlength_7 = DivideLength(Curve=flip_4.Curve, Length=num)  # -> Points, Tangents, Parameters
divlength_8 = DivideLength(Curve=item_13, Length=num)  # -> Points, Tangents, Parameters
profile_column = ClusterOutput(shatter_11)
profile_2nd_floor = ClusterOutput(shatter_10)
second_floor_end_pts = ClusterOutput(cullpt.Points)
cull_i_3 = CullIndex(List=divlength.Points, Indices=0, Wrap=True)
cull_i_4 = CullIndex(List=divlength.Tangents, Indices=0, Wrap=True)
cull_i_5 = CullIndex(List=divlength_2.Points, Indices=0, Wrap=True)
cull_i_6 = CullIndex(List=divlength_2.Tangents, Indices=0, Wrap=True)
cull_i_7 = CullIndex(List=divlength_6.Tangents, Indices=0, Wrap=True)
cull_i_8 = CullIndex(List=divlength_5.Points, Indices=0, Wrap=True)
cull_i_9 = CullIndex(List=divlength_5.Tangents, Indices=0, Wrap=True)
cull_i_10 = CullIndex(List=divlength_8.Tangents, Indices=0, Wrap=True)
cull_i_11 = CullIndex(List=divlength_6.Points, Indices=0, Wrap=True)
cull_i_12 = CullIndex(List=divlength_7.Points, Indices=0, Wrap=True)
cull_i_13 = CullIndex(List=divlength_7.Tangents, Indices=0, Wrap=True)
cull_i_14 = CullIndex(List=divlength_4.Points, Indices=0, Wrap=True)
cull_i_15 = CullIndex(List=divlength_4.Tangents, Indices=0, Wrap=True)
cull_i_16 = CullIndex(List=divlength_3.Points, Indices=0, Wrap=True)
cull_i_17 = CullIndex(List=divlength_3.Tangents, Indices=0, Wrap=True)
cull_i_18 = CullIndex(List=divlength_8.Points, Indices=0, Wrap=True)
item_15 = ListItem(List=divlength.Points, Index=0, Wrap=True)
item_16 = ListItem(List=divlength.Tangents, Index=0, Wrap=True)
item_17 = ListItem(List=divlength_2.Points, Index=0, Wrap=True)
corner_tab_points = Point(flatten([item_15, item_17]))
colom = CollisionOneMany(Collider=corner_tab_points, Obstacles=intersection_pt)  # -> Collision, Index
item_18 = ListItem(List=divlength_2.Tangents, Index=0, Wrap=True)
rev = Reverse(Vector=item_18)
dispatch_12 = Dispatch(List=flatten([item_16, rev]), DispatchPattern=colom.Collision)  # -> ListA, ListB
dispatch_13 = Dispatch(List=corner_tab_points, DispatchPattern=colom.Collision)  # -> ListA, ListB
pt_2 = Point(flatten(divlength_7.Points))
cull = CullPattern(List=cull_i_14, CullPattern=[False, True])
cull_2 = CullPattern(List=cull_i_16, CullPattern=[False, True])
cull_3 = CullPattern(List=cull_i_17, CullPattern=[False, True])
cull_4 = CullPattern(List=cull_i_15, CullPattern=[False, True])
cull_5 = CullPattern(List=cull_i_11, CullPattern=[False, True])
cull_6 = CullPattern(List=cull_i_8, CullPattern=[False, True])
cull_7 = CullPattern(List=cull_i_9, CullPattern=[False, True])
cull_8 = CullPattern(List=cull_i_7, CullPattern=[False, True])
intersection_pt_2 = Point(flatten(merge))
corner_tab_vector = Vector(flatten(dispatch_12.ListB))
corner_tab_points_2 = Point(flatten(dispatch_13.ListB))
colom_2 = CollisionOneMany(Collider=pt_2, Obstacles=outer_curve)  # -> Collision, Index
tab_points = Point(flatten([cull_i_3, cull_i_5, eval_9.Point]))
# Reverse Corner Vector: For roofs with more than 1 roof point (ie internal gutter) this reverses the vectors on the internal corner points.
tab_vectors = Vector(flatten([cull_i_4, cull_i_6, eval_9.Tangent]))
cull_9 = CullPattern(List=cull_i_15, CullPattern=[True, False])
cull_10 = CullPattern(List=cull_i_16, CullPattern=[True, False])
cull_11 = CullPattern(List=cull_i_17, CullPattern=[True, False])
cull_12 = CullPattern(List=cull_i_14, CullPattern=[True, False])
cull_13 = CullPattern(List=cull_i_9, CullPattern=[True, False])
cull_14 = CullPattern(List=cull_i_7, CullPattern=[True, False])
cull_15 = CullPattern(List=cull_i_8, CullPattern=[True, False])
cull_16 = CullPattern(List=cull_i_11, CullPattern=[True, False])
dispatch_14 = Dispatch(List=pt_2, DispatchPattern=colom_2.Collision)  # -> ListA, ListB
cps = ClosestPoints(Point=item_4, Cloud=flatten([tab_points, corner_tab_points_2]), Count=1)  # -> ClosestPoint, CPIndex, Distance
item_19 = ListItem(List=flatten([tab_vectors, corner_tab_vector]), Index=cps.CPIndex, Wrap=True)
cps_2 = ClosestPoints(Point=item_5, Cloud=flatten(tab_points), Count=2)  # -> ClosestPoint, CPIndex, Distance
item_20 = ListItem(List=flatten(tab_vectors), Index=cps_2.CPIndex, Wrap=True)
colom_3 = CollisionOneMany(Collider=corner_tab_points_2, Obstacles=intersection_pt_2)  # -> Collision, Index
item_21 = ListItem(List=eval.Tangent, Index=0, Wrap=False)
cullpt_2 = CullDuplicates(Points=flatten([cull_12, cull_10]), Tolerance=5, CullMode=3)  # -> Points, Indices, Valence
item_22 = ListItem(List=eval.Point, Index=0, Wrap=False)
cullpt_3 = CullDuplicates(Points=flatten([cull_16, cull_15]), Tolerance=5, CullMode=3)  # -> Points, Indices, Valence
vec = Vector(flatten([cull_9, cull_11]))
item_23 = ListItem(List=dispatch_14.ListA, Index=0, Wrap=True)
cullpt_4 = CullDuplicates(Points=tab_points, Tolerance=0.1, CullMode=3)  # -> Points, Indices, Valence
item_24 = ListItem(List=tab_vectors, Index=cullpt_4.Indices, Wrap=True)
distance_from_junction = Slider(1, range=0..3)
distance_from_junction_2 = Slider(2, range=0..3)
dispatch_15 = Dispatch(List=corner_tab_points_2, DispatchPattern=colom_3.Collision)  # -> ListA, ListB
dispatch_16 = Dispatch(List=corner_tab_vector, DispatchPattern=colom_3.Collision)  # -> ListA, ListB
wall_connector_points = Point(flatten([item_6, ccx_4.Points]))
xz = XZPlane(Origin=cullpt_4.Points)
connector_vectors = Vector(flatten(item_19))
connector_points = Point(flatten(cps.ClosestPoint))
lng_3 = ListLength(List=corner_tab_points_2)
grnd_connector_points = Point(cullpt_2.Points)
_1st_connector_points = Point(cullpt_3.Points)
geo_4 = Geometry(dispatch_15.ListB)
geo_5 = Geometry(dispatch_15.ListA)
geo_6 = Geometry(dispatch_16.ListB)
geo_7 = Geometry(dispatch_16.ListA)
tab_vectors_grnd_floor = Vector(flatten([cull_i_15, cull_i_17, item_21]))
tab_points_grnd_floor = Point(flatten([cull_i_14, cull_i_16, item_22]))
tab_vec_intersect = Vector(flatten(eval_2.Tangent))
lng_4 = ListLength(List=[cull_i_5, cull_i_16])
tab_pt_intersect = Point(flatten(eval_2.Point))
cir = Circle(Plane=xz, Radius="149")
vdis = VectorDisplay(Anchor=cullpt_4.Points, Vector=item_24)
lng_5 = ListLength(List=[cull_i_3, cull_i_14])
tab_vectors_2 = Vector(flatten([cull_i_10, cull_i_13, eval_8.Tangent]))
tab_points_2 = Point(flatten([cull_i_18, cull_i_12, eval_8.Point]))
tab_points_3 = Point(flatten([cull_i_11, cull_i_8]))
tab_vectors_3 = Vector(flatten([cull_i_7, cull_i_9]))
equals = Equality(FirstNumber=lng_3, SecondNumber=10)  # -> Equality, Inequality
cull_17 = CullPattern(List=geo_6, CullPattern=[False, True])
cullpt_5 = CullDuplicates(Points=geo_4, Tolerance=0.1, CullMode=3)  # -> Points, Indices, Valence
subtraction_4 = Subtraction(A=lng_5, B=1)
addition = Addition(A=distance_from_junction_2, B=1)
colmm = CollisionManyMany(Colliders=cir)  # -> Collision, Indices
subtraction_5 = Subtraction(A=lng_4, B=1)
lng_6 = ListLength(List=cull_i_12)
lng_7 = ListLength(List=cull_i_18)
cullpt_6 = CullDuplicates(Points=tab_points_2, Tolerance=0.1, CullMode=3)  # -> Points, Indices, Valence
cullpt_7 = CullDuplicates(Points=tab_points_3, Tolerance=0.1, CullMode=3)  # -> Points, Indices, Valence
merge_3 = Merge(Data1=flatten(cull_17), Data2=flatten(geo_7))  # -> flatten(Result)
merge_4 = Merge(Data1=flatten(cullpt_5.Points), Data2=flatten(geo_5))  # -> flatten(Result)
item_25 = ListItem(List=[cull_i_3, cull_i_14], Index=subtraction_4, Wrap=True)
item_26 = ListItem(List=[cull_i_5, cull_i_16], Index=subtraction_5, Wrap=True)
dispatch_17 = Dispatch(List=item_24, DispatchPattern=colmm.Collision)  # -> ListA, ListB
dispatch_18 = Dispatch(List=cullpt_4.Points, DispatchPattern=colmm.Collision)  # -> ListA, ListB
item_27 = ListItem(List=cull_2, Index=distance_from_junction, Wrap=False)
item_28 = ListItem(List=cull_3, Index=distance_from_junction, Wrap=False)
item_29 = ListItem(List=cull, Index=distance_from_junction, Wrap=False)
item_30 = ListItem(List=cull_4, Index=distance_from_junction, Wrap=False)
item_31 = ListItem(List=cull_i_12, Index=distance_from_junction_2, Wrap=False)
item_32 = ListItem(List=cull_i_18, Index=distance_from_junction_2, Wrap=False)
item_33 = ListItem(List=cull_i_10, Index=distance_from_junction_2, Wrap=False)
item_34 = ListItem(List=cull_i_13, Index=distance_from_junction_2, Wrap=False)
item_35 = ListItem(List=cull_6, Index=distance_from_junction, Wrap=False)
item_36 = ListItem(List=cull_7, Index=distance_from_junction, Wrap=False)
item_37 = ListItem(List=divlength.Tangents, Index=addition, Wrap=False)
item_38 = ListItem(List=divlength_2.Tangents, Index=addition, Wrap=False)
item_39 = ListItem(List=cull_5, Index=distance_from_junction, Wrap=False)
item_40 = ListItem(List=cull_8, Index=distance_from_junction, Wrap=False)
item_41 = ListItem(List=divlength.Points, Index=addition, Wrap=False)
item_42 = ListItem(List=divlength_2.Points, Index=addition, Wrap=False)
subtraction_6 = Subtraction(A=lng_7, B=1)
subtraction_7 = Subtraction(A=lng_6, B=1)
cullpt_8 = CullDuplicates(Points=tab_points_grnd_floor, Tolerance=0.1, CullMode=3)  # -> Points, Indices, Valence
item_43 = ListItem(List=tab_vectors_grnd_floor, Index=cullpt_8.Indices, Wrap=True)
xz_2 = XZPlane(Origin=cullpt_6.Points)
ln = Line(StartPoint=item_25, EndPoint=item_26)
item_44 = ListItem(List=tab_vectors_3, Index=cullpt_7.Indices, Wrap=True)
geo_8 = Geometry(dispatch_18.ListA)
geo_9 = Geometry(dispatch_18.ListB)
geo_10 = Geometry(dispatch_17.ListB)
pdecon_2 = Deconstruct(Point=merge_4)  # -> XComponent, YComponent, ZComponent
item_45 = ListItem(List=cull_i_18, Index=subtraction_6, Wrap=True)
item_46 = ListItem(List=cull_i_12, Index=subtraction_7, Wrap=True)
len_2 = Length(Curve=ln)
panel_3 = Panel(merge_4)
cir_2 = Circle(Plane=xz_2, Radius="140")
vdis_2 = VectorDisplay(Anchor=merge_4, Vector=merge_3)
sort_2 = SortList(Keys=pdecon_2.ZComponent, ValuesA=merge_4)  # -> Keys, ValuesA
xz_3 = XZPlane(Origin=cullpt_8.Points)
sort_3 = SortList(Keys=pdecon_2.ZComponent, ValuesA=merge_3)  # -> Keys, ValuesA
larger = LargerThan(FirstNumber=len_2, SecondNumber="599")  # -> LargerThan, OrEqualTo
pgroups = PointGroups(Points=flatten(geo_8), Distance="290")  # -> Groups, Indices
ln_2 = Line(StartPoint=item_45, EndPoint=item_46)
colmm_2 = CollisionManyMany(Colliders=cir_2)  # -> Collision, Indices
len_3 = Length(Curve=ln_2)
lng_8 = ListLength(List=sort_2.ValuesA)
cir_3 = Circle(Plane=xz_3, Radius="149")
dispatch_19 = Dispatch(List=ln, DispatchPattern=larger.LargerThan)  # -> ListA, ListB
larger_2 = LargerThan(FirstNumber=len_3, SecondNumber="599")  # -> LargerThan, OrEqualTo
sort_pt = SortPoints(Points=pgroups.Groups)  # -> Points, Indices
dispatch_20 = Dispatch(List=tab_points_2, DispatchPattern=colmm_2.Collision)  # -> ListA, ListB
dispatch_21 = Dispatch(List=tab_vectors_2, DispatchPattern=colmm_2.Collision)  # -> ListA, ListB
subtraction_8 = Subtraction(A=lng_8, B=1)
colmm_3 = CollisionManyMany(Colliders=cir_3)  # -> Collision, Indices
geo_11 = Geometry(dispatch_20.ListA)
eval_10 = EvaluateLength(Curve=dispatch_19.ListA, Length=0.5, Normalized=True)  # -> Point, Tangent, Parameter
number_slider_2 = Slider(50, range=0..1001)
cull_i_19 = CullIndex(List=sort_pt.Points, Indices=1, Wrap=True)
dispatch_22 = Dispatch(List=ln_2, DispatchPattern=larger_2.LargerThan)  # -> ListA, ListB
cull_i_20 = CullIndex(List=sort_2.ValuesA, Indices=subtraction_8, Wrap=True)
cull_i_21 = CullIndex(List=sort_3.ValuesA, Indices=subtraction_8, Wrap=True)
sort_pt_2 = SortPoints(Points=geo_11)  # -> Points, Indices
dispatch_23 = Dispatch(List=cullpt_8.Points, DispatchPattern=colmm_3.Collision)  # -> ListA, ListB
dispatch_24 = Dispatch(List=item_43, DispatchPattern=colmm_3.Collision)  # -> ListA, ListB
cullpt_9 = CullDuplicates(Points=dispatch_20.ListB, Tolerance=0.1, CullMode=3)  # -> Points, Indices, Valence
item_47 = ListItem(List=dispatch_21.ListB, Index=cullpt_9.Indices, Wrap=True)
pline = PolyLine(Vertices=cull_i_19, Closed=False)
vdis_3 = VectorDisplay(Anchor=cull_i_20, Vector=cull_i_21)
len_4 = Length(Curve=pline)
eval_11 = EvaluateLength(Curve=dispatch_22.ListA, Length=0.5, Normalized=True)  # -> Point, Tangent, Parameter
dispatch_25 = Dispatch(List=cull_i_21, DispatchPattern=equals.Inequality)  # -> ListA, ListB
dispatch_26 = Dispatch(List=cull_i_20, DispatchPattern=equals.Inequality)  # -> ListA, ListB
geo_12 = Geometry(dispatch_23.ListB)
pline_2 = PolyLine(Vertices=sort_pt_2.Points, Closed=False)
geo_13 = Geometry(dispatch_23.ListA)
vec_2 = Vector(dispatch_24.ListB)
smaller = SmallerThan(FirstNumber=len_4, SecondNumber=250)  # -> SmallerThan, OrEqualTo
cull_i_22 = CullIndex(List=dispatch_25.ListB, Indices=[3, 4], Wrap=True)
item_48 = ListItem(List=dispatch_25.ListB, Index=4, Wrap=True)  # disabled
cull_i_23 = CullIndex(List=dispatch_26.ListB, Indices=[3, 4], Wrap=True)
pgroups_2 = PointGroups(Points=flatten(geo_13), Distance="290")  # -> Groups, Indices
item_49 = ListItem(List=dispatch_26.ListB, Index=4, Wrap=True)  # disabled
points = PointList(Points=sort_pt_2.Points)
eval_12 = EvaluateLength(Curve=pline_2, Length=[0, 1], Normalized=True)  # -> Point, Tangent, Parameter
panel_4 = Panel(len_3)
xz_4 = XZPlane(Origin=cullpt_9.Points)
dispatch_27 = Dispatch(List=pline, DispatchPattern=smaller.SmallerThan)  # -> ListA, ListB
rev_2 = Reverse(Vector=item_48)
pt_3 = Point(flatten([cull_i_23, item_49]))
vec_3 = Vector(flatten([cull_i_22, rev_2]))
sort_pt_3 = SortPoints(Points=pgroups_2.Groups)  # -> Points, Indices
cir_4 = Circle(Plane=xz_4, Radius="200")
geo_14 = Geometry(dispatch_27.ListB)
geo_15 = Geometry(dispatch_27.ListA)
vdis_4 = VectorDisplay(Anchor=pt_3, Vector=vec_3)
pline_3 = PolyLine(Vertices=sort_pt_3.Points, Closed=False)
colom_4 = CollisionOneMany(Collider=flatten(cir_4), Obstacles=flatten(cir))  # -> Collision, Index
eval_13 = EvaluateLength(Curve=geo_14, Length=0, Normalized=True)  # -> Point, Tangent, Parameter
eval_14 = EvaluateLength(Curve=geo_14, Length=1, Normalized=True)  # -> Point, Tangent, Parameter
eval_15 = EvaluateLength(Curve=geo_15, Length=0.5, Normalized=True)  # -> Point, Tangent, Parameter
pt_4 = Point(flatten([item_41, item_42]))
vec_4 = Vector(flatten([item_37, item_38]))
eval_16 = EvaluateLength(Curve=pline_3, Length=0.5, Normalized=True)  # -> Point, Tangent, Parameter
geo_16 = Geometry(flatten(cullpt_7.Points))
vec_5 = Vector(flatten(item_44))
dispatch_28 = Dispatch(List=cullpt_9.Points, DispatchPattern=colom_4.Collision)  # -> ListA, ListB
dispatch_29 = Dispatch(List=item_47, DispatchPattern=colom_4.Collision)  # -> ListA, ListB
vec_6 = Vector([item_40, item_36])
geo_17 = Geometry([item_39, item_35])
geo_18 = Geometry(_1st_connector_points)
tab_vectors_4 = Vector(flatten([geo_10, eval_13.Tangent, eval_10.Tangent, eval_14.Tangent, eval_15.Tangent]))
tab_points_4 = Point(flatten([geo_9, eval_13.Point, eval_10.Point, eval_14.Point, eval_15.Point]))
vec_7 = Vector(dispatch_29.ListB)
pt_5 = Point(dispatch_28.ListB)
cullpt_10 = CullDuplicates(Points=geo_16, Tolerance=0.1, CullMode=3)  # -> Points, Indices, Valence
item_50 = ListItem(List=vec_5, Index=cullpt_10.Indices, Wrap=True)
xz_5 = XZPlane(Origin=tab_points_4)
vec_8 = Vector([vec_2, eval_16.Tangent])
pt_6 = Point([geo_12, eval_16.Point])
vdis_5 = VectorDisplay(Anchor=pt_6, Vector=vec_8)
column_tab_tangent = ClusterOutput([eval_12.Tangent, eval_11.Tangent, vec_7])
vdis_6 = VectorDisplay(Anchor=tab_points_4, Vector=tab_vectors_4)
column_tab_points = ClusterOutput([eval_12.Point, eval_11.Point, pt_5])
connector_pts_1st_floor = ClusterOutput(geo_18)
connector_pts_grnd_floor = ClusterOutput(grnd_connector_points)
cir_5 = Circle(Plane=xz_5, Radius="200")
grips_2nd_floor_pt = ClusterOutput(cullpt_10.Points)
grips_2nd_floor_vec = ClusterOutput(item_50)
space_invader_grnd_floor_points = ClusterOutput([item_29, item_27])
space_invader_grnd_floor_t = ClusterOutput([item_30, item_28])
space_invader_tangent = ClusterOutput(vec_4)
space_invader_2nd_floor_points = ClusterOutput(geo_17)
space_invader_floor_t = ClusterOutput(vec_6)
space_invader_points = ClusterOutput(pt_4)
column_floor_int = ClusterOutput(item_23)
space_invader_column_pt = ClusterOutput([item_31, item_32])
roof_connector_pts = ClusterOutput(connector_points)
roof_connector_t = ClusterOutput(connector_vectors)
wall_connector_pts = ClusterOutput(wall_connector_points)
space_invader_column_t = ClusterOutput([item_33, item_34])
tab_pt_intersect_2 = ClusterOutput(tab_pt_intersect)
tab_t_intersect = ClusterOutput(tab_vec_intersect)
pt_7 = ClusterOutput(pt_6)
# Reverse Corner Vector: For roofs with a central column, this prevents collision of internal grips with column grips, by removing internal points, and replacing with corner tab points (external) instead
vec_9 = ClusterOutput(vec_8)
colom_5 = CollisionOneMany(Collider=flatten(cir_5), Obstacles=flatten(cir_4))  # -> Collision, Index
dispatch_30 = Dispatch(List=tab_points_4, DispatchPattern=colom_5.Collision)  # -> ListA, ListB
dispatch_31 = Dispatch(List=tab_vectors_4, DispatchPattern=colom_5.Collision)  # -> ListA, ListB
null_8 = NullItem(Item=colom_5.Collision)  # -> NullFlags, InvalidFlags, Description
vec_10 = Vector(dispatch_31.ListB)
pt_8 = Point(dispatch_30.ListA)
vec_11 = Vector(dispatch_31.ListA)
pt_9 = Point(dispatch_30.ListB)
dispatch_32 = Dispatch(List=tab_points_4, DispatchPattern=null_8.NullFlags)  # -> ListA, ListB
cullpt_11 = CullDuplicates(Points=pt_9, Tolerance=50, CullMode=3)  # -> Points, Indices, Valence
pdecon_3 = Deconstruct(Point=pt_8)  # -> XComponent, YComponent, ZComponent
larger_3 = LargerThan(FirstNumber=pdecon_3.XComponent, SecondNumber=1)  # -> LargerThan, OrEqualTo
join = JoinCurves(Curves=flatten(geo_3), Preserve=False)
dispatch_33 = Dispatch(List=vec_11, DispatchPattern=larger_3.LargerThan)  # -> ListA, ListB
crv_cp = CurveClosestPoint(Point=[cullpt_11.Points, dispatch_32.ListA], Curve=join)  # -> Point, Parameter, Distance
rev_3 = Reverse(Vector=dispatch_33.ListA)
eval_17 = EvaluateCurve(Curve=join, Parameter=crv_cp.Parameter)  # -> Point, Tangent, Angle
pt_10 = Point(flatten([sort_2.ValuesA, pt_8]))
vec_12 = Vector(flatten([sort_3.ValuesA, rev_3, dispatch_33.ListB]))
vdis_7 = VectorDisplay(Anchor=eval_17.Point, Vector=eval_17.Tangent)
corner_tab_vector_2 = ClusterOutput(vec_12)
corner_tab_points_3 = ClusterOutput(pt_10)
tab_tangent = ClusterOutput(eval_17.Tangent)
tab_points_5 = ClusterOutput(eval_17.Point)

# ==== cluster BuildingSectionProfile
no_of_roof_points = ClusterInput()
no_of_floors = ClusterInput()
column_position = ClusterInput()
_1st_floor_height = ClusterInput()
two_storey = ClusterInput()
right_wall = ClusterInput()
left_wall = ClusterInput()
roof_height = ClusterInput()
roof_offset = ClusterInput()
column = ClusterInput()
width = ClusterInput()
max_span = Slider(3900, range=0..4001)
panel = Panel(no_of_roof_points)
addition = Addition(A=no_of_roof_points, B=1)
_1st_floor_height_2 = Number(_1st_floor_height)
two_storey_2 = Boolean(two_storey)
column_position_2 = Number(column_position)
column_2 = Boolean(column)
right_wall_2 = Number(right_wall)
roof_height_2 = Number(roof_height)
roof_offset_2 = Number(roof_offset)
left_wall_2 = Number(left_wall)
width_2 = Number(width)
multiplication = Multiplication(A=max_span, B=2)
no_of_roof_points_2 = Number(addition)
min = Minimum(A=width_2, B=multiplication)
min_2 = Minimum(A=column_position_2, B=max_span)
override_if_exceeds_span_limit = BooleanToggle(True)
division = Division(A=min, B=2)
multiplication_2 = Multiplication(A=division, B=-1)
larger = LargerThan(FirstNumber=min, SecondNumber=max_span)  # -> LargerThan, OrEqualTo
Z = UnitZ(Factor=right_wall_2)
Z_2 = UnitZ(Factor=roof_height_2)
Z_3 = UnitZ(Factor=left_wall_2)
pt = ConstructPoint(XCoordinate=0, YCoordinate=0, ZCoordinate=0)
X = UnitX(Factor=[multiplication_2, division])
dispatch = Dispatch(List=column_2, DispatchPattern=larger.LargerThan)  # -> ListA, ListB
dispatch_2 = Dispatch(List=override_if_exceeds_span_limit, DispatchPattern=larger.LargerThan)  # -> ListA, ListB
move = Move(Geometry=pt, Motion=X)  # -> Geometry, Transform
merge = Merge(Data1=dispatch_2.ListA, Data2=dispatch.ListB)
dispatch_3 = Dispatch(List=move.Geometry, DispatchPattern=[True, False])  # -> ListA, ListB
panel_2 = Panel(merge)
move_2 = Move(Geometry=dispatch_3.ListB, Motion=Z)  # -> Geometry, Transform
move_3 = Move(Geometry=dispatch_3.ListA, Motion=Z_3)  # -> Geometry, Transform
ln = Line(StartPoint=dispatch_3.ListA, EndPoint=dispatch_3.ListB)
len = Length(Curve=ln)
divide = DivideCurve(Curve=ln, Count=no_of_roof_points_2, Kinks=False)  # -> Points, Tangents, Parameters
division_2 = Division(A=len, B=no_of_roof_points_2)
equals = Equality(FirstNumber=no_of_roof_points_2, SecondNumber=1)  # -> Equality, Inequality
dispatch_4 = Dispatch(List=divide.Points, DispatchPattern=[False, True])  # -> ListA, ListB
min_3 = Minimum(A=division_2, B=roof_offset_2)
neg = Negative(Value=division_2)
pt_2 = Point(dispatch_4.ListA)
pt_3 = Point(dispatch_4.ListB)
max = Maximum(A=neg, B=min_3)
division_3 = Division(A=no_of_roof_points_2, B=2)
integer_division = IntegerDivision(A=no_of_roof_points_2, B=2)
dispatch_5 = Dispatch(List=pt_2, DispatchPattern=equals.Equality)  # -> ListA, ListB
equals_2 = Equality(FirstNumber=division_3, SecondNumber=integer_division)  # -> Equality, Inequality
move_4 = Move(Geometry=pt_3, Motion=Z)  # -> Geometry, Transform
X_2 = UnitX(Factor=max)
move_5 = Move(Geometry=dispatch_5.ListB, Motion=Z_2)  # -> Geometry, Transform
item = ListItem(List=move_4.Geometry, Index=1, Wrap=True)
move_6 = Move(Geometry=move_5.Geometry, Motion=X_2)  # -> Geometry, Transform
dispatch_6 = Dispatch(List=move_5.Geometry, DispatchPattern=equals_2.Inequality)  # -> ListA, ListB
dispatch_7 = Dispatch(List=move_6.Geometry, DispatchPattern=equals_2.Equality)  # -> ListA, ListB
dispatch_8 = Dispatch(List=item, DispatchPattern=equals_2.Equality)  # -> ListA, ListB
pt_4 = Point(flatten([dispatch_6.ListA, dispatch_7.ListA, dispatch_8.ListA]))
pdecon = Deconstruct(Point=pt_4)  # -> XComponent, YComponent, ZComponent
sort = SortList(Keys=pdecon.XComponent, ValuesA=pt_4)  # -> Keys, ValuesA
rev = ReverseList(List=sort.ValuesA)
entwine = Entwine(Branch00=move.Geometry, Branch01=move_2.Geometry, Branch02=rev, Branch03=move_3.Geometry, FlattenInputs=True)  # -> flatten(Result)
cullpt = CullDuplicates(Points=entwine, Tolerance=0.1, CullMode=3)  # -> Points, Indices, Valence
pt_5 = Point(flatten(cullpt.Points))
pdecon_2 = Deconstruct(Point=cullpt.Points)  # -> XComponent, YComponent, ZComponent
addition_2 = Addition(A=no_of_roof_points, B=1)
sort_2 = SortList(Keys=pdecon_2.ZComponent, ValuesA=cullpt.Points)  # -> Keys, ValuesA
lng = ListLength(List=sort_2.ValuesA)
dom = ConstructDomain(DomainStart=0, DomainEnd=addition_2)
subtraction = Subtraction(A=lng, B=1)
range = Range(Domain=dom, Steps=addition_2)
int = Integer(range)
subtraction_2 = Subtraction(A=subtraction, B=int)
item_2 = ListItem(List=sort_2.ValuesA, Index=subtraction_2, Wrap=False)
pdecon_3 = Deconstruct(Point=item_2)  # -> XComponent, YComponent, ZComponent
sort_3 = SortList(Keys=pdecon_3.XComponent, ValuesA=item_2)  # -> Keys, ValuesA
points = PointList(Points=sort_3.ValuesA)
profile_curve = PolyLine(Vertices=flatten(pt_5), Closed=True)
pline = PolyLine(Vertices=flatten(sort_3.ValuesA), Closed=False)
pline_2 = PolyLine(Vertices=flatten(move.Geometry), Closed=False)
item_3 = ListItem(List=move.Geometry, Index=0, Wrap=True)
ln_2 = Line(StartPoint=move_2.Geometry, EndPoint=dispatch_3.ListB)
divlength = DivideLength(Curve=pline_2, Length=min_2)  # -> Points, Tangents, Parameters
ln_3 = Line(StartPoint=item_3, EndPoint=move_3.Geometry)
item_4 = ListItem(List=divlength.Points, Index=1, Wrap=True)
divlength_2 = DivideLength(Curve=ln_3, Length=_1st_floor_height_2)  # -> Points, Tangents, Parameters
flip = FlipCurve(Curve=ln_2)  # -> Curve, Flag
Z_4 = UnitZ(Factor=1)
column_pt = Point(item_4)
base_pts = Point(move.Geometry)
item_5 = ListItem(List=divlength_2.Points, Index=1, Wrap=True)
divlength_3 = DivideLength(Curve=flip.Curve, Length=_1st_floor_height_2)  # -> Points, Tangents, Parameters
project = ProjectPoint(Point=item_4, Direction=Z_4, Geometry=pline)  # -> Point, Index
item_6 = ListItem(List=divlength_3.Points, Index=1, Wrap=True)
pline_3 = PolyLine(Vertices=flatten([item_5, item_6]), Closed=False)
pline_4 = PolyLine(Vertices=[project.Point, item_4], Closed=False)

# ----
# SWITCH INTERNAL
# STRUCTURE OFF/ON
two_storey_3 = Dispatch(List=pline_3, DispatchPattern=two_storey_2)  # -> ListA, ListB
column_3 = Dispatch(List=pline_4, DispatchPattern=merge)  # -> ListA, ListB

base_pts_2 = ClusterOutput(base_pts)
column_pt_2 = ClusterOutput(column_pt)
master_profile_curve = Curve(profile_curve)
_1st_floor_profile_curve = Curve(two_storey_3.ListA)
column_profile_curve = Curve(column_3.ListA)
_1st_floor_profile_curve_2 = ClusterOutput(_1st_floor_profile_curve)
column_profile_curve_2 = ClusterOutput(column_profile_curve)
master_profile_curve_2 = ClusterOutput(master_profile_curve)

# ==== cluster FrameGrip
pt = ConstructPoint(XCoordinate=0, YCoordinate=0, ZCoordinate=0)
dog_bone_pocket = DogBonePocket_3(point=pt)  # -> pt_5, tool_size_2, size
points = PointList(Points=dog_bone_pocket.pt_5)
yz = YZPlane(Origin=Point(0, 0, 0))
pt_2 = ConstructPoint(XCoordinate=0, YCoordinate=0, ZCoordinate=0)
rotate = Rotate(Geometry=dog_bone_pocket.pt_5, Angle=1.570796327, Plane=PlaneXY(0, 0, 0))  # -> Geometry, Transform
ply_thickness = ClusterInput()
rotate_2 = Rotate(Geometry=rotate.Geometry, Angle=1.570796327, Plane=yz)  # -> Geometry, Transform
slot_spacing = ClusterInput()
points_2 = PointList(Points=rotate_2.Geometry)
Z = UnitZ(Factor=ply_thickness)
division = Division(A=slot_spacing, B=2)
yz_2 = YZPlane(Origin=Point(0, 0, 0))
centre_point = ClusterOutput(pt)

tab_width = Slider(180, range=25..301)
division_2 = Division(A=tab_width, B=-2)
move = Move(Geometry=pt_2, Motion=Z)  # -> Geometry, Transform

division_3 = Division(A=tab_width, B=2)
X = UnitX(Factor=division_2)
addition = Addition(A=dog_bone_pocket.size, B=division_3)
subtraction = Subtraction(A=addition, B=division)
X_2 = UnitX(Factor=subtraction)
neg = Negative(Value=X_2)
num = Number(tab_width)
tab_width_2 = ClusterOutput(num)

move_2 = Move(Geometry=rotate_2.Geometry, Motion=X)  # -> Geometry, Transform
move_3 = Move(Geometry=pt_2, Motion=X)  # -> Geometry, Transform
move_4 = Move(Geometry=move_3.Geometry, Motion=Z)  # -> Geometry, Transform

rev = ReverseList(List=move_2.Geometry)

pline = PolyLine(Vertices=flatten([rev, move_4.Geometry, move.Geometry]), Closed=False)
mirror = Mirror(Geometry=pline, Plane=yz_2)  # -> Geometry, Transform
join = JoinCurves(Curves=[pline, mirror.Geometry], Preserve=False)

end = EndPoints(Curve=join)  # -> Start, End
move_5 = Move(Geometry=end.End, Motion=neg)  # -> Geometry, Transform
move_6 = Move(Geometry=end.Start, Motion=X_2)  # -> Geometry, Transform
ln = Line(StartPoint=move_6.Geometry, EndPoint=end.Start)
ln_2 = Line(StartPoint=end.End, EndPoint=move_5.Geometry)
join_2 = JoinCurves(Curves=join, Preserve=False)
geometry = ClusterOutput(join_2)

# ==== cluster WRENFrameBuilder
column_grips = ClusterInput()
column_grips_2 = Geometry(flatten(column_grips))
intrusions = ClusterInput()
ext_intrusions = ClusterInput()
frame_grips = ClusterInput()
external_profile = ClusterInput()
internal_profile = ClusterInput()
stair_stringer_crv = ClusterInput()
stair_stringer_grips = ClusterInput()
frame_grips_2 = Geometry(flatten(frame_grips))
colom = CollisionOneMany(Collider=column_grips_2, Obstacles=frame_grips_2)  # -> Collision, Index
floor_grips = ClusterInput()
column_profile = ClusterInput()
dispatch = Dispatch(List=column_grips_2, DispatchPattern=colom.Collision)  # -> ListA, ListB
floor_profile = ClusterInput()
geo = Geometry(stair_stringer_crv)
geo_2 = Geometry(stair_stringer_grips)
geo_3 = Geometry(dispatch.ListB)
int_intrusions = Geometry(intrusions)
spacing = ClusterInput()
grip_length = ClusterInput()
fin_depth = ClusterInput()
inner_curve = Geometry(internal_profile)
offset = Offset(Curve=inner_curve, Distance=20, Plane=PlaneXY(0, 0, 0), Corners=1)
offset_2 = Offset(Curve=inner_curve, Distance=-20, Plane=PlaneXY(0, 0, 0), Corners=1)
len = Length(Curve=offset)
len_2 = Length(Curve=offset_2)
larger = LargerThan(FirstNumber=len, SecondNumber=len_2)  # -> LargerThan, OrEqualTo
dispatch_2 = Dispatch(List=offset, DispatchPattern=larger.LargerThan)  # -> ListA, ListB
dispatch_3 = Dispatch(List=offset_2, DispatchPattern=larger.LargerThan)  # -> ListA, ListB
geo_4 = Geometry([dispatch_2.ListA, dispatch_3.ListB])
colom_2 = CollisionOneMany(Collider=geo_3, Obstacles=geo_4)  # -> Collision, Index
outer_curve = Geometry(external_profile)
dispatch_4 = Dispatch(List=geo_3, DispatchPattern=colom_2.Collision)  # -> ListA, ListB
floor_grips_2 = Geometry(floor_grips)
geo_5 = Geometry(frame_grips_2)
fin_depth_2 = Number(fin_depth)
column = Geometry(column_profile)
floor = Geometry(floor_profile)
geo_6 = Geometry(dispatch_4.ListB)
end = EndPoints(Curve=floor_grips_2)  # -> Start, End
end_2 = EndPoints(Curve=geo_6)  # -> Start, End
subtraction = Subtraction(A=spacing, B=grip_length)
pt = Point(flatten([end.Start, end.End]))
pt_2 = Point(flatten([end_2.Start, end_2.End]))
addition = Addition(A=Slider(30, range=0..101), B=subtraction)
pgroups = PointGroups(Points=pt, Distance=subtraction)  # -> Groups, Indices
pgroups_2 = PointGroups(Points=pt_2, Distance=addition)  # -> Groups, Indices
division = Division(A=fin_depth_2, B=2)
division_2 = Division(A=fin_depth_2, B=2)
pline = PolyLine(Vertices=pgroups.Groups, Closed=False)
pline_2 = PolyLine(Vertices=pgroups_2.Groups, Closed=False)
xz = XZPlane(Origin=Point(0, 0, 0))
neg = Negative(Value=division)
xz_2 = XZPlane(Origin=Point(0, 0, 0))
neg_2 = Negative(Value=division_2)
join = JoinCurves(Curves=flatten([floor_grips_2, pline]), Preserve=False)
offset_3 = Offset(Curve=floor, Distance=division, Plane=xz, Corners=1)
offset_4 = Offset(Curve=floor, Distance=neg, Plane=xz, Corners=1)
join_2 = JoinCurves(Curves=flatten([pline_2, geo_6]), Preserve=False)
offset_5 = Offset(Curve=column, Distance=division_2, Plane=xz_2, Corners=1)
offset_6 = Offset(Curve=column, Distance=neg_2, Plane=xz_2, Corners=1)
colom_3 = CollisionOneMany(Collider=geo_5, Obstacles=outer_curve)  # -> Collision, Index
geo_7 = Geometry([offset_3, offset_4])
geo_8 = Geometry([offset_5, offset_6])
ccx = CurveCurve(CurveA=inner_curve, CurveB=geo_8)  # -> Points, ParamsA, ParamsB
ccx_2 = CurveCurve(CurveA=inner_curve, CurveB=geo_7)  # -> Points, ParamsA, ParamsB
dispatch_5 = Dispatch(List=geo_5, DispatchPattern=colom_3.Collision)  # -> ListA, ListB
outer_grips = Geometry(dispatch_5.ListA)
inner_grips = Geometry(dispatch_5.ListB)
cull_i = CullIndex(List=ccx.Points, Indices=2, Wrap=False)
pt_3 = Point(flatten([ccx.Points, ccx_2.Points]))
points = PointList(Points=ccx.Points)
colmm = CollisionManyMany(Colliders=outer_grips)  # -> Collision, Indices
pline_3 = PolyLine(Vertices=cull_i, Closed=False)
pline_4 = PolyLine(Vertices=ccx_2.Points, Closed=False)
crv_cp = CurveClosestPoint(Point=flatten(pt_3), Curve=inner_curve)  # -> Point, Parameter, Distance
dispatch_6 = Dispatch(List=outer_grips, DispatchPattern=colmm.Collision)  # -> ListA, ListB
ccx_3 = CurveCurve(CurveA=flatten(pline_3), CurveB=pline_4)  # -> Points, flatten(ParamsA), ParamsB
null = NullItem(Item=ccx_2.Points)  # -> NullFlags, InvalidFlags, Description
null_2 = NullItem(Item=pt_3)  # -> NullFlags, InvalidFlags, Description
shatter = Shatter(Curve=inner_curve, Parameters=crv_cp.Parameter)
geo_9 = Geometry(outer_grips)
dispatch_7 = Dispatch(List=inner_curve, DispatchPattern=null_2.NullFlags)  # -> ListA, ListB
dispatch_8 = Dispatch(List=shatter, DispatchPattern=[True, False])  # -> ListA, ListB
dispatch_9 = Dispatch(List=pline_3, DispatchPattern=null.NullFlags)  # -> ListA, ListB
crv_cp_2 = CurveClosestPoint(Point=flatten(ccx_3.Points), Curve=pline_4)  # -> Point, Parameter, Distance
crv_cp_3 = CurveClosestPoint(Point=flatten(ccx_3.Points), Curve=pline_3)  # -> Point, Parameter, Distance
shatter_2 = Shatter(Curve=pline_4, Parameters=crv_cp_2.Parameter)
shatter_3 = Shatter(Curve=pline_3, Parameters=crv_cp_3.Parameter)
geo_10 = Geometry([dispatch_8.ListA, dispatch_7.ListA])
dispatch_10 = Dispatch(List=shatter_2, DispatchPattern=[True, False])  # -> ListA, ListB
dispatch_11 = Dispatch(List=shatter_3, DispatchPattern=[True, False])  # -> ListA, ListB
geo_11 = Geometry(dispatch_10.ListA)
geo_12 = Geometry(dispatch_11.ListA)
join_3 = JoinCurves(Curves=flatten([geo_10, geo_12, geo_11, dispatch_9.ListA]), Preserve=False)  # -> simplify(graft(Curves))
join_4 = JoinCurves(Curves=flatten(outer_curve), Preserve=False)  # -> simplify(graft(Curves))
geo_13 = Geometry(flatten([join_2, join, geo_9, inner_grips]))
colom_4 = CollisionOneMany(Collider=geo_13, Obstacles=join_4)  # -> Collision, Index
colom_5 = CollisionOneMany(Collider=geo_13, Obstacles=join_3)  # -> Collision, Index
dispatch_12 = Dispatch(List=geo_13, DispatchPattern=colom_4.Collision)  # -> ListA, ListB
dispatch_13 = Dispatch(List=geo_13, DispatchPattern=colom_5.Collision)  # -> ListA, ListB
join_5 = JoinCurves(Curves=flatten(dispatch_12.ListA), Preserve=False)
geo_14 = Geometry(dispatch_13.ListA)
external_curve = ClusterOutput(join_4)
internal_curves = ClusterOutput(join_3)
end_3 = EndPoints(Curve=geo_14)  # -> Start, End
ccx_4 = CurveCurve(CurveA=join_5, CurveB=join_4)  # -> Points, ParamsA, ParamsB
crv_cp_4 = CurveClosestPoint(Point=flatten(ccx_4.Points), Curve=join_4)  # -> Point, Parameter, Distance
shatter_4 = Shatter(Curve=join_4, Parameters=crv_cp_4.Parameter)
merge = Merge(Data1=end_3.Start, Data2=end_3.End)
dispatch_14 = Dispatch(List=shatter_4, DispatchPattern=[True, False])  # -> ListA, ListB
crv_cp_5 = CurveClosestPoint(Point=merge, Curve=join_3)  # -> Point, Parameter, Distance
geo_15 = Geometry(dispatch_14.ListA)
grip_width = Number(180)
len_3 = Length(Curve=geo_15)
shatter_5 = Shatter(Curve=join_3, Parameters=crv_cp_5.Parameter)
similar = Similarity(FirstNumber=len_3, SecondNumber=grip_width, Threshold=0.1)  # -> Similarity, AbsoluteDifference
intrusions_2 = Geometry(int_intrusions)
dispatch_15 = Dispatch(List=shatter_5, DispatchPattern=[True, False])  # -> ListA, ListB
geo_16 = Geometry(geo)
dispatch_16 = Dispatch(List=geo_15, DispatchPattern=similar.Similarity)  # -> ListA, ListB
geo_17 = Geometry(dispatch_15.ListA)
geo_18 = Geometry(simplify(flatten(dispatch_16.ListB)))
join_6 = JoinCurves(Curves=flatten([join_5, geo_18]), Preserve=False)
join_7 = JoinCurves(Curves=flatten([geo_14, geo_17]), Preserve=False)
lng = ListLength(List=join_7)
similar_2 = Similarity(FirstNumber=lng, SecondNumber=1, Threshold=0.1)  # -> Similarity, AbsoluteDifference
null_3 = NullItem(Item=geo_16)  # -> NullFlags, InvalidFlags, Description
colom_6 = CollisionOneMany(Collider=intrusions_2, Obstacles=join_6)  # -> Collision, Index
dispatch_17 = Dispatch(List=intrusions_2, DispatchPattern=colom_6.Collision)  # -> ListA, ListB
geo_19 = Geometry(dispatch_17.ListA)
null_4 = NullItem(Item=geo_19)  # -> NullFlags, InvalidFlags, Description
geo_20 = Geometry(dispatch_17.ListB)
dispatch_18 = Dispatch(List=geo_20, DispatchPattern=similar_2.Similarity)  # -> ListA, ListB
split = SplitList(List=dispatch_18.ListB, Index=1)  # -> ListA, ListB
geo_21 = Geometry(flatten([split.ListB, dispatch_18.ListA]))
geo_22 = Geometry(split.ListA)
colom_7 = CollisionOneMany(Collider=join_7, Obstacles=geo_22)  # -> Collision, Index
colom_8 = CollisionOneMany(Collider=join_7, Obstacles=geo_21)  # -> Collision, Index
dispatch_19 = Dispatch(List=join_7, DispatchPattern=colom_7.Collision)  # -> ListA, ListB
dispatch_20 = Dispatch(List=join_7, DispatchPattern=colom_8.Collision)  # -> ListA, ListB
geo_23 = Geometry(dispatch_20.ListB)
geo_24 = Geometry(dispatch_19.ListB)
geo_25 = Geometry(graft(dispatch_19.ListA))
geo_26 = Geometry(graft(dispatch_20.ListA))
colmm_2 = CollisionManyMany(Colliders=[geo_24, geo_23])  # -> Collision, Indices
ccx_5 = CurveCurve(CurveA=geo_21, CurveB=geo_26)  # -> Points, ParamsA, ParamsB
ccx_6 = CurveCurve(CurveA=[geo_22, geo_21], CurveB=geo_25)  # -> Points, ParamsA, ParamsB
dispatch_21 = Dispatch(List=join_6, DispatchPattern=null_4.NullFlags)  # -> ListA, ListB
dispatch_22 = Dispatch(List=geo_24, DispatchPattern=colmm_2.Collision)  # -> ListA, ListB
ccx_7 = CurveCurve(CurveA=join_6, CurveB=geo_19)  # -> flatten(Points), ParamsA, ParamsB
crv_cp_6 = CurveClosestPoint(Point=ccx_5.Points, Curve=geo_26)  # -> Point, Parameter, Distance
crv_cp_7 = CurveClosestPoint(Point=ccx_6.Points, Curve=geo_25)  # -> Point, Parameter, Distance
geo_27 = Geometry(dispatch_22.ListA)
crv_cp_8 = CurveClosestPoint(Point=ccx_7.Points, Curve=graft(join_6))  # -> Point, Parameter, Distance
crv_cp_9 = CurveClosestPoint(Point=ccx_7.Points, Curve=geo_19)  # -> Point, Parameter, Distance
shatter_6 = Shatter(Curve=geo_26, Parameters=flatten(ccx_5.ParamsB))
shatter_7 = Shatter(Curve=geo_25, Parameters=flatten(ccx_6.ParamsB))
shatter_8 = Shatter(Curve=join_6, Parameters=flatten(crv_cp_8.Parameter))
shatter_9 = Shatter(Curve=geo_19, Parameters=crv_cp_9.Parameter)
dispatch_23 = Dispatch(List=shatter_6, DispatchPattern=[True, False])  # -> ListA, ListB
dispatch_24 = Dispatch(List=shatter_7, DispatchPattern=[True, False])  # -> ListA, ListB
dispatch_25 = Dispatch(List=shatter_8, DispatchPattern=[True, False])  # -> ListA, ListB
dispatch_26 = Dispatch(List=shatter_9, DispatchPattern=[True, False])  # -> ListA, ListB
ext_intrusions_2 = Geometry(ext_intrusions)
geo_28 = Geometry(dispatch_23.ListA)
geo_29 = Geometry(dispatch_24.ListA)
geo_30 = Geometry([dispatch_25.ListA, geo_19])
geo_31 = Geometry(dispatch_26.ListB)
merge_2 = Merge(Data1=geo_28, Data2=geo_21)  # -> flatten(Result)
merge_3 = Merge(Data1=geo_29, Data2=geo_22)  # -> flatten(Result)
end_4 = EndPoints(Curve=ext_intrusions_2)  # -> Start, End
join_8 = JoinCurves(Curves=flatten([geo_30, geo_31, dispatch_21.ListA]), Preserve=False)
join_9 = JoinCurves(Curves=merge_2, Preserve=False)
join_10 = JoinCurves(Curves=merge_3, Preserve=False)
merge_4 = Merge(Data1=end_4.Start, Data2=end_4.End)  # -> flatten(Result)
ccx_8 = CurveCurve(CurveA=join_8, CurveB=ext_intrusions_2)  # -> Points, ParamsA, ParamsB
join_11 = JoinCurves(Curves=flatten([geo_27, join_10, join_9]), Preserve=False)
dispatch_27 = Dispatch(List=join_11, DispatchPattern=null_3.NullFlags)  # -> ListA, ListB
no_stairs = Geometry(dispatch_27.ListA)
stairs = Geometry(dispatch_27.ListB)
crv_cp_10 = CurveClosestPoint(Point=merge_4, Curve=graft(ext_intrusions_2))  # -> Point, Parameter, Distance
crv_cp_11 = CurveClosestPoint(Point=merge_4, Curve=join_8)  # -> Point, Parameter, Distance
colom_9 = CollisionOneMany(Collider=stairs, Obstacles=geo_16)  # -> Collision, Index
dispatch_28 = Dispatch(List=geo_16, DispatchPattern=[True, False])  # -> ListA, ListB
shatter_10 = Shatter(Curve=graft(ext_intrusions_2), Parameters=crv_cp_10.Parameter)
dispatch_29 = Dispatch(List=stairs, DispatchPattern=colom_9.Collision)  # -> ListA, ListB
shatter_11 = Shatter(Curve=join_8, Parameters=flatten(crv_cp_11.Parameter))
cull_i_2 = CullIndex(List=dispatch_29.ListA, Indices=1, Wrap=True)
geo_32 = Geometry(dispatch_29.ListA)
dispatch_30 = Dispatch(List=shatter_10, DispatchPattern=[True, False])  # -> ListA, ListB
dispatch_31 = Dispatch(List=shatter_11, DispatchPattern=[True, False])  # -> ListA, ListB
geo_33 = Geometry(flatten([dispatch_29.ListB, cull_i_2]))
item = ListItem(List=dispatch_29.ListA, Index=1, Wrap=True)
ccx_9 = CurveCurve(CurveA=item, CurveB=dispatch_28.ListB)  # -> Points, ParamsA, ParamsB
ccx_10 = CurveCurve(CurveA=item, CurveB=geo_16)  # -> Points, ParamsA, ParamsB
ccx_11 = CurveCurve(CurveA=item, CurveB=dispatch_28.ListA)  # -> Points, ParamsA, ParamsB
geo_34 = Geometry(dispatch_30.ListB)
geo_35 = Geometry(dispatch_31.ListA)
geo_36 = Geometry(ext_intrusions_2)
crv_cp_12 = CurveClosestPoint(Point=ccx_9.Points, Curve=dispatch_28.ListB)  # -> Point, Parameter, Distance
crv_cp_13 = CurveClosestPoint(Point=ccx_11.Points, Curve=dispatch_28.ListA)  # -> Point, Parameter, Distance
crv_cp_14 = CurveClosestPoint(Point=ccx_10.Points, Curve=item)  # -> Point, Parameter, Distance
merge_5 = Merge(Data1=flatten(geo_35), Data2=flatten(geo_36))  # -> flatten(Result)
shatter_12 = Shatter(Curve=item, Parameters=flatten(crv_cp_14.Parameter))
shatter_13 = Shatter(Curve=dispatch_28.ListB, Parameters=flatten(crv_cp_12.Parameter))
shatter_14 = Shatter(Curve=dispatch_28.ListA, Parameters=flatten(crv_cp_13.Parameter))
join_12 = JoinCurves(Curves=merge_5, Preserve=False)
dispatch_32 = Dispatch(List=shatter_12, DispatchPattern=[True, False])  # -> ListA, ListB
dispatch_33 = Dispatch(List=shatter_13, DispatchPattern=[True, False])  # -> ListA, ListB
geo_37 = Geometry(flatten(geo_2))
dispatch_34 = Dispatch(List=shatter_14, DispatchPattern=[True, False])  # -> ListA, ListB
panel = Panel(join_12)
geo_38 = Geometry(dispatch_33.ListB)
geo_39 = Geometry(dispatch_34.ListB)
geo_40 = Geometry(dispatch_32.ListA)
colom_10 = CollisionOneMany(Collider=geo_39, Obstacles=flatten(geo_37))  # -> Collision, Index
colom_11 = CollisionOneMany(Collider=geo_38, Obstacles=flatten(geo_37))  # -> Collision, Index
dispatch_35 = Dispatch(List=geo_39, DispatchPattern=colom_10.Collision)  # -> ListA, ListB
dispatch_36 = Dispatch(List=geo_38, DispatchPattern=colom_11.Collision)  # -> ListA, ListB
geo_41 = Geometry(flatten([dispatch_35.ListA, dispatch_36.ListA]))
colom_12 = CollisionOneMany(Collider=geo_37, Obstacles=geo_40)  # -> Collision, Index
dispatch_37 = Dispatch(List=geo_37, DispatchPattern=colom_12.Collision)  # -> ListA, ListB
geo_42 = Geometry(dispatch_37.ListB)
ccx_12 = CurveCurve(CurveA=geo_41, CurveB=geo_42)  # -> Points, ParamsA, ParamsB
crv_cp_15 = CurveClosestPoint(Point=ccx_12.Points, Curve=geo_41)  # -> Point, Parameter, Distance
shatter_15 = Shatter(Curve=geo_41, Parameters=flatten(crv_cp_15.Parameter))
dispatch_38 = Dispatch(List=shatter_15, DispatchPattern=[True, False])  # -> ListA, ListB
dispatch_39 = Dispatch(List=dispatch_38.ListA, DispatchPattern=[True, False])  # -> ListA, ListB
geo_43 = Geometry(dispatch_39.ListA)
join_13 = JoinCurves(Curves=flatten([geo_43, geo_42]), Preserve=False)
join_14 = JoinCurves(Curves=flatten([dispatch_35.ListB, dispatch_36.ListB, geo_40, join_13]), Preserve=False)
geo_44 = Geometry(flatten([no_stairs, join_14, geo_33]))
join_15 = JoinCurves(Curves=flatten([dispatch_36.ListB, join_13]), Preserve=False)
external_grip_profile = ClusterOutput(join_12)
internal_grip_profile = ClusterOutput(join_11)
internal_profile_stairs = ClusterOutput(geo_44)

# ==== cluster WRENDJointPlacer
fin_depth = ClusterInput()
spacing_ratio = ClusterInput()
ply_thickness = ClusterInput()
sheet_length = ClusterInput()
sheet_width = ClusterInput()
fin_depth_2 = Number(fin_depth)
spacing_ratio_2 = Number(spacing_ratio)
ply_thickness_2 = Number(ply_thickness)
sheet_length_2 = Number(sheet_length)
sheet_width_2 = Number(sheet_width)
division = Division(A=spacing_ratio_2, B=2)
panel = Panel(division)
dovetail_height = Slider(85, range=0..300)
profile_ground_floor = ClusterInput()
profile_ext = ClusterInput()
profile_2nd_floor = ClusterInput()
d_joint_uk = DJOINTUK(dovetail_height=dovetail_height, A=fin_depth_2)  # -> offset_2, points, C_2, C
geo = ClusterInput()
profile_ext_2 = Curve(profile_ext)
profile_ground_floor_2 = Curve(profile_ground_floor)
stair_grip_points = ClusterInput()
stair_grip_vector = ClusterInput()
stringer_profile = ClusterInput()
geo_2 = Geometry(geo)
profile_2nd_floor_2 = Curve(profile_2nd_floor)
offfset = Number(d_joint_uk.offset_2)
geo_3 = Geometry(d_joint_uk.C)
geo_4 = Geometry(d_joint_uk.C_2)
pt = Point(stair_grip_points)
vec = Vector(stair_grip_vector)
profile_stair_stringer = Curve(stringer_profile)
# FIRST FLOOR
first_floor_d_joints = FirstFloorDJoints(
    G=[d_joint_uk.C_2, d_joint_uk.C],
    pa=d_joint_uk.points,
    L=division,
    profile_2nd_floor=profile_2nd_floor_2,
    G_2=[d_joint_uk.C_2, d_joint_uk.C],
    L_2=division,
    pa_2=d_joint_uk.points,
    A_4=sheet_length_2,
    A_2=fin_depth_2,
    B_2=ply_thickness_2,
    B_3=sheet_length_2,
    A_3=sheet_width_2,
    A=fin_depth_2,
    B=ply_thickness_2,
    B_4=sheet_length_2)  # -> L_3, geo_3, L_4, profile_2nd_floor_3
# STAIR STRINGER
column_d_joints = ColumnDJoints_2(
    geo=[d_joint_uk.C_2, d_joint_uk.C],
    stair_pts=pt,
    pa=d_joint_uk.points,
    stair_vec=vec,
    pa_2=d_joint_uk.points,
    profile_column=profile_stair_stringer,
    A_2=sheet_width_2,
    A_3=sheet_width_2,
    A=fin_depth_2,
    B=spacing_ratio_2,
    ply_thickness=ply_thickness_2,
    I=first_floor_d_joints.profile_2nd_floor_3)  # -> L, L_2, geo_5
# GROUND FLOOR
ground_floor_d_joints = GroundFloorDJoints(
    G=[geo_4, geo_3],
    pa=d_joint_uk.points,
    L=division,
    G_2=[geo_4, geo_3],
    L_2=division,
    profile_ground_floor=profile_ground_floor_2,
    pa_2=d_joint_uk.points,
    A_4=sheet_length_2,
    A_2=fin_depth_2,
    B_2=ply_thickness_2,
    B_3=sheet_length_2,
    A_3=sheet_width_2,
    A=fin_depth_2,
    B=ply_thickness_2,
    B_4=sheet_length_2,
    A_5=dovetail_height)  # -> L_3, geo_4, L_4, T
# CENTRAL COLUMN
column_d_joints_2 = ColumnDJoints(
    A_4=sheet_length_2,
    G=[d_joint_uk.C_2, d_joint_uk.C],
    pa=d_joint_uk.points,
    L=division,
    profile_column=geo_2,
    L_2=division,
    G_2=[d_joint_uk.C_2, d_joint_uk.C],
    pa_2=d_joint_uk.points,
    A_2=sheet_width_2,
    A_3=sheet_width_2,
    A_5=sheet_length_2,
    A=fin_depth_2,
    B=ply_thickness_2,
    B_2=spacing_ratio_2,
    I=first_floor_d_joints.profile_2nd_floor_3)  # -> L_3, L_4, geo_3
# WALLS & ROOF
external_profile_d_joints = ExternalProfileDJoints(
    geo_3=geo_2,
    d_joint_height=dovetail_height,
    profile_ext=profile_ext_2,
    sheet_length=sheet_length_2,
    d_joint_points=d_joint_uk.points,
    sheet_width=sheet_width_2,
    ply_thickness=ply_thickness_2,
    d_joint_1=d_joint_uk.C_2,
    fin_depth=fin_depth_2,
    d_joint_2=d_joint_uk.C,
    slot_spacing=division,
    P=ground_floor_d_joints.T,
    geo_2=profile_2nd_floor_2)  # -> G_2, L, L_2, G
geo_5 = Geometry(external_profile_d_joints.G)
geo_6 = Geometry(external_profile_d_joints.G_2)
geo_7 = Geometry([column_d_joints_2.geo_3, ground_floor_d_joints.geo_4])
geo_8 = Geometry(first_floor_d_joints.geo_3)
internal_crv_stairs = ClusterInput()
external_crv = ClusterInput()
inernal_crv = ClusterInput()
internal_crv_stairs_2 = Curve(internal_crv_stairs)
external_crv_2 = Curve(external_crv)
inernal_crv_2 = Curve(inernal_crv)
null = NullItem(Item=internal_crv_stairs_2)  # -> NullFlags, InvalidFlags, Description
crv = Curve(external_crv_2)
crv_2 = Curve(inernal_crv_2)
item = ListItem(List=crv_2, Index=2, Wrap=False)
item_2 = ListItem(List=crv_2, Index=0, Wrap=False)
item_3 = ListItem(List=crv_2, Index=1, Wrap=False)
item_4 = ListItem(List=crv_2, Index=3, Wrap=False)
item_5 = ListItem(List=internal_crv_stairs_2, Index=[3, 4], Wrap=False)
ccx = CurveCurve(CurveA=flatten([geo_7, geo_6, geo_5]), CurveB=graft(crv))  # -> Points, ParamsA, ParamsB
ccx_2 = CurveCurve(CurveA=flatten([geo_8, geo_7, geo_6, geo_5]), CurveB=graft(item))  # -> Points, ParamsA, ParamsB
ccx_3 = CurveCurve(CurveA=flatten([geo_8, geo_7, geo_6, geo_5]), CurveB=graft(item_2))  # -> Points, ParamsA, ParamsB
ccx_4 = CurveCurve(CurveA=flatten([geo_8, geo_7, geo_6, geo_5]), CurveB=graft(item_3))  # -> Points, ParamsA, ParamsB
ccx_5 = CurveCurve(CurveA=flatten([geo_8, geo_7, geo_6, geo_5]), CurveB=graft(item_4))  # -> Points, ParamsA, ParamsB
ccx_6 = CurveCurve(CurveA=flatten(column_d_joints.geo_5), CurveB=graft(item_5))  # -> Points, ParamsA, ParamsB
clean = CleanTree(RemoveNulls=True, RemoveInvalid=True, RemoveEmpty=True, Tree=flatten(ccx.ParamsB))
clean_2 = CleanTree(RemoveNulls=True, RemoveInvalid=True, RemoveEmpty=True, Tree=flatten(ccx_2.ParamsB))
clean_3 = CleanTree(RemoveNulls=True, RemoveInvalid=True, RemoveEmpty=True, Tree=flatten(ccx_3.ParamsB))
clean_4 = CleanTree(RemoveNulls=True, RemoveInvalid=True, RemoveEmpty=True, Tree=flatten(ccx_4.ParamsB))
clean_5 = CleanTree(RemoveNulls=True, RemoveInvalid=True, RemoveEmpty=True, Tree=flatten(ccx_5.ParamsB))
clean_6 = CleanTree(RemoveNulls=True, RemoveInvalid=True, RemoveEmpty=True, Tree=flatten(ccx_6.ParamsB))
shatter = Shatter(Curve=flatten(crv), Parameters=flatten(clean))  # -> flatten(Segments)
len = Length(Curve=shatter)
shatter_2 = Shatter(Curve=flatten(item_3), Parameters=flatten(clean_4))  # -> flatten(Segments)
len_2 = Length(Curve=shatter_2)
shatter_3 = Shatter(Curve=flatten(item), Parameters=flatten(clean_2))  # -> flatten(Segments)
len_3 = Length(Curve=shatter_3)
shatter_4 = Shatter(Curve=flatten(item_2), Parameters=flatten(clean_3))  # -> flatten(Segments)
len_4 = Length(Curve=shatter_4)
shatter_5 = Shatter(Curve=flatten(item_4), Parameters=flatten(clean_5))  # -> flatten(Segments)
len_5 = Length(Curve=shatter_5)
shatter_6 = Shatter(Curve=flatten(item_5), Parameters=flatten(clean_6))  # -> flatten(Segments)
similar = Similarity(FirstNumber=len, SecondNumber=offfset, Threshold=0.1)  # -> Similarity, AbsoluteDifference
similar_2 = Similarity(FirstNumber=len_2, SecondNumber=offfset, Threshold=0.1)  # -> Similarity, AbsoluteDifference
similar_3 = Similarity(FirstNumber=len_5, SecondNumber=offfset, Threshold=0.1)  # -> Similarity, AbsoluteDifference
similar_4 = Similarity(FirstNumber=len_4, SecondNumber=offfset, Threshold=0.1)  # -> Similarity, AbsoluteDifference
similar_5 = Similarity(FirstNumber=len_3, SecondNumber=offfset, Threshold=0.1)  # -> Similarity, AbsoluteDifference
dispatch = Dispatch(List=shatter_5, DispatchPattern=similar_3.Similarity)  # -> ListA, ListB
dispatch_2 = Dispatch(List=shatter, DispatchPattern=similar.Similarity)  # -> ListA, ListB
dispatch_3 = Dispatch(List=shatter_4, DispatchPattern=similar_4.Similarity)  # -> ListA, ListB
dispatch_4 = Dispatch(List=shatter_6, DispatchPattern=[True, False])  # -> ListA, ListB
points_for_labelling = Point([external_profile_d_joints.L, external_profile_d_joints.L_2, ground_floor_d_joints.L_3, ground_floor_d_joints.L_4, column_d_joints_2.L_3, column_d_joints_2.L_4, first_floor_d_joints.L_3, first_floor_d_joints.L_4])
dispatch_5 = Dispatch(List=shatter_2, DispatchPattern=similar_2.Similarity)  # -> ListA, ListB
grnd_floor_points = Point([ground_floor_d_joints.L_3, ground_floor_d_joints.L_4])
dispatch_6 = Dispatch(List=shatter_3, DispatchPattern=similar_5.Similarity)  # -> ListA, ListB
column_points = Point([column_d_joints_2.L_3, column_d_joints_2.L_4])
external_points = Point([external_profile_d_joints.L, external_profile_d_joints.L_2])
_1st_floor_points = Point([first_floor_d_joints.L_3, first_floor_d_joints.L_4])
join = JoinCurves(Curves=flatten(dispatch_3.ListB), Preserve=False)
join_2 = JoinCurves(Curves=flatten(dispatch_2.ListB), Preserve=False)
join_3 = JoinCurves(Curves=flatten(dispatch.ListB), Preserve=False)
join_4 = JoinCurves(Curves=flatten([dispatch_4.ListA, column_d_joints.geo_5]), Preserve=False)
join_5 = JoinCurves(Curves=flatten(dispatch_5.ListB), Preserve=False)
join_6 = JoinCurves(Curves=flatten(dispatch_6.ListB), Preserve=False)
points_for_labelling_2 = ClusterOutput(points_for_labelling)
external_points_2 = ClusterOutput(external_points)
grnd_floor_points_2 = ClusterOutput(grnd_floor_points)
_1st_floor_points_2 = ClusterOutput(_1st_floor_points)
column_points_2 = ClusterOutput(column_points)
join_7 = JoinCurves(Curves=flatten([join_2, join, join_5, join_6, join_3, geo_8, geo_7, geo_6, geo_5]), Preserve=False)
end = EndPoints(Curve=join_7)  # -> Start, End
clean_7 = CleanTree(RemoveNulls=True, RemoveInvalid=True, RemoveEmpty=True, Tree=join_7)
item_6 = ListItem(List=join_7, Index=0, Wrap=True)
boundary = BoundarySurfaces(Edges=clean_7)
C = ClusterOutput(join_4)
wires = BrepWireframe(Brep=boundary, Density=-1)
join_8 = JoinCurves(Curves=wires, Preserve=False)
C_2 = ClusterOutput(join_8)

# ==== cluster WRENConnector01
connector_grip_length = ClusterInput()
tolerance = ClusterInput()
fin_depth = ClusterInput()
end_tab_thickness = Slider(30, range=0..301)
ply_thickness = ClusterInput()
gauge = ClusterInput()
slot_width_wall = ClusterInput()
beam_width = ClusterInput()
slot_width_floor = ClusterInput()
tool_size = ClusterInput()
num = Number(connector_grip_length)
panel = Panel(tolerance)
panel_2 = Panel(gauge)
panel_3 = Panel(fin_depth)
panel_4 = Panel(ply_thickness)
panel_5 = Panel(beam_width)
tab_length = Slider(0, range=0..301)
panel_6 = Panel(slot_width_wall)
division = Division(A=gauge, B=2)
division_2 = Division(A=beam_width, B=2)
division_3 = Division(A=beam_width, B=2)
pt = ConstructPoint(XCoordinate=0, YCoordinate=0, ZCoordinate=0)
division_4 = Division(A=ply_thickness, B=2)
subtraction = Subtraction(A=division, B=division_2)
dog_bone_pocket = DogBonePocket(point=pt)  # -> pt_5, tool_size_2
pt_2 = ConstructPoint(XCoordinate=0, YCoordinate=0, ZCoordinate=0)
division_5 = Division(A=fin_depth, B=2)
addition = Addition(A=division_3, B=tab_length)
X = UnitX(Factor=division_5)
Y = UnitY(Factor=addition)
Y_2 = UnitY(Factor=subtraction)
move = Move(Geometry=graft(pt_2), Motion=flatten(Y_2))  # -> Geometry, Transform
division_6 = Division(A=slot_width_floor, B=2)
division_7 = Division(A=slot_width_floor, B=2)
rotate = Rotate(Geometry=dog_bone_pocket.pt_5, Angle=1.570796327, Plane=PlaneXY(0, 0, 0))  # -> Geometry, Transform
multiplication = Multiplication(A=end_tab_thickness, B=-1)
move_2 = Move(Geometry=graft(move.Geometry), Motion=flatten(Y))  # -> Geometry, Transform
move_3 = Move(Geometry=graft(move.Geometry), Motion=flatten(X))  # -> Geometry, Transform
X_2 = UnitX(Factor=ply_thickness)
X_3 = UnitX(Factor=division_6)
X_4 = UnitX(Factor="10")
Y_3 = UnitY(Factor=multiplication)
X_5 = UnitX(Factor=division_7)
move_4 = Move(Geometry=rotate.Geometry, Motion=X_4)  # -> Geometry, Transform
rev = ReverseList(List=move_4.Geometry)
move_5 = Move(Geometry=rev, Motion=Y_2)  # -> Geometry, Transform
move_6 = Move(Geometry=move_3.Geometry, Motion=Y_3)  # -> Geometry, Transform
rev_2 = ReverseList(List=dog_bone_pocket.pt_5)
move_7 = Move(Geometry=[move_6.Geometry, move_3.Geometry], Motion=X_2)  # -> Geometry, Transform
move_8 = Move(Geometry=move_5.Geometry, Motion=X_5)  # -> Geometry, Transform
move_9 = Move(Geometry=move_2.Geometry, Motion=X_5)  # -> Geometry, Transform
multiplication_2 = Multiplication(A="10", B=-1)
move_10 = Move(Geometry=move_5.Geometry, Motion=X_3)  # -> Geometry, Transform
move_11 = Move(Geometry=move_2.Geometry, Motion=X_3)  # -> Geometry, Transform
move_12 = Move(Geometry=move_5.Geometry, Motion=X_3)  # -> Geometry, Transform
move_13 = Move(Geometry=move_2.Geometry, Motion=X_3)  # -> Geometry, Transform
dog_bone_pocket_2 = DogBonePocket(point=move_6.Geometry)  # -> pt_5, tool_size_2
Y_4 = UnitY(Factor=multiplication_2)
move_14 = Move(Geometry=dog_bone_pocket_2.pt_5, Motion=Y_4)  # -> Geometry, Transform
pt_3 = Point(flatten(move_3.Geometry))
pt_4 = Point(flatten([move_14.Geometry, move_7.Geometry]))
pt_5 = Point(flatten([move_8.Geometry, move_9.Geometry]))
pt_6 = Point(flatten([move_10.Geometry, move_11.Geometry]))
pline = PolyLine(Vertices=pt_6, Closed=False)
ln = Line(StartPoint=move_2.Geometry, EndPoint=move_11.Geometry)
join = JoinCurves(Curves=flatten([ln, pline]), Preserve=False)
pline_2 = PolyLine(Vertices=pt_4, Closed=False)
pline_3 = PolyLine(Vertices=pt_5, Closed=False)
ln_2 = Line(StartPoint=move_2.Geometry, EndPoint=move_9.Geometry)
end = EndPoints(Curve=join)  # -> Start, End
end_2 = EndPoints(Curve=pline_2)  # -> Start, End
end_3 = EndPoints(Curve=pline)  # -> Start, End
end_4 = EndPoints(Curve=pline_2)  # -> Start, End
end_5 = EndPoints(Curve=pline_3)  # -> Start, End
ln_3 = Line(StartPoint=end.End, EndPoint=pt_3)
ln_4 = Line(StartPoint=end_2.End, EndPoint=end_3.End)
ln_5 = Line(StartPoint=end_4.End, EndPoint=end_5.End)
number_slider = Slider(12, range=0..201)
join_2 = JoinCurves(Curves=flatten([ln_3, join]), Preserve=False)
join_3 = JoinCurves(Curves=flatten([pline, pline_2, ln, ln_4]), Preserve=False)
join_4 = JoinCurves(Curves=flatten([pline_3, pline_2, ln_2, ln_5]), Preserve=False)
end_6 = EndPoints(Curve=join_4)  # -> Start, End
end_7 = EndPoints(Curve=join_2)  # -> Start, End
xz = XZPlane(Origin=Point(0, 0, 0))
xz_2 = XZPlane(Origin=Point(0, 0, 0))
xz_3 = XZPlane(Origin=Point(0, 0, 0))
Z = UnitZ(Factor=graft(ply_thickness))
Z_2 = UnitZ(Factor=graft(ply_thickness))
division_8 = Division(A=Z, B=-2)
division_9 = Division(A=Z_2, B=-2)
num_2 = Number(end_tab_thickness)
number_slider_2 = Slider(40, range=0..101)
centre_point = ClusterOutput(pt_2)
tab_length_2 = ClusterOutput(num_2)
layers = CreateModifyLayers(LayerName="Connectors", DeleteLayer=False, enableFullPath=False)  # -> LayerNames, LayerFullPath
layers_2 = CreateModifyLayers(LayerName="Connectors", DeleteLayer=False, enableFullPath=False)  # -> LayerNames, LayerFullPath

tab_width = Slider(90, range=25..301)
division_10 = Division(A=num, B=2)
Y_5 = UnitY(Factor=division_10)
move_15 = Move(Geometry=rev_2, Motion=Y_5)  # -> Geometry, Transform
move_16 = Move(Geometry=pt, Motion=Y_5)  # -> Geometry, Transform
X_6 = UnitX(Factor=ply_thickness)
move_17 = Move(Geometry=move_16.Geometry, Motion=X_6)  # -> Geometry, Transform
move_18 = Move(Geometry=pt, Motion=X_6)  # -> Geometry, Transform
xz_4 = XZPlane(Origin=Point(0, 0, 0))

pt_7 = Point(flatten([move_15.Geometry, move_17.Geometry, move_18.Geometry]))

pline_4 = PolyLine(Vertices=flatten(pt_7), Closed=False)
mirror = Mirror(Geometry=pline_4, Plane=xz_4)  # -> Geometry, Transform
join_5 = JoinCurves(Curves=[pline_4, mirror.Geometry], Preserve=False)

move_19 = Move(Geometry=join_5, Motion=X)  # -> Geometry, Transform
end_8 = EndPoints(Curve=move_19.Geometry)  # -> Start, End
split = SplitList(List=end_8.Start, Index=1)  # -> ListA, ListB
ln_6 = Line(StartPoint=end_8.Start, EndPoint=end_8.End)
pt_8 = Point(flatten([split.ListA, end_6.End]))
pt_9 = Point(flatten([split.ListA, end_7.End]))
pline_5 = PolyLine(Vertices=pt_8, Closed=False)
pline_6 = PolyLine(Vertices=pt_9, Closed=False)
join_6 = JoinCurves(Curves=flatten([join_4, pline_5]), Preserve=False)
join_7 = JoinCurves(Curves=flatten([pline_5, join_3]), Preserve=False)
join_8 = JoinCurves(Curves=flatten([join_2, pline_6]), Preserve=False)
mirror_2 = Mirror(Geometry=join_6, Plane=xz)  # -> Geometry, Transform
mirror_3 = Mirror(Geometry=join_7, Plane=xz_2)  # -> Geometry, Transform
mirror_4 = Mirror(Geometry=join_8, Plane=xz_3)  # -> Geometry, Transform
join_9 = JoinCurves(Curves=[mirror_2.Geometry, move_19.Geometry, join_6], Preserve=False)
join_10 = JoinCurves(Curves=[move_19.Geometry, join_7, mirror_3.Geometry], Preserve=False)
join_11 = JoinCurves(Curves=[ln_6, join_8, mirror_4.Geometry], Preserve=False)
mirror_5 = Mirror(Geometry=join_9, Plane=PlaneYZ(0, 0, 0))  # -> Geometry, Transform
mirror_6 = Mirror(Geometry=join_10, Plane=PlaneYZ(0, 0, 0))  # -> Geometry, Transform
join_12 = JoinCurves(Curves=flatten([join_11, mirror_6.Geometry]), Preserve=False)
join_13 = JoinCurves(Curves=[mirror_5.Geometry, join_9], Preserve=False)
crv = Curve(join_13)
crv_2 = Curve(join_12)

multiplication_3 = Multiplication(A=ply_thickness, B=2)
_1_2_beam_width = Division(A=beam_width, B=2)
division_11 = Division(A=ply_thickness, B=2)
subtraction_2 = Subtraction(A=number_slider, B=multiplication_3)
addition_2 = Addition(A=division_11, B=tolerance)
multiplication_4 = Multiplication(A=addition_2, B=-1)
pt_10 = ConstructPoint(XCoordinate=0, YCoordinate=0, ZCoordinate=0)
X_7 = UnitX(Factor=multiplication_4)
move_20 = Move(Geometry=pt_10, Motion=X_7)  # -> Geometry, Transform
move_21 = Move(Geometry=dog_bone_pocket.pt_5, Motion=X_7)  # -> Geometry, Transform
xz_5 = XZPlane(Origin=Point(0, 0, 0))
addition_3 = Addition(A=subtraction, B=ply_thickness)

addition_4 = Addition(A=number_slider, B=multiplication_3)

division_12 = Division(A=addition_4, B=2)
addition_5 = Addition(A=tolerance, B=division_12)
multiplication_5 = Multiplication(A=addition_5, B=-1)
Y_6 = UnitY(Factor=multiplication_5)
move_22 = Move(Geometry=move_21.Geometry, Motion=Y_6)  # -> Geometry, Transform
move_23 = Move(Geometry=pt_10, Motion=Y_6)  # -> Geometry, Transform
geo = Geometry(flatten([move_23.Geometry, move_22.Geometry, move_20.Geometry]))
pline_7 = PolyLine(Vertices=geo, Closed=False)
mirror_7 = Mirror(Geometry=pline_7, Plane=xz_5)  # -> Geometry, Transform
join_14 = JoinCurves(Curves=[pline_7, mirror_7.Geometry], Preserve=False)
mirror_8 = Mirror(Geometry=join_14, Plane=PlaneYZ(0, 0, 0))  # -> Geometry, Transform
join_15 = JoinCurves(Curves=[mirror_8.Geometry, join_14], Preserve=False)
cp = ControlPoints(Curve=join_15)  # -> Points, Weights, Knots
addition_6 = Addition(A=division_12, B=addition_3)
pline_8 = PolyLine(Vertices=cp.Points, Closed=True)
multiplication_6 = Multiplication(A=addition_6, B=-1)
Y_7 = UnitY(Factor=[addition_6, multiplication_6])
move_24 = Move(Geometry=pline_8, Motion=Y_7)  # -> Geometry, Transform

geo_2 = Geometry(flatten([crv, move_24.Geometry]))
geo_3 = Geometry(flatten([crv_2, move_24.Geometry]))
boundary = BoundarySurfaces(Edges=geo_2)
boundary_2 = BoundarySurfaces(Edges=geo_3)
group = Group(Objects=geo_3)
boxprop = BoxProperties(Box=boundary)  # -> Center, Diagonal, Area, Volume, Degeneracy
lng = ListLength(List=group)
boxprop_2 = BoxProperties(Box=boundary_2)  # -> Center, Diagonal, Area, Volume, Degeneracy
extr = Extrude(Base=boundary, Direction=Z)
extr_2 = Extrude(Base=boundary_2, Direction=Z_2)
move_25 = Move(Geometry=extr, Motion=division_8)  # -> Geometry, Transform
move_26 = Move(Geometry=extr_2, Motion=division_9)  # -> Geometry, Transform
_3d_brep_type_1 = ClusterOutput(move_25.Geometry)
_3d_brep_type2 = ClusterOutput(move_26.Geometry)
surface = ClusterOutput(boundary_2)
xy = XYPlane(Origin=boxprop.Center)
xy_2 = XYPlane(Origin=boxprop_2.Center)
prot = RotatePlane(Plane=xy, Angle=degrees(90))
prot_2 = RotatePlane(Plane=xy_2, Angle=degrees(90))
labelling = Labelling_4(part_label="C2", locations=prot, text_size=number_slider_2)
labelling_2 = Labelling_4(part_label="C1", locations=prot_2, text_size=number_slider_2)
data = Data(simplify(labelling))
clean = CleanTree(RemoveNulls=True, RemoveInvalid=True, RemoveEmpty=False, Tree=data)
data_2 = Data(simplify(labelling_2))
clean_2 = CleanTree(RemoveNulls=True, RemoveInvalid=True, RemoveEmpty=False, Tree=data_2)
wires = BrepWireframe(Brep=boundary, Density=-1)
data_3 = Data(simplify(graft(clean)))
data_4 = Data(simplify(graft(clean_2)))
join_16 = JoinCurves(Curves=wires, Preserve=False)  # -> simplify(flatten(Curves))
wires_2 = BrepWireframe(Brep=boundary_2, Density=-1)
txt = Text(data_3)
txt_2 = Text(data_4)
merge = Merge(Data1=data, Data2=join_16)
join_17 = JoinCurves(Curves=wires_2, Preserve=False)  # -> flatten(Curves)
split_2 = TextSplit(Text=txt, Separators=":")
split_3 = TextSplit(Text=txt_2, Separators=":")
item = ListItem(List=split_2, Index=1, Wrap=True)  # -> simplify(Item)
item_2 = ListItem(List=split_3, Index=1, Wrap=True)  # -> simplify(Item)
group_2 = Group(Objects=merge)
merge_2 = Merge(Data1=data_2, Data2=join_17)
panel_7 = Panel(merge)
createatts = CreateAttributes(Name=item, LayerName=layers.LayerNames, enableFullPath=False)
createatts_2 = CreateAttributes(Name=item_2, LayerName=layers_2.LayerNames, enableFullPath=False)
group_3 = Group(Objects=merge_2)
c_2_attributes = ClusterOutput(createatts)
c1_attributes = ClusterOutput(createatts_2)
profile_1st_floor_c_02 = ClusterOutput(group_2)
profile_grnd_floor_c_01 = ClusterOutput(group_3)

# ==== cluster WRENConnector02
tolerance = ClusterInput()
ply_thickness = ClusterInput()
gauge = ClusterInput()
fin_depth = ClusterInput()
slot_length = ClusterInput()
beam_width = ClusterInput()
panel = Panel(gauge)
panel_2 = Panel(fin_depth)
panel_3 = Panel(ply_thickness)
panel_4 = Panel(beam_width)
tab_length = Slider(0, range=0..301)
division = Division(A=gauge, B=2)
division_2 = Division(A=beam_width, B=2)
division_3 = Division(A=beam_width, B=2)
pt = ConstructPoint(XCoordinate=0, YCoordinate=0, ZCoordinate=0)
tab_length_2 = Slider(100, range=0..301)
slot_depth = Slider(30, range=0..301)
division_4 = Division(A=ply_thickness, B=2)
subtraction = Subtraction(A=division, B=division_2)
dog_bone_pocket = DogBonePocket(point=pt)  # -> pt_5, tool_size_2
division_5 = Division(A=fin_depth, B=2)
addition = Addition(A=division_3, B=tab_length)
subtraction_2 = Subtraction(A=subtraction, B=division_4)
pt_2 = ConstructPoint(XCoordinate=0, YCoordinate=0, ZCoordinate=0)
Y = UnitY(Factor=addition)
Y_2 = UnitY(Factor=subtraction)
panel_5 = Panel(Y_2)
X = UnitX(Factor=division_5)
addition_2 = Addition(A=ply_thickness, B=tolerance)
dog_bone_pocket_2 = DogBonePocket(point=pt_2)  # -> pt_5, tool_size_2
neg = Negative(Value=addition_2)
rotate = Rotate(Geometry=dog_bone_pocket_2.pt_5, Angle=1.570796327, Plane=PlaneXY(0, 0, 0))  # -> Geometry, Transform
Y_3 = UnitY(Factor=neg)
move = Move(Geometry=rotate.Geometry, Motion=Y_3)  # -> Geometry, Transform
xz = XZPlane(Origin=Point(0, 0, 0))
rev = ReverseList(List=move.Geometry)
mirror = Mirror(Geometry=move.Geometry, Plane=xz)  # -> Geometry, Transform
division_6 = Division(A=fin_depth, B=2)
pline = PolyLine(Vertices=flatten([rev, mirror.Geometry]), Closed=False)
subtraction_3 = Subtraction(A=division_6, B=slot_length)
Y_4 = UnitY(Factor=addition_2)
move_2 = Move(Geometry=pline, Motion=Y_4)  # -> Geometry, Transform
X_2 = UnitX(Factor=subtraction_3)
move_3 = Move(Geometry=move_2.Geometry, Motion=X_2)  # -> Geometry, Transform
move_4 = Move(Geometry=move_3.Geometry, Motion=Y_2)  # -> Geometry, Transform
subtraction_4 = Subtraction(A=tab_length_2, B=slot_length)
neg_2 = Negative(Value=subtraction_4)
end = EndPoints(Curve=move_3.Geometry)  # -> Start, End
X_3 = UnitX(Factor=neg_2)
move_5 = Move(Geometry=end.End, Motion=X_3)  # -> Geometry, Transform
move_6 = Move(Geometry=end.Start, Motion=X_3)  # -> Geometry, Transform
Y_5 = UnitY(Factor=division_3)
X_4 = UnitX(Factor=division_5)
move_7 = Move(Geometry=move_6.Geometry, Motion=Y_5)  # -> Geometry, Transform
move_8 = Move(Geometry=pt_2, Motion=X_4)  # -> Geometry, Transform
pt_3 = Point(flatten([end.End, move_5.Geometry, move_7.Geometry]))
mirror_2 = Mirror(Geometry=move_8.Geometry, Plane=PlaneYZ(0, 0, 0))  # -> Geometry, Transform
move_9 = Move(Geometry=move_8.Geometry, Motion=Y_5)  # -> Geometry, Transform
pline_2 = PolyLine(Vertices=[mirror_2.Geometry, end.Start], Closed=False)
pline_3 = PolyLine(Vertices=pt_3, Closed=False)
join = JoinCurves(Curves=flatten([move_3.Geometry, pline_3, pline_2]), Preserve=False)
ln = Line(StartPoint=move_8.Geometry, EndPoint=move_9.Geometry)
ln_2 = Line(StartPoint=move_9.Geometry, EndPoint=move_7.Geometry)
join_2 = JoinCurves(Curves=flatten([join, ln, ln_2]), Preserve=False)
move_10 = Move(Geometry=join_2, Motion=Y_2)  # -> Geometry, Transform
end_2 = EndPoints(Curve=move_10.Geometry)  # -> Start, End
xz_2 = XZPlane(Origin=Point(0, 0, 0))
Z = UnitZ(Factor=graft(ply_thickness))
neg_3 = Negative(Value=Z)
division_7 = Division(A=Z, B=-2)
layers = CreateModifyLayers(LayerName="Connectors", DeleteLayer=False, enableFullPath=False)  # -> LayerNames, LayerFullPath
centre_point = ClusterOutput(pt_2)

tab_width = Slider(80, range=25..301)
division_8 = Division(A=tab_width, B=2)
Y_6 = UnitY(Factor=division_8)
move_11 = Move(Geometry=dog_bone_pocket.pt_5, Motion=Y_6)  # -> Geometry, Transform
move_12 = Move(Geometry=pt, Motion=Y_6)  # -> Geometry, Transform
X_5 = UnitX(Factor=ply_thickness)
move_13 = Move(Geometry=move_12.Geometry, Motion=X_5)  # -> Geometry, Transform
move_14 = Move(Geometry=pt, Motion=X_5)  # -> Geometry, Transform
xz_3 = XZPlane(Origin=Point(0, 0, 0))

rev_2 = ReverseList(List=move_11.Geometry)
pt_4 = Point(flatten([rev_2, move_13.Geometry, move_14.Geometry]))

pline_4 = PolyLine(Vertices=pt_4, Closed=False)
mirror_3 = Mirror(Geometry=pline_4, Plane=xz_3)  # -> Geometry, Transform
join_3 = JoinCurves(Curves=[pline_4, mirror_3.Geometry], Preserve=False)

move_15 = Move(Geometry=join_3, Motion=X)  # -> Geometry, Transform
mirror_4 = Mirror(Geometry=move_15.Geometry, Plane=PlaneYZ(0, 0, 0))  # -> Geometry, Transform
end_3 = EndPoints(Curve=move_15.Geometry)  # -> Start, End
pline_5 = PolyLine(Vertices=[end_3.End, end_3.Start], Closed=False)
ln_3 = Line(StartPoint=end_3.Start, EndPoint=end_2.Start)
mirror_5 = Mirror(Geometry=ln_3, Plane=PlaneYZ(0, 0, 0))  # -> Geometry, Transform
geo = Geometry(flatten([ln_3, mirror_5.Geometry, move_10.Geometry]))
mirror_6 = Mirror(Geometry=geo, Plane=xz_2)  # -> Geometry, Transform
join_4 = JoinCurves(Curves=flatten([mirror_6.Geometry, mirror_4.Geometry, pline_5, geo]), Preserve=False)
geo_2 = Geometry(flatten(join_4))
boundary = BoundarySurfaces(Edges=geo_2)
boxprop = BoxProperties(Box=boundary)  # -> Center, Diagonal, Area, Volume, Degeneracy
extr = Extrude(Base=boundary, Direction=neg_3)
move_16 = Move(Geometry=extr, Motion=division_7)  # -> Geometry, Transform
xy = XYPlane(Origin=boxprop.Center)
prot = RotatePlane(Plane=xy, Angle=degrees(90))
labelling = Labelling_4(part_label="C3", locations=prot, text_size=Slider(40, range=0..101))
data = Data(simplify(labelling))
wires = BrepWireframe(Brep=boundary, Density=-1)
join_5 = JoinCurves(Curves=wires, Preserve=False)  # -> simplify(flatten(Curves))
merge = Merge(Data1=data, Data2=join_5)
group = Group(Objects=merge)
clean = CleanTree(RemoveNulls=True, RemoveInvalid=True, RemoveEmpty=False, Tree=data)
data_2 = Data(simplify(graft(clean)))
txt = Text(data_2)
split = TextSplit(Text=txt, Separators=":")
item = ListItem(List=split, Index=1, Wrap=True)  # -> simplify(Item)
createatts = CreateAttributes(Name=item, LayerName=layers.LayerNames, enableFullPath=False)
attributes = ClusterOutput(createatts)
_2d_profile = ClusterOutput(group)
_3d_solid = ClusterOutput(extr)

# ==== cluster WRENSheathing
sheet_width = ClusterInput()
sheet_length = ClusterInput()
beam_width = ClusterInput()
connector_grip_length = ClusterInput()
connector_tab_length = ClusterInput()
fin_depth = ClusterInput()
gauge = ClusterInput()
grip_tab_length = ClusterInput()
ply_thickness = ClusterInput()
spacing = ClusterInput()
tolerance = ClusterInput()
tool_size = ClusterInput()
si_slot_length = ClusterInput()
count = ClusterInput()
_1st_floor_height = ClusterInput()
gutters_rails = ClusterInput()
outer_curve = ClusterInput()
inner_curve = ClusterInput()
_2nd_floor_curve = ClusterInput()
central_column = ClusterInput()
fin_depth_2 = Number(fin_depth)
crv = Curve(flatten(central_column))
crv_2 = Curve(inner_curve)
crv_3 = Curve(_2nd_floor_curve)
division = Division(A=ply_thickness, B=-2)
crv_4 = Curve(outer_curve)
neg = Negative(Value=division)
xz = XZPlane(Origin=Point(0, 0, 0))
neg_2 = Negative(Value=ply_thickness)
xz_2 = XZPlane(Origin=Point(0, 0, 0))
offset = Offset(Curve=crv_2, Distance=neg, Plane=xz, Corners=1)
offset_2 = Offset(Curve=crv_2, Distance=division, Plane=xz, Corners=1)
len = Length(Curve=crv_2)
offset_3 = Offset(Curve=crv_2, Distance=ply_thickness, Plane=xz_2, Corners=1)
offset_4 = Offset(Curve=crv_2, Distance=neg_2, Plane=xz_2, Corners=1)
len_2 = Length(Curve=offset_2)
len_3 = Length(Curve=offset)
len_4 = Length(Curve=offset_4)
len_5 = Length(Curve=offset_3)
smaller = SmallerThan(FirstNumber=len_3, SecondNumber=len)  # -> SmallerThan, OrEqualTo
smaller_2 = SmallerThan(FirstNumber=len_2, SecondNumber=len)  # -> SmallerThan, OrEqualTo
smaller_3 = SmallerThan(FirstNumber=flatten(len_4), SecondNumber=flatten(len))  # -> SmallerThan, OrEqualTo
smaller_4 = SmallerThan(FirstNumber=len_5, SecondNumber=len)  # -> SmallerThan, OrEqualTo
dispatch = Dispatch(List=offset_2, DispatchPattern=smaller_2.SmallerThan)  # -> ListA, ListB
dispatch_2 = Dispatch(List=offset, DispatchPattern=smaller.OrEqualTo)  # -> ListA, ListB
dispatch_3 = Dispatch(List=offset_4, DispatchPattern=smaller_3.SmallerThan)  # -> ListA, ListB
dispatch_4 = Dispatch(List=offset_3, DispatchPattern=smaller_4.OrEqualTo)  # -> ListA, ListB
crv_5 = Curve(crv_2)
crv_6 = Curve(dispatch.ListA)
crv_7 = Curve(dispatch_2.ListA)
ccx = CurveCurve(CurveA=gutters_rails, CurveB=crv_4)  # -> Points, ParamsA, ParamsB
crv_8 = Curve(dispatch_3.ListA)
crv_9 = Curve(dispatch_4.ListA)
crv_10 = Curve(flatten([crv_9, crv_8]))
crv_11 = Curve(flatten([crv_7, crv_6]))
ccx_2 = CurveCurve(CurveA=crv_11, CurveB=crv_3)  # -> Points, ParamsA, ParamsB
ccx_3 = CurveCurve(CurveA=crv_11, CurveB=crv)  # -> Points, ParamsA, ParamsB
shatter = Shatter(Curve=crv, Parameters=flatten(ccx_3.ParamsB))
shatter_2 = Shatter(Curve=crv_3, Parameters=flatten(ccx_2.ParamsB))
shatter_3 = Shatter(Curve=crv_4, Parameters=flatten(ccx.ParamsB))
dispatch_5 = Dispatch(List=shatter, DispatchPattern=[True, False])  # -> ListA, ListB
disc = Discontinuity(Curve=crv_4, Level=1)  # -> Points, Parameters
dispatch_6 = Dispatch(List=shatter_2, DispatchPattern=[True, False])  # -> ListA, ListB
division_2 = Division(A=fin_depth_2, B=2)
disc_2 = Discontinuity(Curve=crv_11, Level=1)  # -> Points, Parameters
disc_3 = Discontinuity(Curve=crv_5, Level=1)  # -> Points, Parameters
disc_4 = Discontinuity(Curve=crv_10, Level=1)  # -> Points, Parameters
len_6 = Length(Curve=shatter_3)
division_3 = Division(A=fin_depth_2, B=2)
pdecon = Deconstruct(Point=disc.Points)  # -> XComponent, YComponent, ZComponent
crv_12 = Curve(crv)
crv_13 = Curve(dispatch_6.ListB)
pdecon_2 = Deconstruct(Point=disc_2.Points)  # -> XComponent, YComponent, ZComponent
addition = Addition(A=division_2, B=ply_thickness)
pdecon_3 = Deconstruct(Point=disc_3.Points)  # -> XComponent, YComponent, ZComponent
crv_14 = Curve(crv_4)
larger = LargerThan(FirstNumber=len_6, SecondNumber="300")  # -> LargerThan, OrEqualTo
pdecon_4 = Deconstruct(Point=disc_4.Points)  # -> XComponent, YComponent, ZComponent
sort = SortList(Keys=pdecon.ZComponent, ValuesA=disc.Points)  # -> Keys, ValuesA
sort_2 = SortList(Keys=pdecon_2.ZComponent, ValuesA=disc_2.Points)  # -> Keys, ValuesA
sort_3 = SortList(Keys=pdecon_3.ZComponent, ValuesA=disc_3.Points)  # -> Keys, ValuesA
dispatch_7 = Dispatch(List=shatter_3, DispatchPattern=larger.LargerThan)  # -> ListA, ListB
sort_4 = SortList(Keys=pdecon_4.ZComponent, ValuesA=disc_4.Points)  # -> Keys, ValuesA
xz_3 = XZPlane(Origin=Point(0, 0, 0))
neg_3 = Negative(Value=division_3)
xz_4 = XZPlane(Origin=Point(0, 0, 0))
neg_4 = Negative(Value=addition)
crv_15 = Curve(crv_11)
crv_16 = Curve(crv_5)
disc_5 = Discontinuity(Curve=crv_15, Level=1)  # -> Points, flatten(Parameters)
crv_17 = Curve(crv_10)
disc_6 = Discontinuity(Curve=crv_16, Level=1)  # -> Points, flatten(Parameters)
lng = ListLength(List=sort.ValuesA)
disc_7 = Discontinuity(Curve=crv_17, Level=1)  # -> Points, flatten(Parameters)
lng_2 = ListLength(List=sort_2.ValuesA)
lng_3 = ListLength(List=sort_3.ValuesA)
lng_4 = ListLength(List=sort_4.ValuesA)
disc_8 = Discontinuity(Curve=crv_14, Level=1)  # -> Points, flatten(Parameters)
subtraction = Subtraction(A=lng, B=1)
shatter_4 = Shatter(Curve=crv_15, Parameters=disc_5.Parameters)  # -> flatten(Segments)
shatter_5 = Shatter(Curve=crv_16, Parameters=disc_6.Parameters)  # -> flatten(Segments)
shatter_6 = Shatter(Curve=crv_17, Parameters=disc_7.Parameters)  # -> flatten(Segments)
subtraction_2 = Subtraction(A=lng_2, B=1)
subtraction_3 = Subtraction(A=lng_3, B=1)
offset_5 = Offset(Curve=crv_12, Distance=neg_3, Plane=xz_3, Corners=1)
offset_6 = Offset(Curve=crv_12, Distance=division_3, Plane=xz_3, Corners=1)
offset_7 = Offset(Curve=crv_13, Distance=addition, Plane=xz_4, Corners=1)
division_4 = Division(A=ply_thickness, B=2)
subtraction_4 = Subtraction(A=lng_4, B=1)
division_5 = Division(A=ply_thickness, B=2)
offset_8 = Offset(Curve=crv_13, Distance=neg_4, Plane=xz_4, Corners=1)
shatter_7 = Shatter(Curve=crv_14, Parameters=disc_8.Parameters)  # -> flatten(Segments)
item = ListItem(List=sort.ValuesA, Index=subtraction, Wrap=True)
shift = ShiftList(List=shatter_4, Shift=0, Wrap=True)
shift_2 = ShiftList(List=shatter_5, Shift=0, Wrap=True)
Z = UnitZ(Factor=1)
shift_3 = ShiftList(List=shatter_6, Shift=0, Wrap=True)
item_2 = ListItem(List=sort_2.ValuesA, Index=subtraction_2, Wrap=True)
item_3 = ListItem(List=sort_3.ValuesA, Index=subtraction_3, Wrap=True)
item_4 = ListItem(List=sort_4.ValuesA, Index=subtraction_4, Wrap=True)
geo = Geometry([offset_5, offset_6])
neg_5 = Negative(Value=division_5)
cull_i = CullIndex(List=shift, Indices=0, Wrap=True)
cull_i_2 = CullIndex(List=shift_2, Indices=0, Wrap=True)
geo_2 = Geometry(shatter_7)
item_5 = ListItem(List=geo, Index=0, Wrap=True)
cull_i_3 = CullIndex(List=shift_3, Indices=0, Wrap=True)
item_6 = ListItem(List=geo, Index=1, Wrap=True)
move = Move(Motion=Z)  # -> Geometry, Transform
number_slider = Slider(71, range=0..71)
cull_i_4 = CullIndex(List=geo_2, Indices=0, Wrap=True)
neg_6 = Negative(Value=division_4)
eval = EvaluateLength(Curve=cull_i, Length=0.5, Normalized=True)  # -> Point, Tangent, Parameter
eval_2 = EvaluateLength(Curve=cull_i_2, Length=0.5, Normalized=True)  # -> Point, Tangent, Parameter
xz_5 = XZPlane(Origin=Point(0, 0, 0))
eval_3 = EvaluateLength(Curve=cull_i_3, Length=0.5, Normalized=True)  # -> Point, Tangent, Parameter
offset_9 = Offset(Curve=offset_8, Distance=division_5, Plane=xz_4, Corners=1)
offset_10 = Offset(Curve=offset_7, Distance=neg_5, Plane=xz_4, Corners=1)
eval_4 = EvaluateLength(Curve=cull_i_4, Length=0.5, Normalized=True)  # -> Point, Tangent, Parameter
offset_11 = Offset(Curve=item_6, Distance=division_4, Plane=xz_5, Corners=1)
pdecon_5 = Deconstruct(Point=item_2)  # -> XComponent, YComponent, ZComponent
pdecon_6 = Deconstruct(Point=item_3)  # -> XComponent, YComponent, ZComponent
pdecon_7 = Deconstruct(Point=eval.Point)  # -> XComponent, YComponent, ZComponent
pdecon_8 = Deconstruct(Point=item_4)  # -> XComponent, YComponent, ZComponent
pdecon_9 = Deconstruct(Point=eval_2.Point)  # -> XComponent, YComponent, ZComponent
offset_12 = Offset(Curve=item_5, Distance=neg_6, Plane=xz_5, Corners=1)
pdecon_10 = Deconstruct(Point=eval_3.Point)  # -> XComponent, YComponent, ZComponent
pdecon_11 = Deconstruct(Point=item)  # -> XComponent, YComponent, ZComponent
pdecon_12 = Deconstruct(Point=eval_4.Point)  # -> XComponent, YComponent, ZComponent
smaller_5 = SmallerThan(FirstNumber=pdecon_6.XComponent, SecondNumber=pdecon_9.XComponent)  # -> SmallerThan, OrEqualTo
ext = ExtendCurve(Curve=offset_11, Type=0, Start=number_slider, End=number_slider)
ext_2 = ExtendCurve(Curve=offset_12, Type=0, Start=number_slider, End=number_slider)
smaller_6 = SmallerThan(FirstNumber=pdecon_5.XComponent, SecondNumber=pdecon_7.XComponent)  # -> SmallerThan, OrEqualTo
smaller_7 = SmallerThan(FirstNumber=pdecon_8.XComponent, SecondNumber=pdecon_10.XComponent)  # -> SmallerThan, OrEqualTo
smaller_8 = SmallerThan(FirstNumber=pdecon_11.XComponent, SecondNumber=pdecon_12.XComponent)  # -> SmallerThan, OrEqualTo
ccx_4 = CurveCurve(CurveA=ext, CurveB=crv_10)  # -> Points, ParamsA, ParamsB
dispatch_8 = Dispatch(List=cull_i, DispatchPattern=smaller_6.OrEqualTo)  # -> ListA, ListB
dispatch_9 = Dispatch(List=cull_i_2, DispatchPattern=smaller_5.OrEqualTo)  # -> ListA, ListB
ccx_5 = CurveCurve(CurveA=ext_2, CurveB=crv_10)  # -> Points, ParamsA, ParamsB
dispatch_10 = Dispatch(List=cull_i_3, DispatchPattern=smaller_7.OrEqualTo)  # -> ListA, ListB
dispatch_11 = Dispatch(List=cull_i_4, DispatchPattern=smaller_8.OrEqualTo)  # -> ListA, ListB
flip = FlipCurve(Curve=dispatch_8.ListB)  # -> Curve, Flag
flip_2 = FlipCurve(Curve=dispatch_9.ListB)  # -> Curve, Flag
item_7 = ListItem(List=shift, Index=0, Wrap=True)  # -> simplify(flatten(Item))
shatter_8 = Shatter(Curve=ext_2, Parameters=flatten(ccx_5.ParamsA))
shatter_9 = Shatter(Curve=ext, Parameters=flatten(ccx_4.ParamsA))
geo_3 = Geometry(dispatch_8.ListA)
flip_3 = FlipCurve(Curve=dispatch_10.ListB)  # -> Curve, Flag
geo_4 = Geometry(dispatch_9.ListA)
geo_5 = Geometry(dispatch_10.ListA)
item_8 = ListItem(List=geo_2, Index=0, Wrap=True)
flip_4 = FlipCurve(Curve=dispatch_11.ListB)  # -> Curve, Flag
geo_6 = Geometry(dispatch_11.ListA)
dispatch_12 = Dispatch(List=shatter_8, DispatchPattern=[True, False])  # -> ListA, ListB
dispatch_13 = Dispatch(List=shatter_9, DispatchPattern=[True, False])  # -> ListA, ListB
merge = Merge(Data1=geo_3, Data2=flip.Curve)  # -> flatten(Result)
merge_2 = Merge(Data1=geo_4, Data2=flip_2.Curve)  # -> flatten(Result)
merge_3 = Merge(Data1=geo_5, Data2=flip_3.Curve)  # -> flatten(Result)
merge_4 = Merge(Data1=item_8, Data2=geo_6, Data3=flip_4.Curve)  # -> flatten(Result)
geo_7 = Geometry(dispatch_12.ListA)
geo_8 = Geometry(dispatch_12.ListB)
geo_9 = Geometry(dispatch_13.ListA)
geo_10 = Geometry(dispatch_13.ListB)

number_slider_2 = Slider(3, range=0..21)
number_slider_3 = Slider(3, range=0..21)

merge_5 = Merge(Data1=geo_8, Data2=geo_10)  # -> simplify(flatten(Result))
spreadsheet = ClusterInput()
google_token = ClusterInput()
worksheet = ClusterInput()
unit_type = ClusterInput()
data = Data(unit_type)
refresh_spreadsheet_data = BooleanToggle(True)
panel = Panel(worksheet)
concat = Concatenate(FragmentA=worksheet, FragmentB="Window/Door")
panel_2 = Panel(spreadsheet)
readspreadsheet = ReadFromSpreadsheet(
    Token=google_token,
    Name=spreadsheet,
    Worksheet="Window/Door",
    IncludeBlankCells=False,
    OrganizeByRowsOrColumns=False,
    ReadFormulasOrValues=False,
    Refresh=refresh_spreadsheet_data)  # -> Values, CellAddresses, SheetInfo
first_floor_curve = Geometry(crv_3)
# Grip Len
# Grip Len + Tol
# Ply Thk
# Tol
# Ply Thk
null = NullItem(Item=first_floor_curve)  # -> NullFlags, InvalidFlags, Description
cull_i_5 = CullIndex(List=readspreadsheet.Values, Indices=0, Wrap=True)  # -> simplify(List)

roof_connectors = ClusterInput()
ext_grip_points = ClusterInput()
connector_points = ClusterInput()
space_invader_points = ClusterInput()
centre_curve = ClusterInput()
reinforcer_edges = ClusterInput()
int_grip_points = ClusterInput()

tstat = TreeStatistics(Tree=cull_i_5)  # -> Paths, Length, Count

# ----
# Type Label: Find Unit Type Label
branch = TreeBranch(Tree=readspreadsheet.Values, Path="{0;2}", MaintainPaths=True)
item_9 = ListItem(List=branch, Index=0, Wrap=True)
panel_3 = Panel(item_9)

int = Integer(number_slider_3)
subtraction_5 = Subtraction(A=tstat.Count, B=1)
addition_2 = Addition(A=int, B=1)
dom = ConstructDomain(DomainStart=addition_2, DomainEnd=subtraction_5)
subtraction_6 = Subtraction(A=subtraction_5, B=addition_2)
pt = Point(flatten(roof_connectors))
pt_2 = Point(connector_points)
pt_3 = Point(flatten(space_invader_points))  # disabled
pt_4 = Point(flatten(ext_grip_points))
pt_5 = Point(int_grip_points)
crv_18 = Curve(centre_curve)
crv_19 = Curve(crv_18)
disc_9 = Discontinuity(Curve=crv_19, Level=1)  # -> Points, Parameters
pdecon_13 = Deconstruct(Point=disc_9.Points)  # -> XComponent, YComponent, ZComponent
sort_5 = SortList(Keys=pdecon_13.ZComponent, ValuesA=disc_9.Points)  # -> Keys, ValuesA
crv_20 = Curve(crv_19)
disc_10 = Discontinuity(Curve=crv_20, Level=1)  # -> Points, flatten(Parameters)
lng_5 = ListLength(List=sort_5.ValuesA)
shatter_10 = Shatter(Curve=crv_20, Parameters=disc_10.Parameters)  # -> flatten(Segments)
subtraction_7 = Subtraction(A=lng_5, B=1)
shift_4 = ShiftList(List=shatter_10, Shift=0, Wrap=True)
item_10 = ListItem(List=sort_5.ValuesA, Index=subtraction_7, Wrap=True)
cull_i_6 = CullIndex(List=shift_4, Indices=0, Wrap=True)
eval_5 = EvaluateLength(Curve=cull_i_6, Length=0.5, Normalized=True)  # -> Point, Tangent, Parameter
pdecon_14 = Deconstruct(Point=item_10)  # -> XComponent, YComponent, ZComponent
pdecon_15 = Deconstruct(Point=eval_5.Point)  # -> XComponent, YComponent, ZComponent
smaller_9 = SmallerThan(FirstNumber=pdecon_14.XComponent, SecondNumber=pdecon_15.XComponent)  # -> SmallerThan, OrEqualTo
dispatch_14 = Dispatch(List=cull_i_6, DispatchPattern=smaller_9.OrEqualTo)  # -> ListA, ListB
flip_5 = FlipCurve(Curve=dispatch_14.ListB)  # -> Curve, Flag
geo_11 = Geometry(dispatch_14.ListA)
merge_6 = Merge(Data1=geo_11, Data2=flip_5.Curve)  # -> flatten(Result)
centreline_profile = Geometry(simplify(graft(merge_6)))
colom = CollisionOneMany(Collider=centreline_profile, Obstacles=first_floor_curve)  # -> Collision, Index
dispatch_15 = Dispatch(List=centreline_profile, DispatchPattern=colom.Collision)  # -> ListA, ListB
dispatch_16 = Dispatch(List=centreline_profile, DispatchPattern=null.NullFlags)  # -> ListA, ListB
geo_12 = Geometry(dispatch_15.ListA)
ccx_6 = CurveCurve(CurveA=geo_12, CurveB=flatten(first_floor_curve))  # -> Points, ParamsA, ParamsB
shatter_11 = Shatter(Curve=geo_12, Parameters=ccx_6.ParamsA)  # -> simplify(Segments)
tstat_2 = TreeStatistics(Tree=shatter_11)  # -> Paths, Length, Count
subtraction_8 = Subtraction(A=tstat_2.Count, B=1)
geo_13 = Geometry(reinforcer_edges)
path = ConstructPath(Indices=subtraction_8)
range = Range(Domain=dom, Steps=subtraction_6)
split = SplitTree(Data=shatter_11, Masks=flatten(path))  # -> Positive, Negative
int_2 = Integer(range)
concat_2 = Concatenate(FragmentA="{", FragmentB=int_2)
disc_11 = Discontinuity(Curve=crv_18, Level=1)  # -> Points, Parameters
rev = ReverseList(List=split.Positive)
lng_6 = ListLength(List=pt_2)

bay_number = ClusterInput()
int_3 = Integer(bay_number)
subtraction_9 = Subtraction(A=int_3, B=1)
concat_3 = Concatenate(FragmentA="{0;", FragmentB=int_3)
concat_4 = Concatenate(FragmentA=concat_3, FragmentB="}")

subtraction_10 = Subtraction(A=number_slider_3, B=1)
concat_5 = Concatenate(FragmentA=concat_2, FragmentB="}")
shatter_12 = Shatter(Curve=crv_18, Parameters=disc_11.Parameters)
subtraction_11 = Subtraction(A=lng_6, B=2)
merge_7 = Merge(Data1=split.Negative, Data2=rev, Data3=dispatch_15.ListB, Data4=dispatch_16.ListA)  # -> flatten(Result)
ccx_7 = CurveCurve(CurveA=graft(crv), CurveB=geo_13)  # -> flatten(Points), ParamsA, ParamsB
ccx_8 = CurveCurve(CurveA=graft(crv_3), CurveB=geo_13)  # -> flatten(Points), ParamsA, ParamsB
branch_bay = TreeBranch(Tree=simplify(cull_i_5), Path=flatten(subtraction_10), MaintainPaths=True)
ccx_9 = CurveCurve(CurveA=graft(shatter_12), CurveB=geo_13)  # -> flatten(Points), ParamsA, ParamsB
cull_i_7 = CullIndex(List=pt_2, Indices=subtraction_11, Wrap=True)
split_2 = SplitTree(Data=simplify(cull_i_5), Masks=flatten(concat_5))  # -> Positive, Negative
branch_bay_2 = TreeBranch(Tree=simplify(cull_i_5), Path=number_slider_3, MaintainPaths=True)
geo_14 = Geometry(simplify(graft(merge_7)))
cull_i_8 = CullIndex(List=cull_i_7, Indices=subtraction_11, Wrap=False)
monoslope_count = Slider(3, range=0..4)
cull_i_9 = CullIndex(List=branch_bay, Indices=flatten(0), Wrap=False)  # -> simplify(List)
centre_profiles = Geometry(geo_14)
colom_2 = CollisionOneMany(Collider=flatten(pt), Obstacles=graft(shatter_12))  # -> Collision, Index
colom_3 = CollisionOneMany(Collider=flatten(cull_i_8), Obstacles=graft(shatter_12))  # -> Collision, Index
colom_4 = CollisionOneMany(Collider=flatten(pt_2), Obstacles=graft(shatter_12))  # -> Collision, Index
colom_5 = CollisionOneMany(Collider=flatten(pt_2), Obstacles=graft(crv_3))  # -> Collision, Index
colom_6 = CollisionOneMany(Collider=simplify(int_grip_points), Obstacles=graft(crv_3))  # -> Collision, Index
colom_7 = CollisionOneMany(Collider=pt_3, Obstacles=graft(shatter_12))  # -> Collision, Index
colom_8 = CollisionOneMany(Collider=ccx_7.Points, Obstacles=graft(crv))  # -> Collision, Index
colom_9 = CollisionOneMany(Collider=pt_3, Obstacles=graft(crv_3))  # -> Collision, Index
colom_10 = CollisionOneMany(Collider=pt_3, Obstacles=graft(crv))  # -> Collision, Index
colom_11 = CollisionOneMany(Collider=ccx_8.Points, Obstacles=graft(crv_3))  # -> Collision, Index
colom_12 = CollisionOneMany(Collider=ccx_9.Points, Obstacles=graft(shatter_12))  # -> Collision, Index
colom_13 = CollisionOneMany(Collider=pt_4, Obstacles=graft(shatter_12))  # -> Collision, Index
tmatch = MatchText(Text=branch_bay_2, RegEx="FW", Case=True)
tstat_3 = TreeStatistics(Tree=centre_profiles)  # -> Paths, Length, Count
dispatch_17 = Dispatch(List=flatten(pt), DispatchPattern=colom_2.Collision)  # -> simplify(ListA), ListB
dispatch_18 = Dispatch(List=flatten(cull_i_8), DispatchPattern=colom_3.Collision)  # -> ListA, ListB
dispatch_19 = Dispatch(List=flatten(pt_2), DispatchPattern=colom_4.Collision)  # -> ListA, ListB
dispatch_20 = Dispatch(List=flatten(pt_2), DispatchPattern=colom_5.Collision)  # -> ListA, ListB
dispatch_21 = Dispatch(List=pt_3, DispatchPattern=colom_7.Collision)  # -> ListA, ListB
dispatch_22 = Dispatch(List=pt_3, DispatchPattern=colom_9.Collision)  # -> ListA, ListB
dispatch_23 = Dispatch(List=pt_3, DispatchPattern=colom_10.Collision)  # -> ListA, ListB
dispatch_24 = Dispatch(List=pt_4, DispatchPattern=colom_13.Collision)  # -> ListA, ListB
dispatch_25 = Dispatch(List=simplify(int_grip_points), DispatchPattern=colom_6.Collision)  # -> ListA, ListB
dispatch_26 = Dispatch(List=ccx_7.Points, DispatchPattern=colom_8.Collision)  # -> ListA, ListB
dispatch_27 = Dispatch(List=ccx_8.Points, DispatchPattern=colom_11.Collision)  # -> ListA, ListB
dispatch_28 = Dispatch(List=ccx_9.Points, DispatchPattern=colom_12.Collision)  # -> ListA, ListB
similar = Similarity(FirstNumber=tstat_3.Count, SecondNumber=monoslope_count, Threshold=0.1)  # -> Similarity, AbsoluteDifference
dispatch_29 = Dispatch(List=cull_i_9, DispatchPattern=flatten(tmatch))  # -> ListA, simplify(ListB)
dispatch_30 = Dispatch(List=split_2.Positive, DispatchPattern=tmatch)  # -> ListA, ListB
dispatch_31 = Dispatch(List=branch_bay_2, DispatchPattern=tmatch)  # -> ListA, ListB
dispatch_32 = Dispatch(List=centre_profiles, DispatchPattern=similar.Similarity)  # -> ListA, ListB
tmatch_2 = MatchText(Text=dispatch_31.ListB, RegEx="RW", Case=True)
dispatch_33 = Dispatch(List=dispatch_29.ListB, DispatchPattern=flatten(tmatch_2))  # -> ListA, simplify(ListB)
dispatch_34 = Dispatch(List=dispatch_31.ListB, DispatchPattern=tmatch_2)  # -> ListA, ListB
dispatch_35 = Dispatch(List=dispatch_30.ListB, DispatchPattern=tmatch_2)  # -> ListA, ListB
integer_division = IntegerDivision(A=tstat_3.Count, B=2)
subtraction_12 = Subtraction(A=number_slider_3, B=1)
fragment = TextFragment(Text=dispatch_34.ListB, Start=1)
# Ply Thk
# Tol
# Grip Len
# Grip Len + Tol
# Tol
# Grip Len
# Grip Len + Tol
# Hor Grip Width
# Hor Grip Width
# Tool Width
# Hor Grip Width
# Tool Width
# Hor Grip Width
# Tool Width
# Hor Grip Width
# Tool Width
subtraction_13 = Subtraction(A=tstat_3.Count, B=1)
subtraction_14 = Subtraction(A=integer_division, B=1)
panel_4 = Panel(dispatch_29.ListB)
bays_with_openings = Integer(fragment)
dom_2 = ConstructDomain(DomainStart=0, DomainEnd=subtraction_14)
branch_2 = TreeBranch(Tree=dispatch_32.ListA, Path="{0}", MaintainPaths=True)
branch_3 = TreeBranch(Tree=dispatch_32.ListA, Path="{1}", MaintainPaths=True)
branch_4 = TreeBranch(Tree=dispatch_32.ListA, Path=subtraction_13, MaintainPaths=True)
range_2 = Range(Domain=dom_2, Steps=subtraction_14)
len_7 = Length(Curve=branch_2)
len_8 = Length(Curve=branch_4)
equals = Equality(FirstNumber=bays_with_openings, SecondNumber=int_3)  # -> Equality, Inequality
int_4 = Integer(range_2)
smaller_10 = SmallerThan(FirstNumber=len_7, SecondNumber=len_8)  # -> SmallerThan, OrEqualTo
branch_5 = Slider(2, range=0..4)
concat_6 = Concatenate(FragmentA="{", FragmentB=int_4)
branch_6 = Slider(3, range=0..6)
branch_7 = Slider(8, range=0..10)
concat_7 = Concatenate(FragmentA=concat_6, FragmentB="}")
dispatch_36 = Dispatch(List=bays_with_openings, DispatchPattern=equals.Equality)  # -> ListA, ListB
dcon = DeleteConsecutive(Set=bays_with_openings, Wrap=False)  # -> Set, Count
dispatch_37 = Dispatch(List=branch_3, DispatchPattern=smaller_10.SmallerThan)  # -> ListA, ListB
dispatch_38 = Dispatch(List=dispatch_33.ListB, DispatchPattern=equals.Equality)  # -> ListA, ListB
dispatch_39 = Dispatch(List=dispatch_35.ListB, DispatchPattern=equals.Equality)  # -> ListA, ListB
data_2 = Data(dispatch_33.ListB)
data_3 = Data(bays_with_openings)
data_4 = Data(dispatch_35.ListB)
split_3 = SplitTree(Data=dispatch_32.ListB, Masks=flatten(concat_7))  # -> BRIght, Negative
addition_3 = Addition(A=branch_5, B=subtraction_12)
path_mapper = PathMapper(data_2, source="{A;B}", target="{A}")
path_mapper_2 = PathMapper(dispatch_38.ListA, source="{A;B}", target="{A}")
addition_4 = Addition(A=branch_6, B=subtraction_12)
merge_8 = Merge(Data1=branch_2, Data2=dispatch_37.ListA)
addition_5 = Addition(A=branch_7, B=subtraction_12)
merge_9 = Merge(Data1=dispatch_37.ListB, Data2=branch_4)
bay_number_2 = Panel(data_3)
data_5 = Data(dcon.Set)
data_6 = Data(data_3)
side_b = Geometry(merge_8)
side_a = Geometry(merge_9)
panel_5 = Panel(data_5)
lng_7 = ListLength(List=data_5)
equals_2 = Equality(FirstNumber=data_6, SecondNumber=data_5)  # -> Equality, Inequality
merge_10 = Merge(Data1=path_mapper_2, Data2=dispatch_39.ListA)  # -> simplify(Result)
merge_11 = Merge(Data1=path_mapper, Data2=data_4)
data_7 = Data(merge_11)
branch_8 = TreeBranch(Tree=data_7, Path=addition_3, MaintainPaths=True)
branch_9 = TreeBranch(Tree=data_7, Path=addition_4, MaintainPaths=True)
branch_10 = TreeBranch(Tree=data_7, Path=addition_5, MaintainPaths=True)
window_code = Text(branch_8)
height_from_floor = Number(branch_10)
series = Series(Start=0, Step=1, Count=lng_7)
merge_12 = Merge(Data1=split_3.BRIght, Data2=side_b)
left_a_or_right_b = Text(branch_9)
merge_13 = Merge(Data1=split_3.Negative, Data2=side_a)
height_from_floor_2 = Number(_1st_floor_height)
panel_6 = Panel(merge_10)
cull = CullPattern(List=series, CullPattern=equals_2.Equality)
panel_7 = Panel(window_code)
clean = CleanTree(RemoveNulls=True, RemoveInvalid=True, RemoveEmpty=True, Tree=merge_12)
clean_2 = CleanTree(RemoveNulls=True, RemoveInvalid=True, RemoveEmpty=True, Tree=merge_13)
Y = UnitY(Factor=gauge)
Y_2 = UnitY(Factor=gauge)
tmatch_3 = MatchText(Text=left_a_or_right_b, Pattern="A", Case=True)
side_a_2 = Dispatch(List=clean_2, DispatchPattern=tmatch_3)  # -> ListA, ListB
side_a_3 = Dispatch(List=clean, DispatchPattern=tmatch_3)  # -> ListA, ListB
tmatch_4 = MatchText(Text=window_code, Pattern="GF", Case=True)
arrlinear = LinearArray(Geometry=clean, Direction=flatten(Y), Count=flatten(count))  # -> simplify(Geometry), Transform
side_a_4 = Geometry(side_a_2.ListA)
arrlinear_2 = LinearArray(Geometry=clean_2, Direction=flatten(Y_2), Count=flatten(count))  # -> simplify(Geometry), Transform
side_b_2 = Geometry(side_a_3.ListB)
side_a_5 = Dispatch(List=window_code, DispatchPattern=tmatch_3)  # -> ListA, ListB
flip_6 = FlipMatrix(Data=arrlinear.Geometry)
flip_7 = FlipMatrix(Data=arrlinear_2.Geometry)
side_a_6 = Dispatch(List=window_code, DispatchPattern=tmatch_3)  # -> ListA, ListB
side_a_7 = Dispatch(List=height_from_floor, DispatchPattern=tmatch_3)  # -> ListA, ListB
side_a_8 = Dispatch(List=tmatch_4, DispatchPattern=tmatch_3)  # -> ListA, ListB
branch_11 = TreeBranch(Tree=flip_6, Path=dcon.Set, MaintainPaths=True)
branch_12 = TreeBranch(Tree=flip_7, Path=dcon.Set, MaintainPaths=True)
flip_8 = FlipMatrix(Data=branch_11)
side_b_3 = Geometry(flip_8)
flip_9 = FlipMatrix(Data=branch_12)
side_a_9 = Geometry(flip_9)
tstat_4 = TreeStatistics(Tree=side_b_3)  # -> Paths, Length, Count
tstat_5 = TreeStatistics(Tree=side_a_9)  # -> Paths, Length, Count
subtraction_15 = Subtraction(A=tstat_4.Count, B=1)

num = Number(flatten(height_from_floor))
num_2 = Number(flatten(data_6))
lng_8 = ListLength(List=num_2)
panel_8 = Panel(num_2)
bnd = Bounds(Numbers=num_2)
subtraction_16 = Subtraction(A=lng_8, B=1)
range_3 = Range(Domain=bnd, Steps=subtraction_16)
int_5 = Integer(simplify(num_2))
path_2 = ConstructPath(Indices=simplify(graft(int_5)))
similar_2 = Similarity(FirstNumber=int_5, SecondNumber=graft(range_3), Threshold=0.1)  # -> simplify(Similarity), AbsoluteDifference
dispatch_40 = Dispatch(List=num, DispatchPattern=similar_2.Similarity)  # -> simplify(ListA), ListB
tstat_6 = TreeStatistics(Tree=dispatch_40.ListA)  # -> graft(Paths), Length, Count
path_mapper_3 = PathMapper(dispatch_40.ListA, source="{A}", target="{A+1}")
replace = ReplacePaths(Data=dispatch_40.ListA, Search=tstat_6.Paths, Replace=path_2)
clean_3 = CleanTree(RemoveNulls=True, RemoveInvalid=True, RemoveEmpty=True, Tree=path_mapper_3)
panel_9 = Panel(path_mapper_3)

subtraction_17 = Subtraction(A=tstat_5.Count, B=1)
path_3 = ConstructPath(Indices=subtraction_15)
path_4 = ConstructPath(Indices=0)
dispatch_41 = Dispatch(List=side_a_7.ListA, DispatchPattern=side_a_8.ListA)  # -> ListA, ListB
dispatch_42 = Dispatch(List=side_a_7.ListB, DispatchPattern=side_a_8.ListB)  # -> ListA, ListB
rev_2 = ReverseList(List=branch_12)
split_4 = SplitTree(Data=side_b_3, Masks=flatten(path_3))  # -> Positive, Negative
split_5 = SplitTree(Data=side_a_9, Masks=flatten(path_4))  # -> Positive, Negative
tmatch_5 = MatchText(Text=side_a_5.ListB, Pattern="FF", Case=True)
tmatch_6 = MatchText(Text=side_a_5.ListA, Pattern="FF", Case=True)
gf_or_ff = Geometry(split_5.Negative)
rf = Geometry(split_4.Positive)
gf_or_ff_2 = Geometry(split_4.Negative)
rf_2 = Geometry(split_5.Positive)
dispatch_43 = Dispatch(List=height_from_floor_2, DispatchPattern=tmatch_6)  # -> ListA, ListB
dispatch_44 = Dispatch(List=dispatch_41.ListB, DispatchPattern=tmatch_6)  # -> ListA, ListB
dispatch_45 = Dispatch(List=dispatch_42.ListB, DispatchPattern=tmatch_5)  # -> ListA, ListB
dispatch_46 = Dispatch(List=height_from_floor_2, DispatchPattern=tmatch_5)  # -> ListA, ListB
grip_slot_length = Number(grip_tab_length)
connector_grip_length_2 = Number(connector_grip_length)
connector_tab_length_2 = Number(connector_tab_length)
space_invader_size = Number(si_slot_length)
ply_thickness_2 = Number(ply_thickness)
tolerance_2 = Number(tolerance)
tool_size_2 = Number(tool_size)
gf = TreeBranch(Tree=side_a_9, Path=subtraction_17, MaintainPaths=True)
ff = TreeBranch(Tree=side_b_3, Path="{1}", MaintainPaths=True)
rf_3 = TreeBranch(Tree=side_a_9, Path="{0}", MaintainPaths=True)
ff_2 = TreeBranch(Tree=side_a_9, Path="{1}", MaintainPaths=True)
rf_4 = TreeBranch(Tree=side_b_3, Path=subtraction_15, MaintainPaths=True)
gf_2 = TreeBranch(Tree=side_b_3, Path="{0}", MaintainPaths=True)
gf_3 = MatchTree(Tree=dispatch_42.ListA, Guide=gf_2)
ff_3 = MatchTree(Tree=dispatch_45.ListA, Guide=ff)
rf_5 = MatchTree(Tree=dispatch_45.ListB, Guide=rf_4)
rf_6 = MatchTree(Tree=dispatch_44.ListB, Guide=rf_3)
ff_4 = MatchTree(Tree=dispatch_44.ListA, Guide=ff_2)
gf_4 = MatchTree(Tree=dispatch_41.ListA, Guide=gf)
merge_14 = Merge(Data1=gf, Data2=ff_2, Data3=rf_3)
merge_15 = Merge(Data1=gf_2, Data2=ff, Data3=rf_4)
addition_6 = Addition(A=rf_5)
addition_7 = Addition(A=ff_3, B=flatten(dispatch_46.ListA))
addition_8 = Addition(A=rf_6)
addition_9 = Addition(A=ff_4, B=flatten(dispatch_43.ListA))
merge_16 = Merge(Data1=addition_8, Data2=addition_9, Data3=gf_4, Data4=gf_3, Data5=addition_7, Data6=addition_6)
height_from_floor_3 = Data(merge_16)
geo_15 = Geometry(rev_2)
geo_16 = Geometry(branch_11)
clean_4 = CleanTree(RemoveNulls=True, RemoveInvalid=True, RemoveEmpty=True, Tree=height_from_floor_3)
unflatten = UnflattenTree(Tree=side_a_6.ListA, Guide=clean_4)
data_8 = Data(simplify(unflatten))
data_9 = Data(simplify(graft(data_8)))
panel_10 = Panel(unflatten)
match = MatchTree(Tree=data_8, Guide=geo_15)
null_2 = NullItem(Item=match)  # -> NullFlags, InvalidFlags, Description
dispatch_47 = Dispatch(List=data_9, DispatchPattern=null_2.NullFlags)  # -> ListA, ListB
match_2 = MatchTree(Tree=dispatch_47.ListA, Guide=geo_15)
panel_11 = Panel(match_2)
unflatten_2 = UnflattenTree(Tree=side_a_6.ListB, Guide=clean_4)
lng_9 = ListLength(List=geo_15)
_2 = Number(2)
match_3 = MatchTree(Tree=unflatten_2, Guide=geo_16)
data_10 = Data([match_2, match])
larger_2 = LargerThan(FirstNumber=lng_9, SecondNumber=_2)  # -> LargerThan, OrEqualTo

vertical_grip_slot_2 = VerticalGripSlot2(
    ply_thickness=ply_thickness_2,
    tolerance=tolerance_2,
    A=grip_slot_length,
    tool_size=tool_size_2,
    space_invader_slot_size=space_invader_size)
horizontal_grip_slots = HorizontalGripSlots(
    A_2=connector_tab_length_2,
    ply_thickness=ply_thickness_2,
    tolerance=tolerance_2,
    tool_size=tool_size_2,
    A=connector_grip_length_2)
vertical_grip_slots_3 = VerticalGripSlots3(ply_thickness=ply_thickness_2, tolerance=tolerance_2, A=grip_slot_length, tool_size=tool_size_2)
vertical_grip_slots_4 = VerticalGripSlots4(tool_size=tool_size_2, ply_thickness=ply_thickness_2, grip_length=grip_slot_length, tolerance=tolerance_2)
vertical_grip_slot_1 = VerticalGripSlot1(tool_size=tool_size_2, ply_thickness=ply_thickness_2, tolerance=tolerance_2, A=grip_slot_length)

dispatch_48 = Dispatch(List=lng_9, DispatchPattern=larger_2.LargerThan)  # -> ListA, ListB
subtraction_18 = Subtraction(A=lng_9, B=1)
subtraction_19 = Subtraction(A=dispatch_48.ListA, B=1)
_0 = Number(0)
_0_2 = Number(0)
tmatch_7 = MatchText(Text=data_10, Pattern="GF", Case=True)
_1 = Number(subtraction_19)
_2_2 = Number(subtraction_18)
tmatch_8 = MatchText(Text=data_10, Pattern="FF", Case=True)
tmatch_9 = MatchText(Text=match_3, Pattern="GF", Case=True)
_1_2 = Number(1)
tmatch_10 = MatchText(Text=data_10, Pattern="RF", Case=True)
_2_3 = Number(2)
tmatch_11 = MatchText(Text=match_3, Pattern="FF", Case=True)
tmatch_12 = MatchText(Text=match_3, Pattern="RF", Case=True)
dispatch_49 = Dispatch(List=_1, DispatchPattern=graft(tmatch_8))  # -> ListA, ListB
dispatch_50 = Dispatch(List=_0, DispatchPattern=graft(tmatch_7))  # -> ListA, ListB
dispatch_51 = Dispatch(List=_1_2, DispatchPattern=graft(tmatch_11))  # -> ListA, ListB
dispatch_52 = Dispatch(List=_0_2, DispatchPattern=graft(tmatch_9))  # -> ListA, ListB
dispatch_53 = Dispatch(List=_2_2, DispatchPattern=graft(tmatch_10))  # -> ListA, ListB
dispatch_54 = Dispatch(List=_2_3, DispatchPattern=graft(tmatch_12))  # -> ListA, ListB
num_3 = Number(dispatch_50.ListA)
num_4 = Number(dispatch_52.ListA)
num_5 = Number(dispatch_49.ListA)
num_6 = Number(dispatch_53.ListA)
num_7 = Number(dispatch_51.ListA)
num_8 = Number(dispatch_54.ListA)
path_mapper_4 = PathMapper(num_5, source="{A;B}", target="{A}")
path_mapper_5 = PathMapper(num_7, source="{A;B}", target="{A}")
path_mapper_6 = PathMapper(num_6, source="{A;B}", target="{A}")
path_mapper_7 = PathMapper(num_8, source="{A;B}", target="{A}")
path_mapper_8 = PathMapper(num_3, source="{A;B}", target="{A}")
path_mapper_9 = PathMapper(num_4, source="{A;B}", target="{A}")
rf_7 = ListItem(List=geo_15, Index=path_mapper_6, Wrap=False)
ff_5 = ListItem(List=geo_15, Index=path_mapper_4, Wrap=False)
rf_8 = ListItem(List=geo_16, Index=path_mapper_7, Wrap=False)
ff_6 = ListItem(List=geo_16, Index=path_mapper_5, Wrap=False)
gf_5 = ListItem(List=geo_15, Index=path_mapper_8, Wrap=False)
gf_6 = ListItem(List=geo_16, Index=path_mapper_9, Wrap=False)
merge_17 = Merge(Data1=gf_5, Data2=ff_5, Data3=rf_7)
merge_18 = Merge(Data1=gf_6, Data2=ff_6, Data3=rf_8)
eval_6 = EvaluateLength(Curve=merge_17, Length=clean_3, Normalized=False)  # -> Point, Tangent, Parameter
eval_7 = EvaluateLength(Curve=merge_18, Length=clean_3, Normalized=False)  # -> Point, Tangent, Parameter
internal_profile_original = Geometry(simplify(graft(merge_5)))
merge_19 = Merge(Data1=eval_7.Point, Data2=eval_6.Point)
internal_profile_centre = Geometry(simplify(graft(merge)))
internal_profile_centre_2 = Geometry(simplify(internal_profile_original))
multiplication = Multiplication(A=int_3, B=-1200)
Y_3 = UnitY(Factor=gauge)
branch_13 = TreeBranch(Tree=merge_19, Path=int_3, MaintainPaths=True)
Y_4 = UnitY(Factor=gauge)
Y_5 = UnitY(Factor=multiplication)
arrlinear_3 = LinearArray(Geometry=internal_profile_centre, Direction=Y_3, Count=count)  # -> Geometry, Transform
arrlinear_4 = LinearArray(Geometry=internal_profile_centre_2, Direction=Y_4, Count=count)  # -> Geometry, Transform
move_2 = Move(Geometry=branch_13, Motion=Y_5)  # -> Geometry, Transform
flip_10 = FlipMatrix(Data=arrlinear_3.Geometry)
entwine = Entwine(Branch00=item_7, Branch01=offset_9, Branch02=offset_10, FlattenInputs=True)
flip_11 = FlipMatrix(Data=arrlinear_4.Geometry)
concat_8 = Concatenate(FragmentA="{", FragmentB=Slider(0, range=0..7))
concat_9 = Concatenate(FragmentA="{", FragmentB=Slider(0, range=0..7))
internal_profile_original_2 = Geometry(simplify(graft(merge_3)))
sill_points = Geometry(move_2.Geometry)
path_mapper_10 = PathMapper(flip_10, source="{A;B;A}", target="{A;B}")
roof_connector_points = Geometry(simplify(dispatch_17.ListA))
concat_10 = Concatenate(FragmentA=concat_8, FragmentB="}")
concat_11 = Concatenate(FragmentA="{", FragmentB=Slider(0, range=0..7))
clean_5 = CleanTree(RemoveNulls=True, RemoveInvalid=True, RemoveEmpty=True, Tree=entwine)
path_mapper_11 = PathMapper(flip_11, source="{A;B;A}", target="{A;B}")
reinforcer_points = Geometry(simplify(dispatch_28.ListA))
space_invader_points_2 = Geometry(simplify(dispatch_21.ListA))
connector_points_2 = Geometry(simplify(dispatch_19.ListA))
concat_12 = Concatenate(FragmentA=concat_9, FragmentB="}")
clean_6 = CleanTree(RemoveNulls=True, RemoveInvalid=True, RemoveEmpty=False, Tree=pt_5)
grip_points = Geometry(simplify(dispatch_24.ListA))
branch_14 = TreeBranch(Tree=simplify(dispatch_21.ListA), Path="{0}", MaintainPaths=True)
branch_15 = TreeBranch(Tree=simplify(dispatch_24.ListA), Path="{0}", MaintainPaths=True)
branch_16 = TreeBranch(Tree=simplify(dispatch_18.ListA), Path="{0}", MaintainPaths=True)
branch_17 = TreeBranch(Tree=simplify(dispatch_17.ListA), Path="{0}", MaintainPaths=True)
branch_18 = TreeBranch(Tree=simplify(dispatch_28.ListA), Path="{0}", MaintainPaths=True)
roof_connector_points_2 = Geometry(simplify(dispatch_17.ListA))  # disabled
cull_i_10 = CullIndex(List=merge_4, Indices=0, Wrap=True)
space_invader_points_3 = Geometry(simplify(dispatch_21.ListA))
concat_13 = Concatenate(FragmentA=concat_11, FragmentB="}")
reinforcer_points_2 = Geometry(simplify(dispatch_28.ListA))
connector_points_3 = Geometry(simplify(dispatch_18.ListA))
path_mapper_12 = PathMapper(clean_5, source="{A;B}", target="{A}")
space_invader_points_4 = Geometry(simplify(dispatch_23.ListA))
reinforcer_points_3 = Geometry(simplify(dispatch_26.ListA))
grip_points_2 = Geometry(simplify(flatten(clean_6)))
grip_points_3 = Geometry(simplify(dispatch_24.ListA))
lng_10 = ListLength(List=path_mapper_12)
split_6 = SplitTree(Data=reinforcer_points, Masks=flatten(concat_13))  # -> Positive, Negative
entwine_2 = Entwine(Branch00=branch_14, Branch01=dispatch_22.ListA, Branch02=dispatch_22.ListA, FlattenInputs=True)
split_7 = SplitTree(Data=roof_connector_points, Masks=flatten(concat_13))  # -> Positive, Negative
entwine_3 = Entwine(Branch00=branch_15, Branch01=dispatch_25.ListA, Branch02=dispatch_25.ListA, FlattenInputs=True)
split_8 = SplitTree(Data=connector_points_2, Masks=flatten(concat_13))  # -> Positive, Negative
entwine_4 = Entwine(Branch00=branch_16, Branch01=dispatch_20.ListA, Branch02=dispatch_20.ListA, FlattenInputs=True)
split_9 = SplitTree(Data=space_invader_points_2, Masks=flatten(concat_13))  # -> Positive, Negative
internal_profile = Geometry(simplify(internal_profile_original_2))
split_10 = SplitTree(Data=grip_points, Masks=flatten(concat_13))  # -> Positive, Negative
entwine_5 = Entwine(Branch00=branch_17, Branch01=dispatch_20.ListA, Branch02=dispatch_20.ListA, FlattenInputs=True)
entwine_6 = Entwine(Branch00=branch_18, Branch01=dispatch_27.ListA, Branch02=dispatch_27.ListA, FlattenInputs=True)
column_profile = Geometry(simplify(flatten(geo)))
window_sill_points = Geometry(simplify(sill_points))
_1st_floor_profile = Geometry(flatten([offset_7, offset_8]))
internal_profile_2 = Geometry(simplify(graft(merge_2)))
similar_3 = Similarity(FirstNumber=lng_10, SecondNumber=1, Threshold=0.1)  # -> Similarity, AbsoluteDifference
window_sill_points_2 = Geometry(simplify(sill_points))
_1st_floor_profile_2 = Geometry(flatten([offset_7, offset_8]))
internal_profile_3 = Geometry(simplify(internal_profile_centre_2))
column_profile_2 = Geometry(flatten(geo))
external_profile = Geometry(simplify(graft(cull_i_10)))
_1st_floor_profile_3 = Geometry(flatten([offset_7, offset_8]))
internal_profile_4 = Geometry(simplify(internal_profile_original))
split_11 = SplitTree(Data=connector_points_3, Masks=flatten(concat_10))  # -> Positive, Negative
split_12 = SplitTree(Data=space_invader_points_3, Masks=flatten(concat_10))  # -> Positive, Negative
split_13 = SplitTree(Data=reinforcer_points_2, Masks=flatten(concat_10))  # -> Positive, Negative
split_14 = SplitTree(Data=roof_connector_points_2, Masks=flatten(concat_10))  # -> Positive, Negative
split_15 = SplitTree(Data=grip_points_3, Masks=flatten(concat_10))  # -> Positive, Negative
split_16 = SplitTree(Data=reinforcer_points_3, Masks=flatten(concat_12))  # -> Positive, Negative
split_17 = SplitTree(Data=space_invader_points_4, Masks=flatten(concat_12))  # -> Positive, Negative
split_18 = SplitTree(Data=grip_points_2, Masks=flatten(concat_12))  # -> Positive, Negative
geo_17 = Geometry(split_6.Negative)
geo_18 = Geometry(split_7.Negative)
geo_19 = Geometry(split_8.Negative)
geo_20 = Geometry(split_9.Negative)
geo_21 = Geometry(split_10.Negative)
reinforcer_points_4 = Geometry(simplify(entwine_6))
roof_connector_points_3 = Geometry(simplify(entwine_5))
dispatch_55 = Dispatch(List=path_mapper_12, DispatchPattern=similar_3.Similarity)  # -> ListA, graft(ListB)
space_invader_points_5 = Geometry(simplify(entwine_2))
column_profile_3 = Geometry(flatten(geo))
connector_points_4 = Geometry(simplify(entwine_4))
xz_6 = XZPlane(Origin=window_sill_points_2)
grip_points_4 = Geometry(simplify(entwine_3))
geo_22 = Geometry(split_11.Negative)
geo_23 = Geometry(split_12.Negative)
xz_7 = XZPlane(Origin=window_sill_points)
geo_24 = Geometry(split_13.Negative)
geo_25 = Geometry(split_14.Negative)
geo_26 = Geometry(split_15.Negative)
geo_27 = Geometry(flatten(split_16.Negative))
geo_28 = Geometry(flatten(split_17.Negative))
colom_14 = CollisionOneMany(Collider=flatten(column_profile), Obstacles=internal_profile_centre)  # -> Collision, Index
colom_15 = CollisionOneMany(Collider=flatten(_1st_floor_profile), Obstacles=internal_profile_centre)  # -> Collision, Index
geo_29 = Geometry(grip_points_2)
merge_20 = Merge(Data1=dispatch_55.ListA, Data2=dispatch_55.ListB)
colom_16 = CollisionOneMany(Collider=flatten(column_profile_2), Obstacles=external_profile)  # -> Collision, Index
colom_17 = CollisionOneMany(Collider=flatten(_1st_floor_profile_3), Obstacles=internal_profile_centre_2)  # -> Collision, Index
colom_18 = CollisionOneMany(Collider=flatten(_1st_floor_profile_2), Obstacles=external_profile)  # -> Collision, Index
cir = Circle(Plane=xz_6, Radius=250)
item_11 = ListItem(List=geo_2, Index=0, Wrap=False)
branch_19 = TreeBranch(Tree=dispatch_24.ListA, Path="{0;0;0;0}", MaintainPaths=True)
branch_20 = TreeBranch(Tree=dispatch_21.ListA, Path="{0;0;0;0}", MaintainPaths=True)
cir_2 = Circle(Plane=xz_7, Radius=250)
panel_13 = Panel(geo_29)
clean_7 = CleanTree(RemoveNulls=True, RemoveInvalid=True, RemoveEmpty=True, Tree=merge_20)
dispatch_56 = Dispatch(List=internal_profile_centre, DispatchPattern=colom_14.Collision)  # -> ListA, ListB
dispatch_57 = Dispatch(List=internal_profile_centre, DispatchPattern=colom_15.Collision)  # -> ListA, ListB
colom_19 = CollisionOneMany(Collider=cir, Obstacles=internal_profile)  # -> Collision, Index
dispatch_58 = Dispatch(List=internal_profile_centre_2, DispatchPattern=colom_17.Collision)  # -> ListA, ListB
dispatch_59 = Dispatch(List=external_profile, DispatchPattern=colom_18.Collision)  # -> ListA, ListB
dispatch_60 = Dispatch(List=external_profile, DispatchPattern=colom_16.Collision)  # -> ListA, ListB
colom_20 = CollisionOneMany(Collider=cir_2, Obstacles=external_profile)  # -> Collision, Index
crv_cp = CurveClosestPoint(Point=branch_19, Curve=item_11)  # -> Point, Parameter, Distance
crv_cp_2 = CurveClosestPoint(Point=branch_20, Curve=item_11)  # -> Point, Parameter, Distance
eval_8 = EvaluateLength(Curve=item_11, Length=0.5, Normalized=True)  # -> Point, Tangent, Parameter
internal_profile_5 = Geometry(simplify(clean_7))
colom_21 = CollisionOneMany(Collider=flatten(column_profile_3), Obstacles=internal_profile_5)  # -> Collision, Index
crv_cp_3 = CurveClosestPoint(Point=geo_23, Curve=internal_profile)  # -> Point, Parameter, Distance
crv_cp_4 = CurveClosestPoint(Point=geo_24, Curve=internal_profile)  # -> Point, Parameter, Distance
crv_cp_5 = CurveClosestPoint(Point=geo_22, Curve=internal_profile)  # -> Point, Parameter, Distance
crv_cp_6 = CurveClosestPoint(Point=geo_26, Curve=internal_profile)  # -> Point, Parameter, Distance
crv_cp_7 = CurveClosestPoint(Point=geo_25, Curve=internal_profile)  # -> Point, Parameter, Distance
eval_9 = EvaluateLength(Curve=internal_profile, Length=0.5, Normalized=True)  # -> Point, Tangent, Parameter
dispatch_61 = Dispatch(List=internal_profile, DispatchPattern=colom_19.Collision)  # -> ListA, ListB
ccx_10 = CurveCurve(CurveA=dispatch_57.ListA, CurveB=_1st_floor_profile)  # -> Points, ParamsA, ParamsB
ccx_11 = CurveCurve(CurveA=dispatch_56.ListA, CurveB=column_profile)  # -> Points, ParamsA, ParamsB
dispatch_62 = Dispatch(List=external_profile, DispatchPattern=colom_20.Collision)  # -> ListA, ListB
dispatch_63 = Dispatch(List=internal_profile_5, DispatchPattern=colom_21.Collision)  # -> ListA, ListB
geo_30 = Geometry(dispatch_59.ListA)
ccx_12 = CurveCurve(CurveA=dispatch_58.ListA, CurveB=_1st_floor_profile_3)  # -> Points, ParamsA, ParamsB
geo_31 = Geometry(dispatch_60.ListA)
geo_32 = Geometry(dispatch_61.ListA)
len_9 = Length(Curve=item_11)
pframe = PerpFrame(Curve=item_11, Parameter=eval_8.Parameter)
disc_12 = Discontinuity(Curve=internal_profile, Level=1)  # -> Points, Parameters
path_mapper_13 = PathMapper(ccx_10.Points, source="{A;B}", target="{A}")
crv_cp_8 = CurveClosestPoint(Point=geo_17, Curve=external_profile)  # -> Point, Parameter, Distance
ccx_13 = CurveCurve(CurveA=geo_30, CurveB=_1st_floor_profile_2)  # -> Points, ParamsA, ParamsB
crv_cp_9 = CurveClosestPoint(Point=geo_20, Curve=external_profile)  # -> Point, Parameter, Distance
path_mapper_14 = PathMapper(ccx_11.Points, source="{A;B}", target="{A}")
crv_cp_10 = CurveClosestPoint(Point=geo_18, Curve=external_profile)  # -> Point, Parameter, Distance
crv_cp_11 = CurveClosestPoint(Point=geo_19, Curve=external_profile)  # -> Point, Parameter, Distance
crv_cp_12 = CurveClosestPoint(Point=geo_21, Curve=external_profile)  # -> Point, Parameter, Distance
ccx_14 = CurveCurve(CurveA=geo_31, CurveB=column_profile_2)  # -> Points, ParamsA, ParamsB
eval_10 = EvaluateLength(Curve=external_profile, Length=0.5, Normalized=True)  # -> Point, Tangent, Parameter
geo_33 = Geometry(dispatch_62.ListA)
crv_cp_13 = CurveClosestPoint(Point=flatten(window_sill_points), Curve=geo_33)  # -> Point, Parameter, Distance
geo_34 = Geometry(dispatch_63.ListA)
path_mapper_15 = PathMapper(ccx_12.Points, source="{A;B}", target="{A}")
crv_cp_14 = CurveClosestPoint(Point=flatten(window_sill_points_2), Curve=geo_32)  # -> Point, Parameter, Distance
colom_22 = CollisionOneMany(Collider=crv_cp_6.Point, Obstacles=disc_12.Points)  # -> Collision, Index
crv_cp_15 = CurveClosestPoint(Point=geo_27, Curve=internal_profile_3)  # -> Point, Parameter, Distance
crv_cp_16 = CurveClosestPoint(Point=space_invader_points_5, Curve=internal_profile_5)  # -> Point, Parameter, Distance
crv_cp_17 = CurveClosestPoint(Point=geo_28, Curve=internal_profile_3)  # -> Point, Parameter, Distance
eval_11 = EvaluateLength(Curve=internal_profile_3, Length=0.5, Normalized=True)  # -> Point, Tangent, Parameter
crv_cp_18 = CurveClosestPoint(Point=connector_points_4, Curve=internal_profile_5)  # -> Point, Parameter, Distance
crv_cp_19 = CurveClosestPoint(Point=grip_points_4, Curve=internal_profile_5)  # -> Point, Parameter, Distance
crv_cp_20 = CurveClosestPoint(Point=geo_29, Curve=internal_profile_3)  # -> Point, Parameter, Distance
eval_12 = EvaluateLength(Curve=internal_profile_5, Length=0.5, Normalized=True)  # -> Point, Tangent, Parameter
crv_cp_21 = CurveClosestPoint(Point=reinforcer_points_4, Curve=internal_profile_5)  # -> Point, Parameter, Distance
crv_cp_22 = CurveClosestPoint(Point=roof_connector_points_3, Curve=internal_profile_5)  # -> Point, Parameter, Distance
ccx_15 = CurveCurve(CurveA=geo_34, CurveB=column_profile_3)  # -> Points, ParamsA, ParamsB
xy = XYPlane(Origin=Point(0, 0, 0))
len_10 = Length(Curve=external_profile)
pframe_2 = PerpFrame(Curve=external_profile, Parameter=eval_10.Parameter)
path_mapper_16 = PathMapper(ccx_14.Points, source="{A;B}", target="{A}")
vdis = VectorDisplay(Anchor=eval_10.Point, Vector=eval_10.Tangent)
path_mapper_17 = PathMapper(ccx_13.Points, source="{A;B}", target="{A}")
crv_cp_23 = CurveClosestPoint(Point=path_mapper_14, Curve=internal_profile)  # -> Point, Parameter, Distance
crv_cp_24 = CurveClosestPoint(Point=path_mapper_13, Curve=internal_profile)  # -> Point, Parameter, Distance
len_11 = Length(Curve=internal_profile)
eval_13 = EvaluateLength(Curve=internal_profile, Length=0.5, Normalized=True)  # -> Point, Tangent, Parameter
dispatch_64 = Dispatch(List=crv_cp_6.Point, DispatchPattern=colom_22.Collision)  # -> ListA, ListB
pframe_3 = PerpFrame(Curve=internal_profile, Parameter=eval_9.Parameter)
crv_cp_25 = CurveClosestPoint(Point=path_mapper_15, Curve=internal_profile_3)  # -> Point, Parameter, Distance
pt_6 = ConstructPoint(XCoordinate=0, YCoordinate=0, ZCoordinate=0)
orient = Orient(Geometry=crv_cp.Point, Source=pframe, Target=xy)  # -> Geometry, Transform
orient_2 = Orient(Geometry=crv_cp_2.Point, Source=pframe, Target=xy)  # -> Geometry, Transform
pframe_4 = PerpFrame(Curve=internal_profile_5, Parameter=eval_12.Parameter)
pframe_5 = PerpFrame(Curve=internal_profile_3, Parameter=eval_11.Parameter)
division_6 = Division(A=len_9, B=2)
clean_8 = CleanTree(RemoveNulls=True, RemoveInvalid=True, RemoveEmpty=True, Tree=eval_12.Tangent)
path_mapper_18 = PathMapper(ccx_15.Points, source="{A;B}", target="{A}")
X = UnitX(Factor=1)
len_12 = Length(Curve=internal_profile_5)
clean_9 = CleanTree(RemoveNulls=True, RemoveInvalid=True, RemoveEmpty=True, Tree=eval_12.Point)
len_13 = Length(Curve=internal_profile_4)
xy_2 = XYPlane(Origin=Point(0, 0, 0))
division_7 = Division(A=len_10, B=2)
geo_35 = Geometry(dispatch_64.ListB)
xz_8 = XZPlane(Origin=Point(0, 0, 0))
division_8 = Division(A=len_11, B=2)
xy_3 = XYPlane(Origin=Point(0, 0, 0))
neg_7 = Negative(Value=X)
xy_4 = XYPlane(Origin=Point(0, 0, 0))
xy_5 = XYPlane(Origin=Point(0, 0, 0))
division_9 = Division(A=len_13, B=2)
division_10 = Division(A=ply_thickness, B=2)
division_11 = Division(A=len_12, B=2)
orient_3 = Orient(Geometry=crv_cp_12.Point, Source=pframe_2, Target=xy_2)  # -> Geometry, Transform
orient_4 = Orient(Geometry=crv_cp_8.Point, Source=pframe_2, Target=xy_2)  # -> Geometry, Transform
orient_5 = Orient(Geometry=crv_cp_9.Point, Source=pframe_2, Target=xy_2)  # -> Geometry, Transform
orient_6 = Orient(Geometry=crv_cp_10.Point, Source=pframe_2, Target=xy_2)  # -> Geometry, Transform
orient_7 = Orient(Geometry=crv_cp_11.Point, Source=pframe_2, Target=xy_2)  # -> Geometry, Transform
orient_8 = Orient(Geometry=path_mapper_17, Source=pframe_2, Target=xy_2)  # -> Geometry, Transform
orient_9 = Orient(Geometry=crv_cp_13.Point, Source=pframe_2, Target=xy_2)  # -> Geometry, Transform
orient_10 = Orient(Geometry=path_mapper_16, Source=pframe_2, Target=xy_2)  # -> Geometry, Transform
rotate = Rotate(Geometry=orient.Geometry, Angle=degrees(-90), Plane=xz_8)  # -> Geometry, Transform
rotate_2 = Rotate(Geometry=orient_2.Geometry, Angle=degrees(-90), Plane=xz_8)  # -> Geometry, Transform
line = LineSDL(Start=pt_6, Direction=X, Length=division_6)
line_2 = LineSDL(Start=pt_6, Direction=neg_7, Length=division_6)
orient_11 = Orient(Geometry=geo_35, Source=pframe_3, Target=xy_3)  # -> Geometry, Transform
orient_12 = Orient(Geometry=crv_cp_3.Point, Source=pframe_3, Target=xy_3)  # -> Geometry, Transform
orient_13 = Orient(Geometry=crv_cp_4.Point, Source=pframe_3, Target=xy_3)  # -> Geometry, Transform
orient_14 = Orient(Geometry=crv_cp_5.Point, Source=pframe_3, Target=xy_3)  # -> Geometry, Transform
orient_15 = Orient(Geometry=crv_cp_7.Point, Source=pframe_3, Target=xy_3)  # -> Geometry, Transform
orient_16 = Orient(Geometry=crv_cp_24.Point, Source=pframe_3, Target=xy_3)  # -> Geometry, Transform
orient_17 = Orient(Geometry=crv_cp_23.Point, Source=pframe_3, Target=xy_3)  # -> Geometry, Transform
xz_9 = XZPlane(Origin=Point(0, 0, 0))
orient_18 = Orient(Geometry=crv_cp_19.Point, Source=pframe_4, Target=xy_4)  # -> Geometry, Transform
orient_19 = Orient(Geometry=crv_cp_14.Point, Source=pframe_3, Target=xy_3)  # -> Geometry, Transform
orient_20 = Orient(Geometry=crv_cp_20.Point, Source=pframe_5, Target=xy_5)  # -> Geometry, Transform
orient_21 = Orient(Geometry=crv_cp_15.Point, Source=pframe_5, Target=xy_5)  # -> Geometry, Transform
orient_22 = Orient(Geometry=crv_cp_16.Point, Source=pframe_4, Target=xy_4)  # -> Geometry, Transform
orient_23 = Orient(Geometry=crv_cp_17.Point, Source=pframe_5, Target=xy_5)  # -> Geometry, Transform
orient_24 = Orient(Geometry=crv_cp_18.Point, Source=pframe_4, Target=xy_4)  # -> Geometry, Transform
orient_25 = Orient(Geometry=crv_cp_21.Point, Source=pframe_4, Target=xy_4)  # -> Geometry, Transform
orient_26 = Orient(Geometry=crv_cp_22.Point, Source=pframe_4, Target=xy_4)  # -> Geometry, Transform
orient_27 = Orient(Geometry=crv_cp_25.Point, Source=pframe_5, Target=xy_5)  # -> Geometry, Transform
orient_28 = Orient(Geometry=path_mapper_18, Source=pframe_4, Target=xy_4)  # -> Geometry, Transform
split_19 = SplitTree(Data=division_11, Masks=flatten("{0}"))  # -> Positive, Negative
join = JoinCurves(Curves=flatten([line, line_2]), Preserve=False)
xz_10 = XZPlane(Origin=Point(0, 0, 0))
rotate_3 = Rotate(Geometry=orient_4.Geometry, Angle=degrees(-90), Plane=xz_9)  # -> simplify(Geometry), Transform
rotate_4 = Rotate(Geometry=orient_5.Geometry, Angle=degrees(-90), Plane=xz_9)  # -> simplify(Geometry), Transform
rotate_5 = Rotate(Geometry=orient_10.Geometry, Angle=degrees(-90), Plane=xz_9)  # -> simplify(Geometry), Transform
rotate_6 = Rotate(Geometry=orient_8.Geometry, Angle=degrees(-90), Plane=xz_9)  # -> simplify(Geometry), Transform
rotate_7 = Rotate(Geometry=orient_6.Geometry, Angle=degrees(-90), Plane=xz_9)  # -> simplify(Geometry), Transform
rotate_8 = Rotate(Geometry=orient_7.Geometry, Angle=degrees(-90), Plane=xz_9)  # -> simplify(Geometry), Transform
rotate_9 = Rotate(Geometry=orient_3.Geometry, Angle=degrees(-90), Plane=xz_9)  # -> simplify(Geometry), Transform
rotate_10 = Rotate(Geometry=orient_9.Geometry, Angle=degrees(-90), Plane=xz_9)  # -> simplify(Geometry), Transform
xz_11 = XZPlane(Origin=Point(0, 0, 0))
xz_12 = XZPlane(Origin=Point(0, 0, 0))
rotate_11 = Rotate(Geometry=orient_19.Geometry, Angle=degrees(-90), Plane=xz_10)  # -> simplify(Geometry), Transform
rotate_12 = Rotate(Geometry=orient_12.Geometry, Angle=degrees(-90), Plane=xz_10)  # -> simplify(Geometry), Transform
rotate_13 = Rotate(Geometry=orient_17.Geometry, Angle=degrees(-90), Plane=xz_10)  # -> simplify(Geometry), Transform
rotate_14 = Rotate(Geometry=orient_16.Geometry, Angle=degrees(-90), Plane=xz_10)  # -> simplify(Geometry), Transform
rotate_15 = Rotate(Geometry=orient_13.Geometry, Angle=degrees(-90), Plane=xz_10)  # -> simplify(Geometry), Transform
rotate_16 = Rotate(Geometry=orient_14.Geometry, Angle=degrees(-90), Plane=xz_10)  # -> simplify(Geometry), Transform
rotate_17 = Rotate(Geometry=orient_11.Geometry, Angle=degrees(-90), Plane=xz_10)  # -> simplify(Geometry), Transform
rotate_18 = Rotate(Geometry=orient_15.Geometry, Angle=degrees(-90), Plane=xz_10)  # -> simplify(Geometry), Transform
rotate_19 = Rotate(Geometry=orient_21.Geometry, Angle=degrees(-90), Plane=xz_12)  # -> simplify(Geometry), Transform
rotate_20 = Rotate(Geometry=orient_23.Geometry, Angle=degrees(-90), Plane=xz_12)  # -> simplify(Geometry), Transform
rotate_21 = Rotate(Geometry=orient_24.Geometry, Angle=degrees(-90), Plane=xz_11)  # -> simplify(Geometry), Transform
rotate_22 = Rotate(Geometry=orient_22.Geometry, Angle=degrees(-90), Plane=xz_11)  # -> simplify(Geometry), Transform
rotate_23 = Rotate(Geometry=orient_18.Geometry, Angle=degrees(-90), Plane=xz_11)  # -> simplify(Geometry), Transform
rotate_24 = Rotate(Geometry=orient_20.Geometry, Angle=degrees(-90), Plane=xz_12)  # -> simplify(Geometry), Transform
rotate_25 = Rotate(Geometry=orient_28.Geometry, Angle=degrees(-90), Plane=xz_11)  # -> simplify(Geometry), Transform
rotate_26 = Rotate(Geometry=orient_27.Geometry, Angle=degrees(-90), Plane=xz_12)  # -> simplify(Geometry), Transform
rotate_27 = Rotate(Geometry=orient_25.Geometry, Angle=degrees(-90), Plane=xz_11)  # -> simplify(Geometry), Transform
rotate_28 = Rotate(Geometry=orient_26.Geometry, Angle=degrees(-90), Plane=xz_11)  # -> simplify(Geometry), Transform
subtraction_20 = Subtraction(A=simplify(split_19.Negative), B=flatten(division_10))  # -> simplify(Result)
addition_10 = Addition(A=split_19.Positive, B=flatten(division_10))
null_3 = NullItem(Item=split_19.Negative)  # -> NullFlags, InvalidFlags, Description
null_4 = NullItem(Item=split_19.Positive)  # -> NullFlags, InvalidFlags, Description
path_mapper_19 = PathMapper(rotate_3.Geometry, source="{A}", target="{A-1}")
path_mapper_20 = PathMapper(rotate_7.Geometry, source="{A}", target="{A-1}")
path_mapper_21 = PathMapper(rotate_8.Geometry, source="{A}", target="{A-1}")
path_mapper_22 = PathMapper(rotate_4.Geometry, source="{A}", target="{A-1}")
path_mapper_23 = PathMapper(rotate_9.Geometry, source="{A}", target="{A-1}")
path_mapper_24 = PathMapper(rotate_16.Geometry, source="{A}", target="{A-1}")
path_mapper_25 = PathMapper(rotate_12.Geometry, source="{A}", target="{A-1}")
path_mapper_26 = PathMapper(rotate_15.Geometry, source="{A}", target="{A-1}")
path_mapper_27 = PathMapper(rotate_17.Geometry, source="{A}", target="{A-1}")
dispatch_65 = Dispatch(List=subtraction_20, DispatchPattern=null_3.NullFlags)  # -> ListA, ListB
dispatch_66 = Dispatch(List=addition_10, DispatchPattern=null_4.NullFlags)  # -> ListA, ListB
merge_21 = Merge(Data1=dispatch_65.ListB, Data2=dispatch_66.ListB)
clean_10 = CleanTree(RemoveNulls=True, RemoveInvalid=True, RemoveEmpty=True, Tree=merge_21)  # -> simplify(Tree)
dovetail_ht = Slider(65, range=25..300)
ski_panel_width = Slider(250, range=25..300)
external_sheathing = BooleanToggle(True)
external_sheathing_2 = BooleanToggle(False)
dovetail_ht_2 = Slider(65, range=25..300)
internal_sheathing_panels = SheatingPanel_2(
    window_sill_pts=rotate_11.Geometry,
    window_data=merge_10,
    sheet_width=sheet_width,
    sheet_length=sheet_length,
    external_sheathing=external_sheathing_2,
    connector_points=path_mapper_24,
    unit_no=data,
    bay_no=int_3,
    reinforcer_pts=path_mapper_26,
    space_invader_points=rotate_12.Geometry,
    segment_length=division_8,
    intersection_points=rotate_14.Geometry,
    grip_points=path_mapper_27,
    fin_depth=fin_depth_2,
    gauge=gauge,
    dovetail_height=dovetail_ht,
    ply_thickness=ply_thickness,
    grip_slot_length=grip_tab_length,
    spacing=spacing,
    beam_width=beam_width,
    tolerance=tolerance,
    vertical_grip_slot_1=vertical_grip_slot_1,
    vertical_grip_slot_2=vertical_grip_slot_2,
    vertical_grip_slots_3=vertical_grip_slots_3,
    intersection_column=rotate_13.Geometry,
    vertical_grip_slots_4=vertical_grip_slots_4,
    horizontal_grip_slots=horizontal_grip_slots)  # -> window_sides_2d, window_box_geo, window_attributes, panel_2d_geo, trim_2d_geo, _3d, window_indicies, attributes, _3d_trimmers
internal_sheathing_panels_2 = SheatingPanel_2(
    window_sill_pts=rotate_10.Geometry,
    window_data=merge_10,
    sheet_width=sheet_width,
    sheet_length=sheet_length,
    external_sheathing=external_sheathing,
    roof_connector_pts=path_mapper_20,
    connector_points=path_mapper_21,
    unit_no=data,
    bay_no=int_3,
    reinforcer_pts=path_mapper_19,
    space_invader_points=rotate_4.Geometry,
    segment_length=division_7,
    intersection_points=rotate_6.Geometry,
    grip_points=path_mapper_23,
    fin_depth=fin_depth_2,
    gauge=gauge,
    dovetail_height=dovetail_ht,
    ply_thickness=ply_thickness,
    grip_slot_length=grip_tab_length,
    spacing=spacing,
    beam_width=beam_width,
    tolerance=tolerance,
    vertical_grip_slot_1=vertical_grip_slot_1,
    vertical_grip_slot_2=vertical_grip_slot_2,
    vertical_grip_slots_3=vertical_grip_slots_3,
    intersection_column=rotate_5.Geometry,
    vertical_grip_slots_4=vertical_grip_slots_4,
    horizontal_grip_slots=horizontal_grip_slots)  # -> window_sides_2d, window_box_geo, window_attributes, panel_2d_geo, trim_2d_geo, _3d, window_indicies, attributes, _3d_trimmers
sheathing_panel_floor = SheatingPanel_3(
    intersection_column=rotate_25.Geometry,
    sheet_width=sheet_width,
    sheet_length=sheet_length,
    unit_no=data,
    connector_points=rotate_21.Geometry,
    gauge=gauge,
    dovetail_height=dovetail_ht,
    reinforcer_pts=rotate_27.Geometry,
    ply_thickness=ply_thickness,
    grip_slot_length=grip_tab_length,
    space_invader_points=rotate_22.Geometry,
    spacing=spacing,
    beam_width=beam_width,
    tolerance=tolerance,
    tool_size=tool_size,
    segment_length=clean_10,
    grip_points=rotate_23.Geometry,
    vertical_grip_slot_1=vertical_grip_slot_1,
    vertical_grip_slot_2=vertical_grip_slot_2,
    vertical_grip_slots_3=vertical_grip_slots_3,
    vertical_grip_slots_4=vertical_grip_slots_4,
    horizontal_grip_slots=horizontal_grip_slots)  # -> _2d_geo, trim_2d_geo, _3d, attributes, _3d_trimmers
column_panel = SheatingPanel_4(
    unit_no=data,
    bay_no=int_3,
    sheet_width=sheet_width,
    sheet_length=sheet_length,
    fin_depth=fin_depth_2,
    gauge=gauge,
    dovetail_height=dovetail_ht_2,
    ply_thickness=ply_thickness,
    reinforcer_pts=rotate_19.Geometry,
    grip_slot_length=grip_tab_length,
    space_invader_points=rotate_20.Geometry,
    spacing=spacing,
    beam_width=beam_width,
    intersection_points=rotate_26.Geometry,
    segment_length=division_9,
    grip_points=rotate_24.Geometry,
    vertical_grip_slot_1=vertical_grip_slot_1,
    vertical_grip_slot_2=vertical_grip_slot_2,
    vertical_grip_slot_4=vertical_grip_slots_4)  # -> _2d_geo, attrib, _3d, _3d_trimmers
ski_panel = SheatingPanel(
    space_invader_points=rotate_2.Geometry,
    sheet_length=sheet_length,
    ski_panel_width=ski_panel_width,
    segment_curve=join,
    grip_points=rotate.Geometry,
    gauge=gauge,
    ply_thickness_2=ply_thickness,
    grip_slot_length=grip_tab_length,
    ply_thickness=ply_thickness,
    spacing=spacing,
    beam_width=beam_width,
    tolerance=tolerance,
    tool_size=tool_size,
    vertical_grip_slots_1=vertical_grip_slot_1,
    vertical_grip_slot_2=vertical_grip_slot_2,
    vertical_grip_slot_4=vertical_grip_slots_4)  # -> _2d_geo, attrib, _3d
tstat_7 = TreeStatistics(Tree=path_mapper_10)  # -> Paths, Length, Count
clean_11 = CleanTree(RemoveNulls=True, RemoveInvalid=True, RemoveEmpty=True, Tree=internal_sheathing_panels.window_attributes)
tstat_8 = TreeStatistics(Tree=path_mapper_10)  # -> Paths, Length, Count
tstat_9 = TreeStatistics(Tree=path_mapper_10)  # -> Paths, Length, Count
pt_7 = ConstructPoint(XCoordinate=0, YCoordinate=0, ZCoordinate=0)
X_2 = UnitX(Factor=1)
pt_8 = ConstructPoint(XCoordinate=0, YCoordinate=0, ZCoordinate=0)
pt_9 = ConstructPoint(XCoordinate=0, YCoordinate=0, ZCoordinate=0)
pt_10 = ConstructPoint(XCoordinate=0, YCoordinate=0, ZCoordinate=0)
X_3 = UnitX(Factor=1)
X_4 = UnitX(Factor=1)
subtraction_21 = Subtraction(A=tstat_7.Count, B=1)
X_5 = UnitX(Factor=1)
multiplication_2 = Multiplication(A=ply_thickness, B=1)
division_12 = Division(A=fin_depth_2, B=2)
subtraction_22 = Subtraction(A=tstat_8.Count, B=1)
geo_36 = Geometry(internal_sheathing_panels_2.panel_2d_geo)
subtraction_23 = Subtraction(A=tstat_9.Count, B=1)
with_opening = Data(internal_sheathing_panels.window_indicies)
with_opening_2 = Data(internal_sheathing_panels_2.window_indicies)
orient_29 = OrientDirection(Geometry=sheathing_panel_floor._3d_trimmers, PointA=pt_7, DirectionA=X_2, PointB=clean_9, DirectionB=clean_8)  # -> Geometry, Transform
orient_30 = OrientDirection(Geometry=sheathing_panel_floor._3d, PointA=pt_7, DirectionA=X_2, PointB=clean_9, DirectionB=clean_8)  # -> Geometry, Transform
equals_3 = Equality(FirstNumber=tstat_7.Count, SecondNumber=0)  # -> Equality, Inequality
equals_4 = Equality(FirstNumber=subtraction_21, SecondNumber=int_3)  # -> Equality, Inequality
geo_37 = Geometry(sheathing_panel_floor.trim_2d_geo)
geo_38 = Geometry(internal_sheathing_panels.panel_2d_geo)
division_13 = Division(A=gauge, B=-1)
geo_39 = Geometry(ski_panel._2d_geo)
geo_40 = Geometry(sheathing_panel_floor._2d_geo)
addition_11 = Addition(A=division_12, B=multiplication_2)
geo_41 = Geometry(internal_sheathing_panels.trim_2d_geo)
division_14 = Division(A=gauge, B=-1)
orient_31 = OrientDirection(
    Geometry=internal_sheathing_panels.window_box_geo,
    PointA=pt_9,
    DirectionA=X_4,
    PointB=eval_13.Point,
    DirectionB=eval_13.Tangent)  # -> Geometry, Transform
orient_32 = OrientDirection(
    Geometry=internal_sheathing_panels._3d_trimmers,
    PointA=pt_9,
    DirectionA=X_4,
    PointB=eval_13.Point,
    DirectionB=eval_13.Tangent)  # -> Geometry, Transform
orient_33 = OrientDirection(Geometry=internal_sheathing_panels._3d, PointA=pt_9, DirectionA=X_4, PointB=eval_13.Point, DirectionB=eval_13.Tangent)  # -> Geometry, Transform
orient_34 = OrientDirection(Geometry=internal_sheathing_panels_2._3d, PointA=pt_10, DirectionA=X_5, PointB=eval_10.Point, DirectionB=eval_10.Tangent)  # -> Geometry, Transform
orient_35 = OrientDirection(
    Geometry=internal_sheathing_panels_2._3d_trimmers,
    PointA=pt_10,
    DirectionA=X_5,
    PointB=eval_10.Point,
    DirectionB=eval_10.Tangent)  # -> Geometry, Transform
equals_5 = Equality(FirstNumber=tstat_8.Count, SecondNumber=0)  # -> Equality, Inequality
orient_36 = OrientDirection(Geometry=column_panel._3d, PointA=pt_8, DirectionA=X_3, PointB=eval_11.Point, DirectionB=eval_11.Tangent)  # -> Geometry, Transform
equals_6 = Equality(FirstNumber=subtraction_22, SecondNumber=int_3)  # -> Equality, Inequality
tstat_10 = TreeStatistics(Tree=orient_34.Geometry)  # -> Paths, Length, Count
len_14 = Length(Curve=item_8)
geo_42 = Geometry(column_panel._2d_geo)
division_15 = Division(A=gauge, B=-1)
equals_7 = Equality(FirstNumber=tstat_9.Count, SecondNumber=0)  # -> Equality, Inequality
equals_8 = Equality(FirstNumber=subtraction_23, SecondNumber=int_3)  # -> Equality, Inequality
len_15 = Length(Curve=item_8)
dispatch_67 = Dispatch(List=internal_sheathing_panels.panel_2d_geo, DispatchPattern=with_opening)  # -> ListA, ListB
neg_8 = Negative(Value=addition_11)
Y_6 = UnitY(Factor=division_13)
multiplication_3 = Multiplication(A=division_14, B=1.9)
dispatch_68 = Dispatch(List=internal_sheathing_panels_2.panel_2d_geo, DispatchPattern=with_opening_2)  # -> ListA, ListB
multiplication_4 = Multiplication(A=gauge, B=tstat_10.Count)
dispatch_69 = Dispatch(List=orient_29.Geometry, DispatchPattern=equals_3.Equality)  # -> ListA, ListB
dispatch_70 = Dispatch(List=orient_29.Geometry, DispatchPattern=equals_4.Equality)  # -> ListA, ListB
len_16 = Length(Curve=item_8)
division_16 = Division(A=len_14, B=1.5)
multiplication_5 = Multiplication(A=division_15, B=2.5)
division_17 = Division(A=len_15, B=1.5)
dispatch_71 = Dispatch(List=orient_32.Geometry, DispatchPattern=equals_5.Equality)  # -> ListA, ListB
dispatch_72 = Dispatch(List=orient_32.Geometry, DispatchPattern=equals_6.Equality)  # -> ListA, ListB
null_5 = NullItem(Item=internal_sheathing_panels.window_box_geo)  # -> NullFlags, InvalidFlags, Description
dispatch_73 = Dispatch(List=orient_35.Geometry, DispatchPattern=equals_7.Equality)  # -> ListA, ListB
dispatch_74 = Dispatch(List=orient_35.Geometry, DispatchPattern=equals_8.Equality)  # -> ListA, ListB
geo_43 = Geometry(internal_sheathing_panels.window_sides_2d)
geo_44 = Geometry(dispatch_67.ListA)
Z_2 = UnitZ(Factor=neg_8)
null_6 = NullItem(Item=internal_sheathing_panels.window_box_geo)  # -> NullFlags, InvalidFlags, Description
Y_7 = UnitY(Factor=multiplication_3)
geo_45 = Geometry(dispatch_68.ListA)
addition_12 = Addition(A=division_16, B=multiplication_4)
division_18 = Division(A=len_16, B=1.5)
Y_8 = UnitY(Factor=multiplication_5)
xz_13 = XZPlane(Origin=Point(0, 0, 0))
mirror = Mirror(Geometry=dispatch_70.ListA, Plane=xz_13)  # -> Geometry, Transform
neg_9 = Negative(Value=addition_12)
dispatch_75 = Dispatch(List=geo_44, DispatchPattern=null_5.NullFlags)  # -> ListA, ListB
neg_10 = Negative(Value=division_17)
xz_14 = XZPlane(Origin=Point(0, 0, 0))
mirror_2 = Mirror(Geometry=dispatch_72.ListA, Plane=xz_14)  # -> Geometry, Transform
clean_12 = CleanTree(RemoveNulls=True, RemoveInvalid=True, RemoveEmpty=True, Tree=orient_31.Geometry)
dispatch_76 = Dispatch(List=geo_45, DispatchPattern=null_6.NullFlags)  # -> ListA, ListB
xz_15 = XZPlane(Origin=Point(0, 0, 0))
mirror_3 = Mirror(Geometry=dispatch_74.ListA, Plane=xz_15)  # -> Geometry, Transform
move_3 = Move(Geometry=geo_39, Motion=flatten(Y_6))  # -> Geometry, Transform
move_4 = Move(Geometry=ski_panel._3d, Motion=Z_2)  # -> Geometry, Transform
X_6 = UnitX(Factor=division_18)
move_5 = Move(Geometry=geo_37, Motion=flatten(Y_8))  # -> Geometry, Transform
X_7 = UnitX(Factor=neg_9)
merge_22 = Merge(Data1=mirror.Geometry, Data2=dispatch_69.ListA)
division_19 = Division(A=gauge, B=-1)
division_20 = Division(A=gauge, B=-1)
move_6 = Move(Geometry=geo_40, Motion=flatten(Y_8))  # -> Geometry, Transform
division_21 = Division(A=gauge, B=-1)
X_8 = UnitX(Factor=neg_10)
rotate_29 = Rotate(Geometry=dispatch_76.ListB, Angle=degrees(90), Plane=PlaneXY(0, 0, 0))  # -> Geometry, Transform
rotate_30 = Rotate(Geometry=dispatch_75.ListB, Angle=degrees(90), Plane=PlaneXY(0, 0, 0))  # -> Geometry, Transform
rotate_31 = Rotate(Geometry=geo_43, Angle=degrees(90), Plane=PlaneXY(0, 0, 0))  # -> Geometry, Transform
merge_23 = Merge(Data1=dispatch_71.ListA, Data2=mirror_2.Geometry)
merge_24 = Merge(Data1=dispatch_73.ListA, Data2=mirror_3.Geometry)
move_7 = Move(Geometry=geo_38, Motion=flatten(X_6))  # -> Geometry, Transform
move_8 = Move(Geometry=geo_41, Motion=flatten(X_6))  # -> Geometry, Transform
division_22 = Division(A=gauge, B=-2)
division_23 = Division(A=gauge, B=-2)
multiplication_6 = Multiplication(A=division_19, B=2)
multiplication_7 = Multiplication(A=division_20, B=2)
move_9 = Move(Geometry=move_3.Geometry, Motion=flatten(Y_7))  # -> Geometry, Transform
multiplication_8 = Multiplication(A=division_21, B=2)
move_10 = Move(Geometry=geo_36, Motion=flatten(X_7))  # -> Geometry, Transform
move_11 = Move(Geometry=geo_42, Motion=X_8)  # -> Geometry, Transform
move_12 = Move(Geometry=rotate_29.Geometry, Motion=flatten(X_7))  # -> Geometry, Transform
clean_13 = CleanTree(RemoveNulls=True, RemoveInvalid=True, RemoveEmpty=False, Tree=merge_23)
move_13 = Move(Geometry=rotate_30.Geometry, Motion=flatten(X_6))  # -> Geometry, Transform
move_14 = Move(Geometry=rotate_31.Geometry, Motion=flatten(X_6))  # -> Geometry, Transform
clean_14 = CleanTree(RemoveNulls=True, RemoveInvalid=True, RemoveEmpty=False, Tree=merge_24)
Y_9 = UnitY(Factor=division_22)
clean_15 = CleanTree(RemoveNulls=True, RemoveInvalid=True, RemoveEmpty=True, Tree=move_7.Geometry)
Y_10 = UnitY(Factor=multiplication_6)
Y_11 = UnitY(Factor=multiplication_7)
Y_12 = UnitY(Factor=division_23)
Y_13 = UnitY(Factor=multiplication_8)
internal_trim_att = Data(internal_sheathing_panels.attributes)
move_15 = Move(Geometry=move_10.Geometry, Motion=flatten(Y_11))  # -> Geometry, Transform
internal_trim = Geometry(clean_13)
move_16 = Move(Geometry=move_4.Geometry, Motion=flatten(Y_9))  # -> Geometry, Transform
move_17 = Move(Geometry=orient_36.Geometry, Motion=flatten(Y_12))  # -> Geometry, Transform
move_18 = Move(Geometry=clean_15, Motion=flatten(Y_10))  # -> Geometry, Transform
move_19 = Move(Geometry=move_11.Geometry, Motion=flatten(Y_13))  # -> Geometry, Transform
external_trim = Geometry(clean_14)
external_trim_2 = Data(internal_sheathing_panels_2.attributes)
external_panels = Geometry(orient_34.Geometry)
external_panels_2 = Geometry(move_15.Geometry)
internal_panels = Geometry(orient_33.Geometry)
internal_panels_2 = Geometry(move_18.Geometry)
column_panels = Geometry(move_19.Geometry)
column_panels_2 = Geometry(move_17.Geometry)
internal_panels_3 = Data(internal_sheathing_panels.attributes)
window_box = Geometry(clean_12)
external_panels_3 = Data(internal_sheathing_panels_2.attributes)
column_panels_3 = Data(column_panel.attrib)
window_box_2 = Data(clean_11)
floor_panels = Geometry(orient_30.Geometry)
floor_panels_2 = Geometry(move_6.Geometry)
ski_panels = Geometry(move_9.Geometry)
floor_panels_3 = Data(sheathing_panel_floor.attributes)
int_2d_profile_with_openings = Geometry([move_13.Geometry, move_14.Geometry])
ski_panels_2 = Geometry(move_16.Geometry)
ski_panels_3 = Data(ski_panel.attrib)
ext_2d_profile_with_openings = Geometry(move_12.Geometry)
addition_13 = Addition(A=int_3)
_2d_openings = Entwine(Branch00=int_2d_profile_with_openings, Branch01=ext_2d_profile_with_openings, FlattenInputs=True)
_2d_profiles = Entwine(
    Branch00=floor_panels_2,
    Branch01=internal_panels_2,
    Branch02=external_panels_2,
    Branch03=ski_panels,
    Branch04=column_panels,
    FlattenInputs=True)
_3d_geometry = Entwine(
    Branch00=floor_panels,
    Branch01=internal_panels,
    Branch02=window_box,
    Branch03=external_panels,
    Branch04=ski_panels_2,
    Branch05=column_panels_2,
    FlattenInputs=True)
attributes = Entwine(
    Branch00=floor_panels_3,
    Branch01=internal_panels_3,
    Branch02=window_box_2,
    Branch03=external_panels_3,
    Branch04=ski_panels_3,
    Branch05=column_panels_3,
    FlattenInputs=True)
bay_number_3 = Number(addition_13)
gauge_2 = Number(gauge)
division_24 = Division(A=gauge, B=2)
multiplication_9 = Multiplication(A=gauge_2, B=bay_number_3)
Y_14 = UnitY(Factor=division_24)
Y_15 = UnitY(Factor=multiplication_9)
move_20 = Move(Geometry=_3d_geometry, Motion=flatten(Y_14))  # -> Geometry, Transform
geo_46 = Geometry(simplify(path_mapper_10))
bake = BakeGeometry(Bake=Toggle(False), Geometry=_3d_geometry, Attributes=attributes)
move_21 = Move(Geometry=geo_46, Motion=flatten(Y_14))  # -> Geometry, Transform
move_22 = Move(Geometry=_2d_openings, Motion=flatten(Y_15))  # -> Geometry, Transform
move_23 = Move(Geometry=move_20.Geometry, Motion=flatten(Y_15))  # -> Geometry, Transform
int_2d_profiles = ClusterOutput(_2d_profiles)
opening_profiles = ClusterOutput(move_22.Geometry)
bay_guide = ClusterOutput(move_21.Geometry)
_3d_geo_ext = ClusterOutput(move_23.Geometry)
attributes_2 = ClusterOutput(attributes)

# ==== cluster CNCPartsBake
geo = ClusterInput()
geo_2 = Geometry(geo)
clean = CleanTree(RemoveNulls=True, RemoveInvalid=True, RemoveEmpty=True, Tree=geo_2)
ungroup = Ungroup(Group=clean)  # -> simplify(Objects)
tmatch = MatchText(Text=ungroup, RegEx="Text:", Case=True)
dispatch = Dispatch(List=ungroup, DispatchPattern=tmatch)  # -> ListA, ListB
txt = Text(dispatch.ListA)
geo_3 = Geometry(dispatch.ListB)
geo_4 = Geometry(geo_3)
len = Length(Curve=geo_4)
larger = LargerThan(FirstNumber=len, SecondNumber=Slider(708, range=0..3001))  # -> LargerThan, OrEqualTo
dispatch_2 = Dispatch(List=geo_4, DispatchPattern=larger.LargerThan)  # -> ListA, ListB
geo_5 = Geometry(dispatch_2.ListA)
disc = Discontinuity(Curve=geo_5, Level=1)  # -> Points, Parameters
multiple_count = ClusterInput()
pdecon = Deconstruct(Point=disc.Points)  # -> XComponent, YComponent, ZComponent
sort_pt = SortPoints(Points=disc.Points)  # -> Points, Indices
lng = ListLength(List=sort_pt.Points)
attributes = ObjectAttributes(Name=txt, Layer="Quantities")
attributes_2 = ObjectAttributes(Name=txt, Layer="Internal Sheathing")
subtraction = Subtraction(A=lng, B=1)
multiple_count_2 = Integer(multiple_count)
panel = Panel(txt)
item = ListItem(List=sort_pt.Points, Index=subtraction, Wrap=True)
concat = Concatenate(FragmentA="x", FragmentB=multiple_count_2)
xy = XYPlane(Origin=item)
bool = ClusterInput()
textdot = CreateTextDot(Text=concat, Location=xy, Font="Arial", Size=14)
text = CreateText(Text=concat, Plane=xy, Size=180, Font="Arial", JustificationMode=65537)
merge = Merge(Data1=clean, Data2=textdot)
bool_2 = Boolean(bool)
panel_2 = Panel(text)
bake = BakeObjects(Geometry=clean, Attributes=attributes_2, Bake=bool_2)
bake_2 = BakeObjects(Geometry=textdot, Attributes=attributes, Bake=bool_2)

# ==== cluster DogBonePocket
point = ClusterInput()

tool_size = Slider(10, range=0..20)
division = Division(A=tool_size, B="2")
multiplication = Multiplication(A=division, B=-1)
pt = Point(point)
X = UnitX(Factor=multiplication)
Y = UnitY(Factor=tool_size)
move = Move(Geometry=graft(pt), Motion=X)  # -> Geometry, Transform
pt_2 = Point(flatten([pt, move.Geometry]))
move_2 = Move(Geometry=flatten(pt_2), Motion=Y)  # -> Geometry, Transform
pt_3 = Point([pt_2, move_2.Geometry])
avr = Average(Input=pt_3)
xy = XYPlane(Origin=avr)
vec2pt = Vector2Pt(PointA=avr, PointB=pt_3, Unitize=False)  # -> Vector, Length
pcomp = PlaneComponents(Plane=xy)  # -> Origin, XAxis, YAxis, ZAxis
angle = Angle(VectorA=vec2pt.Vector, VectorB=pcomp.XAxis, Plane=xy)  # -> Angle, Reflex
sort = SortList(Keys=angle.Angle, ValuesA=pt_3)  # -> List, ValuesA
pt_4 = Point(sort.ValuesA)

tool_size_2 = ClusterOutput(tool_size)
pt_5 = ClusterOutput(pt_4)

# ==== cluster DogBonePocket_2
point = ClusterInput()

tool_size = Slider(10, range=0..20)
division = Division(A=tool_size, B="2")
multiplication = Multiplication(A=division, B=-1)
pt = Point(point)
X = UnitX(Factor=multiplication)
Y = UnitY(Factor=tool_size)
move = Move(Geometry=graft(pt), Motion=X)  # -> Geometry, Transform
pt_2 = Point(flatten([pt, move.Geometry]))
move_2 = Move(Geometry=flatten(pt_2), Motion=Y)  # -> Geometry, Transform
pt_3 = Point([pt_2, move_2.Geometry])
avr = Average(Input=pt_3)
xy = XYPlane(Origin=avr)
vec2pt = Vector2Pt(PointA=avr, PointB=pt_3, Unitize=False)  # -> Vector, Length
pcomp = PlaneComponents(Plane=xy)  # -> Origin, XAxis, YAxis, ZAxis
angle = Angle(VectorA=vec2pt.Vector, VectorB=pcomp.XAxis, Plane=xy)  # -> Angle, Reflex
sort = SortList(Keys=angle.Angle, ValuesA=pt_3)  # -> List, ValuesA
pt_4 = Point(sort.ValuesA)

num = Number(tool_size)
size = ClusterOutput(num)
pt_5 = ClusterOutput(pt_4)

# ==== cluster ExternalSpacers
ply_thickness = ClusterInput()
beam_width = ClusterInput()
curve_length = ClusterInput()
space_invader_pts = ClusterInput()
regular_tab_pts = ClusterInput()
space_invader_tab = ClusterInput()
reinforcer_edges = ClusterInput()
reinforcer_tab = ClusterInput()
regular_tab = ClusterInput()
intrusions = ClusterInput()
sheet_length = ClusterInput()
num = Number(beam_width)
num_2 = Number(ply_thickness)
space_invader_tab_pts = Point(space_invader_pts)
intrusion_pts = Geometry(intrusions)
sheet_length_2 = Number(sheet_length)
internal_curve_length = Number(curve_length)
space_invader_tab_2 = Geometry(space_invader_tab)
regular_tab_2 = Geometry(regular_tab)
reinforcer_tab_2 = Geometry(reinforcer_tab)
regular_tab_pts_2 = Point(regular_tab_pts)
reinforcer_edge_pts = Point(reinforcer_edges)
panel = Panel(sheet_length)
division = Division(A=num, B=2)
clean = CleanTree(RemoveNulls=True, RemoveInvalid=True, RemoveEmpty=True, Tree=reinforcer_edge_pts)
subtraction = Subtraction(A=division, B=num_2)
division_2 = Division(A=internal_curve_length, B=2)
subtraction_2 = Subtraction(A=division_2, B=flatten(num_2))
subtraction_3 = Subtraction(A=subtraction, B=num_2)
pt = ConstructPoint(XCoordinate=0, YCoordinate=0, ZCoordinate=0)
X = UnitX(Factor=1)
neg = Negative(Value=division_2)
null = NullItem(Item=intrusion_pts)  # -> NullFlags, InvalidFlags, Description
line = LineSDL(Start=pt, Direction=X, Length=division_2)
line_2 = LineSDL(Start=pt, Direction=X, Length=neg)
join = JoinCurves(Curves=[line, line_2], Preserve=False)
dispatch = Dispatch(List=simplify(join), DispatchPattern=null.NullFlags)  # -> ListA, ListB
crv_cp = CurveClosestPoint(Point=intrusion_pts, Curve=simplify(dispatch.ListB))  # -> simplify(Point), simplify(Parameter), Distance
geo = Geometry(join)
crv_cp_2 = CurveClosestPoint(Point=clean, Curve=geo)  # -> Point, Parameter, Distance
shatter = Shatter(Curve=geo, Parameters=crv_cp_2.Parameter)  # -> simplify(Segments)
shatter_2 = Shatter(Curve=simplify(join), Parameters=crv_cp.Parameter)
dispatch_2 = Dispatch(List=shatter, DispatchPattern=[True, False])  # -> ListA, ListB
panel_2 = Panel(geo)
dispatch_3 = Dispatch(List=shatter_2, DispatchPattern=[True, False])  # -> ListA, ListB
reinforced = Geometry(dispatch_2.ListA)
un_reinforced = Geometry(dispatch_2.ListB)
geo_2 = Geometry(simplify(dispatch_3.ListA))
colom = CollisionOneMany(Collider=regular_tab_pts_2, Obstacles=reinforced)  # -> Collision, Index
merge = Merge(Data1=geo_2, Data2=dispatch.ListA)
dispatch_4 = Dispatch(List=regular_tab_pts_2, DispatchPattern=colom.Collision)  # -> ListA, ListB
regular_tab_pt = Point(dispatch_4.ListB)
reinforcer_tab_pt = Point(dispatch_4.ListA)
cullpt = CullDuplicates(Points=regular_tab_pt, Tolerance=0.1, CullMode=3)  # -> Points, Indices, Valence
cullpt_2 = CullDuplicates(Points=reinforcer_tab_pt, Tolerance=0.1, CullMode=3)  # -> Points, Indices, Valence
colom_2 = CollisionOneMany(Collider=cullpt.Points, Obstacles=space_invader_pts)  # -> Collision, Index
dispatch_5 = Dispatch(List=cullpt.Points, DispatchPattern=colom_2.Collision)  # -> ListA, ListB
space_invader_points = Point(dispatch_5.ListA)

slot_length = Slider(30, range=0..100)
tolerance = Slider(0.25, range=0..1)
ply_thickness_2 = Number(num_2)
addition = Addition(A=slot_length, B=tolerance)
addition_2 = Addition(A=ply_thickness_2, B=tolerance)
rectangle = Rectangle(Plane=PlaneXY(0, 0, 0), XSize=addition_2, YSize=addition, Radius=0)  # -> Rectangle, Length
pcen = PolygonCenter(Polyline=rectangle.Rectangle)  # -> CenterV, CenterE, CenterA
orient = OrientDirection(
    Geometry=graft(rectangle.Rectangle),
    PointA=pcen.CenterA,
    DirectionA=Vector(0, 0, 1),
    PointB=space_invader_points,
    DirectionB=Vector(0, 0, 1))  # -> simplify(Geometry), Transform

pt_2 = Point(dispatch_5.ListB)
cull_i = CullIndex(List=reinforced, Indices=flatten(0), Wrap=False)  # -> simplify(List)
lng = ListLength(List=cull_i)
orient_2 = OrientDirection(Geometry=graft(regular_tab_2), PointA=pt, DirectionA=Vector(0, 0, 1), PointB=pt_2, DirectionB=Vector(0, 0, 1))  # -> simplify(Geometry), Transform
orient_3 = OrientDirection(
    Geometry=graft(reinforcer_tab_2),
    PointA=pt,
    DirectionA=Vector(0, 0, 1),
    PointB=cullpt_2.Points,
    DirectionB=Vector(0, 0, 1))  # -> simplify(Geometry), Transform
orient_4 = OrientDirection(
    Geometry=graft(regular_tab_2),
    PointA=pt,
    DirectionA=Vector(0, 0, 1),
    PointB=space_invader_points,
    DirectionB=Vector(0, 0, 1))  # -> simplify(Geometry), Transform
subtraction_4 = Subtraction(A=lng, B=1)
cull_i_2 = CullIndex(List=cull_i, Indices=subtraction_4, Wrap=False)  # -> simplify(List)
eval = EvaluateLength(Curve=cull_i_2, Length=0.5, Normalized=True)  # -> simplify(Point), Tangent, Parameter
crv_cp_3 = CurveClosestPoint(Point=eval.Point, Curve=merge)  # -> simplify(Point), Parameter, Distance
shatter_3 = Shatter(Curve=merge, Parameters=crv_cp_3.Parameter)  # -> simplify(Segments)
null_2 = NullItem(Item=shatter_3)  # -> NullFlags, InvalidFlags, Description
dispatch_6 = Dispatch(List=merge, DispatchPattern=null_2.NullFlags)  # -> ListA, ListB
merge_2 = Merge(Data1=simplify(dispatch_6.ListA))
len = Length(Curve=merge_2)

end = EndPoints(Curve=orient_3.Geometry)  # -> Start, End
merge_3 = Merge(Data1=end.Start, Data2=end.End)
item = ListItem(List=reinforced, Index=1, Wrap=False)
item_2 = ListItem(List=reinforced, Index=2, Wrap=False)
item_3 = ListItem(List=reinforced, Index=3, Wrap=False)
item_4 = ListItem(List=reinforced, Index=0, Wrap=True)
item_5 = ListItem(List=reinforced, Index=4, Wrap=False)
crv_cp_4 = CurveClosestPoint(Point=merge_3, Curve=item_4)  # -> Point, Parameter, Distance
crv_cp_5 = CurveClosestPoint(Point=merge_3, Curve=item)  # -> Point, Parameter, Distance
crv_cp_6 = CurveClosestPoint(Point=merge_3, Curve=item_2)  # -> Point, Parameter, Distance
crv_cp_7 = CurveClosestPoint(Point=merge_3, Curve=item_3)  # -> Point, Parameter, Distance
crv_cp_8 = CurveClosestPoint(Point=merge_3, Curve=item_5)  # -> Point, Parameter, Distance
shatter_4 = Shatter(Curve=item_4, Parameters=crv_cp_4.Parameter)
shatter_5 = Shatter(Curve=item, Parameters=crv_cp_5.Parameter)
shatter_6 = Shatter(Curve=item_2, Parameters=crv_cp_6.Parameter)
shatter_7 = Shatter(Curve=item_3, Parameters=crv_cp_7.Parameter)
shatter_8 = Shatter(Curve=item_5, Parameters=crv_cp_8.Parameter)
path_mapper = PathMapper(shatter_5, source="{A;B}", target="{A}")
path_mapper_2 = PathMapper(shatter_4, source="{A;B}", target="{A}")
path_mapper_3 = PathMapper(shatter_6, source="{A;B}", target="{A}")
path_mapper_4 = PathMapper(shatter_7, source="{A;B}", target="{A}")
path_mapper_5 = PathMapper(shatter_8, source="{A;B}", target="{A}")
dispatch_7 = Dispatch(List=path_mapper, DispatchPattern=[True, False])  # -> ListA, ListB
dispatch_8 = Dispatch(List=path_mapper_2, DispatchPattern=[True, False])  # -> ListA, ListB
dispatch_9 = Dispatch(List=path_mapper_3, DispatchPattern=[True, False])  # -> ListA, ListB
dispatch_10 = Dispatch(List=path_mapper_4, DispatchPattern=[True, False])  # -> ListA, ListB
dispatch_11 = Dispatch(List=path_mapper_5, DispatchPattern=[True, False])  # -> ListA, ListB
geo_3 = Geometry(dispatch_7.ListA)
geo_4 = Geometry(dispatch_8.ListA)
geo_5 = Geometry(dispatch_9.ListA)
geo_6 = Geometry(dispatch_10.ListA)
geo_7 = Geometry(dispatch_11.ListA)
merge_4 = Merge(Data1=geo_4, Data2=geo_3, Data3=orient_3.Geometry, Data4=geo_5, Data5=geo_6, Data6=geo_7)
join_2 = JoinCurves(Curves=merge_4, Preserve=False)

larger = LargerThan(FirstNumber=len, SecondNumber=sheet_length_2)  # -> simplify(LargerThan), OrEqualTo
dispatch_12 = Dispatch(List=merge_2, DispatchPattern=larger.LargerThan)  # -> ListA, ListB
geo_8 = Geometry(dispatch_12.ListA)
merge_5 = Merge(Data1=simplify(geo_8), Data2=shatter_3)  # -> simplify(Result)
eval_2 = EvaluateLength(Curve=merge_5, Length=0.5, Normalized=True)  # -> simplify(Point), Tangent, Parameter
path_mapper_6 = PathMapper(eval_2.Point, source=["{A}", "{A;B}"], target=["{A}", "{A}"])
merge_6 = Merge(Data1=simplify(pt_2))  # -> simplify(Result)
cps = ClosestPoints(Point=path_mapper_6, Cloud=simplify(merge_6), Count=1)  # -> simplify(ClosestPoint), CPIndex, Distance
path_mapper_7 = PathMapper(cps.ClosestPoint, source="{A}", target="{A}")
path_mapper_8 = PathMapper(cps.ClosestPoint, source="{A;B}", target="{A}")
merge_7 = Merge(Data1=path_mapper_8, Data2=path_mapper_7)
Y = UnitY(Factor=subtraction)
Y_2 = UnitY(Factor=subtraction_3)
panel_3 = Panel(path_mapper_6)
move = Move(Geometry=join_2, Motion=Y_2)  # -> Geometry, Transform
end_2 = EndPoints(Curve=move.Geometry)  # -> Start, End
number_slider = Slider(2, range=0..6)
xz = XZPlane(Origin=Point(0, 0, 0))
intrusions_pt = Point(intrusion_pts)
unit_type = ClusterInput()
sub_labels = ClusterInput()
panel_4 = Panel(sub_labels)
unit_type_2 = Data(unit_type)
concat = Concatenate(FragmentA=unit_type_2, FragmentB=" / FRM ")
concat_2 = Concatenate(FragmentA=concat, FragmentB="/ S")
Z = UnitZ(Factor=num_2)
division_3 = Division(A=Z, B=-2)
layers = CreateModifyLayers(LayerName="SPACERS", DeleteLayer=False, enableFullPath=False)  # -> LayerNames, LayerFullPath

merge_8 = Merge(Data1=orient_4.Geometry, Data2=orient_2.Geometry)
end_3 = EndPoints(Curve=merge_8)  # -> Start, End
merge_9 = Merge(Data1=end_3.Start, Data2=end_3.End)
item_6 = ListItem(List=un_reinforced, Index=0, Wrap=True)
item_7 = ListItem(List=un_reinforced, Index=1, Wrap=False)
item_8 = ListItem(List=un_reinforced, Index=2, Wrap=False)
item_9 = ListItem(List=un_reinforced, Index=3, Wrap=False)
crv_cp_9 = CurveClosestPoint(Point=merge_9, Curve=item_6)  # -> Point, Parameter, Distance
crv_cp_10 = CurveClosestPoint(Point=merge_9, Curve=item_7)  # -> Point, Parameter, Distance
crv_cp_11 = CurveClosestPoint(Point=merge_9, Curve=item_8)  # -> Point, Parameter, Distance
crv_cp_12 = CurveClosestPoint(Point=merge_9, Curve=item_9)  # -> Point, Parameter, Distance
shatter_9 = Shatter(Curve=item_6, Parameters=crv_cp_9.Parameter)
shatter_10 = Shatter(Curve=item_7, Parameters=crv_cp_10.Parameter)
shatter_11 = Shatter(Curve=item_8, Parameters=crv_cp_11.Parameter)
shatter_12 = Shatter(Curve=item_9, Parameters=crv_cp_12.Parameter)
path_mapper_9 = PathMapper(shatter_9, source="{A;B}", target="{A}")
path_mapper_10 = PathMapper(shatter_10, source="{A;B}", target="{A}")
path_mapper_11 = PathMapper(shatter_11, source="{A;B}", target="{A}")
path_mapper_12 = PathMapper(shatter_12, source="{A;B}", target="{A}")
dispatch_13 = Dispatch(List=path_mapper_9, DispatchPattern=[True, False])  # -> ListA, ListB
dispatch_14 = Dispatch(List=path_mapper_10, DispatchPattern=[True, False])  # -> ListA, ListB
dispatch_15 = Dispatch(List=path_mapper_11, DispatchPattern=[True, False])  # -> ListA, ListB
dispatch_16 = Dispatch(List=path_mapper_12, DispatchPattern=[True, False])  # -> ListA, ListB
geo_9 = Geometry(dispatch_13.ListA)
geo_10 = Geometry(dispatch_14.ListA)
geo_11 = Geometry(dispatch_16.ListA)

geo_12 = Geometry(dispatch_15.ListA)

merge_10 = Merge(Data1=geo_9, Data2=geo_10, Data3=orient_4.Geometry, Data4=orient_2.Geometry, Data5=geo_12, Data6=geo_11)
join_3 = JoinCurves(Curves=merge_10, Preserve=False)
branch = TreeBranch(Tree=join_3, Path="{0;0}", MaintainPaths=True)

move_2 = Move(Geometry=join_3, Motion=Y)  # -> Geometry, Transform
end_4 = EndPoints(Curve=move_2.Geometry)  # -> Start, End
pt_3 = Point([end_4.Start, end_4.End, end_2.Start, end_2.End])
pgroups = PointGroups(Points=pt_3, Distance=num_2)  # -> simplify(Groups), Indices
pline = PolyLine(Vertices=pgroups.Groups, Closed=False)
clean_2 = CleanTree(RemoveNulls=True, RemoveInvalid=True, RemoveEmpty=True, Tree=pline)
path_mapper_13 = PathMapper(clean_2, source="{A;B}", target="{A}")
geo_13 = Geometry(path_mapper_13)
path_mapper_14 = PathMapper(path_mapper_13, source="{A}", target="{A-2;0}")
merge_11 = Merge(Data1=path_mapper_13, Data2=move_2.Geometry, Data3=move.Geometry)
panel_5 = Panel(clean_2)
path_mapper_15 = PathMapper(merge_11, source="{A;B}", target="{A}")
join_4 = JoinCurves(Curves=path_mapper_15, Preserve=False)  # -> simplify(Curves)
item_10 = ListItem(List=join_4, Index=0, Wrap=True)
geo_14 = Geometry(item_10)
mirror = Mirror(Geometry=geo_14, Plane=xz)  # -> Geometry, Transform
end_5 = EndPoints(Curve=mirror.Geometry)  # -> Start, End
end_6 = EndPoints(Curve=geo_14)  # -> Start, End
ln = Line(StartPoint=end_6.Start, EndPoint=end_5.Start)
ln_2 = Line(StartPoint=end_6.End, EndPoint=end_5.End)
geo_15 = Geometry([mirror.Geometry, ln, ln_2, geo_14])
join_5 = JoinCurves(Curves=geo_15, Preserve=False)
branch_2 = TreeBranch(Tree=simplify(join_4), Path=Slider(0, range=0..6), MaintainPaths=True)
boundary = BoundarySurfaces(Edges=join_5)  # -> simplify(Surfaces)
crv_cp_13 = CurveClosestPoint(Point=intrusions_pt, Curve=geo_14)  # -> Point, Parameter, Distance
crv_cp_14 = CurveClosestPoint(Point=intrusions_pt, Curve=mirror.Geometry)  # -> Point, Parameter, Distance
srfsplit = SurfaceSplit(Surface=boundary, Curves=orient.Geometry)
geo_16 = Geometry(srfsplit)
ln_3 = Line(StartPoint=crv_cp_13.Point, EndPoint=crv_cp_14.Point)
area = Area(Geometry=geo_16)  # -> Area, Centroid
larger_2 = LargerThan(FirstNumber=area.Area, SecondNumber="1000")  # -> LargerThan, OrEqualTo
clean_3 = CleanTree(RemoveNulls=True, RemoveInvalid=True, RemoveEmpty=False, Tree=ln_3)
dispatch_17 = Dispatch(List=geo_16, DispatchPattern=larger_2.LargerThan)  # -> ListA, ListB
geo_17 = Geometry(simplify(dispatch_17.ListA))
srfsplit_2 = SurfaceSplit(Surface=geo_17, Curves=clean_3)
geo_18 = Geometry(srfsplit_2)
area_2 = Area(Geometry=geo_18)  # -> Area, Centroid
larger_3 = LargerThan(FirstNumber=area_2.Area, SecondNumber=Slider(50274, range=0..54061))  # -> LargerThan, OrEqualTo
null_3 = NullItem(Item=srfsplit_2)  # -> NullFlags, InvalidFlags, Description
dispatch_18 = Dispatch(List=geo_17, DispatchPattern=null_3.NullFlags)  # -> ListA, ListB
dispatch_19 = Dispatch(List=geo_18, DispatchPattern=larger_3.LargerThan)  # -> ListA, ListB
merge_12 = Merge(Data1=dispatch_19.ListA, Data2=dispatch_18.ListA)
geo_19 = Geometry(merge_12)

join_6 = JoinCurves(Curves=merge, Preserve=False)  # -> simplify(Curves)
len_2 = Length(Curve=join_6)
larger_4 = LargerThan(FirstNumber=len_2, SecondNumber="2400")  # -> LargerThan, OrEqualTo
dispatch_20 = Dispatch(List=join_6, DispatchPattern=larger_4.OrEqualTo)  # -> ListA, ListB
crv = Curve(dispatch_20.ListA)
dovetail_split = DovetailSplit(F=division)  # -> G, pt_4

crv_cp_15 = CurveClosestPoint(Point=simplify(merge_7), Curve=crv)  # -> Point, simplify(Parameter), Distance
branch_3 = TreeBranch(Tree=simplify(crv_cp_15.Point), Path=number_slider, MaintainPaths=True)
branch_4 = TreeBranch(Tree=simplify(crv), Path=number_slider, MaintainPaths=True)

eval_3 = EvaluateCurve(Curve=crv, Parameter=crv_cp_15.Parameter)  # -> Point, Tangent, Angle
orient_5 = OrientDirection(
    Geometry=dovetail_split.G,
    PointA=dovetail_split.pt_4,
    DirectionA=Vector(0, 0, 1),
    PointB=eval_3.Point,
    DirectionB=eval_3.Tangent)  # -> simplify(Geometry), Transform

panel_6 = Panel(orient_5.Geometry)
srfsplit_3 = SurfaceSplit(Surface=geo_19, Curves=orient_5.Geometry)  # -> simplify(Fragments)
geo_20 = Geometry(srfsplit_3)
area_3 = Area(Geometry=geo_20)  # -> Area, Centroid
larger_5 = LargerThan(FirstNumber=area_3.Area, SecondNumber="200")  # -> LargerThan, OrEqualTo
dispatch_21 = Dispatch(List=geo_20, DispatchPattern=larger_5.LargerThan)  # -> ListA, ListB
path_mapper_16 = PathMapper(dispatch_21.ListA, source=["{A}", "{A;B}"], target=["{A}", "{A}"])
geo_21 = Geometry(path_mapper_16)
rev = ReverseList(List=geo_21)
geo_22 = Geometry(geo_21)
rev_2 = ReverseList(List=geo_22)
area_4 = Area(Geometry=rev_2)  # -> Area, Centroid
pdecon = Deconstruct(Point=area_4.Centroid)  # -> XComponent, YComponent, ZComponent
sort = SortList(Keys=pdecon.XComponent, ValuesA=rev_2)  # -> Keys, ValuesA
spacers = Geometry(flatten(sort.ValuesA))
labelling = Labelling(geometry=spacers, wall_label=concat_2, part_label=sub_labels, text_size=Slider(40, range=0..61))  # -> geometry_3, G
clean_4 = CleanTree(RemoveNulls=True, RemoveInvalid=True, RemoveEmpty=True, Tree=labelling.G)  # -> simplify(graft(Tree))
wires = BrepWireframe(Brep=simplify(labelling.geometry_3), Density=-1)  # -> simplify(Wireframe)
join_7 = JoinCurves(Curves=wires, Preserve=False)  # -> simplify(Curves)
txt = Text(clean_4)
split = TextSplit(Text=txt, Separators=":")
extr = Extrude(Base=rev, Direction=flatten(Z))
merge_13 = Merge(Data1=join_7, Data2=clean_4)
item_11 = ListItem(List=split, Index=1, Wrap=True)  # -> simplify(Item)
move_3 = Move(Geometry=extr, Motion=flatten(division_3))  # -> Geometry, Transform
group = Group(Objects=merge_13)
createatts = CreateAttributes(Name=item_11, LayerName=layers.LayerNames, enableFullPath=False)
geo_23 = Geometry(simplify(move_3.Geometry))
data = Data(simplify(flatten(createatts)))
geo_24 = Geometry(flatten(group))
branch_5 = TreeBranch(Tree=geo_23, Path=Slider(0, range=0..6), MaintainPaths=True)
unflatten = UnflattenTree(Tree=data, Guide=geo_23)
_2d_geo = ClusterOutput(geo_24)
attributes = ClusterOutput(unflatten)
_3d = ClusterOutput(geo_23)

# ==== cluster PegCrossSlots
ply_thickness = ClusterInput()
tolerance = ClusterInput()
pt = ConstructPoint(XCoordinate=0, YCoordinate=0, ZCoordinate=0)
dog_bone_pocket = DogBonePocket(point=pt)  # -> pt_5, tool_size_2
slot_length = Slider(70, range=25..301)
division = Division(A=ply_thickness, B=2)
addition = Addition(A=division, B=tolerance)
multiplication = Multiplication(A=addition, B=-1)
X = UnitX(Factor=multiplication)
addition_2 = Addition(A=tolerance, B=slot_length)
multiplication_2 = Multiplication(A=addition_2, B=-1)
Y = UnitY(Factor=multiplication_2)
move = Move(Geometry=pt, Motion=X)  # -> Geometry, Transform
move_2 = Move(Geometry=dog_bone_pocket.pt_5, Motion=X)  # -> Geometry, Transform
move_3 = Move(Geometry=move_2.Geometry, Motion=Y)  # -> Geometry, Transform
move_4 = Move(Geometry=pt, Motion=Y)  # -> Geometry, Transform
geo = Geometry(flatten([move_4.Geometry, move_3.Geometry, move.Geometry]))
pline = PolyLine(Vertices=geo, Closed=False)
slot_length_2 = Slider(48, range=25..301)
corner_slots = ClusterInput()
connectors = ClusterInput()
locations = ClusterInput()
mirror = Mirror(Geometry=pline, Plane=PlaneYZ(0, 0, 0))  # -> Geometry, Transform
slot_length_3 = ClusterInput()
join = JoinCurves(Curves=flatten([pline, mirror.Geometry]), Preserve=False)
xz = XZPlane(Origin=Point(0, 0, 0))
mirror_2 = Mirror(Geometry=join, Plane=xz)  # -> Geometry, Transform
ext = ExtendCurve(Curve=mirror_2.Geometry, Type=0, Start=slot_length_2, End=slot_length_2)
connectors_2 = Geometry(connectors)
join_2 = JoinCurves(Curves=flatten(ext), Preserve=False)
end = EndPoints(Curve=join_2)  # -> Start, End
connectors_3 = Geometry(corner_slots)
xz_2 = XZPlane(Origin=Point(0, 0, 0))
ln = Line(StartPoint=end.Start, EndPoint=end.End)
join_3 = JoinCurves(Curves=flatten([ln, join_2]), Preserve=False)
orient = OrientDirection(Geometry=join_3, PointA=pt, DirectionA=xz_2, PointB=locations, DirectionB=Vector(0, 0, 1))  # -> Geometry, Transform
boundary = BoundarySurfaces(Edges=connectors_3)
ccx = CurveCurve(CurveA=connectors_3, CurveB=graft(orient.Geometry))  # -> Points, ParamsA, ParamsB
boundary_2 = BoundarySurfaces(Edges=orient.Geometry)
shatter = Shatter(Curve=connectors_3, Parameters=flatten(ccx.ParamsA))
shatter_2 = Shatter(Curve=orient.Geometry, Parameters=flatten(ccx.ParamsB))
sunion = SolidUnion(Breps=flatten([boundary, boundary_2]))
dispatch = Dispatch(List=shatter, DispatchPattern=[True, False])  # -> ListA, ListB
dispatch_2 = Dispatch(List=shatter_2, DispatchPattern=[True, False])  # -> ListA, ListB
mesh = MeshBrep(
    Brep=sunion,
    Settings={GridMaxCount=0, GridMinCount=16, JaggedSeams=False, MaxEdgeLength=0, MinEdgeLength=0.0001, MinTolerance=0, Refine=True, RefineAngle=0, RelativeTolerance=0.65, SimplePlanes=True, Tolerance=0})
join_4 = JoinCurves(Curves=flatten([shatter, shatter_2]), Preserve=False)
geo_2 = Geometry(dispatch.ListA)
geo_3 = Geometry(dispatch_2.ListA)
xz_3 = XZPlane(Origin=Point(0, 0, 0))
Y_2 = UnitY(Factor=1)
boundary_3 = BoundarySurfaces(Edges=join_4)
mshadow = MeshShadow(Mesh=mesh, Light=Y_2, Plane=xz_3)  # -> flatten(Outlines)
wires = BrepWireframe(Brep=boundary_3, Density=-1)
join_5 = JoinCurves(Curves=flatten(mshadow), Preserve=False)
item = ListItem(List=mshadow, Index=0, Wrap=True)
panel = Panel(item)
C = ClusterOutput(join_5)
_2d_geo = ClusterOutput(join_5)

# ==== cluster Labelling_2
unit_type = ClusterInput()
wall_label = ClusterInput()
part_label = ClusterInput()
text_size = ClusterInput()
locations = ClusterInput()
concat = Concatenate(FragmentA=unit_type, FragmentB=wall_label)
concat_2 = Concatenate(FragmentA=concat, FragmentB=part_label)
panel = Panel(concat_2)
text = CreateText(Text=concat_2, Plane=locations, Size=text_size, Font="Arial", JustificationMode=65537)
subtraction = Subtraction(A=text_size, B=Slider(30.194, range=0..61))
len = TextLength(Text=text)
cir = Circle(Plane=PlaneXY(0, 0, 0), Radius=text_size)
multiplication = Multiplication(A=subtraction, B=len)
colom = CollisionOneMany(Collider=cir)  # -> Collision, Index
division = Division(A=text_size, B=2)
neg = Negative(Value=Slider(45, range=0..261))
division_2 = Division(A=multiplication, B=2)
dispatch = Dispatch(List=text, DispatchPattern=colom.Collision)  # -> ListA, ListB
neg_2 = Negative(Value=division)
neg_3 = Negative(Value=division_2)
collision = Geometry(dispatch.ListA)
no_collision = Geometry(dispatch.ListB)
Z = UnitZ(Factor=neg)
Y = UnitY(Factor=neg)
Z_2 = UnitZ(Factor=neg_2)
move = Move(Geometry=collision, Motion=Z)  # -> Geometry, Transform
merge = Merge(Data1=move.Geometry, Data2=no_collision)
Y_2 = UnitY(Factor=neg_2)
move_2 = Move(Geometry=text, Motion=Z_2)  # -> Geometry, Transform
X = UnitX(Factor=neg_3)
move_3 = Move(Geometry=move_2.Geometry, Motion=X)  # -> Geometry, Transform
G = ClusterOutput(move_3.Geometry)

# ==== cluster Labelling_3
unit_type = ClusterInput()
wall_label = ClusterInput()
part_label = ClusterInput()
text_size = ClusterInput()
locations = ClusterInput()
concat = Concatenate(FragmentA=unit_type, FragmentB=wall_label)
concat_2 = Concatenate(FragmentA=concat, FragmentB=part_label)
panel = Panel(concat_2)
text = CreateText(Text=concat_2, Plane=locations, Size=text_size, Font="Arial", JustificationMode=65537)
subtraction = Subtraction(A=text_size, B=Slider(31.532, range=0..61))
len = TextLength(Text=text)
cir = Circle(Plane=PlaneXY(0, 0, 0), Radius=text_size)
multiplication = Multiplication(A=subtraction, B=len)
colom = CollisionOneMany(Collider=cir)  # -> Collision, Index
division = Division(A=text_size, B=2)
neg = Negative(Value=Slider(55, range=0..261))
division_2 = Division(A=multiplication, B=2)
dispatch = Dispatch(List=text, DispatchPattern=colom.Collision)  # -> ListA, ListB
neg_2 = Negative(Value=division)
neg_3 = Negative(Value=division_2)
collision = Geometry(dispatch.ListA)
no_collision = Geometry(dispatch.ListB)
Z = UnitZ(Factor=neg)
Y = UnitY(Factor=neg)
Z_2 = UnitZ(Factor=division)
move = Move(Geometry=collision, Motion=Z)  # -> Geometry, Transform
merge = Merge(Data1=move.Geometry, Data2=no_collision)
Y_2 = UnitY(Factor=neg_2)
move_2 = Move(Geometry=text, Motion=Z_2)  # -> Geometry, Transform
X = UnitX(Factor=neg_3)
move_3 = Move(Geometry=move_2.Geometry, Motion=X)  # -> Geometry, Transform
G = ClusterOutput(move_3.Geometry)

# ==== cluster DogBonePocket_3
point = ClusterInput()

tool_size = Slider(10, range=0..20)
division = Division(A=tool_size, B="2")
multiplication = Multiplication(A=division, B=-1)
pt = Point(point)
X = UnitX(Factor=multiplication)
Y = UnitY(Factor=tool_size)
move = Move(Geometry=graft(pt), Motion=X)  # -> Geometry, Transform
pt_2 = Point(flatten([pt, move.Geometry]))
move_2 = Move(Geometry=flatten(pt_2), Motion=Y)  # -> Geometry, Transform
pt_3 = Point([pt_2, move_2.Geometry])
avr = Average(Input=pt_3)
xy = XYPlane(Origin=avr)
vec2pt = Vector2Pt(PointA=avr, PointB=pt_3, Unitize=False)  # -> Vector, Length
pcomp = PlaneComponents(Plane=xy)  # -> Origin, XAxis, YAxis, ZAxis
angle = Angle(VectorA=vec2pt.Vector, VectorB=pcomp.XAxis, Plane=xy)  # -> Angle, Reflex
sort = SortList(Keys=angle.Angle, ValuesA=pt_3)  # -> List, ValuesA
pt_4 = Point(sort.ValuesA)

num = Number(tool_size)
size = ClusterOutput(num)
tool_size_2 = ClusterOutput(tool_size)
pt_5 = ClusterOutput(pt_4)

# ==== cluster DJOINTUK
A = ClusterInput()
division = Division(A=A, B=2)
addition = Addition(A=division, B=0)
pt = ConstructPoint(XCoordinate=0, YCoordinate=0, ZCoordinate=0)
Z = UnitZ(Factor=addition)
multiplication = Multiplication(A=Z, B=-1)
move = Move(Geometry=pt, Motion=[Z, multiplication])  # -> Geometry, Transform
split = SplitList(List=move.Geometry, Index=1)  # -> ListA, ListB
dovetail_height = ClusterInput()
tolerance = Slider(0.5, range=0..5)
pline = PolyLine(Vertices=[split.ListA, split.ListB], Closed=False)
divide = DivideCurve(Curve=pline, Count=Slider(5, range=0..5), Kinks=False)  # -> Points, Tangents, Parameters
division_2 = Division(A=dovetail_height, B=2)
points = ClusterOutput(pt)
division_3 = Division(A=tolerance, B=2)
Z_2 = UnitZ(Factor=division_3)
neg = Negative(Value=Z_2)
cull_i = CullIndex(List=divide.Points, Indices=[0, 5], Wrap=True)
subtraction = Subtraction(A=division_2, B=division_3)
addition_2 = Addition(A=division_2, B=division_3)
dispatch = Dispatch(List=cull_i, DispatchPattern=[True, False, True, False])  # -> ListA, ListB
X = UnitX(Factor=subtraction)
X_2 = UnitX(Factor=addition_2)
move_2 = Move(Geometry=dispatch.ListA, Motion=neg)  # -> Geometry, Transform
move_3 = Move(Geometry=dispatch.ListB, Motion=Z_2)  # -> Geometry, Transform
move_4 = Move(Geometry=dispatch.ListA, Motion=Z_2)  # -> Geometry, Transform
move_5 = Move(Geometry=dispatch.ListB, Motion=neg)  # -> Geometry, Transform

move_6 = Move(Geometry=dispatch.ListA, Motion=neg)  # -> Geometry, Transform
move_7 = Move(Geometry=dispatch.ListB, Motion=Z_2)  # -> Geometry, Transform
item = ListItem(List=divide.Points, Index=[0, 5], Wrap=True)
pt_2 = Point([move_6.Geometry, move_7.Geometry])
sort_pt = SortPoints(Points=pt_2)  # -> Points, Indices
rev = ReverseList(List=sort_pt.Points)
pt_3 = Point(flatten([rev, item]))
sort_pt_2 = SortPoints(Points=pt_3)  # -> Points, Indices
dispatch_2 = Dispatch(List=rev, DispatchPattern=[True, True, False, False])  # -> ListA, ListB
rev_2 = ReverseList(List=sort_pt_2.Points)
avr = Average(Input=dispatch_2.ListA)
item_2 = ListItem(List=dispatch_2.ListA, Index=0, Wrap=True)
xy = XYPlane(Origin=avr)
rev_3 = ReverseList(List=item_2)
mirror = Mirror(Geometry=rev_3, Plane=xy)  # -> Geometry, Transform
xy_2 = XYPlane(Origin=Point(0, 0, 0))
pt_4 = Point([mirror.Geometry, item_2])
pline_2 = PolyLine(Vertices=pt_4, Closed=False)
mirror_2 = Mirror(Geometry=pline_2, Plane=xy_2)  # -> Geometry, Transform
multiplication_2 = Multiplication(A=X, B=-1)
move_8 = Move(Geometry=rev_2, Motion=X_2)  # -> Geometry, Transform
move_9 = Move(Geometry=[pline_2, mirror_2.Geometry], Motion=multiplication_2)  # -> Geometry, Transform
dispatch_3 = Dispatch(List=move_9.Geometry, DispatchPattern=[True, False])  # -> ListA, ListB
split_2 = SplitList(List=move_8.Geometry, Index=2)  # -> ListA, ListB
end = EndPoints(Curve=dispatch_3.ListA)  # -> Start, End
end_2 = EndPoints(Curve=dispatch_3.ListB)  # -> Start, End
dispatch_4 = Dispatch(List=split_2.ListB, DispatchPattern=[True, True, False, False])  # -> ListA, ListB
pline_3 = PolyLine(Vertices=flatten([split_2.ListA, end.End]), Closed=False)
pline_4 = PolyLine(Vertices=dispatch_4.ListA, Closed=False)
end_3 = EndPoints(Curve=pline_4)  # -> Start, End
xy_3 = XYPlane(Origin=Point(0, 0, 0))
pline_5 = PolyLine(Vertices=flatten([end_2.Start, end_3.End]), Closed=False)
pline_6 = PolyLine(Vertices=flatten([end.Start, end_3.Start]), Closed=False)
mirror_3 = Mirror(Geometry=pline_3, Plane=xy_3)  # -> Geometry, Transform
fillet = Slider(10, range=0..15)
join = JoinCurves(Curves=flatten([pline_3, move_9.Geometry, mirror_3.Geometry, pline_4, pline_6, pline_5]), Preserve=False)
fillet_2 = Fillet(Curve=join, Radius=fillet)

item_3 = ListItem(List=divide.Points, Index=[0, 5], Wrap=True)
pt_5 = Point([move_2.Geometry, move_3.Geometry])
pt_6 = Point([move_4.Geometry, move_5.Geometry])
sort_pt_3 = SortPoints(Points=pt_5)  # -> Points, Indices
sort_pt_4 = SortPoints(Points=pt_6)  # -> Points, Indices
rev_4 = ReverseList(List=sort_pt_3.Points)
pt_7 = Point(flatten([rev_4, item_3]))
rev_5 = ReverseList(List=sort_pt_4.Points)
sort_pt_5 = SortPoints(Points=pt_7)  # -> Points, Indices
dispatch_5 = Dispatch(List=rev_4, DispatchPattern=[True, True, False, False])  # -> ListA, ListB
dispatch_6 = Dispatch(List=rev_5, DispatchPattern=[True, True, False, False])  # -> ListA, ListB
rev_6 = ReverseList(List=sort_pt_5.Points)
avr_2 = Average(Input=dispatch_5.ListA)
item_4 = ListItem(List=dispatch_5.ListA, Index=0, Wrap=True)
avr_3 = Average(Input=dispatch_6.ListA)
item_5 = ListItem(List=dispatch_6.ListA, Index=0, Wrap=True)
dog_bone_pocket = DogBonePocket_4(point=item_4)  # -> tool_size_2, i
xy_4 = XYPlane(Origin=avr_2)
dog_bone_pocket_2 = DogBonePocket_5(point=item_5)  # -> tool_size_2, i
end_4 = EndPoints(Curve=pline)  # -> Start, End
xy_5 = XYPlane(Origin=avr_3)
xy_6 = XYPlane(Origin=Point(0, 0, 0))
rev_7 = ReverseList(List=dog_bone_pocket.i)
mirror_4 = Mirror(Geometry=rev_7, Plane=xy_4)  # -> Geometry, Transform
rev_8 = ReverseList(List=dog_bone_pocket_2.i)
mirror_5 = Mirror(Geometry=dog_bone_pocket_2.i, Plane=xy_5)  # -> Geometry, Transform
rev_9 = ReverseList(List=mirror_5.Geometry)
mirror_6 = Mirror(Geometry=rev_9, Plane=xy_6)  # -> Geometry, Transform
xy_7 = XYPlane(Origin=Point(0, 0, 0))
pt_8 = Point([mirror_4.Geometry, dog_bone_pocket.i])
pt_9 = Point(rev_8)
xy_8 = XYPlane(Origin=Point(0, 0, 0))
pt_10 = Point([mirror_5.Geometry, mirror_6.Geometry])
pline_7 = PolyLine(Vertices=pt_8, Closed=False)
mirror_7 = Mirror(Geometry=pline_7, Plane=xy_7)  # -> Geometry, Transform
pline_8 = PolyLine(Vertices=flatten([pt_9, end_4.Start]), Closed=False)
pline_9 = PolyLine(Vertices=pt_10, Closed=False)
mirror_8 = Mirror(Geometry=pline_8, Plane=xy_8)  # -> Geometry, Transform
multiplication_3 = Multiplication(A=X, B=-1)
multiplication_4 = Multiplication(A=X_2, B=-1)
move_10 = Move(Geometry=rev_6, Motion=X_2)  # -> Geometry, Transform
move_11 = Move(Geometry=[pline_7, mirror_7.Geometry], Motion=multiplication_3)  # -> Geometry, Transform
move_12 = Move(Geometry=[move_4.Geometry, move_5.Geometry], Motion=multiplication_4)  # -> Geometry, Transform
move_13 = Move(Geometry=pline_8, Motion=X)  # -> Geometry, Transform
move_14 = Move(Geometry=pline_9, Motion=X)  # -> Geometry, Transform
move_15 = Move(Geometry=mirror_8.Geometry, Motion=X)  # -> Geometry, Transform
sort_pt_6 = SortPoints(Points=move_12.Geometry)  # -> Points, Indices
dispatch_7 = Dispatch(List=move_11.Geometry, DispatchPattern=[True, False])  # -> ListA, ListB
end_5 = EndPoints(Curve=move_15.Geometry)  # -> Start, End
end_6 = EndPoints(Curve=move_13.Geometry)  # -> Start, End
end_7 = EndPoints(Curve=move_14.Geometry)  # -> Start, End
split_3 = SplitList(List=move_10.Geometry, Index=2)  # -> ListA, ListB
rev_10 = ReverseList(List=sort_pt_6.Points)
end_8 = EndPoints(Curve=dispatch_7.ListA)  # -> Start, End
end_9 = EndPoints(Curve=dispatch_7.ListB)  # -> Start, End
dispatch_8 = Dispatch(List=split_3.ListB, DispatchPattern=[True, True, False, False])  # -> ListA, ListB
dispatch_9 = Dispatch(List=rev_10, DispatchPattern=[True, True, False, False])  # -> ListA, ListB
rev_11 = ReverseList(List=dispatch_9.ListB)
pline_10 = PolyLine(Vertices=flatten([split_3.ListA, end_8.End]), Closed=False)
pline_11 = PolyLine(Vertices=dispatch_8.ListA, Closed=False)
pline_12 = PolyLine(Vertices=flatten([end_5.End, rev_11, end_7.End]), Closed=False)
pline_13 = PolyLine(Vertices=flatten([end_6.End, dispatch_9.ListA, end_7.Start]), Closed=False)
end_10 = EndPoints(Curve=pline_11)  # -> Start, End
xy_9 = XYPlane(Origin=Point(0, 0, 0))
pline_14 = PolyLine(Vertices=flatten([end_9.Start, end_10.End]), Closed=False)
pline_15 = PolyLine(Vertices=flatten([end_8.Start, end_10.Start]), Closed=False)
division_4 = Division(A=division_3, B=1)
mirror_9 = Mirror(Geometry=pline_10, Plane=xy_9)  # -> Geometry, Transform
join_2 = JoinCurves(Curves=flatten([pline_10, move_11.Geometry, mirror_9.Geometry, pline_11, pline_15, pline_14]), Preserve=False)
join_3 = JoinCurves(Curves=flatten([pline_13, pline_12, move_15.Geometry, move_14.Geometry, move_13.Geometry]), Preserve=False)
xz = XZPlane(Origin=Point(0, 0, 0))
offset = Offset(Curve=fillet_2, Distance=division_4, Plane=xz, Corners=1)
C = ClusterOutput(offset)
C_2 = ClusterOutput(fillet_2)
offset_2 = ClusterOutput(division_4)

# ==== cluster ExternalProfileDJoints
profile_ext = ClusterInput()
slot_spacing = ClusterInput()
panel = Panel(slot_spacing)
# WALLS & ROOF
profile_ext_2 = Curve(profile_ext)
item = ListItem(List=profile_ext_2, Index=0, Wrap=True)
item_2 = ListItem(List=profile_ext_2, Index=1, Wrap=True)
flip = FlipCurve(Curve=item_2)  # -> Curve, Flag
divlength = DivideLength(Curve=item, Length=slot_spacing)  # -> Points, Tangents, Parameters
divlength_2 = DivideLength(Curve=flip.Curve, Length=slot_spacing)  # -> Points, Tangents, Parameters
int = Integer([Slider(0, range=0..1), Slider(1, range=0..1)])
cull = CullPattern(List=divlength.Points, CullPattern=[False, True])
cull_2 = CullPattern(List=divlength.Tangents, CullPattern=[False, True])
cull_3 = CullPattern(List=divlength_2.Points, CullPattern=[False, True])
cull_4 = CullPattern(List=divlength_2.Tangents, CullPattern=[False, True])
L = ClusterOutput(cull)
L_2 = ClusterOutput(cull_3)
cull_i = CullIndex(List=cull, Indices=int, Wrap=True)
cull_i_2 = CullIndex(List=cull_2, Indices=int, Wrap=True)
cull_i_3 = CullIndex(List=cull_3, Indices=int, Wrap=True)
cull_i_4 = CullIndex(List=cull_4, Indices=int, Wrap=True)

join = JoinCurves(Curves=flatten(profile_ext_2), Preserve=False)
disc = Discontinuity(Curve=join, Level=1)  # -> Points, Parameters
pdecon = Deconstruct(Point=disc.Points)  # -> XComponent, YComponent, ZComponent
sort = SortList(Keys=pdecon.ZComponent, ValuesA=disc.Points)  # -> Keys, ValuesA
lng = ListLength(List=sort.ValuesA)
subtraction = Subtraction(A=lng, B=1)
item_3 = ListItem(List=sort.ValuesA, Index=subtraction, Wrap=True)
crv_cp = CurveClosestPoint(Point=item_3, Curve=join)  # -> Point, Parameter, Distance
shatter = Shatter(Curve=join, Parameters=crv_cp.Parameter)
dispatch = Dispatch(List=shatter, DispatchPattern=[True, False])  # -> ListA, ListB

geo = Geometry([cull_i, cull_i_3])
equals = Equality(FirstNumber=pdecon.ZComponent, SecondNumber=Slider(0, range=0..1))  # -> Equality, Inequality
geo_2 = ClusterInput()
geo_3 = ClusterInput()
dispatch_2 = Dispatch(List=disc.Points, DispatchPattern=equals.Equality)  # -> ListA, ListB
geo_4 = Geometry(geo_2)
geo_5 = Geometry(geo_3)
cps = ClosestPoints(Point=dispatch_2.ListB, Cloud=flatten(geo), Count=2)  # -> ClosestPoint, CPIndex, Distance
colom = CollisionOneMany(Collider=flatten(geo), Obstacles=flatten(cps.ClosestPoint))  # -> Collision, Index
dispatch_3 = Dispatch(List=flatten(geo), DispatchPattern=colom.Collision)  # -> ListA, ListB
geo_6 = Geometry(dispatch.ListA)
geo_7 = Geometry(dispatch.ListB)
geo_8 = Geometry(geo)
flip_2 = FlipCurve(Curve=dispatch.ListB)  # -> Curve, Flag
flip_3 = FlipCurve(Curve=geo_7)  # -> Curve, Flag
null = NullItem(Item=geo_5)  # -> NullFlags, InvalidFlags, Description
ccx = CurveCurve(CurveA=flip_2.Curve, CurveB=geo_5)  # -> Points, ParamsA, ParamsB
ccx_2 = CurveCurve(CurveA=flip_2.Curve, CurveB=geo_4)  # -> Points, ParamsA, ParamsB
ccx_3 = CurveCurve(CurveA=dispatch.ListA, CurveB=geo_4)  # -> Points, ParamsA, ParamsB
disc_2 = Discontinuity(Curve=flip_2.Curve, Level=1)  # -> Points, Parameters
crv_cp_2 = CurveClosestPoint(Point=flatten([ccx_2.Points, disc_2.Points, ccx.Points]), Curve=flip_2.Curve)  # -> Point, Parameter, Distance
disc_3 = Discontinuity(Curve=dispatch.ListA, Level=1)  # -> Points, Parameters
ccx_4 = CurveCurve(CurveA=dispatch.ListA, CurveB=geo_5)  # -> Points, ParamsA, ParamsB
crv_cp_3 = CurveClosestPoint(Point=flatten([ccx_3.Points, disc_3.Points, ccx_4.Points]), Curve=dispatch.ListA)  # -> Point, Parameter, Distance
item_4 = ListItem(List=disc_2.Parameters, Index=1, Wrap=ccx_2.Points)
item_5 = ListItem(List=disc_3.Parameters, Index=1, Wrap=True)
dispatch_4 = Dispatch(List=geo_8, DispatchPattern=null.NullFlags)  # -> ListA, ListB
colom_2 = CollisionOneMany(Collider=geo_8, Obstacles=flip_2.Curve)  # -> Collision, Index
shatter_2 = Shatter(Curve=flip_2.Curve, Parameters=crv_cp_2.Parameter)  # -> flatten(Segments)
dispatch_5 = Dispatch(List=geo_8, DispatchPattern=colom_2.Collision)  # -> ListA, ListB
shatter_3 = Shatter(Curve=dispatch.ListA, Parameters=crv_cp_3.Parameter)  # -> flatten(Segments)
pt = Point(dispatch_5.ListB)
pt_2 = Point(dispatch_5.ListA)
rev = ReverseList(List=shatter_2)
alongcrv = SortAlongCurve(Points=pt, Curve=geo_6)  # -> Points, Indices
alongcrv_2 = SortAlongCurve(Points=pt_2, Curve=flip_3.Curve)  # -> Points, Indices
cullpt = CullDuplicates(Points=flatten(alongcrv_2.Points), Tolerance=0.1, CullMode=3)  # -> Points, Indices, Valence
cullpt_2 = CullDuplicates(Points=flatten(alongcrv.Points), Tolerance=0.1, CullMode=3)  # -> Points, Indices, Valence
d_joint_height = ClusterInput()
sheet_length = ClusterInput()
sheet_width = ClusterInput()
ply_thickness = ClusterInput()
fin_depth = ClusterInput()
P = ClusterInput()
toggle = BooleanToggle(True)
panel_2 = Panel(toggle)
d_joint_points = ClusterInput()
d_joint_1 = ClusterInput()
right_wall_roof_joint_locator = RightWallRoofJointLocator(
    total_points_right_side=cullpt_2.Points,
    half_profile_curve=shatter_3,
    d_joint_height=d_joint_height,
    _2nd_floor_intersection_pt=ccx_3.Points,
    column_intersection_pt=ccx_4.Points,
    sheet_length=sheet_length,
    sheet_width=sheet_width,
    ply_thickness=ply_thickness,
    fin_depth=fin_depth,
    true_false=toggle)  # -> points, vectors
d_joint_2 = ClusterInput()
left_wall_roof_joint_locator = RightWallRoofJointLocator(
    total_points_right_side=cullpt.Points,
    half_profile_curve=shatter_2,
    d_joint_height=d_joint_height,
    _2nd_floor_intersection_pt=ccx_2.Points,
    column_intersection_pt=ccx.Points,
    sheet_length=sheet_length,
    sheet_width=sheet_width,
    ply_thickness=ply_thickness,
    fin_depth=fin_depth,
    true_false=toggle)  # -> points, vectors
d_joint_1_2 = Geometry(d_joint_1)
d_joint_2_2 = Geometry(d_joint_2)
d_joint_points_2 = Geometry(d_joint_points)
X = UnitX(Factor=1)
X_2 = UnitX(Factor=1)
orient = OrientDirection(
    Geometry=flatten([d_joint_1_2, d_joint_2_2]),
    PointA=d_joint_points_2,
    DirectionA=X,
    PointB=graft(left_wall_roof_joint_locator.points),
    DirectionB=graft(left_wall_roof_joint_locator.vectors))  # -> Geometry, Transform
orient_2 = OrientDirection(
    Geometry=flatten([d_joint_1_2, d_joint_2_2]),
    PointA=d_joint_points_2,
    DirectionA=X_2,
    PointB=graft(right_wall_roof_joint_locator.points),
    DirectionB=graft(right_wall_roof_joint_locator.vectors))  # -> Geometry, Transform
G = ClusterOutput(orient.Geometry)
G_2 = ClusterOutput(orient_2.Geometry)

# ==== cluster GroundFloorDJoints
profile_ground_floor = ClusterInput()
# GROUND FLOOR
profile_ground_floor_2 = Curve(profile_ground_floor)
simplify = SimplifyTree(Tree=profile_ground_floor_2, Front=False)
panel = Panel(simplify)
A = ClusterInput()
A_2 = ClusterInput()
join = JoinCurves(Curves=simplify, Preserve=False)
B = ClusterInput()
division = Division(A=A, B=2)
B_2 = ClusterInput()
division_2 = Division(A=A_2, B=2)
A_3 = ClusterInput()
A_4 = ClusterInput()
addition = Addition(A=division, B=B)
addition_2 = Addition(A=division_2, B=B_2)
subtraction = Subtraction(A=A_3, B=addition)
subtraction_2 = Subtraction(A=A_4, B=addition_2)
sheet_width_from_corner = Panel(subtraction)
item = ListItem(List=profile_ground_floor_2, Index=0, Wrap=True)
item_2 = ListItem(List=profile_ground_floor_2, Index=1, Wrap=True)
sheet_length_from_corner = Panel(subtraction_2)
branch = TreeBranch(Tree=profile_ground_floor_2, Path="{0;0;0;0}", MaintainPaths=True)
L = ClusterInput()
L_2 = ClusterInput()
flip = FlipCurve(Curve=item_2)  # -> Curve, Flag
join_2 = JoinCurves(Curves=branch, Preserve=False)
_2 = Number(2)
_2_2 = Number(2)
B_3 = ClusterInput()
B_4 = ClusterInput()
divlength = DivideLength(Curve=item, Length=L)  # -> Points, Tangents, Parameters
divlength_2 = DivideLength(Curve=flip.Curve, Length=L_2)  # -> Points, Tangents, Parameters
double = Multiplication(A=subtraction, B=_2)
double_2 = Multiplication(A=subtraction_2, B=_2_2)
addition_3 = Addition(A=double_2, B=B_3)
addition_4 = Addition(A=double, B=B_4)
cull = CullPattern(List=divlength.Points, CullPattern=[False, True])
cull_2 = CullPattern(List=divlength.Tangents, CullPattern=[False, True])
cull_3 = CullPattern(List=divlength_2.Points, CullPattern=[False, True])
cull_4 = CullPattern(List=divlength_2.Tangents, CullPattern=[False, True])
len = Length(Curve=join)
max_length_l_l_l = Panel(addition_3)
sheet_w_l_w = Panel(addition_4)
panel_2 = Panel(double_2)
L_3 = ClusterOutput(cull)
L_4 = ClusterOutput(cull_3)
larger = LargerThan(FirstNumber=len, SecondNumber=addition_3)  # -> LargerThan, OrEqualTo
toggle = BooleanToggle(True)
dispatch = Dispatch(List=join, DispatchPattern=larger.LargerThan)  # -> ListA, ListB
larger_2 = LargerThan(FirstNumber=len, SecondNumber=addition_4)  # -> LargerThan, OrEqualTo
buffer = Slider(299, range=0..601)
dispatch_2 = Dispatch(List=dispatch.ListB, DispatchPattern=larger_2.LargerThan)  # -> ListA, ListB
A_5 = ClusterInput()
buffer_2 = Slider(506, range=0..601)
len_2 = Length(Curve=dispatch_2.ListA)  # -> simplify(Length)
addition_5 = Addition(A=subtraction, B=buffer)
multiplication = Multiplication(A=A_5, B=2)
division_3 = Division(A=len_2, B=Slider(3, range=0..3))

eval = EvaluateLength(Curve=dispatch.ListA, Length=0.5, Normalized=True)  # -> Point, Tangent, Parameter
txt = Text("Error. Span is too large for sheet.")
tag = TextTag(Location=eval.Point, Text=txt)

len_3 = Length(Curve=dispatch_2.ListB)
subtraction_3 = Subtraction(A=addition_5, B=multiplication)
subtraction_4 = Subtraction(A=division_3, B=buffer_2)
subtraction_5 = Subtraction(A=len_3, B=subtraction_3)
subtraction_6 = Subtraction(A=len_3, B=subtraction_5)  # -> simplify(Result)
left = TreeBranch(Tree=[division_3, subtraction_6], Path=Slider(0, range=0..1), MaintainPaths=True)
right = TreeBranch(Tree=[division_3, subtraction_6], Path=Slider(1, range=0..1), MaintainPaths=True)
right_2 = TreeBranch(Tree=[division_3, subtraction_6], Path="{0;0;0;0}", MaintainPaths=True)
subtraction_7 = Subtraction(A=len_2, B=subtraction_4)
larger_3 = LargerThan(FirstNumber=[left, right_2], SecondNumber=subtraction)  # -> LargerThan, OrEqualTo
larger_4 = LargerThan(FirstNumber=[right, right_2], SecondNumber=subtraction)  # -> LargerThan, OrEqualTo
panel_3 = Panel(addition_5)
eval_2 = EvaluateLength(Curve=dispatch_2.ListA, Length=subtraction_4, Normalized=False)  # -> Point, Tangent, Parameter
eval_3 = EvaluateLength(Curve=dispatch_2.ListA, Length=subtraction_7, Normalized=False)  # -> Point, Tangent, Parameter
eval_4 = EvaluateLength(Curve=dispatch_2.ListB, Length=subtraction_3, Normalized=False)  # -> Point, Tangent, Parameter
eval_5 = EvaluateLength(Curve=dispatch_2.ListB, Length=subtraction_5, Normalized=False)  # -> Point, Tangent, Parameter
cp = ClosestPoint(Point=[eval_2.Point, eval_3.Point, eval_4.Point, eval_5.Point], Cloud=flatten([cull, cull_3]))  # -> ClosestPoint, CPIndex, Distance
item_3 = ListItem(List=flatten([cull_2, cull_4]), Index=cp.CPIndex, Wrap=True)
clean = CleanTree(RemoveNulls=True, RemoveInvalid=True, RemoveEmpty=True, Tree=larger_3.LargerThan)
clean_2 = CleanTree(RemoveNulls=True, RemoveInvalid=True, RemoveEmpty=True, Tree=larger_4.LargerThan)
pt = Point(cp.ClosestPoint)
pgroups = PointGroups(Points=pt, Distance=Slider(900, range=0..1301))  # -> Groups, Indices
lng = ListLength(List=pgroups.Groups)
vec = Vector(item_3)
T = ClusterOutput(clean_2)
equals = Equality(FirstNumber=lng, SecondNumber=2)  # -> Equality, Inequality
dispatch_3 = Dispatch(List=pgroups.Groups, DispatchPattern=equals.Equality)  # -> ListA, ListB
dispatch_4 = Dispatch(List=vec, DispatchPattern=equals.Equality)  # -> ListA, ListB
geo = Geometry(dispatch_3.ListA)
vec_2 = Vector(dispatch_4.ListA)
cull_i = CullIndex(List=geo, Indices=0, Wrap=True)
cull_i_2 = CullIndex(List=vec_2, Indices=0, Wrap=True)
merge = Merge(Data1=cull_i_2, Data2=dispatch_4.ListB)
merge_2 = Merge(Data1=cull_i, Data2=dispatch_3.ListB)
clean_3 = CleanTree(RemoveNulls=True, RemoveInvalid=True, RemoveEmpty=True, Tree=merge_2)
clean_4 = CleanTree(RemoveNulls=True, RemoveInvalid=True, RemoveEmpty=True, Tree=merge)
panel_4 = Panel(clean_4)
vec_3 = Vector(clean_4)
geo_2 = Geometry(clean_3)
dispatch_5 = Dispatch(List=vec_3, DispatchPattern=[True, False])  # -> ListA, ListB
dispatch_6 = Dispatch(List=geo_2, DispatchPattern=[True, False])  # -> ListA, ListB
G = ClusterInput()
mirror = Mirror(Geometry=G, Plane=PlaneYZ(0, 0, 0))  # -> Geometry, Transform
yz = YZPlane(Origin=Point(0, 0, 0))
pa = ClusterInput()
G_2 = ClusterInput()
pa_2 = ClusterInput()
orient = OrientDirection(
    Geometry=flatten(mirror.Geometry),
    PointA=pa,
    DirectionA=yz,
    PointB=graft(dispatch_6.ListA),
    DirectionB=graft(dispatch_5.ListA))  # -> Geometry, Transform
orient_2 = OrientDirection(Geometry=flatten(G_2), PointA=pa_2, DirectionA=yz, PointB=graft(dispatch_6.ListB), DirectionB=graft(dispatch_5.ListB))  # -> Geometry, Transform
geo_3 = Geometry(flatten([orient.Geometry, orient_2.Geometry]))
panel_5 = Panel(geo_3)
geo_4 = ClusterOutput(geo_3)

# ==== cluster ColumnDJoints
profile_column = ClusterInput()
# CENTRAL COLUMN
profile_column_2 = Curve(profile_column)
A = ClusterInput()
A_2 = ClusterInput()
B = ClusterInput()
division = Division(A=A, B=2)
I = ClusterInput()
A_3 = ClusterInput()
division_2 = Division(A=A_2, B=2)
addition = Addition(A=division, B=B)
B_2 = ClusterInput()
join = JoinCurves(Curves=flatten(profile_column_2), Preserve=False)
null = NullItem(Item=I)  # -> NullFlags, InvalidFlags, Description
subtraction = Subtraction(A=A_3, B=addition)
subtraction_2 = Subtraction(A=division_2, B=addition)
subtraction_3 = Subtraction(A=subtraction, B=B_2)
end = EndPoints(Curve=join)  # -> Start, End
colom = CollisionOneMany(Collider=[end.Start, end.End], Obstacles=profile_column_2)  # -> Collision, Index
dispatch = Dispatch(List=profile_column_2, DispatchPattern=colom.Collision)  # -> flatten(ListA), flatten(ListB)
item = ListItem(List=profile_column_2, Index=0, Wrap=True)
item_2 = ListItem(List=profile_column_2, Index=1, Wrap=True)
L = ClusterInput()
L_2 = ClusterInput()
flip = FlipCurve(Curve=item_2)  # -> Curve, Flag
dispatch_2 = Dispatch(List=dispatch.ListB, DispatchPattern=[True, False])  # -> ListA, ListB
dispatch_3 = Dispatch(List=dispatch.ListA, DispatchPattern=[True, False])  # -> ListA, ListB
divlength = DivideLength(Curve=item, Length=L)  # -> Points, Tangents, Parameters
divlength_2 = DivideLength(Curve=flip.Curve, Length=L_2)  # -> Points, Tangents, Parameters
join_2 = JoinCurves(Curves=[dispatch_2.ListA, dispatch_3.ListA], Preserve=False)
join_3 = JoinCurves(Curves=[dispatch_2.ListB, dispatch_3.ListB], Preserve=False)
cull = CullPattern(List=divlength.Points, CullPattern=[False, True])
cull_2 = CullPattern(List=divlength.Tangents, CullPattern=[False, True])
cull_3 = CullPattern(List=divlength_2.Points, CullPattern=[False, True])
cull_4 = CullPattern(List=divlength_2.Tangents, CullPattern=[False, True])
flip_2 = FlipCurve(Curve=join_3)  # -> Curve, Flag
L_3 = ClusterOutput(cull)
L_4 = ClusterOutput(cull_3)
eval = EvaluateLength(Curve=[join_2, flip_2.Curve], Length=subtraction_3, Normalized=False)  # -> Point, Tangent, Parameter
cull_i = CullIndex(List=cull, Indices=[0, 1], Wrap=True)
cull_i_2 = CullIndex(List=cull_2, Indices=0, Wrap=True)
shatter = Shatter(Curve=[join_2, flip_2.Curve], Parameters=eval.Parameter)
dispatch_4 = Dispatch(List=shatter, DispatchPattern=[True, False])  # -> ListA, ListB
dispatch_5 = Dispatch(List=dispatch_4.ListB, DispatchPattern=null.NullFlags)  # -> ListA, ListB
flip_3 = FlipCurve(Curve=dispatch_5.ListB)  # -> Curve, Flag
eval_2 = EvaluateLength(Curve=flip_3.Curve, Length=subtraction_2, Normalized=False)  # -> Point, Tangent, Parameter
cp = ClosestPoint(Point=eval.Point, Cloud=flatten([cull, cull_3]))  # -> ClosestPoint, CPIndex, Distance
item_3 = ListItem(List=flatten([cull_2, cull_4]), Index=cp.CPIndex, Wrap=True)
cp_2 = ClosestPoint(Point=eval_2.Point, Cloud=flatten([cull_3, cull_i]))  # -> ClosestPoint, CPIndex, Distance
item_4 = ListItem(List=flatten([cull_4, cull_i_2]), Index=cp_2.CPIndex, Wrap=True)
buffer = Slider(60, range=0..601)
shatter_2 = Shatter(Curve=flip_3.Curve, Parameters=eval_2.Parameter)
buffer_2 = Slider(60, range=0..601)
A_4 = ClusterInput()
A_5 = ClusterInput()
split = SplitList(List=cp.ClosestPoint, Index=1)  # -> ListA, ListB
dispatch_6 = Dispatch(List=shatter_2, DispatchPattern=[True, False])  # -> ListA, ListB
dist = Distance(PointA=split.ListA, PointB=split.ListB)
eval_3 = EvaluateLength(Curve=dispatch_6.ListB, Length=0.5, Normalized=True)  # -> Point, Tangent, Parameter
subtraction_4 = Subtraction(A=A_4, B=buffer_2)
len = Length(Curve=dispatch_6.ListB)
subtraction_5 = Subtraction(A=A_5, B=buffer)
larger = LargerThan(FirstNumber=dist, SecondNumber=subtraction_4)  # -> LargerThan, OrEqualTo
pt = Point([cp.ClosestPoint, cp_2.ClosestPoint])
vec = Vector([item_3, item_4])
larger_2 = LargerThan(FirstNumber=len, SecondNumber=subtraction_5)  # -> LargerThan, OrEqualTo
dispatch_7 = Dispatch(List=larger.LargerThan, DispatchPattern=[True, False])  # -> ListA, ListB
dispatch_8 = Dispatch(List=eval_3.Point, DispatchPattern=larger_2.LargerThan)  # -> ListA, ListB
geo = Geometry(pt)
vec_2 = Vector(vec)
dispatch_9 = Dispatch(List=flatten(vec_2), DispatchPattern=[False, False, True, True])  # -> ListA, ListB
dispatch_10 = Dispatch(List=flatten(geo), DispatchPattern=[False, False, True, True])  # -> ListA, ListB
txt = Text("Error. Span is too large for sheet.")
G = ClusterInput()
tag = TextTag(Location=dispatch_8.ListA, Text=txt)
mirror = Mirror(Geometry=G, Plane=PlaneYZ(0, 0, 0))  # -> Geometry, Transform
yz = YZPlane(Origin=Point(0, 0, 0))
pa = ClusterInput()
G_2 = ClusterInput()
pa_2 = ClusterInput()
orient = OrientDirection(
    Geometry=flatten(mirror.Geometry),
    PointA=pa,
    DirectionA=yz,
    PointB=graft(dispatch_10.ListA),
    DirectionB=graft(dispatch_9.ListA))  # -> Geometry, Transform
orient_2 = OrientDirection(Geometry=flatten(G_2), PointA=pa_2, DirectionA=yz, PointB=graft(dispatch_10.ListB), DirectionB=graft(dispatch_9.ListB))  # -> Geometry, Transform
geo_2 = Geometry([orient_2.Geometry, orient.Geometry])
geo_3 = ClusterOutput(geo_2)

# ==== cluster FirstFloorDJoints
profile_2nd_floor = ClusterInput()
A = ClusterInput()
A_2 = ClusterInput()
profile_2nd_floor_2 = Curve(profile_2nd_floor)
B = ClusterInput()
division = Division(A=A, B=2)
B_2 = ClusterInput()
division_2 = Division(A=A_2, B=2)
# FIRST FLOOR
profile_2nd_floor_3 = ClusterOutput(profile_2nd_floor_2)
A_3 = ClusterInput()
A_4 = ClusterInput()
addition = Addition(A=division, B=B)
addition_2 = Addition(A=division_2, B=B_2)
subtraction = Subtraction(A=A_3, B=addition)
subtraction_2 = Subtraction(A=A_4, B=addition_2)
item = ListItem(List=profile_2nd_floor_2, Index=0, Wrap=True)
item_2 = ListItem(List=profile_2nd_floor_2, Index=1, Wrap=True)
sheet_width_from_corner = Panel(subtraction)
branch = TreeBranch(Tree=profile_2nd_floor_2, Path="{0;1}", MaintainPaths=True)
branch_2 = TreeBranch(Tree=profile_2nd_floor_2, Path="{0;0}", MaintainPaths=True)
sheet_length_from_corner = Panel(subtraction_2)
L = ClusterInput()
L_2 = ClusterInput()
flip = FlipCurve(Curve=item_2)  # -> Curve, Flag
join = JoinCurves(Curves=branch, Preserve=False)
join_2 = JoinCurves(Curves=branch_2, Preserve=False)
_2 = Number(2)
_2_2 = Number(2)
B_3 = ClusterInput()
B_4 = ClusterInput()
divlength = DivideLength(Curve=item, Length=L)  # -> Points, Tangents, Parameters
divlength_2 = DivideLength(Curve=flip.Curve, Length=L_2)  # -> Points, Tangents, Parameters
double = Multiplication(A=subtraction, B=_2)
double_2 = Multiplication(A=subtraction_2, B=_2_2)
addition_3 = Addition(A=double_2, B=B_3)
addition_4 = Addition(A=double, B=B_4)
cull = CullPattern(List=divlength.Points, CullPattern=[False, True])
cull_2 = CullPattern(List=divlength.Tangents, CullPattern=[False, True])
cull_3 = CullPattern(List=divlength_2.Points, CullPattern=[False, True])
cull_4 = CullPattern(List=divlength_2.Tangents, CullPattern=[False, True])
max_length_l_l_l = Panel(addition_3)
sheet_w_l_w = Panel(addition_4)
L_3 = ClusterOutput(cull)
L_4 = ClusterOutput(cull_3)
len = Length(Curve=[join_2, join])
panel = Panel(len)
larger = LargerThan(FirstNumber=len, SecondNumber=addition_3)  # -> LargerThan, OrEqualTo
dispatch = Dispatch(List=[join_2, join], DispatchPattern=larger.LargerThan)  # -> ListA, ListB
buffer = Slider(50, range=0..601)
len_2 = Length(Curve=dispatch.ListB)
division_3 = Division(A=len_2, B=Slider(3, range=0..3))

eval = EvaluateLength(Curve=dispatch.ListA, Length=0.5, Normalized=True)  # -> Point, Tangent, Parameter
txt = Text("Error. Span is too large for sheet.")
tag = TextTag(Location=eval.Point, Text=txt)

panel_2 = Panel(division_3)
subtraction_3 = Subtraction(A=division_3, B=buffer)
subtraction_4 = Subtraction(A=len_2, B=subtraction_3)
eval_2 = EvaluateLength(Curve=dispatch.ListB, Length=subtraction_3, Normalized=False)  # -> Point, Tangent, Parameter
eval_3 = EvaluateLength(Curve=dispatch.ListB, Length=subtraction_4, Normalized=False)  # -> Point, Tangent, Parameter
cp = ClosestPoint(Point=[eval_2.Point, eval_3.Point], Cloud=flatten([cull, cull_3]))  # -> ClosestPoint, CPIndex, Distance
item_3 = ListItem(List=flatten([cull_2, cull_4]), Index=cp.CPIndex, Wrap=True)
pt = Point(cp.ClosestPoint)
vec = Vector(item_3)
geo = Geometry(pt)
vec_2 = Vector(vec)
dispatch_2 = Dispatch(List=flatten(vec_2), DispatchPattern=[True, False])  # -> ListA, ListB
dispatch_3 = Dispatch(List=flatten(geo), DispatchPattern=[True, False])  # -> ListA, ListB
G = ClusterInput()
mirror = Mirror(Geometry=G, Plane=PlaneYZ(0, 0, 0))  # -> Geometry, Transform
yz = YZPlane(Origin=Point(0, 0, 0))
pa = ClusterInput()
G_2 = ClusterInput()
pa_2 = ClusterInput()
orient = OrientDirection(
    Geometry=flatten(mirror.Geometry),
    PointA=pa,
    DirectionA=yz,
    PointB=graft(dispatch_3.ListA),
    DirectionB=graft(dispatch_2.ListA))  # -> Geometry, Transform
orient_2 = OrientDirection(Geometry=flatten(G_2), PointA=pa_2, DirectionA=yz, PointB=graft(dispatch_3.ListB), DirectionB=graft(dispatch_2.ListB))  # -> Geometry, Transform
geo_2 = Geometry([orient_2.Geometry, orient.Geometry])
geo_3 = ClusterOutput(geo_2)

# ==== cluster ColumnDJoints_2
profile_column = ClusterInput()
ply_thickness = ClusterInput()
A = ClusterInput()
profile_column_2 = Curve(profile_column)
A_2 = ClusterInput()
division = Division(A=A, B=2)
I = ClusterInput()
eval = EvaluateLength(Curve=profile_column_2, Length=0.5, Normalized=True)  # -> Point, Tangent, Parameter
A_3 = ClusterInput()
division_2 = Division(A=A_2, B=2)
addition = Addition(A=division, B=ply_thickness)
B = ClusterInput()
panel = Panel(B)
null = NullItem(Item=I)  # -> NullFlags, InvalidFlags, Description
shatter = Shatter(Curve=profile_column_2, Parameters=eval.Parameter)
subtraction = Subtraction(A=A_3, B=addition)
subtraction_2 = Subtraction(A=division_2, B=addition)
subtraction_3 = Subtraction(A=subtraction, B=B)
# CENTRAL COLUMN
stair_pts = ClusterInput()
stair_vec = ClusterInput()
pt = Point(stair_pts)
vec = Vector(stair_vec)
dispatch = Dispatch(List=shatter, DispatchPattern=[True, False])  # -> flatten(ListA), flatten(ListB)
join = JoinCurves(Curves=dispatch.ListA, Preserve=False)
join_2 = JoinCurves(Curves=dispatch.ListB, Preserve=False)
cull = CullPattern(CullPattern=[False, True])
cull_2 = CullPattern(CullPattern=[False, True])
cull_3 = CullPattern(CullPattern=[False, True])
cull_4 = CullPattern(CullPattern=[False, True])
flip = FlipCurve(Curve=join_2)  # -> Curve, Flag
eval_2 = EvaluateLength(Curve=[join, flip.Curve], Length=subtraction, Normalized=False)  # -> Point, Tangent, Parameter
L = ClusterOutput(cull)
L_2 = ClusterOutput(cull_3)
cull_i = CullIndex(List=cull, Indices=[0, 1], Wrap=True)
cull_i_2 = CullIndex(List=cull_2, Indices=0, Wrap=True)
shatter_2 = Shatter(Curve=[join, flip.Curve], Parameters=eval_2.Parameter)
dispatch_2 = Dispatch(List=shatter_2, DispatchPattern=[True, False])  # -> ListA, ListB
dispatch_3 = Dispatch(List=dispatch_2.ListB, DispatchPattern=null.NullFlags)  # -> ListA, ListB
flip_2 = FlipCurve(Curve=dispatch_3.ListB)  # -> Curve, Flag
eval_3 = EvaluateLength(Curve=flip_2.Curve, Length=subtraction_2, Normalized=False)  # -> Point, Tangent, Parameter
cp = ClosestPoint(Point=eval_2.Point, Cloud=flatten(pt))  # -> ClosestPoint, CPIndex, Distance
item = ListItem(List=flatten(vec), Index=cp.CPIndex, Wrap=True)
cp_2 = ClosestPoint(Point=eval_3.Point, Cloud=flatten([cull_3, cull_i]))  # -> ClosestPoint, CPIndex, Distance
item_2 = ListItem(List=flatten([cull_4, cull_i_2]), Index=cp_2.CPIndex, Wrap=True)
pt_2 = Point([cp.ClosestPoint, cp_2.ClosestPoint])
vec_2 = Vector([item, item_2])
geo = ClusterInput()
geo_2 = Geometry(pt_2)
vec_3 = Vector(vec_2)
geo_3 = Geometry(geo)
ext = ExtendCurve(Curve=geo_3, Type=0, Start=0, End=ply_thickness)
dispatch_4 = Dispatch(List=flatten(vec_3), DispatchPattern=[False, False, True, True])  # -> ListA, ListB
dispatch_5 = Dispatch(List=flatten(geo_2), DispatchPattern=[False, False, True, True])  # -> ListA, ListB
mirror = Mirror(Geometry=ext, Plane=PlaneYZ(0, 0, 0))  # -> Geometry, Transform
yz = YZPlane(Origin=Point(0, 0, 0))
pa = ClusterInput()
pa_2 = ClusterInput()
orient = OrientDirection(
    Geometry=flatten(mirror.Geometry),
    PointA=pa,
    DirectionA=yz,
    PointB=graft(dispatch_5.ListA),
    DirectionB=graft(dispatch_4.ListA))  # -> Geometry, Transform
orient_2 = OrientDirection(Geometry=flatten(ext), PointA=pa_2, DirectionA=yz, PointB=graft(dispatch_5.ListB), DirectionB=graft(dispatch_4.ListB))  # -> Geometry, Transform
geo_4 = Geometry([orient_2.Geometry, orient.Geometry])
geo_5 = ClusterOutput(geo_4)

# ==== cluster Labelling_4
unit_type = ClusterInput()
wall_label = ClusterInput()
part_label = ClusterInput()
text_size = ClusterInput()
locations = ClusterInput()
concat = Concatenate(FragmentA=unit_type, FragmentB=wall_label)
concat_2 = Concatenate(FragmentA=concat, FragmentB=part_label)
panel = Panel(concat_2)
text = CreateText(Text=concat_2, Plane=locations, Size=text_size, Font="Arial", JustificationMode=65537)
subtraction = Subtraction(A=text_size, B=Slider(45.051, range=0..61))
len = TextLength(Text=text)
cir = Circle(Plane=PlaneXY(0, 0, 0), Radius=text_size)
multiplication = Multiplication(A=subtraction, B=len)
colom = CollisionOneMany(Collider=cir)  # -> Collision, Index
division = Division(A=text_size, B=2)
neg = Negative(Value=Slider(45, range=0..261))
division_2 = Division(A=multiplication, B=2)
dispatch = Dispatch(List=text, DispatchPattern=colom.Collision)  # -> ListA, ListB
neg_2 = Negative(Value=division)
neg_3 = Negative(Value=division_2)
collision = Geometry(dispatch.ListA)
no_collision = Geometry(dispatch.ListB)
Z = UnitZ(Factor=neg)
Y = UnitY(Factor=neg)
Z_2 = UnitZ(Factor=neg_2)
move = Move(Geometry=collision, Motion=Y)  # -> Geometry, Transform
merge = Merge(Data1=move.Geometry, Data2=no_collision)
Y_2 = UnitY(Factor=neg_2)
move_2 = Move(Geometry=text, Motion=Y_2)  # -> Geometry, Transform
X = UnitX(Factor=neg_3)
move_3 = Move(Geometry=move_2.Geometry, Motion=X)  # -> Geometry, Transform
G = ClusterOutput(move_3.Geometry)

# ==== cluster SheatingPanel
grip_points = ClusterInput()
grip_slot_length = ClusterInput()
# PARAMETERS
gauge = ClusterInput()
ply_thickness = ClusterInput()
spacing = ClusterInput()
beam_width = ClusterInput()
tolerance = ClusterInput()
tool_size = ClusterInput()
connector_points = ClusterInput()
space_invader_points = ClusterInput()
sheet_length = ClusterInput()
segment_curve = ClusterInput()
ply_thickness_2 = ClusterInput()
ski_panel_width = ClusterInput()

vertical_grip_slots_1 = ClusterInput()
vertical_grip_slot_2 = ClusterInput()
# Ply Thk
# Tol
# Grip Len
# Grip Len + Tol
vertical_grip_slot_4 = ClusterInput()
geo = Geometry(vertical_grip_slot_2)
geo_2 = Geometry(vertical_grip_slots_1)
geo_3 = Geometry(vertical_grip_slot_4)

division = Division(A=gauge, B=2)
num = Number(tolerance)
num_2 = Number(beam_width)
num_3 = Number(tool_size)
num_4 = Number(spacing)
num_5 = Number(ply_thickness)
num_6 = Number(grip_slot_length)
num_7 = Number(ply_thickness_2)
division_2 = Division(A=num_3, B=2)
division_3 = Division(A=num_2, B=2)
reinforcer_points = Slider(2, range=0..11)
crv = Curve(segment_curve)
end = EndPoints(Curve=crv)  # -> Start, End
division_4 = Division(A="30", B=2)
division_5 = Division(A=num_5, B=2)
cps = ClosestPoints(Point=[end.Start, end.End], Cloud=grip_points, Count=reinforcer_points)  # -> ClosestPoint, CPIndex, Distance
addition = Addition(A=division_4, B=division_5)
cull_i = CullIndex(List=grip_points, Indices=flatten(cps.CPIndex), Wrap=False)
Y = UnitY(Factor=addition)
pt = Point(connector_points)
pt_2 = Point(space_invader_points)
move = Move(Geometry=pt, Motion=Y)  # -> Geometry, Transform
cp = ClosestPoint(Point=pt_2, Cloud=cull_i)  # -> ClosestPoint, CPIndex, Distance
pcen = PolygonCenter(Polyline=geo_3)  # -> CenterV, CenterE, CenterA
division_6 = Division(A=num_5, B=2)
Y_2 = UnitY(Factor=division_6)
move_2 = Move(Geometry=pcen.CenterA, Motion=Y_2)  # -> Geometry, Transform
orient = OrientDirection(Geometry=geo_3, PointA=move_2.Geometry, DirectionA=Vector(0, 0, 1), PointB=cps.ClosestPoint, DirectionB=Vector(0, 0, 1))  # -> Geometry, Transform
cull_i_2 = CullIndex(List=cull_i, Indices=cp.CPIndex, Wrap=True)
len = Length(Curve=segment_curve)
division_7 = Division(A=len, B=sheet_length)
round = Round(Number=division_7)  # -> Nearest, Floor, Ceiling
pcen_2 = PolygonCenter(Polyline=geo_2)  # -> CenterV, CenterE, CenterA
pcen_3 = PolygonCenter()  # -> CenterV, CenterE, CenterA
pcen_4 = PolygonCenter()  # -> CenterV, CenterE, CenterA
subtraction = Subtraction(A=division_3, B=division_6)
divide = DivideCurve(Curve=crv, Count=round.Ceiling, Kinks=False)  # -> Points, Tangents, Parameters
division_8 = Division(A=ski_panel_width, B=2)
pt_3 = Point(flatten([cps.ClosestPoint, cull_i_2]))
cull_i_3 = CullIndex(List=divide.Points, Indices=0, Wrap=True)
Y_3 = UnitY(Factor=division_8)
division_9 = Division(A=num_4, B=2)
orient_2 = OrientDirection(PointA=pcen_3.CenterA, DirectionA=Vector(0, 0, 1), PointB=move.Geometry, DirectionB=Vector(0, 0, 1))  # -> Geometry, Transform
orient_3 = OrientDirection(Geometry=geo, PointA=Point(0, 0, 0), DirectionA=Vector(0, 0, 1), PointB=cp.ClosestPoint, DirectionB=Vector(0, 0, 1))  # -> Geometry, Transform
orient_4 = OrientDirection(Geometry=geo_2, PointA=pcen_2.CenterA, DirectionA=Vector(0, 0, 1), PointB=cull_i_2, DirectionB=Vector(0, 0, 1))  # -> Geometry, Transform
orient_5 = OrientDirection(PointA=pcen_4.CenterA, DirectionA=Vector(0, 0, 1), PointB=pt, DirectionB=Vector(0, 0, 1))  # -> Geometry, Transform
Y_4 = UnitY(Factor=subtraction)
lng = ListLength(List=cull_i_3)
subtraction_2 = Subtraction(A=lng, B=1)
X = UnitX(Factor=division_9)
len_2 = Length(Curve=crv)
move_3 = Move(Geometry=flatten([orient_4.Geometry, orient.Geometry, orient_3.Geometry, orient_2.Geometry]), Motion=Y_4)  # -> Geometry, Transform
move_4 = Move(Geometry=pt_3, Motion=X)  # -> Geometry, Transform
cull_i_4 = CullIndex(List=cull_i_3, Indices=subtraction_2, Wrap=True)
larger = LargerThan(FirstNumber=len_2, SecondNumber=sheet_length)  # -> LargerThan, OrEqualTo
cp_2 = ClosestPoint(Point=cull_i_4, Cloud=move_4.Geometry)  # -> ClosestPoint, CPIndex, Distance
neg = Negative(Value=Y_3)
move_5 = Move(Geometry=cp_2.ClosestPoint, Motion=neg)  # -> Geometry, Transform
move_6 = Move(Geometry=cp_2.ClosestPoint, Motion=Y_3)  # -> Geometry, Transform
xz = XZPlane(Origin=Point(0, 0, 0))
move_7 = Move(Geometry=segment_curve, Motion=Y_3)  # -> Geometry, Transform
ln = Line(StartPoint=move_6.Geometry, EndPoint=move_5.Geometry)
mirror = Mirror(Geometry=move_3.Geometry, Plane=xz)  # -> Geometry, Transform
mirror_2 = Mirror(Geometry=move_7.Geometry, Plane=xz)  # -> Geometry, Transform
end_2 = EndPoints(Curve=move_7.Geometry)  # -> Start, End
end_3 = EndPoints(Curve=mirror_2.Geometry)  # -> Start, End
ln_2 = Line(StartPoint=end_2.End, EndPoint=end_3.End)
ln_3 = Line(StartPoint=end_2.Start, EndPoint=end_3.Start)
geo_4 = Geometry([mirror.Geometry, orient_5.Geometry, move_3.Geometry])
join = JoinCurves(Curves=[move_7.Geometry, ln_3, mirror_2.Geometry, ln_2], Preserve=False)
geo_5 = Geometry(flatten([geo_4, join]))
boundary = BoundarySurfaces(Edges=flatten(geo_5))
dispatch = Dispatch(List=boundary, DispatchPattern=larger.LargerThan)  # -> ListA, ListB
srfsplit = SurfaceSplit(Surface=dispatch.ListA, Curves=ln)
area = Area(Geometry=srfsplit)  # -> Area, Centroid
larger_2 = LargerThan(FirstNumber=area.Area, SecondNumber="10000")  # -> LargerThan, OrEqualTo
dispatch_2 = Dispatch(List=srfsplit, DispatchPattern=larger_2.LargerThan)  # -> ListA, ListB
geo_6 = Geometry(flatten([dispatch_2.ListA, dispatch.ListB]))
geo_7 = Geometry(geo_6)
Z = UnitZ(Factor=num_7)
rev = ReverseList(List=geo_7)
extr = Extrude(Base=geo_7, Direction=flatten(Z))
unit_no = ClusterInput()
rotate = Rotate(Geometry=rev, Angle=degrees(0), Plane=PlaneXY(0, 0, 0))  # -> Geometry, Transform
bay_no = ClusterInput()
area_2 = Area(Geometry=rotate.Geometry)  # -> Area, Centroid
unit_type = Data(unit_no)
bay_no_2 = Data(bay_no)
pdecon = Deconstruct(Point=area_2.Centroid)  # -> XComponent, YComponent, ZComponent
sort = SortList(Keys=pdecon.XComponent, ValuesA=rotate.Geometry)  # -> Keys, ValuesA
geo_8 = Geometry(sort.ValuesA)
concat = Concatenate(FragmentA=unit_type, FragmentB=bay_no_2)
tstat = TreeStatistics(Tree=geo_8)  # -> Paths, Length, Count
concat_2 = Concatenate(FragmentA=unit_type, FragmentB="/ FRM ")
number_slider = Slider(100, range=0..7001)
addition_2 = Addition(B=Slider(100, range=0..7001))
concat_3 = Concatenate(FragmentA=concat_2, FragmentB="/ SKI /")
pt_4 = ConstructPoint(XCoordinate=0, YCoordinate=0, ZCoordinate=0)
X_2 = UnitX(Factor=addition_2)
Y_5 = UnitY(Factor=addition_2)
labelling = Labelling_5(geometry=geo_8, wall_label=concat_3, part_label=" ", text_size=Slider(40, range=0..61))  # -> geometry_3, G
arrlinear = LinearArray(Geometry=pt_4, Direction=X_2, Count=tstat.Count)  # -> Geometry, Transform
Z_2 = UnitZ(Factor=1)
clean = CleanTree(RemoveNulls=True, RemoveInvalid=True, RemoveEmpty=False, Tree=labelling.G)
data = Data(simplify(clean))
txt = Text(data)
orient_6 = OrientDirection(
    Geometry=labelling.geometry_3,
    PointA=Point(0, 0, 0),
    DirectionA=Z_2,
    PointB=graft(arrlinear.Geometry),
    DirectionB=graft(Vector(0, 0, 1)))  # -> simplify(Geometry), Transform
orient_7 = OrientDirection(
    Geometry=labelling.G,
    PointA=Point(0, 0, 0),
    DirectionA=Z_2,
    PointB=graft(arrlinear.Geometry),
    DirectionB=Vector(0, 0, 1))  # -> simplify(graft(Geometry)), Transform
txt_2 = Text("Skis")
split = TextSplit(Text=txt, Separators=":")
item = ListItem(List=split, Index=1, Wrap=True)  # -> simplify(Item)
layers = CreateModifyLayers(LayerName=txt_2, DeleteLayer=False, enableFullPath=False)  # -> LayerNames, LayerFullPath
clean_2 = CleanTree(RemoveNulls=True, RemoveInvalid=True, RemoveEmpty=True, Tree=orient_7.Geometry)
wires = BrepWireframe(Brep=orient_6.Geometry, Density=-1)  # -> simplify(Wireframe)
area_3 = Area(Geometry=orient_6.Geometry)  # -> Area, Centroid
createatts = CreateAttributes(Name=item, LayerName=flatten(layers.LayerNames), enableFullPath=False)
join_2 = JoinCurves(Curves=wires, Preserve=False)  # -> simplify(Curves)
merge = Merge(Data1=join_2, Data2=clean_2)
data_2 = Data(createatts)
group = Group(Objects=merge)
_2d_geo = ClusterOutput(group)
attrib = ClusterOutput(data_2)
_3d = ClusterOutput(extr)

# ==== cluster SheatingPanel_2
sheet_width = ClusterInput()
sheet_length = ClusterInput()
roof_connector_pts = ClusterInput()
connector_points = ClusterInput()
reinforcer_pts = ClusterInput()
space_invader_points = ClusterInput()

# ---- group: Slot Geometry
horizontal_grip_slots = ClusterInput()
vertical_grip_slot_1 = ClusterInput()
vertical_grip_slot_2 = ClusterInput()
vertical_grip_slots_3 = ClusterInput()

# ----
# PARAMETERS
grip_points = ClusterInput()
vertical_grip_slots_4 = ClusterInput()
intersection_points = ClusterInput()
fin_depth = ClusterInput()
gauge = ClusterInput()
dovetail_height = ClusterInput()
ply_thickness = ClusterInput()
grip_slot_length = ClusterInput()
spacing = ClusterInput()
beam_width = ClusterInput()
tolerance = ClusterInput()
segment_length = ClusterInput()
num = Number(fin_depth)
pt = Point(connector_points)
pt_2 = Point(roof_connector_pts)
pt_3 = Point(reinforcer_pts)
ply_thickness_2 = Number(ply_thickness)
grip_slot_length_2 = Number(grip_slot_length)
division = Division(A=gauge, B=2)
beam_width_2 = Number(beam_width)
pt_4 = Point(space_invader_points)
tolerance_2 = Number(tolerance)
spacing_2 = Number(spacing)
pt_5 = Point(intersection_points)
pt_6 = ConstructPoint(XCoordinate=0, YCoordinate=0, ZCoordinate=0)
X = UnitX(Factor=1)
neg = Negative(Value=X)
line = LineSDL(Start=pt_6, Direction=neg, Length=segment_length)
line_2 = LineSDL(Start=pt_6, Direction=X, Length=segment_length)
join = JoinCurves(Curves=[line_2, line], Preserve=False)  # -> simplify(Curves)
lng = ListLength(List=pt_5)
null = NullItem(Item=lng)  # -> NullFlags, InvalidFlags, Description
equals = Equality(FirstNumber=lng, SecondNumber="2")  # -> Equality, Inequality
dispatch = Dispatch(List=join, DispatchPattern=equals.Equality)  # -> ListA, ListB
dispatch_2 = Dispatch(List=join, DispatchPattern=null.NullFlags)  # -> ListA, ListB
dispatch_3 = Dispatch(List=grip_points, DispatchPattern=null.NullFlags)  # -> ListA, ListB
dispatch_4 = Dispatch(List=grip_points, DispatchPattern=equals.Equality)  # -> ListA, ListB
pt_7 = Point(dispatch_4.ListA)
crv = Curve(dispatch.ListA)
crv_2 = Curve([dispatch.ListB, dispatch_2.ListA])
pt_8 = Point([dispatch_4.ListB, dispatch_3.ListA])
merge = Merge(Data1=crv, Data2=crv_2)
crv_cp = CurveClosestPoint(Point=pt_5, Curve=crv)  # -> Point, Parameter, Distance
shatter = Shatter(Curve=crv, Parameters=crv_cp.Parameter)
dispatch_5 = Dispatch(List=shatter, DispatchPattern=[True, False])  # -> simplify(ListA), ListB
crv_cp_2 = CurveClosestPoint(Point=pt_3, Curve=join)  # -> Point, Parameter, Distance
merge_2 = Merge(Data1=dispatch_5.ListA, Data2=crv_2)
shatter_2 = Shatter(Curve=join, Parameters=crv_cp_2.Parameter)  # -> simplify(Segments)
crv_3 = Curve(merge_2)
colom = CollisionOneMany(Collider=pt_7, Obstacles=crv_3)  # -> Collision, Index
dispatch_6 = Dispatch(List=pt_7, DispatchPattern=colom.Collision)  # -> ListA, ListB
merge_3 = Merge(Data1=pt_8, Data2=dispatch_6.ListA)
pt_9 = Point(merge_3)
dispatch_7 = Dispatch(List=shatter_2, DispatchPattern=[True, False])  # -> ListA, ListB
reinforcer = Geometry(dispatch_7.ListA)
regular = Geometry(dispatch_7.ListB)

# ----
# DOVETAIL (DT)
X_2 = UnitX(Factor=gauge)
pt_0 = ConstructPoint(XCoordinate=0, YCoordinate=0, ZCoordinate=0)
move_pt_1 = Move(Geometry=pt_0, Motion=X_2)  # -> Geometry, Transform
ln_sheet_top_edge = Line(StartPoint=pt_0, EndPoint=move_pt_1.Geometry)
_1 = Number(1)
Y = UnitY(Factor=dovetail_height)
_1_2 = Number(1)
neg_2 = Negative(Value=Y)
eval_x_10 = Evaluate(F="x/10", x=_1)
eval_x_15 = Evaluate(F="x/15", x=_1)
eval_x_30 = Evaluate(F="x/30", x=_1)
move = Move(Geometry=ln_sheet_top_edge, Motion=neg_2)  # -> Geometry, Transform
eval_x_10_2 = Evaluate(F="x/10", x=_1_2)
eval_x_15_2 = Evaluate(F="x/15", x=_1_2)
eval_x_20 = Evaluate(F="x/20", x=_1_2)
crv_female = Curve(reparameterize(move.Geometry))
_6 = Number(6)
_5 = Number(5)
crv_male = Curve(reparameterize(ln_sheet_top_edge))
_5_2 = Number(5)
_6_2 = Number(6)
repeat = RepeatData(Data=eval_x_10_2, Length=_5)
repeat_2 = RepeatData(Data=eval_x_15_2, Length=_6)
repeat_3 = RepeatData(Data=eval_x_15, Length=_5_2)
repeat_4 = RepeatData(Data=eval_x_10, Length=_6_2)
weave = Weave(Pattern=[0, 1], Stream0=repeat_2, Stream1=repeat, NullGaps=False)
weave_2 = Weave(Pattern=[0, 1], Stream0=repeat_4, Stream1=repeat_3, NullGaps=False)
ins = InsertItems(List=weave, Item=eval_x_20, Indices=0, Wrap=False)
ins_2 = InsertItems(List=weave_2, Item=eval_x_30, Indices=0, Wrap=False)
ma = MassAddition(Input=ins)  # -> Result, PartialResults
ma_2 = MassAddition(Input=ins_2)  # -> Result, PartialResults
shatter_3 = Shatter(Curve=crv_female, Parameters=ma.PartialResults)
shatter_4 = Shatter(Curve=crv_male, Parameters=ma_2.PartialResults)
dispatch_8 = Dispatch(List=shatter_3, DispatchPattern=[True, False])  # -> ListA, ListB
dispatch_9 = Dispatch(List=shatter_4, DispatchPattern=[True, False])  # -> ListA, ListB
crv_4 = Curve(dispatch_8.ListA)
crv_5 = Curve(dispatch_9.ListB)
end = EndPoints(Curve=crv_4)  # -> Start, End
end_2 = EndPoints(Curve=crv_5)  # -> Start, End
pt_10 = Point(end_2.Start)
pt_11 = Point(end.Start)
pt_12 = Point(end_2.End)
pt_13 = Point(end.End)
weave_3 = Weave(Pattern=[0, 1, 2, 3], Stream0=pt_11, Stream1=pt_13, Stream2=pt_10, Stream3=pt_12, NullGaps=False)
pt_dovetail = Point(weave_3)
pline = PolyLine(Vertices=pt_dovetail, Closed=False)
fillet = Fillet(Curve=pline, Radius=Slider(5, range=0..41))
rotate = Rotate(Geometry=fillet, Angle=1.570796327, Plane=PlaneXY(0, 0, 0))  # -> Geometry, Transform
neg_3 = Negative(Value="0.25")
offset = Offset(Curve=rotate.Geometry, Distance="0.25", Plane=PlaneXY(0, 0, 0), Corners=1)
offset_2 = Offset(Curve=rotate.Geometry, Distance=neg_3, Plane=PlaneXY(0, 0, 0), Corners=1)

colom_2 = CollisionOneMany(Collider=pt_9, Obstacles=reinforcer)  # -> Collision, Index
dispatch_10 = Dispatch(List=pt_9, DispatchPattern=colom_2.Collision)  # -> ListA, ListB
reinforcer_grip_pts = Geometry(dispatch_10.ListA)
regular_grip_pts = Geometry(dispatch_10.ListB)
cp = ClosestPoint(Point=pt, Cloud=reinforcer_grip_pts)  # -> ClosestPoint, CPIndex, Distance

# ----
# SCREW GUIDE HOLES
number_slider = Slider(50, range=0..61)
len = Length(Curve=crv_3)
end_3 = EndPoints(Curve=crv_3)  # -> Start, End
subtraction = Subtraction(A=len, B=number_slider)
pt_14 = Point(end_3.Start)
eval = EvaluateLength(Curve=crv_3, Length=subtraction, Normalized=False)  # -> Point, Tangent, Parameter
division_2 = Division(A=spacing_2, B=2)
ln = Line(StartPoint=pt_14, EndPoint=eval.Point)
divlength = DivideLength(Curve=ln, Length=flatten(division_2))  # -> Points, Tangents, Parameters
path_mapper = PathMapper(divlength.Points, source="{A}", target="{A}")
path_mapper_2 = PathMapper(divlength.Points, source="{A;B}", target="{A}")
merge_4 = Merge(Data1=path_mapper_2, Data2=path_mapper)
sort_pt = SortPoints(Points=divlength.Points)  # -> Points, Indices
lng_2 = ListLength(List=sort_pt.Points)
subtraction_2 = Subtraction(A=lng_2, B=1)
cull_i = CullIndex(List=sort_pt.Points, Indices=0, Wrap=False)  # -> simplify(List)
cull_i_2 = CullIndex(List=sort_pt.Points, Indices=subtraction_2, Wrap=False)
path_mapper_3 = PathMapper(cull_i, source="{A}", target="{A}")
path_mapper_4 = PathMapper(cull_i, source="{A;B}", target="{A}")
drill_bit_size_radius = Slider(3, range=0..12)
merge_5 = Merge(Data1=path_mapper_4, Data2=path_mapper_3)
xy = XYPlane(Origin=merge_5)
cir = Circle(Plane=xy, Radius=drill_bit_size_radius)  # -> simplify(Circle)

monoslope_count = Slider(3, range=0..4)
centre_profiles = Geometry(merge)
window_sill_pts = ClusterInput()
window_data = ClusterInput()
tstat = TreeStatistics(Tree=centre_profiles)  # -> Paths, Length, Count
similar = Similarity(FirstNumber=tstat.Count, SecondNumber=monoslope_count, Threshold=0.1)  # -> Similarity, AbsoluteDifference

# ----
# Column Intersection: This takes the intersection points of the column with the Internal Profile to generate notches in the floor and ceiling sheathing panels so the columns can protrude through.
intersection_column = ClusterInput()
pt_15 = Point(intersection_column)
multiplication = Multiplication(A=tolerance_2, B=2)
dispatch_11 = Dispatch(List=pt_15, DispatchPattern=[True, False])  # -> ListA, ListB
X_3 = UnitX(Factor=multiplication)
division_3 = Division(A=beam_width_2, B=2)
neg_4 = Negative(Value=X_3)
neg_5 = Negative(Value=division)
addition = Addition(A=division_3, B=multiplication)
move_2 = Move(Geometry=dispatch_11.ListA, Motion=flatten(X_3))  # -> Geometry, Transform
move_3 = Move(Geometry=dispatch_11.ListB, Motion=flatten(neg_4))  # -> Geometry, Transform
Y_2 = UnitY(Factor=neg_5)
Y_3 = UnitY(Factor=addition)
move_4 = Move(Geometry=[move_2.Geometry, move_3.Geometry], Motion=flatten(Y_2))  # -> Geometry, Transform
move_5 = Move(Geometry=move_4.Geometry, Motion=flatten(Y_3))  # -> Geometry, Transform
rev = ReverseList(List=move_5.Geometry)
pt_16 = Point([move_4.Geometry, rev])
shift = ShiftList(List=pt_16, Shift=1, Wrap=True)

geo = Geometry(window_sill_pts)
dispatch_12 = Dispatch(List=centre_profiles, DispatchPattern=similar.Similarity)  # -> ListA, ListB
subtraction_3 = Subtraction(A=tstat.Count, B=1)
integer_division = IntegerDivision(A=tstat.Count, B=2)
subtraction_4 = Subtraction(A=integer_division, B=1)
branch = TreeBranch(Tree=dispatch_12.ListA, Path=subtraction_3, MaintainPaths=True)
branch_2 = Slider(16, range=0..18)
dom = ConstructDomain(DomainStart=0, DomainEnd=subtraction_4)
branch_3 = TreeBranch(Tree=dispatch_12.ListA, Path="{0}", MaintainPaths=True)
branch_4 = TreeBranch(Tree=dispatch_12.ListA, Path="{1}", MaintainPaths=True)
len_2 = Length(Curve=branch)
range = Range(Domain=dom, Steps=subtraction_4)
len_3 = Length(Curve=branch_3)
len_4 = Length(Curve=branch_4)
int = Integer(range)
smaller = SmallerThan(FirstNumber=len_3, SecondNumber=len_2)  # -> SmallerThan, OrEqualTo
concat = Concatenate(FragmentA="{", FragmentB=int)
concat_2 = Concatenate(FragmentA=concat, FragmentB="}")
dispatch_13 = Dispatch(List=branch_4, DispatchPattern=smaller.SmallerThan)  # -> ListA, ListB
branch_5 = Slider(2, range=0..4)
branch_6 = Slider(4, range=0..6)
branch_7 = Slider(5, range=0..7)
branch_8 = Slider(3, range=0..6)
branch_9 = Slider(8, range=0..10)
merge_6 = Merge(Data1=dispatch_13.ListB, Data2=branch)
data = Data(concat_2)
merge_7 = Merge(Data1=branch_3, Data2=dispatch_13.ListA)
split = SplitTree(Data=dispatch_12.ListB, Masks=flatten(concat_2))  # -> BRIght, Negative
side_a = Geometry(merge_6)
side_b = Geometry(merge_7)
addition_2 = Addition(A=branch_6, B=branch_2)
addition_3 = Addition(A=branch_7, B=branch_2)
addition_4 = Addition(A=branch_5, B=branch_2)
addition_5 = Addition(A=branch_8, B=branch_2)
addition_6 = Addition(A=branch_9, B=branch_2)
branch_10 = TreeBranch(Tree=window_data, Path=addition_2, MaintainPaths=True)
branch_11 = TreeBranch(Tree=window_data, Path=addition_4, MaintainPaths=True)
branch_12 = TreeBranch(Tree=window_data, Path=addition_3, MaintainPaths=True)
branch_13 = TreeBranch(Tree=window_data, Path=addition_6, MaintainPaths=True)
branch_14 = TreeBranch(Tree=window_data, Path=addition_5, MaintainPaths=True)
branch_15 = TreeBranch(Tree=window_data, Path=branch_2, MaintainPaths=True)
merge_8 = Merge(Data1=split.BRIght, Data2=side_b)
merge_9 = Merge(Data1=split.Negative, Data2=side_a)
panel = Panel(window_data)
opening_width = Number(branch_10)
opening_height = Number(branch_12)
window_code = Text(branch_11)
height_from_floor = Number(branch_13)
window_name = Data(flatten(branch_15))
left_a_or_right_b = Text(branch_14)
clean = CleanTree(RemoveNulls=True, RemoveInvalid=True, RemoveEmpty=True, Tree=merge_8)
clean_2 = CleanTree(RemoveNulls=True, RemoveInvalid=True, RemoveEmpty=True, Tree=merge_9)
side_b_2 = Geometry(clean)
side_a_2 = Geometry(clean_2)
tstat_2 = TreeStatistics(Tree=side_a_2)  # -> Paths, Length, Count
tstat_3 = TreeStatistics(Tree=side_b_2)  # -> Paths, Length, Count
item = ListItem(List=tstat_3.Paths, Index=1, Wrap=False)
tmatch = MatchText(Text=left_a_or_right_b, Pattern="A", Case=True)
tmatch_2 = MatchText(Text=window_code, Pattern="GF", Case=True)
item_2 = ListItem(List=tstat_2.Paths, Index=0, Wrap=False)
item_3 = ListItem(List=tstat_2.Paths, Index=1, Wrap=False)
item_4 = ListItem(List=tstat_3.Paths, Index=0, Wrap=False)
gf_or_ff = TreeBranch(Tree=side_b_2, Path=item_4, MaintainPaths=True)
rf = TreeBranch(Tree=side_b_2, Path=item, MaintainPaths=True)
gf_or_ff_2 = TreeBranch(Tree=side_a_2, Path=item_3, MaintainPaths=True)
rf_2 = TreeBranch(Tree=side_a_2, Path=item_2, MaintainPaths=True)
side_a_3 = Dispatch(List=window_code, DispatchPattern=tmatch)  # -> ListA, ListB
side_a_4 = Dispatch(List=window_code, DispatchPattern=tmatch)  # -> ListA, ListB
merge_10 = Merge(Data1=gf_or_ff, Data2=rf, Data3=gf_or_ff_2, Data4=rf_2)
pt_17 = ConstructPoint(XCoordinate=0, YCoordinate=0, ZCoordinate=0)
side_a_5 = Dispatch(List=opening_height, DispatchPattern=tmatch)  # -> ListA, ListB
side_a_6 = Dispatch(List=tmatch_2, DispatchPattern=tmatch)  # -> ListA, ListB
side_a_7 = Dispatch(List=tmatch_2, DispatchPattern=tmatch)  # -> ListA, ListB
side_a_8 = Dispatch(List=opening_width, DispatchPattern=tmatch)  # -> ListA, ListB
division_4 = Division(A=ply_thickness_2, B=2)
panel_2 = Panel(side_a_5.ListB)
panel_3 = Panel(division_4)
Y_4 = UnitY(Factor=division_4)
move_6 = Move(Geometry=pt_17, Motion=flatten(Y_4))  # -> Geometry, Transform
dispatch_14 = Dispatch(List=side_a_5.ListA, DispatchPattern=side_a_6.ListA)  # -> ListA, ListB
dispatch_15 = Dispatch(List=side_a_5.ListB, DispatchPattern=side_a_6.ListB)  # -> ListA, ListB
dispatch_16 = Dispatch(List=side_a_8.ListA, DispatchPattern=side_a_7.ListA)  # -> ListA, ListB
dispatch_17 = Dispatch(List=side_a_8.ListB, DispatchPattern=side_a_7.ListB)  # -> ListA, ListB
orient = OrientDirection(
    Geometry=flatten(vertical_grip_slots_3),
    PointA=flatten(move_6.Geometry),
    DirectionA=Vector(0, 0, 1),
    PointB=cp.ClosestPoint,
    DirectionB=Vector(0, 0, 1))  # -> Geometry, Transform
tmatch_3 = MatchText(Text=side_a_4.ListB, Pattern="FF", Case=True)
tmatch_4 = MatchText(Text=side_a_4.ListA, Pattern="FF", Case=True)
orient_2 = OrientDirection(
    Geometry=flatten(vertical_grip_slots_4),
    PointA=flatten(move_6.Geometry),
    DirectionA=Vector(0, 0, 1),
    PointB=reinforcer_grip_pts,
    DirectionB=Vector(0, 0, 1))  # -> Geometry, Transform
tmatch_5 = MatchText(Text=side_a_3.ListB, Pattern="FF", Case=True)
tmatch_6 = MatchText(Text=side_a_3.ListA, Pattern="FF", Case=True)
dispatch_18 = Dispatch(List=dispatch_14.ListB, DispatchPattern=tmatch_4)  # -> ListA, ListB
dispatch_19 = Dispatch(List=dispatch_15.ListB, DispatchPattern=tmatch_3)  # -> ListA, ListB
dispatch_20 = Dispatch(List=dispatch_16.ListB, DispatchPattern=tmatch_6)  # -> ListA, ListB
dispatch_21 = Dispatch(List=dispatch_17.ListB, DispatchPattern=tmatch_5)  # -> ListA, ListB
colom_3 = CollisionOneMany(Collider=orient_2.Geometry, Obstacles=orient.Geometry)  # -> Collision, Index
dispatch_22 = Dispatch(List=orient_2.Geometry, DispatchPattern=colom_3.Collision)  # -> ListA, ListB
gf = MatchTree(Tree=dispatch_15.ListA, Guide=gf_or_ff)
ff = MatchTree(Tree=dispatch_19.ListA, Guide=gf_or_ff)
rf_3 = MatchTree(Tree=dispatch_19.ListB, Guide=rf)
rf_4 = MatchTree(Tree=dispatch_18.ListB, Guide=rf_2)
ff_2 = MatchTree(Tree=dispatch_21.ListA, Guide=gf_or_ff)
rf_5 = MatchTree(Tree=dispatch_21.ListB, Guide=rf)
ff_3 = MatchTree(Tree=dispatch_18.ListA, Guide=gf_or_ff_2)
gf_2 = MatchTree(Tree=dispatch_14.ListA, Guide=gf_or_ff_2)
gf_3 = MatchTree(Tree=dispatch_16.ListA, Guide=gf_or_ff_2)
gf_4 = MatchTree(Tree=dispatch_17.ListA, Guide=gf_or_ff)
rf_6 = MatchTree(Tree=dispatch_20.ListB, Guide=rf_2)
ff_4 = MatchTree(Tree=dispatch_20.ListA, Guide=gf_or_ff_2)
geo_2 = Geometry(dispatch_22.ListA)
merge_11 = Merge(Data1=orient_2.Geometry, Data2=orient.Geometry)
merge_12 = Merge(Data1=orient.Geometry, Data2=dispatch_22.ListB)
merge_13 = Merge(Data1=rf_4, Data2=ff_3, Data3=gf_2, Data4=gf, Data5=ff, Data6=rf_3)
merge_14 = Merge(Data1=rf_6, Data2=ff_4, Data3=gf_3, Data4=gf_4, Data5=ff_2, Data6=rf_5)
geo_3 = Geometry(merge_12)

# ---- group: Intermediary Wall Panel Grip/Slot
tab_depth = Slider(50, range=0..104)
pt_18 = ConstructPoint(XCoordinate=0, YCoordinate=0, ZCoordinate=0)
division_5 = Division(A=num, B=2)
addition_7 = Addition(A=division_5, B=ply_thickness_2)
ply_thickness_3 = Number(ply_thickness_2)
dog_bone = DogBonePocket_3(point=pt_18)  # -> pt_5, tool_size_2, size
subtraction_5 = Subtraction(A=division_5, B=tab_depth)
_2 = Number(2)
X_4 = UnitX(Factor=addition_7)
division_6 = Division(A=beam_width_2, B=_2)
X_5 = UnitX(Factor=division_5)
multiplication_2 = Multiplication(A=ply_thickness_3, B=2)
X_6 = UnitX(Factor=subtraction_5)
rotate_2 = Rotate(Geometry=dog_bone.pt_5, Angle=degrees(-90), Plane=PlaneXY(0, 0, 0))  # -> Geometry, Transform
neg_6 = Negative(Value=X_4)
xz = XZPlane(Origin=Point(0, 0, 0))
subtraction_6 = Subtraction(A=division_6, B=multiplication_2)
mirror = Mirror(Geometry=rotate_2.Geometry, Plane=PlaneYZ(0, 0, 0))  # -> Geometry, Transform
mirror_2 = Mirror(Geometry=mirror.Geometry, Plane=xz)  # -> Geometry, Transform
move_7 = Move(Geometry=pt_18, Motion=X_5)  # -> Geometry, Transform
move_8 = Move(Geometry=pt_18, Motion=X_6)  # -> Geometry, Transform
move_9 = Move(Geometry=pt_18, Motion=neg_6)  # -> Geometry, Transform
Y_5 = UnitY(Factor=subtraction_6)
Y_6 = UnitY(Factor=division_6)
move_10 = Move(Geometry=mirror_2.Geometry, Motion=X_5)  # -> Geometry, Transform
move_11 = Move(Geometry=mirror.Geometry, Motion=X_5)  # -> Geometry, Transform
move_12 = Move(Geometry=move_9.Geometry, Motion=Y_6)  # -> Geometry, Transform
move_13 = Move(Geometry=move_8.Geometry, Motion=Y_5)  # -> Geometry, Transform
move_14 = Move(Geometry=move_10.Geometry, Motion=Y_5)  # -> Geometry, Transform
move_15 = Move(Geometry=move_11.Geometry, Motion=Y_6)  # -> Geometry, Transform
rev_2 = ReverseList(List=move_14.Geometry)
merge_15 = Merge(
    Data1=move_7.Geometry,
    Data2=move_8.Geometry,
    Data3=move_13.Geometry,
    Data4=rev_2,
    Data5=move_15.Geometry,
    Data6=move_12.Geometry)
pline_2 = PolyLine(Vertices=merge_15, Closed=False)

# ----
null_2 = NullItem(Item=geo_3)  # -> NullFlags, InvalidFlags, Description
pt_19 = Point(regular_grip_pts)
opening_width_2 = Data(merge_14)
opening_height_2 = Data(merge_13)
pt_20 = Point(pt_4)
dispatch_23 = Dispatch(List=merge_11, DispatchPattern=null_2.NullFlags)  # -> ListA, ListB
cp_2 = ClosestPoint(Point=pt_4, Cloud=pt_19)  # -> simplify(ClosestPoint), simplify(CPIndex), Distance
multiplication_3 = Multiplication(A=ply_thickness_2, B=2)
multiplication_4 = Multiplication(A=ply_thickness_2, B=2)
addition_8 = Addition(A=opening_width_2, B=flatten(multiplication_3))
addition_9 = Addition(A=opening_height_2, B=flatten(multiplication_4))
clean_3 = CleanTree(RemoveNulls=True, RemoveInvalid=True, RemoveEmpty=False, Tree=cp_2.CPIndex)
_2_2 = Number(2)
similar_2 = Similarity(FirstNumber=addition_8, SecondNumber=flatten(multiplication_3), Threshold=0.1)  # -> Similarity, AbsoluteDifference
similar_3 = Similarity(FirstNumber=addition_9, SecondNumber=flatten(multiplication_4), Threshold=0.1)  # -> Similarity, AbsoluteDifference
division_7 = Division(A=beam_width_2, B=_2_2)
cull_i_3 = CullIndex(List=pt_19, Indices=clean_3, Wrap=True)
pcen = PolygonCenter(Polyline=vertical_grip_slot_1)  # -> CenterV, CenterE, CenterA
pt_21 = ConstructPoint(XCoordinate=0, YCoordinate=0, ZCoordinate=0)
dispatch_24 = Dispatch(List=addition_9, DispatchPattern=similar_3.Similarity)  # -> ListA, ListB
dispatch_25 = Dispatch(List=addition_8, DispatchPattern=similar_2.Similarity)  # -> ListA, ListB
subtraction_7 = Subtraction(A=division_7, B=division_4)
multiplication_5 = Multiplication(A=ply_thickness_2, B=3.5)
orient_3 = OrientDirection(
    Geometry=flatten(vertical_grip_slot_2),
    PointA=flatten(pt_21),
    DirectionA=Vector(0, 0, 1),
    PointB=cp_2.ClosestPoint,
    DirectionB=Vector(0, 0, 1))  # -> simplify(Geometry), Transform
orient_4 = OrientDirection(
    Geometry=flatten(vertical_grip_slot_1),
    PointA=flatten(pcen.CenterA),
    DirectionA=Vector(0, 0, 1),
    PointB=cull_i_3,
    DirectionB=Vector(0, 0, 1))  # -> simplify(Geometry), Transform
pt_22 = Point(simplify(shift))
Y_7 = UnitY(Factor=subtraction_7)
subtraction_8 = Subtraction(A=division_7, B=multiplication_5)

# ----
# WINDOW OPENING
external_sheathing = ClusterInput()
subtraction_9 = Subtraction(A=sheet_width, B=beam_width_2)
subtraction_10 = Subtraction(A=gauge, B=beam_width_2)
min = Minimum(A=dispatch_25.ListB, B=flatten(subtraction_9))
xy_2 = XYPlane(Origin=geo)
subtraction_11 = Subtraction(A=subtraction_10, B=ply_thickness_2)
bool = Boolean(external_sheathing)
rectangle = Rectangle(Plane=xy_2, XSize=dispatch_24.ListB, YSize=min, Radius=0)  # -> Rectangle, Length
division_8 = Division(A=min, B=2)
max_opening_width = Number(subtraction_11)
width = Number(min)
neg_7 = Negative(Value=division_8)
Y_8 = UnitY(Factor=neg_7)
window_system_v0_1 = WindowSystemV01(
    ply_thickness_2=ply_thickness_2,
    profile_shapes=rectangle.Rectangle,
    width=width,
    max_opening_width=max_opening_width,
    fin_depth=num)  # -> reference_geo_2, centre_point, faces_2, sides_2, sides_3d_geo
move_16 = Move(Geometry=rectangle.Rectangle, Motion=Y_8)  # -> Geometry, Transform
crv_6 = Curve(simplify(move_16.Geometry))
clean_4 = CleanTree(RemoveNulls=True, RemoveInvalid=True, RemoveEmpty=False, Tree=crv_6)
geo_4 = Geometry(simplify(window_system_v0_1.faces_2))
geo_5 = Geometry(simplify(window_system_v0_1.sides_3d_geo))
geo_6 = Geometry(simplify(window_system_v0_1.sides_2))
path_mapper_5 = PathMapper(clean_4, source="{A}", target="{A}")
path_mapper_6 = PathMapper(clean_4, source="{A;B}", target="{A}")
dispatch_26 = Dispatch(List=geo_5, DispatchPattern=bool)  # -> ListA, ListB
dispatch_27 = Dispatch(List=geo_6, DispatchPattern=bool)  # -> ListA, ListB
merge_16 = Merge(Data1=path_mapper_5, Data2=path_mapper_6)
clean_5 = CleanTree(RemoveNulls=True, RemoveInvalid=True, RemoveEmpty=True, Tree=dispatch_26.ListB)  # -> simplify(Tree)
area = Area(Geometry=merge_16)  # -> Area, Centroid
orient_5 = OrientDirection(
    Geometry=clean_5,
    PointA=Point(0, 0, 0),
    DirectionA=Vector(0, 0, 1),
    PointB=graft(area.Centroid),
    DirectionB=Vector(0, 0, 1))  # -> simplify(Geometry), Transform
orient_6 = OrientDirection(Geometry=geo_4, PointA=Point(0, 0, 0), DirectionA=Vector(0, 0, 1), PointB=area.Centroid, DirectionB=Vector(0, 0, 1))  # -> simplify(Geometry), Transform
path_mapper_7 = PathMapper(orient_5.Geometry, source="{A;B}", target="{A}")
null_3 = NullItem(Item=path_mapper_7)  # -> NullFlags, InvalidFlags, Description
dispatch_28 = Dispatch(List=orient_5.Geometry, DispatchPattern=null_3.NullFlags)  # -> ListA, ListB
match = MatchTree(Tree=orient_6.Geometry, Guide=merge_16)
match_2 = MatchTree(Tree=dispatch_28.ListA, Guide=merge_16)

Y_9 = UnitY(Factor=subtraction_8)
merge_17 = Merge(Data1=orient_3.Geometry, Data2=orient_4.Geometry, Data3=geo_3, Data4=dispatch_23.ListA)
clean_6 = CleanTree(RemoveNulls=True, RemoveInvalid=True, RemoveEmpty=True, Tree=pt_22)
clean_7 = CleanTree(RemoveNulls=True, RemoveInvalid=True, RemoveEmpty=False, Tree=pt_22)
neg_8 = Negative(Value=division)
move_17 = Move(Geometry=cir, Motion=flatten(Y_9))  # -> Geometry, Transform
move_18 = Move(Geometry=merge_17, Motion=flatten(Y_7))  # -> Geometry, Transform
Y_10 = UnitY(Factor=neg_8)
pline_3 = PolyLine(Vertices=clean_6, Closed=False)  # -> simplify(Polyline)
lng_3 = ListLength(List=pline_3)
move_19 = Move(Geometry=crv_3, Motion=flatten(Y_10))  # -> Geometry, Transform
null_4 = NullItem(Item=clean_7)  # -> NullFlags, InvalidFlags, Description
move_20 = Move(Geometry=move_18.Geometry, Motion=flatten(Y_10))  # -> Geometry, Transform
end_4 = EndPoints(Curve=pline_3)  # -> Start, End
move_21 = Move(Geometry=move_17.Geometry, Motion=flatten(Y_10))  # -> Geometry, Transform
equals_2 = Equality(FirstNumber=lng_3, SecondNumber=1)  # -> Equality, Inequality
dispatch_29 = Dispatch(List=move_19.Geometry, DispatchPattern=null_4.NullFlags)  # -> simplify(ListA), ListB
end_5 = EndPoints(Curve=dispatch_29.ListB)  # -> Start, End
pt_23 = Point([end_4.Start, end_4.End])
dispatch_30 = Dispatch(List=end_5.End, DispatchPattern=equals_2.Equality)  # -> ListA, ListB
cp_3 = ClosestPoint(Point=end_5.Start, Cloud=pt_23)  # -> ClosestPoint, CPIndex, Distance
cp_4 = ClosestPoint(Point=dispatch_30.ListB, Cloud=pt_23)  # -> ClosestPoint, CPIndex, Distance
pdecon = Deconstruct(Point=dispatch_30.ListA)  # -> XComponent, YComponent, ZComponent
pdecon_2 = Deconstruct(Point=end_4.Start)  # -> XComponent, YComponent, ZComponent
pline_4 = PolyLine(Vertices=[cp_3.ClosestPoint, end_5.Start], Closed=False)
pline_5 = PolyLine(Vertices=[end_5.End, cp_4.ClosestPoint], Closed=False)
pt_24 = ConstructPoint(XCoordinate=pdecon.XComponent, YCoordinate=pdecon_2.YComponent, ZCoordinate=0)
merge_18 = Merge(Data1=pline_4, Data2=pline_5)
ln_2 = Line(StartPoint=end_4.End, EndPoint=pt_24)
ln_3 = Line(StartPoint=end_4.Start, EndPoint=pt_24)
join_2 = JoinCurves(Curves=merge_18, Preserve=False)  # -> simplify(Curves)
len_5 = Length(Curve=ln_2)
len_6 = Length(Curve=ln_3)
smaller_2 = SmallerThan(FirstNumber=len_6, SecondNumber=len_5)  # -> SmallerThan, OrEqualTo
merge_19 = Merge(Data1=pt_2, Data2=pt)
xz_2 = XZPlane(Origin=Point(0, 0, 0))
dispatch_31 = Dispatch(List=ln_2, DispatchPattern=smaller_2.SmallerThan)  # -> ListA, ListB
dispatch_32 = Dispatch(List=ln_3, DispatchPattern=smaller_2.SmallerThan)  # -> ListA, ListB
geo_7 = Geometry([dispatch_32.ListA, dispatch_31.ListB])
match_3 = MatchTree(Tree=geo_7, Guide=join_2)
merge_20 = Merge(Data1=join_2, Data2=match_3, Data3=pline_3)
merge_21 = Merge(Data1=join_2, Data2=match_3, Data3=dispatch_29.ListA)
join_3 = JoinCurves(Curves=merge_20, Preserve=False)  # -> simplify(Curves)
colom_4 = CollisionOneMany(Collider=move_20.Geometry, Obstacles=join_3)  # -> Collision, Index
dispatch_33 = Dispatch(List=move_20.Geometry, DispatchPattern=colom_4.Collision)  # -> ListA, ListB
geo_8 = Geometry(dispatch_33.ListB)

# ---- group: Panel Trimmers (Outer frames)
beam_width_3 = Number(beam_width_2)
division_9 = Division(A=beam_width_3, B=2)
addition_10 = Addition(A=division_9, B=neg_8)
neg_9 = Negative(Value=addition_10)
neg_10 = Negative(Value=Y_10)
Y_11 = UnitY(Factor=neg_9)
xz_3 = XZPlane(Origin=Point(0, 0, 0))
move_22 = Move(Geometry=merge_21, Motion=flatten(neg_10))  # -> Geometry, Transform
move_23 = Move(Geometry=merge_21, Motion=flatten(Y_11))  # -> Geometry, Transform
mirror_3 = Mirror(Geometry=move_18.Geometry, Plane=xz_3)  # -> Geometry, Transform
mirror_4 = Mirror(Geometry=move_22.Geometry, Plane=xz_3)  # -> Geometry, Transform
end_6 = EndPoints(Curve=move_23.Geometry)  # -> Start, End
end_7 = EndPoints(Curve=mirror_4.Geometry)  # -> Start, End
ln_4 = Line(StartPoint=end_7.Start, EndPoint=end_6.Start)
ln_5 = Line(StartPoint=end_7.End, EndPoint=end_6.End)
join_4 = JoinCurves(Curves=[mirror_4.Geometry, move_23.Geometry, ln_4, ln_5], Preserve=False)  # -> simplify(Curves)
boundary = BoundarySurfaces(Edges=join_4)
srfsplit = SurfaceSplit(Surface=boundary, Curves=mirror_3.Geometry)
path_mapper_8 = PathMapper(srfsplit, source="{A;B}", target="{A}")
area_2 = Slider(10000, range=0..20004)
area_3 = Area(Geometry=path_mapper_8)  # -> Area, Centroid
larger = LargerThan(FirstNumber=area_3.Area, SecondNumber=area_2)  # -> LargerThan, OrEqualTo
dispatch_34 = Dispatch(List=path_mapper_8, DispatchPattern=larger.LargerThan)  # -> ListA, ListB
geo_9 = Geometry(dispatch_34.ListA)
neg_11 = Negative(Value=division)
Y_12 = UnitY(Factor=neg_11)
move_24 = Move(Geometry=geo_9, Motion=flatten(Y_12))  # -> Geometry, Transform
merge_22 = Merge(Data1=move_24.Geometry)

# ----
merge_23 = Merge(Data1=join_3, Data2=dispatch_29.ListA)

# ---- group: Intermediary Wall Panel
pt_25 = ConstructPoint(XCoordinate=0, YCoordinate=0, ZCoordinate=0)
orient_7 = OrientDirection(
    Geometry=flatten(horizontal_grip_slots),
    PointA=flatten(pt_25),
    DirectionA=Vector(0, 0, 1),
    PointB=merge_19,
    DirectionB=Vector(0, 0, 1))  # -> Geometry, Transform
orient_8 = OrientDirection(
    Geometry=flatten(vertical_grip_slots_3),
    PointA=flatten(pt_25),
    DirectionA=Vector(0, 0, 1),
    PointB=pt,
    DirectionB=Vector(0, 0, 1))  # -> Geometry, Transform
end_8 = EndPoints(Curve=merge_23)  # -> Start, End
pt_26 = Point([end_8.Start, end_8.End])
pgroups = PointGroups(Points=pt_26, Distance=600)  # -> Groups, Indices
pline_6 = PolyLine(Vertices=pgroups.Groups, Closed=False)  # -> simplify(Polyline)
path_mapper_9 = PathMapper(pline_6, source="{A;B}", target="{A}")
clean_8 = CleanTree(RemoveNulls=True, RemoveInvalid=True, RemoveEmpty=True, Tree=path_mapper_9)
eval_2 = EvaluateLength(Curve=clean_8, Length=0.5, Normalized=True)  # -> Point, Tangent, Parameter
orient_9 = OrientDirection(
    Geometry=flatten(pline_2),
    PointA=flatten(pt_25),
    DirectionA=Vector(0, 0, 1),
    PointB=eval_2.Point,
    DirectionB=Vector(0, 0, 1))  # -> Geometry, Transform
end_9 = EndPoints(Curve=clean_8)  # -> Start, End
end_10 = EndPoints(Curve=orient_9.Geometry)  # -> Start, End
ln_6 = Line(StartPoint=end_9.End, EndPoint=end_10.Start)
merge_24 = Merge(Data1=ln_6, Data2=orient_9.Geometry)
join_5 = JoinCurves(Curves=merge_24, Preserve=False)
geo_10 = Geometry(join_5)
mirror_5 = Mirror(Geometry=geo_10, Plane=xz_2)  # -> Geometry, Transform
end_11 = EndPoints(Curve=geo_10)  # -> Start, End
end_12 = EndPoints(Curve=mirror_5.Geometry)  # -> Start, End
merge_25 = Merge(Data1=orient_7.Geometry)
ln_7 = Line(StartPoint=end_12.Start, EndPoint=end_11.Start)
ln_8 = Line(StartPoint=end_12.End, EndPoint=end_11.End)
pcen_2 = PolygonCenter(Polyline=merge_25)  # -> CenterV, CenterE, CenterA
merge_26 = Merge(Data1=mirror_5.Geometry, Data2=geo_10, Data3=ln_7, Data4=ln_8)
clean_9 = CleanTree(RemoveNulls=True, RemoveInvalid=True, RemoveEmpty=True, Tree=merge_26)
join_6 = JoinCurves(Curves=clean_9, Preserve=False)  # -> simplify(Curves)
incurves = PointInCurves(Point=pcen_2.CenterA, Curves=join_6)  # -> Relationship, Index, Point
item_5 = ListItem(List=orient_7.Geometry, Index=incurves.Index, Wrap=False)
merge_27 = Merge(Data1=join_6, Data4=item_5)
clean_10 = CleanTree(RemoveNulls=True, RemoveInvalid=True, RemoveEmpty=False, Tree=merge_27)
boundary_2 = BoundarySurfaces(Edges=clean_10)

# ----
mirror_6 = Mirror(Geometry=geo_8, Plane=xz_2)  # -> Geometry, Transform
mirror_7 = Mirror(Geometry=move_21.Geometry, Plane=xz_2)  # -> simplify(Geometry), Transform
mirror_8 = Mirror(Geometry=merge_23, Plane=xz_2)  # -> Geometry, Transform
end_13 = EndPoints(Curve=mirror_8.Geometry)  # -> Start, End
end_14 = EndPoints(Curve=merge_23)  # -> Start, End
merge_28 = Merge(Data1=move_21.Geometry, Data2=mirror_7.Geometry)  # -> simplify(Result)
merge_29 = Merge(Data1=mirror_6.Geometry, Data2=geo_8, Data3=orient_7.Geometry)
ln_9 = Line(StartPoint=end_14.Start, EndPoint=end_13.Start)
ln_10 = Line(StartPoint=end_14.End, EndPoint=end_13.End)
screw_guides = Geometry(merge_28)
slots = Geometry(merge_29)
join_7 = JoinCurves(Curves=[ln_9, mirror_8.Geometry, ln_10, merge_23], Preserve=False)  # -> simplify(Curves)
geo_11 = Geometry(move_19.Geometry)
window_geometry = Geometry(match)
colom_5 = CollisionOneMany(Collider=slots, Obstacles=join_7)  # -> Collision, Index
boundary_3 = BoundarySurfaces(Edges=join_7)
dispatch_35 = Dispatch(List=slots, DispatchPattern=colom_5.Collision)  # -> ListA, ListB
tstat_4 = TreeStatistics(Tree=window_geometry)  # -> Paths, Length, Count
geo_12 = Geometry(dispatch_35.ListA)
geo_13 = Geometry(dispatch_35.ListB)
null_5 = NullItem(Item=tstat_4.Paths)  # -> NullFlags, InvalidFlags, Description
dispatch_36 = Dispatch(List=boundary_3, DispatchPattern=null_5.NullFlags)  # -> ListA, ListB
srfsplit_2 = SurfaceSplit(Surface=dispatch_36.ListB, Curves=window_geometry)
area_4 = Area(Geometry=window_geometry)  # -> Area, Centroid
path_mapper_10 = PathMapper(srfsplit_2, source="{A;B}", target="{A}")
cir_2 = Circle(Plane=area_4.Centroid, Radius=100)
colom_6 = CollisionOneMany(Collider=path_mapper_10, Obstacles=cir_2)  # -> Collision, Index
dispatch_37 = Dispatch(List=path_mapper_10, DispatchPattern=colom_6.Collision)  # -> ListA, ListB
geo_14 = Geometry(dispatch_37.ListB)
merge_30 = Merge(Data1=dispatch_36.ListA, Data2=geo_14)
area_5 = Area(Geometry=merge_30)  # -> Area, Centroid
_10000 = Text("10000")
larger_2 = LargerThan(FirstNumber=area_5.Area, SecondNumber=_10000)  # -> LargerThan, OrEqualTo
dispatch_38 = Dispatch(List=merge_30, DispatchPattern=larger_2.LargerThan)  # -> ListA, ListB
clean_11 = CleanTree(RemoveNulls=True, RemoveInvalid=True, RemoveEmpty=True, Tree=dispatch_38.ListA)  # -> simplify(Tree)
srfsplit_3 = SurfaceSplit(Surface=simplify(clean_11), Curves=simplify(geo_13))
area_6 = Area(Geometry=srfsplit_3)  # -> Area, Centroid
_10000_2 = Text("10000")
larger_3 = LargerThan(FirstNumber=area_6.Area, SecondNumber=_10000_2)  # -> LargerThan, OrEqualTo
dispatch_39 = Dispatch(List=srfsplit_3, DispatchPattern=larger_3.LargerThan)  # -> ListA, ListB
clean_12 = CleanTree(RemoveNulls=True, RemoveInvalid=True, RemoveEmpty=True, Tree=dispatch_39.ListA)  # -> simplify(Tree)
merge_31 = Merge(Data1=clean_12)
path_mapper_11 = PathMapper(merge_31, source=["{A}", "{A;B}"], target=["{A}", "{A}"])
_10000_3 = Text("10000")
_10000_4 = Text("10000")
reinforcer_points = Slider(3, range=0..4)
reinforcer_points_2 = Slider(0, range=0..4)
unit_no = ClusterInput()
bay_no = ClusterInput()
unit_type = Data(unit_no)
side_a_9 = Dispatch(List=" / A-0", DispatchPattern=tmatch)  # -> ListA, ListB
side_a_10 = Dispatch(List=" / B-0", DispatchPattern=tmatch)  # -> ListA, ListB
bay_no_2 = Data(bay_no)
data_2 = Data(flatten(window_name))
data_3 = Data(flatten(unit_type))
concat_3 = Concatenate(FragmentA=side_a_10.ListB, FragmentB=bay_no_2)  # disabled
concat_4 = Concatenate(FragmentC=data_3, FragmentB="/", FragmentA=data_2)
concat_5 = Concatenate(FragmentA=unit_type, FragmentB=concat_3)  # -> flatten(Result)
geo_15 = Geometry(dispatch_27.ListB)
window_name_2 = Data(simplify(concat_4))
dispatch_40 = Dispatch(List=" / EXROOF /", DispatchPattern=bool)  # -> ListA, ListB
dispatch_41 = Dispatch(List=" / EXWALL /", DispatchPattern=bool)  # -> ListA, ListB
dispatch_42 = Dispatch(List=" / INCEIL /", DispatchPattern=bool)  # -> ListA, ListB
dispatch_43 = Dispatch(List=" / INWALL /", DispatchPattern=bool)  # -> ListA, ListB
number_slider_2 = Slider(40, range=0..61)
data_4 = Data(simplify(window_name_2))
concat_6 = Concatenate(FragmentA=concat_5, FragmentB=[dispatch_42.ListB, dispatch_40.ListA])
concat_7 = Concatenate(FragmentA=concat_5, FragmentB=[dispatch_43.ListB, dispatch_41.ListA])
ply_thickness_4 = Number(ply_thickness_2)
rotate_3 = Rotate(Geometry=geo_15, Angle=1.570796327, Plane=PlaneXY(0, 0, 0))  # -> Geometry, Transform
lng_4 = ListLength(List=flatten(geo_15))  # -> flatten(Length)
addition_11 = Addition(A=gauge, B=Slider(100, range=0..7001))
pt_27 = ConstructPoint(XCoordinate=0, YCoordinate=0, ZCoordinate=0)
Y_13 = UnitY(Factor=Slider(368, range=0..7001))
Z = UnitZ(Factor=flatten(ply_thickness_4))
panel_4 = Panel(window_name_2)
division_10 = Division(A=ply_thickness_4, B=-2)
pt_28 = ConstructPoint(XCoordinate=0, YCoordinate=0, ZCoordinate=0)
X_7 = UnitX(Factor=addition_11)
path_mapper_12 = PathMapper(data_4, source=["{A}", "{A}", "{A}", "{A}"], target=["{A;0}", "{A;1}", "{A;2}", "{A;3}"])
geo_16 = Geometry(match_2)
Z_2 = UnitZ(Factor=division_10)
arrlinear = LinearArray(Geometry=pt_27, Direction=Y_13, Count=lng_4)  # -> Geometry, Transform
data_5 = Data(simplify(flatten(window_name_2)))
null_6 = NullItem(Item=path_mapper_12)  # -> NullFlags, InvalidFlags, Description
ply_thickness_5 = Number(ply_thickness_2)
dispatch_44 = Dispatch(List=data_5, DispatchPattern=null_6.NullFlags)  # -> ListA, ListB
split_2 = SplitTree(Data=geo_16, Masks=flatten(data))  # -> Positive, BRight
Z_3 = UnitZ(Factor=flatten(ply_thickness_5))
labelling = Labelling_6(geometry=rotate_3.Geometry, wall_label=data_4, part_label="/SIDE-", text_size=Slider(40, range=0..61))  # -> path_mapper_4, path_mapper_5
clean_13 = CleanTree(RemoveNulls=True, RemoveInvalid=True, RemoveEmpty=False, Tree=labelling.path_mapper_5)
side_a_11 = Geometry(split_2.Positive)
Z_4 = UnitZ(Factor=1)
side_b_3 = Geometry(split_2.BRight)
xy_3 = XYPlane(Origin=Point(0, 0, 0))
dispatch_45 = Dispatch(List="External Sheathing", DispatchPattern=bool)  # -> ListA, ListB
dispatch_46 = Dispatch(List="Internal Sheathing", DispatchPattern=bool)  # -> ListA, ListB
xy_4 = XYPlane(Origin=Point(0, 0, 0))
data_6 = Data(simplify(clean_13))
mirror_9 = Mirror(Geometry=side_a_11, Plane=xy_3)  # -> Geometry, Transform
merge_32 = Merge(Data1=labelling.path_mapper_4, Data2=labelling.path_mapper_5)
layers = CreateModifyLayers(LayerName=[dispatch_46.ListB, dispatch_45.ListA], DeleteLayer=False, enableFullPath=False)  # -> LayerNames, LayerFullPath
txt = Text(data_6)
merge_33 = Merge(Data1=mirror_9.Geometry, Data2=side_b_3)
split_3 = TextSplit(Text=txt, Separators=":")
Z_5 = UnitZ(Factor=1)
xy_5 = XYPlane(Origin=Point(0, 0, 0))
clean_14 = CleanTree(RemoveNulls=True, RemoveInvalid=True, RemoveEmpty=False, Tree=merge_33)
item_6 = ListItem(List=split_3, Index=1, Wrap=True)  # -> simplify(Item)
orient_10 = OrientDirection(
    Geometry=merge_32,
    PointA=Point(0, 0, 0),
    DirectionA=Z_5,
    PointB=graft(arrlinear.Geometry),
    DirectionB=graft(Vector(0, 0, 1)))  # -> simplify(Geometry), Transform
path_mapper_13 = PathMapper(clean_14, source="{A;B}", target="{A}")
createatts = CreateAttributes(Name=item_6, LayerName=layers.LayerNames, enableFullPath=False)
data_7 = Data(createatts)
null_7 = NullItem(Item=path_mapper_13)  # -> NullFlags, InvalidFlags, Description
dispatch_47 = Dispatch(List=clean_14, DispatchPattern=null_7.NullFlags)  # -> ListA, ListB
merge_34 = Merge(Data1=path_mapper_13, Data2=dispatch_47.ListA)
clean_15 = CleanTree(RemoveNulls=True, RemoveInvalid=True, RemoveEmpty=True, Tree=graft(merge_34))
match_4 = MatchTree(Tree=data_7, Guide=clean_15)
path_mapper_14 = PathMapper(match_4, source=["{A}", "{A;B}"], target=["{A}", "{A}"])
window_attributes = ClusterOutput(path_mapper_14)
window_box_geo = ClusterOutput(merge_34)
window_sides_2d = ClusterOutput(orient_10.Geometry)

buffer = Slider(0, range=0..2400)
buffer_2 = Slider(50, range=0..2400)
subtraction_12 = Subtraction(A=sheet_length, B=buffer)
neg_12 = Negative(Value=buffer_2)
pt_29 = Point(pt_9)
sort_pt_2 = SortPoints(Points=pt_29)  # -> Points, Indices
X_8 = UnitX(Factor=neg_12)
lng_5 = ListLength(List=sort_pt_2.Points)
subtraction_13 = Subtraction(A=lng_5, B=2)
subtraction_14 = Subtraction(A=lng_5, B=1)
division_11 = Division(A=spacing_2, B=2)
cull_i_4 = CullIndex(List=sort_pt_2.Points, Indices=[subtraction_14, subtraction_13], Wrap=False)  # -> simplify(List)
X_9 = UnitX(Factor=division_11)
move_25 = Move(Geometry=cull_i_4, Motion=flatten(X_9))  # -> Geometry, Transform
division_12 = Division(A=dovetail_height, B=2)
neg_13 = Negative(Value=division)
Y_14 = UnitY(Factor=neg_13)
pt_30 = ConstructPoint(XCoordinate=0, YCoordinate=0, ZCoordinate=0)
X_10 = UnitX(Factor=division_12)
move_26 = Move(Geometry=pt_30, Motion=flatten(X_10))  # -> Geometry, Transform
beam_width_4 = Number(beam_width_2)
division_13 = Division(A=beam_width_4, B=2)

addition_12 = Addition(A=subtraction_12, B=buffer_2)

divlength_2 = DivideLength(Curve=geo_11, Length=flatten(addition_12))  # -> Points, Tangents, Parameters
cull_i_5 = CullIndex(List=divlength_2.Points, Indices=0, Wrap=True)  # -> simplify(List)
path_mapper_15 = PathMapper(cull_i_5, source=["{A}", "{A;B}"], target=["{A}", "{A}"])
move_27 = Move(Geometry=path_mapper_15, Motion=flatten(X_8))  # -> Geometry, Transform
cp_5 = ClosestPoint(Point=move_27.Geometry, Cloud=move_25.Geometry)  # -> ClosestPoint, CPIndex, Distance
move_28 = Move(Geometry=cp_5.ClosestPoint, Motion=flatten(Y_14))  # -> Geometry, Transform
orient_11 = OrientDirection(
    Geometry=flatten([offset, offset_2]),
    PointA=flatten(move_26.Geometry),
    DirectionA=Vector(0, 0, 1),
    PointB=move_28.Geometry,
    DirectionB=Vector(0, 0, 1))  # -> Geometry, Transform
clean_16 = CleanTree(RemoveNulls=True, RemoveInvalid=True, RemoveEmpty=False, Tree=orient_11.Geometry)
ext = ExtendCurve(Curve=clean_16, Type=0, Start=flatten(division_13), End=flatten(division_13))

panel_5 = Panel(move_27.Geometry)
null_8 = NullItem(Item=clean_16)  # -> NullFlags, InvalidFlags, Description
srfsplit_4 = SurfaceSplit(Surface=simplify(path_mapper_11), Curves=clean_16)  # -> simplify(Fragments)
dispatch_48 = Dispatch(List=merge_31, DispatchPattern=null_8.NullFlags)  # -> ListA, ListB
null_9 = NullItem(Item=clean_16)  # -> NullFlags, InvalidFlags, Description
area_7 = Area(Geometry=dispatch_48.ListA)  # -> Area, Centroid
area_8 = Area(Geometry=srfsplit_4)  # -> Area, Centroid
srfsplit_5 = SurfaceSplit(Surface=merge_22, Curves=ext)  # -> simplify(Fragments)
dispatch_49 = Dispatch(List=merge_22, DispatchPattern=null_9.NullFlags)  # -> ListA, ListB
larger_4 = LargerThan(FirstNumber=area_7.Area, SecondNumber=_10000_3)  # -> LargerThan, OrEqualTo
larger_5 = LargerThan(FirstNumber=area_8.Area, SecondNumber=_10000_3)  # -> LargerThan, OrEqualTo
area_9 = Area(Geometry=dispatch_49.ListA)  # -> Area, Centroid
dispatch_50 = Dispatch(List=dispatch_48.ListA, DispatchPattern=larger_4.LargerThan)  # -> ListA, ListB
area_10 = Area(Geometry=srfsplit_5)  # -> Area, Centroid
dispatch_51 = Dispatch(List=srfsplit_4, DispatchPattern=larger_5.LargerThan)  # -> ListA, ListB
larger_6 = LargerThan(FirstNumber=area_9.Area, SecondNumber=_10000_4)  # -> LargerThan, OrEqualTo
clean_17 = CleanTree(RemoveNulls=True, RemoveInvalid=True, RemoveEmpty=True, Tree=dispatch_50.ListA)  # -> simplify(Tree); disabled
larger_7 = LargerThan(FirstNumber=area_10.Area, SecondNumber=_10000_4)  # -> LargerThan, OrEqualTo
clean_18 = CleanTree(RemoveNulls=True, RemoveInvalid=True, RemoveEmpty=True, Tree=dispatch_51.ListA)  # -> simplify(Tree)
dispatch_52 = Dispatch(List=dispatch_49.ListA, DispatchPattern=larger_6.LargerThan)  # -> ListA, ListB
dispatch_53 = Dispatch(List=srfsplit_5, DispatchPattern=larger_7.LargerThan)  # -> ListA, ListB
path_mapper_16 = PathMapper(clean_18, source="{A}", target="{A}")
path_mapper_17 = PathMapper(clean_18, source="{A;B}", target="{A}")
clean_19 = CleanTree(RemoveNulls=True, RemoveInvalid=True, RemoveEmpty=True, Tree=dispatch_52.ListA)  # -> simplify(Tree); disabled
clean_20 = CleanTree(RemoveNulls=True, RemoveInvalid=True, RemoveEmpty=True, Tree=dispatch_53.ListA)  # -> simplify(Tree)
merge_35 = Merge(Data1=clean_17, Data2=path_mapper_17, Data3=path_mapper_16)
branch_16 = TreeBranch(Tree=simplify(merge_35), MaintainPaths=True)
path_mapper_18 = PathMapper(clean_20, source="{A;B}", target="{A}")
path_mapper_19 = PathMapper(clean_20, source="{A}", target="{A}")
geo_17 = Geometry(merge_35)
area_11 = Area(Geometry=geo_17)  # -> Area, Centroid
merge_36 = Merge(Data1=clean_19, Data2=path_mapper_18, Data3=path_mapper_19)
larger_8 = LargerThan(FirstNumber=area_11.Area, SecondNumber=_10000_3)  # -> LargerThan, OrEqualTo
dispatch_54 = Dispatch(List=geo_17, DispatchPattern=larger_8.LargerThan)  # -> ListA, ListB
geo_18 = Geometry(dispatch_54.ListA)
merge_37 = Merge(Data1=geo_18, Data2=simplify(boundary_2))  # -> simplify(Result)
rev_3 = ReverseList(List=merge_37)
area_12 = Area(Geometry=rev_3)  # -> Area, Centroid
pdecon_3 = Deconstruct(Point=area_12.Centroid)  # -> XComponent, YComponent, ZComponent
sort = SortList(Keys=pdecon_3.XComponent, ValuesA=rev_3)  # -> Keys, ValuesA
geo_19 = Geometry(sort.ValuesA)
srfsplit_6 = SurfaceSplit(Surface=geo_19, Curves=screw_guides)  # -> simplify(Fragments)
colom_7 = CollisionOneMany(Collider=geo_19, Obstacles=window_geometry)  # -> Collision, Index
dispatch_55 = Dispatch(List=geo_19, DispatchPattern=colom_7.Collision)  # -> ListA, ListB
path_mapper_20 = PathMapper(srfsplit_6, source="{A;B}", target="{A}")
path_mapper_21 = PathMapper(srfsplit_6, source="{A}", target="{A}")
data_8 = Data(colom_7.Collision)
geo_20 = Geometry(dispatch_55.ListA)
window_indicies = ClusterOutput(data_8)
merge_38 = Merge(Data1=path_mapper_21, Data2=path_mapper_20)
area_13 = Area(Geometry=merge_38)  # -> Area, Centroid
smaller_3 = SmallerThan(FirstNumber=area_13.Area, SecondNumber=100)  # -> SmallerThan, OrEqualTo
dispatch_56 = Dispatch(List=merge_38, DispatchPattern=smaller_3.SmallerThan)  # -> ListA, ListB
branch_17 = TreeBranch(Tree=simplify(geo_19), Path=reinforcer_points, MaintainPaths=True)
rotate_4 = Rotate(Geometry=dispatch_56.ListB, Angle=1.570796327, Plane=PlaneXY(0, 0, 0))  # -> Geometry, Transform
geo_21 = Geometry(rotate_4.Geometry)
tstat_5 = TreeStatistics(Tree=geo_21)  # -> Paths, Length, Count
item_7 = ListItem(List=branch_17, Index=reinforcer_points_2, Wrap=True)
panel_6 = Panel(tstat_5.Count)
subtraction_15 = Subtraction(A=tstat_5.Count, B=1)
branch_18 = TreeBranch(Tree=geo_21, Path="{0}", MaintainPaths=True)
branch_19 = TreeBranch(Tree=geo_21, Path=subtraction_15, MaintainPaths=True)
merge_39 = Merge(Data1=branch_18, Data2=branch_19)
tstat_6 = TreeStatistics(Tree=merge_39)  # -> Paths, Length, Count
split_4 = SplitTree(Data=data_8, Masks=flatten(tstat_6.Paths))  # -> Positive, Negative
unique_roof_panel = Data(split_4.Negative)
unique_wall_panel = Data(split_4.Positive)
tstat_7 = TreeStatistics(Tree=merge_39)  # -> Paths, Length, Count
split_5 = SplitTree(Data=geo_21, Masks=flatten(tstat_7.Paths))  # -> Positive, Negative
walls = Geometry(graft(merge_39))
roof = Geometry(graft(split_5.Negative))
labelling_2 = Labelling_6(
    geometry=walls,
    wall_label=concat_7,
    part_label=" ",
    window_code=data_2,
    unique_panels=unique_wall_panel,
    text_size=number_slider_2)  # -> path_mapper_4, path_mapper_5
labelling_3 = Labelling_6(geometry=roof, wall_label=concat_6, part_label=" ", unique_panels=unique_roof_panel, text_size=number_slider_2)  # -> path_mapper_4, path_mapper_5
extr = Extrude(Base=geo_19, Direction=Z)
arrlinear_2 = LinearArray(Geometry=pt_28, Direction=X_7, Count=tstat_5.Count)  # -> Geometry, Transform
merge_40 = Merge(Data1=labelling_2.path_mapper_5, Data2=labelling_3.path_mapper_5)
merge_41 = Merge(Data1=labelling_2.path_mapper_4, Data2=labelling_3.path_mapper_4)
clean_21 = CleanTree(RemoveNulls=True, RemoveInvalid=True, RemoveEmpty=False, Tree=merge_40)
clean_22 = CleanTree(RemoveNulls=True, RemoveInvalid=True, RemoveEmpty=False, Tree=merge_41)
split_6 = SplitTree(Data=extr, Masks=flatten(data))  # -> Positive, BRight
clean_23 = CleanTree(RemoveNulls=True, RemoveInvalid=True, RemoveEmpty=False, Tree=clean_21)
extr_2 = Extrude(Base=merge_36, Direction=Z_3)
data_9 = Data(simplify(graft(clean_23)))
side_b_4 = Geometry(split_6.BRight)
side_a_12 = Geometry(split_6.Positive)
rotate_5 = Rotate(Geometry=merge_36, Angle=1.570796327, Plane=PlaneXY(0, 0, 0))  # -> Geometry, Transform
txt_2 = Text(data_9)
orient_12 = OrientDirection(Geometry=clean_21, PointA=Point(0, 0, 0), DirectionA=Z_4, PointB=graft(arrlinear_2.Geometry), DirectionB=Vector(0, 0, 1))  # -> simplify(graft(Geometry)), Transform
split_7 = SplitTree(Data=extr_2, Masks=flatten(data))  # -> Positive, BRight
orient_13 = OrientDirection(
    Geometry=rotate_5.Geometry,
    PointA=Point(0, 0, 0),
    DirectionA=Z_4,
    PointB=graft(arrlinear_2.Geometry),
    DirectionB=graft(Vector(0, 0, 1)))  # -> simplify(Geometry), Transform
orient_14 = OrientDirection(
    Geometry=clean_22,
    PointA=Point(0, 0, 0),
    DirectionA=Z_4,
    PointB=graft(arrlinear_2.Geometry),
    DirectionB=graft(Vector(0, 0, 1)))  # -> simplify(Geometry), Transform
mirror_10 = Mirror(Geometry=side_a_12, Plane=xy_4)  # -> Geometry, Transform
split_8 = TextSplit(Text=txt_2, Separators=":")
item_8 = ListItem(List=split_8, Index=1, Wrap=True)  # -> simplify(Item)
merge_42 = Merge(Data1=mirror_10.Geometry, Data2=side_b_4)
side_b_5 = Geometry(split_7.BRight)
side_a_13 = Geometry(split_7.Positive)
wires = BrepWireframe(Brep=orient_13.Geometry, Density=-1)  # -> simplify(Wireframe)
wires_2 = BrepWireframe(Brep=orient_14.Geometry, Density=-1)  # -> simplify(Wireframe)
createatts_2 = CreateAttributes(Name=item_8, LayerName=layers.LayerNames, enableFullPath=False)
mirror_11 = Mirror(Geometry=side_a_13, Plane=xy_5)  # -> Geometry, Transform
join_8 = JoinCurves(Curves=wires, Preserve=False)  # -> simplify(Curves)
path_mapper_22 = PathMapper(createatts_2, source=["{A}", "{A;B}"], target=["{A}", "{A}"])
join_9 = JoinCurves(Curves=wires_2, Preserve=False)  # -> simplify(Curves)
panel_7 = Panel(createatts_2)
merge_43 = Merge(Data1=mirror_11.Geometry, Data2=side_b_5)
merge_44 = Merge(Data1=join_9, Data2=orient_12.Geometry)
data_10 = Data(path_mapper_22)
group = Group(Objects=merge_44)
path_mapper_23 = PathMapper(join_8, source=["{A}", "{A;B}"], target=["{A}", "{A}"])
path_mapper_24 = PathMapper(group, source=["{A}", "{A;B}"], target=["{A}", "{A}"])
_3d = ClusterOutput(merge_42)
attributes = ClusterOutput(data_10)
panel_2d_geo = ClusterOutput(path_mapper_24)
trim_2d_geo = ClusterOutput(path_mapper_23)
_3d_trimmers = ClusterOutput(merge_43)

# ==== cluster SheatingPanel_3
# PARAMETERS
hor_edge_grip_width = Slider(18, range=0..50)
gauge = ClusterInput()
dovetail_height = ClusterInput()
beam_width = ClusterInput()
grip_slot_length = ClusterInput()
tolerance = ClusterInput()
spacing = ClusterInput()
tool_size = ClusterInput()
ply_thickness = ClusterInput()
ply_thickness_2 = Number(ply_thickness)
grip_slot_length_2 = Number(grip_slot_length)
beam_width_2 = Number(beam_width)
division = Division(A=gauge, B=2)
spacing_2 = Number(spacing)
tolerance_2 = Number(tolerance)
tool_size_2 = Number(tool_size)
division_2 = Division(A=tool_size_2, B=2)
dovetail_height_2 = Number(hor_edge_grip_width)
hor_edge_grip_width_2 = Slider(117, range=0..350)
X = UnitX(Factor=gauge)
pt_0 = ConstructPoint(XCoordinate=0, YCoordinate=0, ZCoordinate=0)
move_pt_1 = Move(Geometry=pt_0, Motion=X)  # -> Geometry, Transform
division_3 = Division(A=hor_edge_grip_width_2, B=2)
division_4 = Division(A=beam_width_2, B=2)
ln_sheet_top_edge = Line(StartPoint=pt_0, EndPoint=move_pt_1.Geometry)
len = Length(Curve=ln_sheet_top_edge)
division_5 = Division(A=len, B=2)
subtraction = Subtraction(A=len, B=division_4)
subtraction_2 = Subtraction(A=division_5, B=division_3)
addition = Addition(A=division_5, B=division_3)
eval = EvaluateLength(Curve=ln_sheet_top_edge, Length=[division_4, subtraction], Normalized=False)  # -> Point, Tangent, Parameter
eval_2 = EvaluateLength(Curve=ln_sheet_top_edge, Length=[subtraction_2, addition], Normalized=False)  # -> Point, Tangent, Parameter
ply_thickness_3 = Number(ply_thickness_2)
tolerance_3 = Number(tolerance_2)
tool_size_3 = Number(tool_size_2)
division_6 = Division(A=tool_size_3, B=2)
merge = Merge(Data1=eval.Point, Data2=eval_2.Point)
crv_cp = CurveClosestPoint(Point=merge, Curve=ln_sheet_top_edge)  # -> Point, Parameter, Distance
shatter = Shatter(Curve=ln_sheet_top_edge, Parameters=crv_cp.Parameter)
dispatch = Dispatch(List=shatter, DispatchPattern=[True, False])  # -> ListA, ListB
geo = Geometry(dispatch.ListA)
geo_2 = Geometry(dispatch.ListB)
item = ListItem(List=geo_2, Index=1, Wrap=True)
item_2 = ListItem(List=geo_2, Index=0, Wrap=True)
cull_i = CullIndex(List=geo, Indices=1, Wrap=True)
item_3 = ListItem(List=geo, Index=1, Wrap=True)
flip = FlipCurve(Curve=item_2)  # -> Curve, Flag
number_slider = Slider(12, range=0..41)
merge_2 = Merge(Data1=item, Data2=flip.Curve)
number_slider_2 = Slider(10, range=0..41)

# ----
# DOVETAIL (DT)
Y = UnitY(Factor=dovetail_height_2)
crv_male = Curve(reparameterize(merge_2))
_1 = Number(1)
_1_2 = Number(1)
neg = Negative(Value=Y)
move = Move(Geometry=merge_2, Motion=neg)  # -> Geometry, Transform
eval_x_10 = Evaluate(F="x/5", x=_1_2)
eval_x_15 = Evaluate(F="x/10", x=_1_2)
eval_x_20 = Evaluate(F="x/10", x=_1_2)
eval_x_10_2 = Evaluate(F="x/5", x=_1)
eval_x_15_2 = Evaluate(F="x/10", x=_1)
eval_x_30 = Evaluate(F="x/25", x=_1)
_6 = Number(6)
_5 = Number(5)
_5_2 = Number(5)
_6_2 = Number(6)
crv_female = Curve(reparameterize(move.Geometry))
# Tool Width
repeat = RepeatData(Data=eval_x_10, Length=_5)
repeat_2 = RepeatData(Data=eval_x_15, Length=_6)
repeat_3 = RepeatData(Data=eval_x_15_2, Length=_5_2)
repeat_4 = RepeatData(Data=eval_x_10_2, Length=_6_2)
weave = Weave(Pattern=[0, 1], Stream0=repeat_2, Stream1=repeat, NullGaps=False)
weave_2 = Weave(Pattern=[0, 1], Stream0=repeat_4, Stream1=repeat_3, NullGaps=False)
ins = InsertItems(List=weave, Item=eval_x_20, Indices=0, Wrap=False)
ins_2 = InsertItems(List=weave_2, Item=eval_x_30, Indices=0, Wrap=False)
ma = MassAddition(Input=ins)  # -> Result, PartialResults
ma_2 = MassAddition(Input=ins_2)  # -> Result, PartialResults
shatter_2 = Shatter(Curve=crv_female, Parameters=ma.PartialResults)
shatter_3 = Shatter(Curve=crv_male, Parameters=ma_2.PartialResults)
dispatch_2 = Dispatch(List=shatter_2, DispatchPattern=[True, False])  # -> ListA, ListB
dispatch_3 = Dispatch(List=shatter_3, DispatchPattern=[True, False])  # -> ListA, ListB
crv = Curve(dispatch_2.ListA)
crv_2 = Curve(dispatch_3.ListB)
end = EndPoints(Curve=crv)  # -> Start, End
end_2 = EndPoints(Curve=crv_2)  # -> Start, End
pt = Point(end_2.End)
pt_2 = Point(end_2.Start)
pt_3 = Point(end.Start)
pt_4 = Point(end.End)
weave_3 = Weave(Pattern=[0, 1, 2, 3], Stream0=pt_3, Stream1=pt_4, Stream2=pt_2, Stream3=pt, NullGaps=False)
pt_dovetail = Point(weave_3)

pt_5 = ConstructPoint(XCoordinate=0, YCoordinate=0, ZCoordinate=0)
move_2 = Move(Geometry=item_3, Motion=neg)  # -> Geometry, Transform
Y_2 = UnitY(Factor=division_2)
Y_3 = UnitY(Factor=division_2)
sheet_width = ClusterInput()
sheet_length = ClusterInput()
connector_points = ClusterInput()
reinforcer_pts = ClusterInput()
space_invader_points = ClusterInput()
intersection_points = ClusterInput()
segment_length = ClusterInput()
grip_points = ClusterInput()

horizontal_grip_slots = ClusterInput()
vertical_grip_slot_1 = ClusterInput()
vertical_grip_slot_2 = ClusterInput()
vertical_grip_slots_3 = ClusterInput()

vertical_grip_slots_4 = ClusterInput()
data = Data(segment_length)
X_2 = UnitX(Factor=1)
xz = XZPlane(Origin=Point(0, 0, 0))
pt_6 = ConstructPoint(XCoordinate=0, YCoordinate=0, ZCoordinate=0)
pt_7 = Point(reinforcer_pts)
pt_8 = Point(space_invader_points)
pt_9 = Point(intersection_points)
mirror = Mirror(Geometry=vertical_grip_slot_2, Plane=xz)  # -> Geometry, Transform
neg_2 = Negative(Value=X_2)
pline = PolyLine(Vertices=pt_dovetail, Closed=False)
line = LineSDL(Start=pt_6, Direction=neg_2, Length=data)
line_2 = LineSDL(Start=pt_6, Direction=X_2, Length=data)
fillet = Fillet(Curve=pline, Radius=Slider(8, range=0..41))
merge_3 = Merge(Data1=fillet, Data2=move_2.Geometry, Data3=cull_i)  # -> flatten(Result)
merge_4 = Merge(Data1=line_2, Data2=line)
merge_5 = Merge(Data1=line_2, Data2=line)
join = JoinCurves(Curves=merge_3, Preserve=False)
neg_3 = Negative(Value="0.25")
join_2 = JoinCurves(Curves=simplify(merge_5), Preserve=False)  # -> simplify(Curves)
panel = Panel(join_2)
rotate = Rotate(Geometry=join, Angle=1.570796327, Plane=PlaneXY(0, 0, 0))  # -> Geometry, Transform
lng = ListLength(List=intersection_points)
offset = Offset(Curve=rotate.Geometry, Distance="0.25", Plane=PlaneXY(0, 0, 0), Corners=1)
offset_2 = Offset(Curve=rotate.Geometry, Distance=neg_3, Plane=PlaneXY(0, 0, 0), Corners=1)
reinforcer_points = Slider(0, range=0..4)
null = NullItem(Item=lng)  # -> NullFlags, InvalidFlags, Description
equals = Equality(FirstNumber=lng, SecondNumber="2")  # -> Equality, Inequality
item_4 = ListItem(List=join_2, Index=0, Wrap=True)
dispatch_4 = Dispatch(List=join_2, DispatchPattern=equals.Equality)  # -> ListA, ListB
dispatch_5 = Dispatch(List=join_2, DispatchPattern=null.NullFlags)  # -> ListA, ListB
dispatch_6 = Dispatch(List=grip_points, DispatchPattern=null.NullFlags)  # -> ListA, ListB
dispatch_7 = Dispatch(List=grip_points, DispatchPattern=equals.Equality)  # -> ListA, ListB
crv_cp_2 = CurveClosestPoint(Point=pt_7, Curve=join_2)  # -> Point, Parameter, Distance
crv_3 = Curve(simplify([dispatch_4.ListB, dispatch_5.ListA]))
pt_10 = Point(dispatch_7.ListA)
crv_4 = Curve(dispatch_4.ListA)
pt_11 = Point([dispatch_7.ListB, dispatch_6.ListA])

# ----
# Column Intersection: This takes the intersection points of the column with the Internal Profile to generate notches in the floor and ceiling sheathing panels so the columns can protrude through.
intersection_column = ClusterInput()
pt_12 = Point(intersection_column)
multiplication = Multiplication(A=tolerance_2, B=2)
dispatch_8 = Dispatch(List=pt_12, DispatchPattern=[True, False])  # -> ListA, ListB
X_3 = UnitX(Factor=multiplication)
division_7 = Division(A=beam_width_2, B=2)
neg_4 = Negative(Value=X_3)
neg_5 = Negative(Value=division)
addition_2 = Addition(A=division_7, B=multiplication)
move_3 = Move(Geometry=dispatch_8.ListA, Motion=flatten(X_3))  # -> Geometry, Transform
move_4 = Move(Geometry=dispatch_8.ListB, Motion=flatten(neg_4))  # -> Geometry, Transform
Y_4 = UnitY(Factor=neg_5)
Y_5 = UnitY(Factor=addition_2)
move_5 = Move(Geometry=[move_3.Geometry, move_4.Geometry], Motion=flatten(Y_4))  # -> Geometry, Transform
move_6 = Move(Geometry=move_5.Geometry, Motion=flatten(Y_5))  # -> Geometry, Transform
rev = ReverseList(List=move_6.Geometry)
pt_13 = Point([move_5.Geometry, rev])
shift = ShiftList(List=pt_13, Shift=1, Wrap=True)

shatter_4 = Shatter(Curve=join_2, Parameters=crv_cp_2.Parameter)  # -> simplify(Segments)
crv_cp_3 = CurveClosestPoint(Point=intersection_points, Curve=crv_4)  # -> Point, Parameter, Distance
dispatch_9 = Dispatch(List=shatter_4, DispatchPattern=[True, False])  # -> ListA, ListB
shatter_5 = Shatter(Curve=crv_4, Parameters=crv_cp_3.Parameter)
reinforcer = Geometry(dispatch_9.ListA)
branch = TreeBranch(Tree=reinforcer, Path=reinforcer_points, MaintainPaths=True)
regular = Geometry(dispatch_9.ListB)
dispatch_10 = Dispatch(List=shatter_5, DispatchPattern=[True, False])  # -> simplify(ListA), ListB
pt_14 = Point(connector_points)
branch_2 = TreeBranch(Tree=pt_14, Path=reinforcer_points, MaintainPaths=True)
merge_6 = Merge(Data1=dispatch_10.ListA, Data2=crv_3)  # -> simplify(Result)
colom = CollisionOneMany(Collider=pt_14, Obstacles=reinforcer)  # -> Collision, Index
crv_5 = Curve(simplify(merge_6))
colom_2 = CollisionOneMany(Collider=pt_10, Obstacles=crv_5)  # -> Collision, Index
dispatch_11 = Dispatch(List=pt_10, DispatchPattern=colom_2.Collision)  # -> ListA, ListB
merge_7 = Merge(Data1=pt_11, Data2=dispatch_11.ListA)
pt_15 = Point(merge_7)
colom_3 = CollisionOneMany(Collider=pt_15, Obstacles=reinforcer)  # -> Collision, Index
dispatch_12 = Dispatch(List=pt_15, DispatchPattern=colom_3.Collision)  # -> ListA, ListB
dispatch_13 = Dispatch(List=pt_14, DispatchPattern=colom.Collision)  # -> ListA, ListB
reinforcer_grip_pts = Geometry(dispatch_12.ListA)
reinforcer_connector_pts = Geometry(dispatch_13.ListA)
regular_grip_pts = Geometry(dispatch_12.ListB)
connector_grip_pts = Geometry(dispatch_13.ListB)
len_2 = Length(Curve=crv_5)
pt_16 = ConstructPoint(XCoordinate=0, YCoordinate=0, ZCoordinate=0)
end_3 = EndPoints(Curve=crv_5)  # -> Start, End
subtraction_3 = Subtraction(A=len_2, B=Slider(50, range=0..61))
division_8 = Division(A=ply_thickness_2, B=2)
colom_4 = CollisionOneMany(Collider=reinforcer_grip_pts, Obstacles=regular_grip_pts)  # -> Collision, Index
colom_5 = CollisionOneMany(Collider=reinforcer_grip_pts, Obstacles=reinforcer_connector_pts)  # -> Collision, Index
pt_17 = Point(end_3.Start)
eval_3 = EvaluateLength(Curve=crv_5, Length=subtraction_3, Normalized=False)  # -> Point, Tangent, Parameter
dispatch_14 = Dispatch(List=reinforcer_grip_pts, DispatchPattern=colom_5.Collision)  # -> ListA, ListB
dispatch_15 = Dispatch(List=regular_grip_pts, DispatchPattern=colom_4.Collision)  # -> ListA, ListB
Y_6 = UnitY(Factor=division_8)
ln = Line(StartPoint=pt_17, EndPoint=eval_3.Point)
geo_3 = Geometry(dispatch_14.ListA)
geo_4 = Geometry(dispatch_14.ListB)
geo_5 = Geometry(dispatch_15.ListA)
move_7 = Move(Geometry=pt_16, Motion=flatten(Y_6))  # -> Geometry, Transform
orient = OrientDirection(
    Geometry=flatten(vertical_grip_slots_3),
    PointA=flatten(move_7.Geometry),
    DirectionA=Vector(0, 0, 1),
    PointB=reinforcer_connector_pts,
    DirectionB=Vector(0, 0, 1))  # -> Geometry, Transform
pt_18 = Point(regular_grip_pts)
cp = ClosestPoint(Point=pt_8, Cloud=pt_18)  # -> simplify(ClosestPoint), simplify(CPIndex), Distance
merge_8 = Merge(Data1=reinforcer_connector_pts, Data2=geo_4, Data3=connector_grip_pts, Data4=cp.ClosestPoint)
cull_i_2 = CullIndex(List=pt_18, Indices=cp.CPIndex, Wrap=True)
pt_19 = ConstructPoint(XCoordinate=0, YCoordinate=0, ZCoordinate=0)
pt_20 = ConstructPoint(XCoordinate=0, YCoordinate=0, ZCoordinate=0)
orient_2 = OrientDirection(
    Geometry=flatten(vertical_grip_slot_1),
    PointA=flatten(pt_19),
    DirectionA=Vector(0, 0, 1),
    PointB=pt_15,
    DirectionB=Vector(0, 0, 1))  # -> simplify(Geometry), Transform
orient_3 = OrientDirection(
    Geometry=flatten(vertical_grip_slot_2),
    PointA=flatten(pt_20),
    DirectionA=Vector(0, 0, 1),
    PointB=cp.ClosestPoint,
    DirectionB=Vector(0, 0, 1))  # -> simplify(Geometry), Transform
orient_4 = OrientDirection(
    Geometry=flatten(mirror.Geometry),
    PointA=flatten(pt_20),
    DirectionA=Vector(0, 0, 1),
    PointB=connector_grip_pts,
    DirectionB=Vector(0, 0, 1))  # -> simplify(Geometry), Transform
_2 = Number(2)
division_9 = Division(A=beam_width_2, B=_2)
subtraction_4 = Subtraction(A=division_9, B=division_8)
pt_21 = Point(simplify(shift))
Y_7 = UnitY(Factor=subtraction_4)
multiplication_2 = Multiplication(A=ply_thickness_2, B=3.5)
path_mapper = PathMapper(crv_5, source=["{A}", "{A;B}", "{A;B;C}", "{A;B;C;D}"], target=["{A}", "{A}", "{A}", "{A}"])
clean = CleanTree(RemoveNulls=True, RemoveInvalid=True, RemoveEmpty=True, Tree=pt_21)
neg_6 = Negative(Value=division)
pline_2 = PolyLine(Vertices=clean, Closed=False)  # -> simplify(Polyline)
path_mapper_2 = PathMapper(pline_2, source=["{A}", "{A;B}", "{A;B;C}", "{A;B;C;D}"], target=["{A}", "{A}", "{A}", "{A}"])
subtraction_5 = Subtraction(A=division_9, B=multiplication_2)
Y_8 = UnitY(Factor=neg_6)
Y_9 = UnitY(Factor=subtraction_5)
move_8 = Move(Geometry=path_mapper, Motion=flatten(Y_8))  # -> Geometry, Transform
null_2 = NullItem(Item=path_mapper_2)  # -> NullFlags, InvalidFlags, Description
end_4 = EndPoints(Curve=path_mapper_2)  # -> Start, End
dispatch_16 = Dispatch(List=move_8.Geometry, DispatchPattern=null_2.NullFlags)  # -> simplify(ListA), ListB
pt_22 = Point([end_4.Start, end_4.End])
clean_2 = CleanTree(RemoveNulls=True, RemoveInvalid=True, RemoveEmpty=True, Tree=dispatch_16.ListA)
clean_3 = CleanTree(RemoveNulls=True, RemoveInvalid=True, RemoveEmpty=True, Tree=dispatch_16.ListB)
end_5 = EndPoints(Curve=clean_3)  # -> Start, End
cp_2 = ClosestPoint(Point=end_5.End, Cloud=pt_22)  # -> ClosestPoint, CPIndex, Distance
cp_3 = ClosestPoint(Point=end_5.Start, Cloud=pt_22)  # -> ClosestPoint, CPIndex, Distance
pline_3 = PolyLine(Vertices=[cp_3.ClosestPoint, end_5.Start], Closed=False)
pline_4 = PolyLine(Vertices=[end_5.End, cp_2.ClosestPoint], Closed=False)
merge_9 = Merge(Data1=pline_3, Data2=pline_4)
pt_23 = ConstructPoint(XCoordinate=0, YCoordinate=0, ZCoordinate=0)
beam_width_3 = Number(beam_width_2)
join_3 = JoinCurves(Curves=merge_9, Preserve=False)  # -> simplify(Curves)
orient_5 = OrientDirection(
    Geometry=flatten(horizontal_grip_slots),
    PointA=flatten(pt_23),
    DirectionA=Vector(0, 0, 1),
    PointB=pt_14,
    DirectionB=Vector(0, 0, 1))  # -> Geometry, Transform
merge_10 = Merge(Data1=join_3, Data2=pline_2)
clean_4 = CleanTree(RemoveNulls=True, RemoveInvalid=True, RemoveEmpty=True, Tree=join_3)
merge_11 = Merge(Data1=clean_4, Data2=clean_2)  # -> simplify(Result)
division_10 = Division(A=beam_width_3, B=2)
xz_2 = XZPlane(Origin=Point(0, 0, 0))
join_4 = JoinCurves(Curves=merge_10, Preserve=False)  # -> simplify(Curves)
merge_12 = Merge(Data1=join_4, Data2=clean_2)  # -> simplify(Result)
addition_3 = Addition(A=division_10, B=neg_6)
panel_2 = Panel(clean_4)
neg_7 = Negative(Value=Y_8)
neg_8 = Negative(Value=addition_3)
mirror_2 = Mirror(Geometry=merge_12, Plane=xz_2)  # -> Geometry, Transform
end_6 = EndPoints(Curve=mirror_2.Geometry)  # -> Start, End
end_7 = EndPoints(Curve=merge_12)  # -> Start, End
Y_10 = UnitY(Factor=neg_8)
move_9 = Move(Geometry=merge_11, Motion=flatten(neg_7))  # -> Geometry, Transform
ln_2 = Line(StartPoint=end_7.End, EndPoint=end_6.End)
ln_3 = Line(StartPoint=end_7.Start, EndPoint=end_6.Start)
move_10 = Move(Geometry=merge_11, Motion=flatten(Y_10))  # -> Geometry, Transform
xz_3 = XZPlane(Origin=Point(0, 0, 0))
mirror_3 = Mirror(Geometry=move_9.Geometry, Plane=xz_3)  # -> Geometry, Transform
join_5 = JoinCurves(Curves=[ln_3, mirror_2.Geometry, ln_2, merge_12], Preserve=False)  # -> simplify(Curves)
path_mapper_3 = PathMapper(join_5, source=["{A}", "{A;B}", "{A;B;C}", "{A;B;C;D}"], target=["{A}", "{A}", "{A}", "{A}"])
end_8 = EndPoints(Curve=move_10.Geometry)  # -> Start, End
end_9 = EndPoints(Curve=mirror_3.Geometry)  # -> Start, End
ln_4 = Line(StartPoint=end_9.Start, EndPoint=end_8.Start)
ln_5 = Line(StartPoint=end_9.End, EndPoint=end_8.End)
join_6 = JoinCurves(Curves=[mirror_3.Geometry, move_10.Geometry, ln_4, ln_5], Preserve=False)  # -> simplify(Curves)
division_11 = Division(A=beam_width_2, B=2)
boundary = BoundarySurfaces(Edges=join_6)
neg_9 = Negative(Value=division_11)
path_mapper_4 = PathMapper(boundary, source=["{A}", "{A;B}", "{A;B;C}", "{A;B;C;D}"], target=["{A}", "{A}", "{A}", "{A}"])
Y_11 = UnitY(Factor=neg_9)
len_3 = Length(Curve=crv_5)
xz_4 = XZPlane(Origin=Point(0, 0, 0))
larger = LargerThan(FirstNumber=len_3, SecondNumber=flatten(sheet_length))  # -> LargerThan, OrEqualTo
area = Slider(10000, range=0..20004)
_10000 = Text("10000")
neg_10 = Negative(Value=division)
Y_12 = UnitY(Factor=neg_10)
_10000_2 = Text("10000")
unit_no = ClusterInput()
unit_type = Data(unit_no)
reinforcer_points_2 = Slider(1, range=0..4)
concat = Concatenate(FragmentA=unit_type)  # -> flatten(Result)
path = ConstructPath(Indices=reinforcer_points_2)
number_slider_3 = Slider(40, range=0..61)
concat_2 = Concatenate(FragmentA=concat, FragmentB=" / FLOOR / ")
concat_3 = Concatenate(FragmentA=concat, FragmentB=" / CEIL / ")
addition_4 = Addition(A=gauge, B=Slider(100, range=0..7001))
pt_24 = ConstructPoint(XCoordinate=0, YCoordinate=0, ZCoordinate=0)
neg_11 = Negative(Value=addition_4)
Y_13 = UnitY(Factor=addition_4)
ply_thickness_4 = Number(ply_thickness_2)
Z = UnitZ(Factor=1)
Z_2 = UnitZ(Factor=flatten(ply_thickness_4))
division_12 = Division(A=ply_thickness_4, B=-2)
ply_thickness_5 = Number(ply_thickness_2)
Z_3 = UnitZ(Factor=division_12)
reinforcer_points_3 = Slider(0, range=0..4)
Z_4 = UnitZ(Factor=ply_thickness_5)
division_13 = Division(A=ply_thickness_5, B=-2)
Z_5 = UnitZ(Factor=division_13)
layers = CreateModifyLayers(LayerName="Internal Sheathing", DeleteLayer=False, enableFullPath=False)  # -> LayerNames, LayerFullPath
addition_5 = Addition(A=sheet_width, B=100)

# ----
# VERTICAL GRIP SLOTS 3 (2 x PLY THK)
# Ply Thk
# Tol
# Grip Len
# Grip Len + Tol
num_2 = Number(2)
division_14 = Division(A=grip_slot_length, B=num_2)
addition_6 = Addition(A=division_14, B=tolerance_2)
Y_14 = UnitY(Factor=addition_6)
pt_25 = Point(pt_5)
_1_3 = Number(1)
division_15 = Division(A=ply_thickness_2, B=_1_3)
addition_7 = Addition(A=division_15, B=tolerance_2)
X_4 = UnitX(Factor=addition_7)
X_5 = UnitX(Factor=tool_size_2)
neg_12 = Negative(Value=X_5)
neg_13 = Negative(Value=Y_3)
subtraction_6 = Subtraction(A=addition_6, B=tool_size_2)
yz = YZPlane(Origin=Point(0, 0, 0))
xz_5 = XZPlane(Origin=Point(0, 0, 0))

X_6 = UnitX(Factor=addition_6)
Y_15 = UnitY(Factor=addition_7)
X_7 = UnitX(Factor=subtraction_6)

move_11 = Move(Geometry=pt_25, Motion=X_6)  # -> Geometry, Transform
move_12 = Move(Geometry=move_11.Geometry, Motion=Y_15)  # -> Geometry, Transform
move_13 = Move(Geometry=move_12.Geometry, Motion=Y_2)  # -> Geometry, Transform
move_14 = Move(Geometry=move_13.Geometry, Motion=neg_12)  # -> Geometry, Transform
move_15 = Move(Geometry=move_14.Geometry, Motion=neg_13)  # -> Geometry, Transform
neg_14 = Negative(Value=X_7)
move_16 = Move(Geometry=move_15.Geometry, Motion=neg_14)  # -> Geometry, Transform
merge_13 = Merge(Data1=move_11.Geometry, Data2=move_13.Geometry, Data3=move_14.Geometry, Data4=move_15.Geometry, Data5=move_16.Geometry)
pline_5 = PolyLine(Vertices=merge_13, Closed=False)
crv_6 = Curve(pline_5)
mirror_4 = Mirror(Geometry=crv_6, Plane=yz)  # -> Geometry, Transform
join_7 = JoinCurves(Curves=[crv_6, mirror_4.Geometry], Preserve=False)
mirror_5 = Mirror(Geometry=join_7, Plane=xz_5)  # -> Geometry, Transform
join_8 = JoinCurves(Curves=[join_7, mirror_5.Geometry], Preserve=False)

orient_6 = OrientDirection(
    Geometry=flatten(join_8),
    PointA=flatten(move_7.Geometry),
    DirectionA=Vector(0, 0, 1),
    PointB=geo_4,
    DirectionB=Vector(0, 0, 1))  # -> Geometry, Transform
colom_6 = CollisionOneMany(Collider=orient_6.Geometry, Obstacles=orient.Geometry)  # -> Collision, Index
dispatch_17 = Dispatch(List=orient_6.Geometry, DispatchPattern=colom_6.Collision)  # -> ListA, ListB
merge_14 = Merge(Data1=orient.Geometry, Data2=dispatch_17.ListB)
geo_6 = Geometry(merge_14)
merge_15 = Merge(Data1=orient_6.Geometry, Data2=orient.Geometry)
null_3 = NullItem(Item=geo_6)  # -> NullFlags, InvalidFlags, Description
dispatch_18 = Dispatch(List=merge_15, DispatchPattern=null_3.NullFlags)  # -> ListA, ListB
merge_16 = Merge(Data1=orient_3.Geometry, Data2=orient_4.Geometry, Data3=geo_6, Data4=dispatch_18.ListA)
colom_7 = CollisionOneMany(Collider=orient_2.Geometry, Obstacles=merge_16)  # -> Collision, Index
dispatch_19 = Dispatch(List=orient_2.Geometry, DispatchPattern=colom_7.Collision)  # -> ListA, ListB
merge_17 = Merge(Data1=merge_16, Data2=dispatch_19.ListB)
move_17 = Move(Geometry=merge_17, Motion=flatten(Y_7))  # -> Geometry, Transform
move_18 = Move(Geometry=move_17.Geometry, Motion=flatten(Y_8))  # -> Geometry, Transform
mirror_6 = Mirror(Geometry=move_18.Geometry, Plane=xz_2)  # -> Geometry, Transform
merge_18 = Merge(Data1=mirror_6.Geometry, Data2=move_18.Geometry, Data3=orient_5.Geometry)
clean_5 = CleanTree(RemoveNulls=True, RemoveInvalid=True, RemoveEmpty=True, Tree=merge_18)
geo_7 = Geometry(clean_5)
merge_19 = Merge(Data1=path_mapper_3, Data2=geo_7)
mirror_7 = Mirror(Geometry=move_17.Geometry, Plane=xz_3)  # -> Geometry, Transform
geometry = Geometry(merge_19)
clean_6 = CleanTree(RemoveNulls=True, RemoveInvalid=True, RemoveEmpty=True, Tree=mirror_7.Geometry)
path_mapper_5 = PathMapper(clean_6, source=["{A}", "{A;B}", "{A;B;C}", "{A;B;C;D}"], target=["{A}", "{A}", "{A}", "{A}"])
boundary_2 = BoundarySurfaces(Edges=geometry)
srfsplit = SurfaceSplit(Surface=path_mapper_4, Curves=path_mapper_5)
path_mapper_6 = PathMapper(srfsplit, source="{A;B}", target="{A}")
dispatch_20 = Dispatch(List=boundary_2, DispatchPattern=flatten(larger.LargerThan))  # -> simplify(ListA), simplify(ListB)
area_2 = Area(Geometry=path_mapper_6)  # -> Area, Centroid
larger_2 = LargerThan(FirstNumber=area_2.Area, SecondNumber=area)  # -> LargerThan, OrEqualTo
dispatch_21 = Dispatch(List=path_mapper_6, DispatchPattern=larger_2.LargerThan)  # -> ListA, ListB
geo_8 = Geometry(dispatch_21.ListA)
move_19 = Move(Geometry=geo_8, Motion=flatten(Y_12))  # -> Geometry, Transform

# ----
# SCREW GUIDE HOLES
division_16 = Division(A=spacing_2, B=2)
X_8 = UnitX(Factor=division_16)
move_20 = Move(Geometry=pt_15, Motion=flatten(X_8))  # -> Geometry, Transform
drill_bit_size_radius = Slider(3, range=0..12)

divlength = DivideLength(Curve=ln, Length=flatten(division_16))  # -> simplify(Points), Tangents, Parameters
path_mapper_7 = PathMapper(divlength.Points, source="{A}", target="{A}")
path_mapper_8 = PathMapper(divlength.Points, source=["{A}", "{A;B}", "{A;B;C}"], target=["{A}", "{A}", "{A}"])
sort_pt = SortPoints(Points=divlength.Points)  # -> Points, Indices
lng_2 = ListLength(List=sort_pt.Points)
subtraction_7 = Subtraction(A=lng_2, B=1)
cull_i_3 = CullIndex(List=sort_pt.Points, Indices=0, Wrap=False)  # -> simplify(List)
cull_i_4 = CullIndex(List=sort_pt.Points, Indices=subtraction_7, Wrap=False)
path_mapper_9 = PathMapper(cull_i_3, source=["{A}", "{A;B}", "{A;B;C}", "{A;B;C;D}"], target=["{A}", "{A}", "{A}", "{A}"])

merge_20 = Merge(Data1=path_mapper_8, Data2=path_mapper_7)
xy = XYPlane(Origin=path_mapper_9)
cir = Circle(Plane=xy, Radius=drill_bit_size_radius)  # -> simplify(Circle)

move_21 = Move(Geometry=cir, Motion=flatten(Y_9))  # -> Geometry, Transform
merge_21 = Merge(Data1=move_17.Geometry, Data2=cir)
move_22 = Move(Geometry=move_21.Geometry, Motion=flatten(Y_8))  # -> Geometry, Transform
mirror_8 = Mirror(Geometry=move_22.Geometry, Plane=xz_2)  # -> simplify(Geometry), Transform
merge_22 = Merge(Data1=move_22.Geometry, Data2=mirror_8.Geometry)  # -> simplify(Result)
screw_guides = Geometry(merge_22)

buffer = Slider(200, range=100..2400)
subtraction_8 = Subtraction(A=sheet_length, B=buffer)
divlength_2 = DivideLength(Curve=crv_5, Length=flatten(subtraction_8))  # -> simplify(Points), Tangents, Parameters
cull_i_5 = CullIndex(List=divlength_2.Points, Indices=0, Wrap=True)  # -> simplify(List)
connector_pt = Point(pt_14)
division_17 = Division(A=spacing_2, B=2)
X_9 = UnitX(Factor=division_17)
move_23 = Move(Geometry=connector_pt, Motion=flatten(X_9))  # -> Geometry, Transform
division_18 = Division(A=dovetail_height_2, B=2)
neg_15 = Negative(Value=division)
Y_16 = UnitY(Factor=neg_15)
pt_26 = ConstructPoint(XCoordinate=0, YCoordinate=0, ZCoordinate=0)
X_10 = UnitX(Factor=division_18)
move_24 = Move(Geometry=pt_26, Motion=flatten(X_10))  # -> Geometry, Transform

path_mapper_10 = PathMapper(cull_i_5, source=["{A}", "{A;B}", "{A;B;C}", "{A;B;C;D}"], target=["{A}", "{A}", "{A}", "{A}"])

cp_4 = ClosestPoint(Point=path_mapper_10, Cloud=connector_pt)  # -> ClosestPoint, CPIndex, Distance
move_25 = Move(Geometry=cp_4.ClosestPoint, Motion=flatten(Y_16))  # -> Geometry, Transform
orient_7 = OrientDirection(
    Geometry=offset_2,
    PointA=move_24.Geometry,
    DirectionA=Vector(0, 0, 1),
    PointB=move_25.Geometry,
    DirectionB=Vector(0, 0, 1))  # -> Geometry, Transform

panel_3 = Panel(move_25.Geometry)
move_26 = Move(Geometry=move_25.Geometry, Motion=flatten(Y_11))  # -> Geometry, Transform
mirror_9 = Mirror(Geometry=move_25.Geometry, Plane=xz_4)  # -> Geometry, Transform
ln_6 = Line(StartPoint=move_25.Geometry, EndPoint=move_26.Geometry)
ln_7 = Line(StartPoint=move_25.Geometry, EndPoint=mirror_9.Geometry)
orient_8 = OrientDirection(
    Geometry=offset,
    PointA=move_24.Geometry,
    DirectionA=Vector(0, 0, 1),
    PointB=move_25.Geometry,
    DirectionB=Vector(0, 0, 1))  # -> Geometry, Transform
merge_23 = Merge(Data1=orient_8.Geometry, Data2=orient_7.Geometry)
ext = ExtendCurve(Curve=merge_23, Type=0, Start=flatten(division_11), End=flatten(division_11))  # -> simplify(Curve)
clean_7 = CleanTree(RemoveNulls=True, RemoveInvalid=True, RemoveEmpty=True, Tree=ext)  # -> simplify(Tree)
clean_8 = CleanTree(RemoveNulls=True, RemoveInvalid=True, RemoveEmpty=True, Tree=merge_23)
srfsplit_2 = SurfaceSplit(Surface=dispatch_20.ListA, Curves=clean_8)  # -> simplify(Fragments)
area_3 = Area(Geometry=srfsplit_2)  # -> Area, Centroid
larger_3 = LargerThan(FirstNumber=area_3.Area, SecondNumber=_10000)  # -> LargerThan, OrEqualTo
dispatch_22 = Dispatch(List=srfsplit_2, DispatchPattern=larger_3.LargerThan)  # -> ListA, ListB
clean_9 = CleanTree(RemoveNulls=True, RemoveInvalid=True, RemoveEmpty=True, Tree=dispatch_22.ListA)  # -> simplify(Tree)
srfsplit_3 = SurfaceSplit(Surface=move_19.Geometry, Curves=clean_7)  # -> simplify(Fragments)
path_mapper_11 = PathMapper(clean_9, source=["{A}", "{A;B}", "{A;B;C}", "{A;B;C;D}"], target=["{A}", "{A}", "{A}", "{A}"])
area_4 = Area(Geometry=srfsplit_3)  # -> Area, Centroid
merge_24 = Merge(Data1=dispatch_20.ListB, Data2=path_mapper_11)  # -> simplify(Result)
larger_4 = LargerThan(FirstNumber=area_4.Area, SecondNumber=_10000_2)  # -> LargerThan, OrEqualTo
geo_9 = Geometry(merge_24)
dispatch_23 = Dispatch(List=srfsplit_3, DispatchPattern=larger_4.LargerThan)  # -> ListA, ListB
area_5 = Area(Geometry=geo_9)  # -> Area, Centroid
larger_5 = LargerThan(FirstNumber=area_5.Area, SecondNumber=_10000)  # -> LargerThan, OrEqualTo
clean_10 = CleanTree(RemoveNulls=True, RemoveInvalid=True, RemoveEmpty=True, Tree=dispatch_23.ListA)  # -> simplify(Tree)
dispatch_24 = Dispatch(List=geo_9, DispatchPattern=larger_5.LargerThan)  # -> ListA, ListB
path_mapper_12 = PathMapper(clean_10, source=["{A}", "{A;B}"], target=["{0}", "{A}"])
geo_10 = Geometry(dispatch_24.ListA)
boxprop = BoxProperties(Box=geo_10)  # -> Center, Diagonal, Area, Volume, Degeneracy
pdecon = Deconstruct(Point=boxprop.Center)  # -> XComponent, YComponent, ZComponent
sort = SortList(Keys=pdecon.XComponent, ValuesA=geo_10)  # -> Keys, ValuesA
geo_11 = Geometry(simplify(sort.ValuesA))
srfsplit_4 = SurfaceSplit(Surface=geo_11, Curves=screw_guides)  # -> simplify(Fragments)
path_mapper_13 = PathMapper(srfsplit_4, source="{A}", target="{A}")
path_mapper_14 = PathMapper(srfsplit_4, source="{A;B}", target="{A}")
merge_25 = Merge(Data1=path_mapper_13, Data2=path_mapper_14)
area_6 = Area(Geometry=merge_25)  # -> Area, Centroid
smaller = SmallerThan(FirstNumber=area_6.Area, SecondNumber=100)  # -> SmallerThan, OrEqualTo
tstat = TreeStatistics(Tree=geo_11)  # -> Paths, Length, Count
dispatch_25 = Dispatch(List=merge_25, DispatchPattern=smaller.SmallerThan)  # -> ListA, ListB
larger_6 = LargerThan(FirstNumber=tstat.Count, SecondNumber=1)  # -> LargerThan, OrEqualTo
geo_12 = Geometry(dispatch_25.ListB)
dispatch_26 = Dispatch(List=geo_12, DispatchPattern=larger_6.LargerThan)  # -> ListA, ListB
geo_13 = Geometry(flatten(dispatch_26.ListB))
geo_14 = Geometry(dispatch_26.ListA)
clean_11 = CleanTree(RemoveNulls=True, RemoveInvalid=True, RemoveEmpty=True, Tree=geo_13)
clean_12 = CleanTree(RemoveNulls=True, RemoveInvalid=True, RemoveEmpty=True, Tree=geo_14)
split = SplitTree(Data=clean_12, Masks=flatten(path))  # -> Positive, Negative
ceiling = Geometry(split.Positive)
floor = Geometry([split.Negative, clean_11])
labelling = Labelling_7(geometry=floor, wall_label=concat_2, text_size=number_slider_3)  # -> geometry_3, path_mapper_6
labelling_2 = Labelling_7(geometry=ceiling, wall_label=concat_3, text_size=number_slider_3)  # -> geometry_3, path_mapper_6
clean_13 = CleanTree(RemoveNulls=True, RemoveInvalid=True, RemoveEmpty=True, Tree=geo_11)
tstat_2 = TreeStatistics(Tree=clean_13)  # -> Paths, Length, Count
arrlinear = LinearArray(Geometry=pt_24, Direction=Y_13, Count=tstat_2.Count)  # -> flatten(Geometry), Transform
merge_26 = Merge(Data1=labelling_2.geometry_3, Data2=labelling.geometry_3)
merge_27 = Merge(Data1=labelling_2.path_mapper_6, Data2=labelling.path_mapper_6)
clean_14 = CleanTree(RemoveNulls=True, RemoveInvalid=True, RemoveEmpty=False, Tree=merge_27)
orient_9 = OrientDirection(
    Geometry=merge_26,
    PointA=Point(0, 0, 0),
    DirectionA=Z,
    PointB=graft(arrlinear.Geometry),
    DirectionB=graft(Vector(0, 0, 1)))  # -> simplify(Geometry), Transform
orient_10 = OrientDirection(Geometry=clean_14, PointA=Point(0, 0, 0), DirectionA=Z, PointB=graft(arrlinear.Geometry), DirectionB=Vector(0, 0, 1))  # -> simplify(Geometry), Transform
orient_11 = OrientDirection(
    Geometry=path_mapper_12,
    PointA=Point(0, 0, 0),
    DirectionA=Z,
    PointB=graft(arrlinear.Geometry),
    DirectionB=graft(Vector(0, 0, 1)))  # -> simplify(Geometry), Transform
clean_15 = CleanTree(RemoveNulls=True, RemoveInvalid=True, RemoveEmpty=False, Tree=clean_14)
extr = Extrude(Base=path_mapper_12, Direction=Z_2)
data_2 = Data(simplify(clean_15))
wires = BrepWireframe(Brep=orient_9.Geometry, Density=-1)  # -> simplify(Wireframe)
move_27 = Move(Geometry=extr, Motion=flatten(Z_3))  # -> Geometry, Transform
wires_2 = BrepWireframe(Brep=orient_11.Geometry, Density=-1)  # -> simplify(Wireframe)
txt = Text(data_2)
extr_2 = Extrude(Base=geo_11, Direction=flatten(Z_4))
split_2 = TextSplit(Text=txt, Separators=":")
geo_15 = Geometry(move_27.Geometry)
join_9 = JoinCurves(Curves=wires_2, Preserve=False)  # -> simplify(Curves)
item_5 = ListItem(List=split_2, Index=1, Wrap=True)  # -> simplify(Item)
join_10 = JoinCurves(Curves=wires, Preserve=False)  # -> simplify(Curves)
move_28 = Move(Geometry=extr_2, Motion=flatten(Z_5))  # -> Geometry, Transform
branch_3 = TreeBranch(Tree=simplify(geo_15), Path=reinforcer_points_3, MaintainPaths=True)
merge_28 = Merge(Data1=join_10, Data2=simplify(graft(orient_10.Geometry)))
createatts = CreateAttributes(Name=item_5, LayerName=layers.LayerNames, enableFullPath=False)
multiplication_3 = Multiplication(A=tstat_2.Count, B=addition_5)
geo_16 = Geometry(move_28.Geometry)
neg_16 = Negative(Value=multiplication_3)
group = Group(Objects=merge_28)
path_mapper_15 = PathMapper(createatts, source=["{A}", "{A;B}"], target=["{A}", "{A}"])
Y_17 = UnitY(Factor=neg_16)
move_29 = Move(Geometry=join_9, Motion=flatten(Y_17))  # -> Geometry, Transform
move_30 = Move(Geometry=group, Motion=flatten(Y_17))  # -> Geometry, Transform
data_3 = Data(path_mapper_15)
path_mapper_16 = PathMapper(move_29.Geometry, source=["{A}", "{A;B}"], target=["{A}", "{A}"])
path_mapper_17 = PathMapper(move_30.Geometry, source=["{A}", "{A;B}"], target=["{A}", "{A}"])
trim_2d_geo = ClusterOutput(path_mapper_16)
_3d_trimmers = ClusterOutput(geo_15)
attributes = ClusterOutput(data_3)
_2d_geo = ClusterOutput(path_mapper_17)
_3d = ClusterOutput(geo_16)

# ==== cluster SheatingPanel_4
fin_depth = ClusterInput()
# PARAMETERS
gauge = ClusterInput()
dovetail_height = ClusterInput()
beam_width = ClusterInput()
grip_slot_length = ClusterInput()
spacing = ClusterInput()
ply_thickness = ClusterInput()

vertical_grip_slot_1 = ClusterInput()
vertical_grip_slot_2 = ClusterInput()
vertical_grip_slot_4 = ClusterInput()
geo = Geometry(vertical_grip_slot_1)
geo_2 = Geometry(vertical_grip_slot_2)
geo_3 = Geometry(vertical_grip_slot_4)

num = Number(fin_depth)
ply_thickness_2 = Number(ply_thickness)
grip_slot_length_2 = Number(grip_slot_length)
beam_width_2 = Number(beam_width)
spacing_2 = Number(spacing)
division = Division(A=gauge, B=2)
division_2 = Division(A=beam_width_2, B=2)
X = UnitX(Factor=gauge)
pt_0 = ConstructPoint(XCoordinate=0, YCoordinate=0, ZCoordinate=0)
move_pt_1 = Move(Geometry=pt_0, Motion=X)  # -> Geometry, Transform
ln_sheet_top_edge = Line(StartPoint=pt_0, EndPoint=move_pt_1.Geometry)

# ----
# DOVETAIL (DT)
Y = UnitY(Factor=dovetail_height)
crv_male = Curve(reparameterize(ln_sheet_top_edge))
_1 = Number(1)
_1_2 = Number(1)
neg = Negative(Value=Y)
move = Move(Geometry=ln_sheet_top_edge, Motion=neg)  # -> Geometry, Transform
eval_x_10 = Evaluate(F="x/10", x=_1_2)
eval_x_15 = Evaluate(F="x/15", x=_1_2)
eval_x_20 = Evaluate(F="x/20", x=_1_2)
eval_x_10_2 = Evaluate(F="x/10", x=_1)
eval_x_15_2 = Evaluate(F="x/15", x=_1)
eval_x_30 = Evaluate(F="x/30", x=_1)
_6 = Number(6)
_5 = Number(5)
_5_2 = Number(5)
_6_2 = Number(6)
crv_female = Curve(reparameterize(move.Geometry))
# Tool Width
repeat = RepeatData(Data=eval_x_10, Length=_5)
repeat_2 = RepeatData(Data=eval_x_15, Length=_6)
repeat_3 = RepeatData(Data=eval_x_15_2, Length=_5_2)
repeat_4 = RepeatData(Data=eval_x_10_2, Length=_6_2)
weave = Weave(Pattern=[0, 1], Stream0=repeat_2, Stream1=repeat, NullGaps=False)
weave_2 = Weave(Pattern=[0, 1], Stream0=repeat_4, Stream1=repeat_3, NullGaps=False)
ins = InsertItems(List=weave, Item=eval_x_20, Indices=0, Wrap=False)
ins_2 = InsertItems(List=weave_2, Item=eval_x_30, Indices=0, Wrap=False)
ma = MassAddition(Input=ins)  # -> Result, PartialResults
ma_2 = MassAddition(Input=ins_2)  # -> Result, PartialResults
shatter = Shatter(Curve=crv_female, Parameters=ma.PartialResults)
shatter_2 = Shatter(Curve=crv_male, Parameters=ma_2.PartialResults)
dispatch = Dispatch(List=shatter, DispatchPattern=[True, False])  # -> ListA, ListB
dispatch_2 = Dispatch(List=shatter_2, DispatchPattern=[True, False])  # -> ListA, ListB
crv = Curve(dispatch.ListA)
crv_2 = Curve(dispatch_2.ListB)
end = EndPoints(Curve=crv)  # -> Start, End
end_2 = EndPoints(Curve=crv_2)  # -> Start, End
pt = Point(end_2.End)
pt_2 = Point(end.Start)
pt_3 = Point(end_2.Start)
pt_4 = Point(end.End)
weave_3 = Weave(Pattern=[0, 1, 2, 3], Stream0=pt_2, Stream1=pt_4, Stream2=pt_3, Stream3=pt, NullGaps=False)
pt_dovetail = Point(weave_3)

intersection_points = ClusterInput()
grip_points = ClusterInput()
segment_length = ClusterInput()
space_invader_points = ClusterInput()
reinforcer_pts = ClusterInput()
sheet_width = ClusterInput()
sheet_length = ClusterInput()
clean = CleanTree(RemoveNulls=True, RemoveInvalid=True, RemoveEmpty=True, Tree=intersection_points)
pt_5 = Point(reinforcer_pts)
pt_6 = Point(space_invader_points)
pt_7 = ConstructPoint(XCoordinate=0, YCoordinate=0, ZCoordinate=0)
X_2 = UnitX(Factor=1)
pt_8 = Point(clean)
neg_2 = Negative(Value=X_2)
line = LineSDL(Start=pt_7, Direction=neg_2, Length=segment_length)
line_2 = LineSDL(Start=pt_7, Direction=X_2, Length=segment_length)
join = JoinCurves(Curves=[line_2, line], Preserve=False)  # -> simplify(Curves)
lng = ListLength(List=pt_8)
null = NullItem(Item=lng)  # -> NullFlags, InvalidFlags, Description
equals = Equality(FirstNumber=lng, SecondNumber="2")  # -> Equality, Inequality
dispatch_3 = Dispatch(List=join, DispatchPattern=equals.Equality)  # -> ListA, ListB
dispatch_4 = Dispatch(List=join, DispatchPattern=null.NullFlags)  # -> ListA, ListB
dispatch_5 = Dispatch(List=grip_points, DispatchPattern=null.NullFlags)  # -> ListA, ListB
dispatch_6 = Dispatch(List=grip_points, DispatchPattern=equals.Equality)  # -> ListA, ListB
crv_cp = CurveClosestPoint(Point=pt_5, Curve=join)  # -> Point, Parameter, Distance
pt_9 = Point(dispatch_6.ListA)
crv_3 = Curve(dispatch_3.ListA)
crv_4 = Curve([dispatch_3.ListB, dispatch_4.ListA])
pt_10 = Point([dispatch_6.ListB, dispatch_5.ListA])
merge = Merge(Data1=crv_3, Data2=crv_4)
shatter_3 = Shatter(Curve=join, Parameters=crv_cp.Parameter)  # -> simplify(Segments)
crv_cp_2 = CurveClosestPoint(Point=pt_8, Curve=crv_3)  # -> Point, Parameter, Distance
dispatch_7 = Dispatch(List=shatter_3, DispatchPattern=[True, False])  # -> ListA, ListB
shatter_4 = Shatter(Curve=crv_3, Parameters=crv_cp_2.Parameter)
reinforcer = Geometry(dispatch_7.ListA)
regular = Geometry(dispatch_7.ListB)
dispatch_8 = Dispatch(List=shatter_4, DispatchPattern=[True, False])  # -> simplify(ListA), ListB
merge_2 = Merge(Data1=dispatch_8.ListA, Data2=crv_4)
crv_5 = Curve(merge_2)
colom = CollisionOneMany(Collider=pt_9, Obstacles=crv_5)  # -> Collision, Index
dispatch_9 = Dispatch(List=pt_9, DispatchPattern=colom.Collision)  # -> ListA, ListB
merge_3 = Merge(Data1=pt_10, Data2=dispatch_9.ListA)
pt_11 = Point(merge_3)
colom_2 = CollisionOneMany(Collider=pt_11, Obstacles=reinforcer)  # -> Collision, Index
dispatch_10 = Dispatch(List=pt_11, DispatchPattern=colom_2.Collision)  # -> ListA, ListB
len = Length(Curve=crv_5)
reinforcer_grip_pts = Geometry(dispatch_10.ListA)
regular_grip_pts = Geometry(dispatch_10.ListB)
end_3 = EndPoints(Curve=crv_5)  # -> Start, End
subtraction = Subtraction(A=len, B=Slider(50, range=0..61))
pt_12 = Point(end_3.Start)
eval = EvaluateLength(Curve=crv_5, Length=subtraction, Normalized=False)  # -> Point, Tangent, Parameter
ln = Line(StartPoint=pt_12, EndPoint=eval.Point)
pline = PolyLine(Vertices=pt_dovetail, Closed=False)
fillet = Fillet(Curve=pline, Radius=Slider(5, range=0..41))
rotate = Rotate(Geometry=fillet, Angle=1.570796327, Plane=PlaneXY(0, 0, 0))  # -> Geometry, Transform
neg_3 = Negative(Value="0.25")
offset = Offset(Curve=rotate.Geometry, Distance="0.25", Plane=PlaneXY(0, 0, 0), Corners=1)
offset_2 = Offset(Curve=rotate.Geometry, Distance=neg_3, Plane=PlaneXY(0, 0, 0), Corners=1)
reinforcer_points = Slider(1, range=0..4)
branch = TreeBranch(Tree=simplify(crv_5), Path=reinforcer_points, MaintainPaths=True)
reinforcer_points_2 = Slider(1, range=0..4)
pt_13 = ConstructPoint(XCoordinate=0, YCoordinate=0, ZCoordinate=0)
division_3 = Division(A=ply_thickness_2, B=2)
pt_14 = Point(pt_6)
pt_15 = Point(regular_grip_pts)
Y_2 = UnitY(Factor=division_3)
_2 = Number(2)
cp = ClosestPoint(Point=pt_6, Cloud=pt_15)  # -> simplify(ClosestPoint), simplify(CPIndex), Distance
branch_2 = TreeBranch(Tree=pt_6, Path=reinforcer_points_2, MaintainPaths=True)
branch_3 = TreeBranch(Tree=pt_15, Path=reinforcer_points_2, MaintainPaths=True)
move_2 = Move(Geometry=pt_13, Motion=flatten(Y_2))  # -> Geometry, Transform
division_4 = Division(A=beam_width_2, B=_2)
cull_i = CullIndex(List=pt_15, Indices=cp.CPIndex, Wrap=True)
pcen = PolygonCenter(Polyline=geo)  # -> CenterV, CenterE, CenterA
pt_16 = ConstructPoint(XCoordinate=0, YCoordinate=0, ZCoordinate=0)
subtraction_2 = Subtraction(A=division_4, B=division_3)
orient = OrientDirection(
    Geometry=flatten(geo_3),
    PointA=flatten(move_2.Geometry),
    DirectionA=Vector(0, 0, 1),
    PointB=reinforcer_grip_pts,
    DirectionB=Vector(0, 0, 1))  # -> simplify(Geometry), Transform
orient_2 = OrientDirection(
    Geometry=flatten(geo_2),
    PointA=flatten(pt_16),
    DirectionA=Vector(0, 0, 1),
    PointB=cp.ClosestPoint,
    DirectionB=Vector(0, 0, 1))  # -> simplify(Geometry), Transform
orient_3 = OrientDirection(
    Geometry=flatten(geo),
    PointA=flatten(pcen.CenterA),
    DirectionA=Vector(0, 0, 1),
    PointB=pt_15,
    DirectionB=Vector(0, 0, 1))  # -> simplify(Geometry), Transform
multiplication = Multiplication(A=ply_thickness_2, B=3.5)
Y_3 = UnitY(Factor=subtraction_2)
subtraction_3 = Subtraction(A=subtraction_2, B=multiplication)
Y_4 = UnitY(Factor=subtraction_3)
merge_4 = Merge(Data1=orient_2.Geometry, Data2=orient_3.Geometry, Data3=orient.Geometry)
neg_4 = Negative(Value=division_2)
move_3 = Move(Geometry=merge_4, Motion=flatten(Y_3))  # -> Geometry, Transform
Y_5 = UnitY(Factor=neg_4)
geo_4 = Geometry(crv_5)
xz = XZPlane(Origin=Point(0, 0, 0))
geo_5 = Geometry(geo_4)
move_4 = Move(Geometry=geo_4, Motion=flatten(Y_5))  # -> Geometry, Transform
merge_5 = Merge(Data2=move_4.Geometry)
mirror = Mirror(Geometry=move_3.Geometry, Plane=xz)  # -> Geometry, Transform
end_4 = EndPoints(Curve=geo_5)  # -> Start, End
end_5 = EndPoints(Curve=merge_5)  # -> Start, End
ln_2 = Line(StartPoint=end_5.Start, EndPoint=end_4.Start)
ln_3 = Line(StartPoint=end_5.End, EndPoint=end_4.End)
join_2 = JoinCurves(Curves=[ln_2, geo_5, ln_3, merge_5], Preserve=False)  # -> simplify(Curves)
boundary = BoundarySurfaces(Edges=join_2)
srfsplit = SurfaceSplit(Surface=boundary, Curves=mirror.Geometry)
xz_2 = XZPlane(Origin=Point(0, 0, 0))
path_mapper = PathMapper(srfsplit, source="{A;B}", target="{A}")
merge_6 = Merge(Data2=move_4.Geometry)
mirror_2 = Mirror(Geometry=move_3.Geometry, Plane=xz_2)  # -> Geometry, Transform
mirror_3 = Mirror(Geometry=merge_6, Plane=xz_2)  # -> Geometry, Transform
area = Slider(10000, range=0..20004)
end_6 = EndPoints(Curve=mirror_3.Geometry)  # -> Start, End
buffer = Slider(200, range=0..2400)
area_2 = Area(Geometry=path_mapper)  # -> Area, Centroid
end_7 = EndPoints(Curve=merge_6)  # -> Start, End
merge_7 = Merge(Data1=mirror_2.Geometry, Data2=move_3.Geometry)
ln_4 = Line(StartPoint=end_7.Start, EndPoint=end_6.Start)
larger = LargerThan(FirstNumber=area_2.Area, SecondNumber=area)  # -> LargerThan, OrEqualTo
ln_5 = Line(StartPoint=end_7.End, EndPoint=end_6.End)
join_3 = JoinCurves(Curves=[ln_4, mirror_3.Geometry, ln_5, merge_6], Preserve=False)  # -> simplify(Curves)
slots = Geometry(merge_7)
dispatch_11 = Dispatch(List=path_mapper, DispatchPattern=larger.LargerThan)  # -> ListA, ListB
panel = Panel(slots)
geo_6 = Geometry(dispatch_11.ListA)
boundary_2 = BoundarySurfaces(Edges=join_3)
srfsplit_2 = SurfaceSplit(Surface=boundary_2, Curves=slots)
neg_5 = Negative(Value=buffer)
reinforcer_points_3 = Slider(0, range=0..4)
area_3 = Area(Geometry=srfsplit_2)  # -> Area, Centroid
_10000 = Text("10000")
X_3 = UnitX(Factor=neg_5)
larger_2 = LargerThan(FirstNumber=area_3.Area, SecondNumber=_10000)  # -> LargerThan, OrEqualTo
dispatch_12 = Dispatch(List=srfsplit_2, DispatchPattern=larger_2.LargerThan)  # -> ListA, ListB
path_mapper_2 = PathMapper(dispatch_12.ListA, source="{A;B}", target="{A}")
branch_4 = TreeBranch(Tree=geo_6, Path=reinforcer_points_3, MaintainPaths=True)
wires = BrepWireframe(Brep=path_mapper_2, Density=-1)
join_4 = JoinCurves(Curves=wires, Preserve=False)  # -> simplify(Curves)
boundary_3 = BoundarySurfaces(Edges=join_4)
xz_3 = XZPlane(Origin=Point(0, 0, 0))
geo_7 = Geometry(boundary_3)
_10000_2 = Text("10000")
merge_8 = Merge(Data1=geo_6)
null_2 = NullItem()  # -> NullFlags, InvalidFlags, Description
dispatch_13 = Dispatch(List=merge_8, DispatchPattern=null_2.NullFlags)  # -> ListA, ListB
unit_no = ClusterInput()
bay_no = ClusterInput()
area_4 = Area(Geometry=dispatch_13.ListA)  # -> Area, Centroid
_10000_3 = Text("10000")
larger_3 = LargerThan(FirstNumber=area_4.Area, SecondNumber=_10000_3)  # -> LargerThan, OrEqualTo
unit_type = Data(unit_no)
bay_no_2 = Data(bay_no)
dispatch_14 = Dispatch(List=dispatch_13.ListA, DispatchPattern=larger_3.LargerThan)  # -> ListA, ListB
clean_2 = CleanTree(RemoveNulls=True, RemoveInvalid=True, RemoveEmpty=True, Tree=dispatch_14.ListA)  # -> simplify(Tree); disabled
concat = Concatenate(FragmentA=unit_type, FragmentB=bay_no_2)
ply_thickness_3 = Number(ply_thickness_2)
Z = UnitZ(Factor=flatten(ply_thickness_3))
division_5 = Division(A=ply_thickness_3, B=-2)
Z_2 = UnitZ(Factor=division_5)
concat_2 = Concatenate(FragmentB=unit_type)
number_slider = Slider(40, range=0..61)
concat_3 = Concatenate(FragmentA=concat_2, FragmentB="/ COL /")
concat_4 = Concatenate(FragmentA=concat_2, FragmentB="/ COL /")
addition = Addition(A=beam_width_2, B=Slider(100, range=0..7001))
pt_17 = ConstructPoint(XCoordinate=0, YCoordinate=0, ZCoordinate=0)
X_4 = UnitX(Factor=addition)
Y_6 = UnitY(Factor=addition)
ply_thickness_4 = Number(ply_thickness_2)
Z_3 = UnitZ(Factor=1)
Z_4 = UnitZ(Factor=flatten(ply_thickness_4))
division_6 = Division(A=ply_thickness_4, B=-2)
Z_5 = UnitZ(Factor=division_6)
txt = Text("Internal Sheathing")
reinforcer_points_4 = Slider(1, range=0..4)
layers = CreateModifyLayers(LayerName=txt, DeleteLayer=False, enableFullPath=False)  # -> LayerNames, LayerFullPath

# ----
# SCREW GUIDE HOLES
division_7 = Division(A=spacing_2, B=2)
X_5 = UnitX(Factor=division_7)
move_5 = Move(Geometry=pt_11, Motion=flatten(X_5))  # -> Geometry, Transform
drill_bit_size_radius = Slider(3, range=0..12)

divlength = DivideLength(Curve=ln, Length=flatten(division_7))  # -> Points, Tangents, Parameters
path_mapper_3 = PathMapper(divlength.Points, source="{A}", target="{A}")
path_mapper_4 = PathMapper(divlength.Points, source="{A;B}", target="{A}")
sort_pt = SortPoints(Points=move_5.Geometry)  # -> Points, Indices
lng_2 = ListLength(List=sort_pt.Points)
subtraction_4 = Subtraction(A=lng_2, B=1)
cull_i_2 = CullIndex(List=sort_pt.Points, Indices=0, Wrap=False)  # -> simplify(List)
cull_i_3 = CullIndex(List=sort_pt.Points, Indices=subtraction_4, Wrap=False)

merge_9 = Merge(Data1=path_mapper_4, Data2=path_mapper_3)
xy = XYPlane(Origin=cull_i_3)
cir = Circle(Plane=xy, Radius=drill_bit_size_radius)  # -> simplify(Circle)

path_mapper_5 = PathMapper(cull_i_2, source="{A}", target="{A}")
path_mapper_6 = PathMapper(cull_i_2, source="{A;B}", target="{A}")
merge_10 = Merge(Data1=path_mapper_6, Data2=path_mapper_5)
branch_5 = TreeBranch(Tree=simplify(merge_10), Path=reinforcer_points, MaintainPaths=True)
move_6 = Move(Geometry=cir, Motion=flatten(Y_4))  # -> Geometry, Transform
move_7 = Move(Geometry=move_6.Geometry, Motion=flatten(Y_5))  # -> Geometry, Transform
mirror_4 = Mirror(Geometry=move_7.Geometry, Plane=xz_2)  # -> simplify(Geometry), Transform
merge_11 = Merge(Data1=move_7.Geometry, Data2=mirror_4.Geometry)  # -> simplify(Result)
screw_guides = Geometry(merge_11)

buffer_2 = Slider(0, range=0..2400)
subtraction_5 = Subtraction(A=sheet_length, B=buffer_2)
divlength_2 = DivideLength(Curve=crv_5, Length=flatten(subtraction_5))  # -> Points, Tangents, Parameters
cull_i_4 = CullIndex(List=divlength_2.Points, Indices=0, Wrap=True)  # -> simplify(List)
division_8 = Division(A=spacing_2, B=2)
pt_18 = Point(pt_11)
X_6 = UnitX(Factor=division_8)
move_8 = Move(Geometry=pt_18, Motion=flatten(X_6))  # -> Geometry, Transform
division_9 = Division(A=dovetail_height, B=2)
neg_6 = Negative(Value=division_2)
Y_7 = UnitY(Factor=neg_6)
pt_19 = ConstructPoint(XCoordinate=0, YCoordinate=0, ZCoordinate=0)
X_7 = UnitX(Factor=division_9)
move_9 = Move(Geometry=pt_19, Motion=flatten(X_7))  # -> Geometry, Transform

path_mapper_7 = PathMapper(cull_i_4, source=["{A}", "{A;B}"], target=["{A}", "{A}"])
move_10 = Move(Geometry=path_mapper_7, Motion=flatten(X_3))  # -> Geometry, Transform

cp_2 = ClosestPoint(Point=move_10.Geometry, Cloud=move_8.Geometry)  # -> ClosestPoint, CPIndex, Distance
move_11 = Move(Geometry=cp_2.ClosestPoint, Motion=flatten(Y_7))  # -> Geometry, Transform
orient_4 = OrientDirection(
    Geometry=flatten([offset, offset_2]),
    PointA=flatten(move_9.Geometry),
    DirectionA=Vector(0, 0, 1),
    PointB=move_11.Geometry,
    DirectionB=Vector(0, 0, 1))  # -> Geometry, Transform

mirror_5 = Mirror(Geometry=move_11.Geometry, Plane=xz_3)  # -> Geometry, Transform
ln_6 = Line(StartPoint=mirror_5.Geometry, EndPoint=move_11.Geometry)
null_3 = NullItem(Item=ln_6)  # -> NullFlags, InvalidFlags, Description
srfsplit_3 = SurfaceSplit(Surface=geo_7, Curves=ln_6)  # -> simplify(Fragments)
dispatch_15 = Dispatch(List=geo_7, DispatchPattern=null_3.NullFlags)  # -> ListA, ListB
area_5 = Area(Geometry=dispatch_15.ListA)  # -> Area, Centroid
area_6 = Area(Geometry=srfsplit_3)  # -> Area, Centroid
larger_4 = LargerThan(FirstNumber=area_5.Area, SecondNumber=_10000_2)  # -> LargerThan, OrEqualTo
larger_5 = LargerThan(FirstNumber=area_6.Area, SecondNumber=_10000_2)  # -> LargerThan, OrEqualTo
dispatch_16 = Dispatch(List=dispatch_15.ListA, DispatchPattern=larger_4.LargerThan)  # -> ListA, ListB
dispatch_17 = Dispatch(List=srfsplit_3, DispatchPattern=larger_5.LargerThan)  # -> ListA, ListB
clean_3 = CleanTree(RemoveNulls=True, RemoveInvalid=True, RemoveEmpty=True, Tree=dispatch_16.ListA)  # -> simplify(Tree)
clean_4 = CleanTree(RemoveNulls=True, RemoveInvalid=True, RemoveEmpty=True, Tree=dispatch_17.ListA)  # -> simplify(Tree)
path_mapper_8 = PathMapper(clean_4, source="{A;B}", target="{A}")
path_mapper_9 = PathMapper(clean_4, source="{A}", target="{A}")
merge_12 = Merge(Data1=clean_3, Data2=path_mapper_8, Data3=path_mapper_9)
geo_8 = Geometry(merge_12)
area_7 = Area(Geometry=geo_8)  # -> Area, Centroid
larger_6 = LargerThan(FirstNumber=area_7.Area, SecondNumber=_10000_2)  # -> LargerThan, OrEqualTo
dispatch_18 = Dispatch(List=geo_8, DispatchPattern=larger_6.LargerThan)  # -> ListA, ListB
geo_9 = Geometry(dispatch_18.ListA)
merge_13 = Merge(Data1=geo_9)  # -> simplify(Result)
srfsplit_4 = SurfaceSplit(Surface=merge_13, Curves=screw_guides)  # -> simplify(Fragments)
path_mapper_10 = PathMapper(srfsplit_4, source="{A;B}", target="{A}")
area_8 = Area(Geometry=path_mapper_10)  # -> Area, Centroid
smaller = SmallerThan(FirstNumber=area_8.Area, SecondNumber=100)  # -> SmallerThan, OrEqualTo
dispatch_19 = Dispatch(List=path_mapper_10, DispatchPattern=smaller.SmallerThan)  # -> ListA, ListB
geo_10 = Geometry(dispatch_19.ListB)
srfsplit_5 = SurfaceSplit(Surface=merge_8, Curves=ln_6)  # -> simplify(Fragments)
rev = ReverseList(List=geo_10)
rotate_2 = Rotate(Geometry=rev, Angle=1.570796327, Plane=PlaneXY(0, 0, 0))  # -> Geometry, Transform
area_9 = Area(Geometry=srfsplit_5)  # -> Area, Centroid
area_10 = Area(Geometry=rotate_2.Geometry)  # -> Area, Centroid
larger_7 = LargerThan(FirstNumber=area_9.Area, SecondNumber=_10000_3)  # -> LargerThan, OrEqualTo
pdecon = Deconstruct(Point=area_10.Centroid)  # -> XComponent, YComponent, ZComponent
dispatch_20 = Dispatch(List=srfsplit_5, DispatchPattern=larger_7.LargerThan)  # -> ListA, ListB
sort = SortList(Keys=pdecon.YComponent, ValuesA=rotate_2.Geometry)  # -> Keys, ValuesA
clean_5 = CleanTree(RemoveNulls=True, RemoveInvalid=True, RemoveEmpty=True, Tree=dispatch_20.ListA)  # -> simplify(Tree)
geo_11 = Geometry(sort.ValuesA)
path_mapper_11 = PathMapper(clean_5, source="{A;B}", target="{A}")
path_mapper_12 = PathMapper(clean_5, source="{A}", target="{A}")
tstat = TreeStatistics(Tree=geo_11)  # -> Paths, Length, Count
subtraction_6 = Subtraction(A=tstat.Count, B=1)
merge_14 = Merge(Data1=clean_2, Data2=path_mapper_11, Data3=path_mapper_12)
branch_6 = TreeBranch(Tree=geo_11, Path="{0}", MaintainPaths=True)
branch_7 = TreeBranch(Tree=geo_11, Path=subtraction_6, MaintainPaths=True)
merge_15 = Merge(Data1=branch_6, Data2=branch_7)
tstat_2 = TreeStatistics(Tree=merge_15)  # -> Paths, Length, Count
extr = Extrude(Base=merge_13, Direction=Z)
split = SplitTree(Data=geo_11, Masks=flatten(tstat_2.Paths))  # -> Positive, Negative
move_12 = Move(Geometry=extr, Motion=flatten(Z_2))  # -> Geometry, Transform
walls = Geometry(merge_15)
roof = Geometry(split.Negative)
geo_12 = Geometry(move_12.Geometry)
labelling = Labelling_8(geometry=walls, wall_label=concat_4, part_label=" ", text_size=number_slider)  # -> geometry_3, G
labelling_2 = Labelling_8(geometry=roof, wall_label=concat_3, part_label=" ", text_size=number_slider)  # -> geometry_3, G
arrlinear = LinearArray(Geometry=pt_17, Direction=X_4, Count=tstat.Count)  # -> Geometry, Transform
merge_16 = Merge(Data1=labelling.geometry_3, Data2=labelling_2.geometry_3)
merge_17 = Merge(Data1=labelling.G, Data2=labelling_2.G)
clean_6 = CleanTree(RemoveNulls=True, RemoveInvalid=True, RemoveEmpty=True, Tree=merge_17)
clean_7 = CleanTree(RemoveNulls=True, RemoveInvalid=True, RemoveEmpty=False, Tree=merge_17)
data = Data(simplify(clean_7))
txt_2 = Text(data)
orient_5 = OrientDirection(Geometry=clean_6, PointA=Point(0, 0, 0), DirectionA=Z_3, PointB=graft(arrlinear.Geometry), DirectionB=Vector(0, 0, 1))  # -> simplify(graft(Geometry)), Transform
orient_6 = OrientDirection(
    Geometry=merge_16,
    PointA=Point(0, 0, 0),
    DirectionA=Z_3,
    PointB=graft(arrlinear.Geometry),
    DirectionB=graft(Vector(0, 0, 1)))  # -> simplify(Geometry), Transform
extr_2 = Extrude(Base=merge_14, Direction=Z_4)
split_2 = TextSplit(Text=txt_2, Separators=":")
item = ListItem(List=split_2, Index=1, Wrap=True)  # -> simplify(Item)
move_13 = Move(Geometry=extr_2, Motion=flatten(Z_5))  # -> Geometry, Transform
clean_8 = CleanTree(RemoveNulls=True, RemoveInvalid=True, RemoveEmpty=True, Tree=orient_5.Geometry)
wires_2 = BrepWireframe(Brep=orient_6.Geometry, Density=-1)  # -> simplify(Wireframe)
area_11 = Area(Geometry=orient_6.Geometry)  # -> Area, Centroid
createatts = CreateAttributes(Name=item, LayerName=layers.LayerNames, enableFullPath=False)
geo_13 = Geometry(move_13.Geometry)
join_5 = JoinCurves(Curves=wires_2, Preserve=False)  # -> simplify(Curves)
path_mapper_13 = PathMapper(createatts, source="{A;B}", target="{A}")
branch_8 = TreeBranch(Tree=simplify(geo_13), Path=reinforcer_points_4, MaintainPaths=True)
_3d_trimmers = ClusterOutput(geo_13)
_3d = ClusterOutput(geo_12)
path_mapper_14 = PathMapper(join_5, source="{A;B}", target="{A}")
merge_18 = Merge(Data1=join_5, Data2=clean_8)
data_2 = Data(path_mapper_13)
group = Group(Objects=merge_18)
attrib = ClusterOutput(data_2)
_2d_geo = ClusterOutput(group)

# ==== cluster VerticalGripSlot1
tolerance = ClusterInput()
ply_thickness = ClusterInput()
tool_size = ClusterInput()
tolerance_2 = Number(tolerance)
ply_thickness_2 = Number(ply_thickness)
tool_size_2 = Number(tool_size)
# Ply Thk
# Tol
division = Division(A=tool_size_2, B=2)
A = ClusterInput()
pt = ConstructPoint(XCoordinate=0, YCoordinate=0, ZCoordinate=0)
Y = UnitY(Factor=division)

# ----
# VERTICAL GRIP SLOTS 1
# Ply Thk
# Grip Len
# Tol
# Grip Len + Tol
# (Grip len + Tol) - Tool Depth
# TOOL DEPTH
# Ply Thk
_2 = Number(2)
# Tol
division_2 = Division(A=A, B=_2)
addition = Addition(A=division_2, B=tolerance_2)
Y_2 = UnitY(Factor=addition)
pt_2 = Point(pt)
_2_2 = Number(2)
division_3 = Division(A=ply_thickness_2, B=_2_2)
addition_2 = Addition(A=division_3, B=tolerance_2)
tool_depth = Slider(10, range=1..20)
X = UnitX(Factor=addition_2)
Y_3 = UnitY(Factor=division)
neg = Negative(Value=Y)
subtraction = Subtraction(A=addition, B=tool_depth)
Y_4 = UnitY(Factor=subtraction)
yz = YZPlane(Origin=Point(0, 0, 0))
xz = XZPlane(Origin=Point(0, 0, 0))

X_2 = UnitX(Factor=addition)
Y_5 = UnitY(Factor=addition_2)
X_3 = UnitX(Factor=tool_depth)
X_4 = UnitX(Factor=subtraction)

move = Move(Geometry=pt_2, Motion=X_2)  # -> Geometry, Transform
move_2 = Move(Geometry=move.Geometry, Motion=Y_5)  # -> Geometry, Transform
neg_2 = Negative(Value=X_3)
move_3 = Move(Geometry=move_2.Geometry, Motion=Y_3)  # -> Geometry, Transform
move_4 = Move(Geometry=move_3.Geometry, Motion=neg_2)  # -> Geometry, Transform
move_5 = Move(Geometry=move_4.Geometry, Motion=neg)  # -> Geometry, Transform
neg_3 = Negative(Value=X_4)
move_6 = Move(Geometry=move_5.Geometry, Motion=neg_3)  # -> Geometry, Transform
merge = Merge(Data1=move.Geometry, Data2=move_3.Geometry, Data3=move_4.Geometry, Data4=move_5.Geometry, Data5=move_6.Geometry)
pline = PolyLine(Vertices=merge, Closed=False)
crv = Curve(pline)
mirror = Mirror(Geometry=crv, Plane=yz)  # -> Geometry, Transform
join = JoinCurves(Curves=[crv, mirror.Geometry], Preserve=False)
mirror_2 = Mirror(Geometry=join, Plane=xz)  # -> Geometry, Transform
join_2 = JoinCurves(Curves=[join, mirror_2.Geometry], Preserve=False)

C = ClusterOutput(join_2)

# ==== cluster VerticalGripSlot2
space_invader_slot_size = ClusterInput()
ply_thickness = ClusterInput()
tolerance = ClusterInput()
tool_size = ClusterInput()
space_invader_size = Number(space_invader_slot_size)
tool_size_2 = Number(tool_size)
ply_thickness_2 = Number(ply_thickness)
tolerance_2 = Number(tolerance)
division = Division(A=tool_size_2, B=2)
A = ClusterInput()
subtraction = Subtraction(A=space_invader_size, B=ply_thickness_2)
subtraction_2 = Subtraction(A=subtraction, B=tool_size_2)

# ----
# VERTICAL GRIP SLOTS 2
_2 = Number(2)
division_2 = Division(A=ply_thickness_2, B=_2)
addition = Addition(A=division_2, B=tolerance_2)
neg = Negative(Value=addition)
Y = UnitY(Factor=neg)
_2_2 = Number(2)
division_3 = Division(A=A, B=_2_2)
pt = ConstructPoint(XCoordinate=0, YCoordinate=0, ZCoordinate=0)
addition_2 = Addition(A=division_3, B=tolerance_2)
move = Move(Geometry=pt, Motion=Y)  # -> Geometry, Transform
subtraction_3 = Subtraction(A=addition_2, B=tool_size_2)
X = UnitX(Factor=tool_size_2)
Y_2 = UnitY(Factor=division)
X_2 = UnitX(Factor=subtraction_3)
pt_2 = Point(move.Geometry)
move_2 = Move(Geometry=pt_2, Motion=X_2)  # -> Geometry, Transform
neg_2 = Negative(Value=Y_2)
addition_3 = Addition(A=addition, B=division)
move_3 = Move(Geometry=move_2.Geometry, Motion=neg_2)  # -> Geometry, Transform
_2_3 = Number(2)
multiplication = Multiplication(A=addition_3, B=_2_3)
move_4 = Move(Geometry=move_3.Geometry, Motion=X)  # -> Geometry, Transform
Y_3 = UnitY(Factor=multiplication)
move_5 = Move(Geometry=move_4.Geometry, Motion=Y_3)  # -> Geometry, Transform
X_3 = UnitX(Factor=tool_size_2)
neg_3 = Negative(Value=X_3)
move_6 = Move(Geometry=move_5.Geometry, Motion=neg_3)  # -> Geometry, Transform
neg_4 = Negative(Value=Y_2)
move_7 = Move(Geometry=move_6.Geometry, Motion=neg_4)  # -> Geometry, Transform
subtraction_4 = Subtraction(A=addition_2, B=addition)
subtraction_5 = Subtraction(A=subtraction_4, B=tool_size_2)
X_4 = UnitX(Factor=subtraction_5)
neg_5 = Negative(Value=X_4)
_20 = Number(20)
Y_4 = UnitY(Factor=subtraction_2)
move_8 = Move(Geometry=move_7.Geometry, Motion=neg_5)  # -> Geometry, Transform
move_9 = Move(Geometry=move_8.Geometry, Motion=Y_4)  # -> Geometry, Transform
X_5 = UnitX(Factor=division)
move_10 = Move(Geometry=move_9.Geometry, Motion=X_5)  # -> Geometry, Transform
Y_5 = UnitY(Factor=tool_size_2)
addition_4 = Addition(A=addition, B=division)
move_11 = Move(Geometry=move_10.Geometry, Motion=Y_5)  # -> Geometry, Transform
X_6 = UnitX(Factor=addition_4)
neg_6 = Negative(Value=X_6)
move_12 = Move(Geometry=move_11.Geometry, Motion=neg_6)  # -> Geometry, Transform
merge = Merge(
    Data1=move.Geometry,
    Data2=move_2.Geometry,
    Data3=move_3.Geometry,
    Data4=move_4.Geometry,
    Data5=move_5.Geometry,
    Data6=move_6.Geometry,
    Data7=move_7.Geometry,
    Data8=move_8.Geometry,
    Data9=move_9.Geometry,
    Data10=move_10.Geometry,
    Data11=move_11.Geometry,
    Data12=move_12.Geometry)
pline = PolyLine(Vertices=merge, Closed=False)
yz = YZPlane(Origin=Point(0, 0, 0))
crv = Curve(pline)
mirror = Mirror(Geometry=crv, Plane=yz)  # -> Geometry, Transform
xz = XZPlane(Origin=Point(0, 0, 0))
join = JoinCurves(Curves=[crv, mirror.Geometry], Preserve=False)
mirror_2 = Mirror(Geometry=join, Plane=xz)  # -> Geometry, Transform

G = ClusterOutput(mirror_2.Geometry)

# ==== cluster VerticalGripSlots3
ply_thickness = ClusterInput()
tolerance = ClusterInput()
tool_size = ClusterInput()
ply_thickness_2 = Number(ply_thickness)
tolerance_2 = Number(tolerance)
tool_size_2 = Number(tool_size)
division = Division(A=tool_size_2, B=2)
_1 = Number(1)
division_2 = Division(A=ply_thickness_2, B=_1)
addition = Addition(A=division_2, B=tolerance_2)
neg = Negative(Value=addition)
Y = UnitY(Factor=neg)
A = ClusterInput()
pt = ConstructPoint(XCoordinate=0, YCoordinate=0, ZCoordinate=0)
Y_2 = UnitY(Factor=tool_size_2)
yz = YZPlane(Origin=Point(0, 0, 0))

# ----
# VERTICAL GRIP SLOTS 2
# Ply Thk
# Tol
# Grip Len
# Grip Len + Tol
_2 = Number(2)
division_3 = Division(A=ply_thickness_2, B=_2)
addition_2 = Addition(A=division_3, B=tolerance_2)
_2_2 = Number(2)
division_4 = Division(A=A, B=_2_2)
addition_3 = Addition(A=division_4, B=tolerance_2)
move = Move(Geometry=pt, Motion=Y)  # -> Geometry, Transform
subtraction = Subtraction(A=addition_3, B=tool_size_2)
X = UnitX(Factor=tool_size_2)
Y_3 = UnitY(Factor=division)
pt_2 = Point(move.Geometry)
neg_2 = Negative(Value=Y_3)
addition_4 = Addition(A=addition, B=division)
_2_3 = Number(2)
multiplication = Multiplication(A=addition_4, B=_2_3)
X_2 = UnitX(Factor=tool_size_2)
neg_3 = Negative(Value=X_2)
neg_4 = Negative(Value=Y_3)
subtraction_2 = Subtraction(A=addition_3, B=addition_2)
subtraction_3 = Subtraction(A=subtraction_2, B=tool_size_2)
_20 = Number(20)
Y_4 = UnitY(Factor=_20)
X_3 = UnitX(Factor=division)
addition_5 = Addition(A=addition_2, B=division)
xz = XZPlane(Origin=Point(0, 0, 0))

X_4 = UnitX(Factor=subtraction)
Y_5 = UnitY(Factor=multiplication)
X_5 = UnitX(Factor=subtraction_3)
X_6 = UnitX(Factor=addition_5)

move_2 = Move(Geometry=pt_2, Motion=X_4)  # -> Geometry, Transform
move_3 = Move(Geometry=move_2.Geometry, Motion=neg_2)  # -> Geometry, Transform
move_4 = Move(Geometry=move_3.Geometry, Motion=X)  # -> Geometry, Transform
move_5 = Move(Geometry=move_4.Geometry, Motion=Y_5)  # -> Geometry, Transform
move_6 = Move(Geometry=move_5.Geometry, Motion=neg_3)  # -> Geometry, Transform
move_7 = Move(Geometry=move_6.Geometry, Motion=neg_4)  # -> Geometry, Transform
neg_5 = Negative(Value=X_5)
move_8 = Move(Geometry=move_7.Geometry, Motion=neg_5)  # -> Geometry, Transform
move_9 = Move(Geometry=move_8.Geometry, Motion=Y_4)  # -> Geometry, Transform
move_10 = Move(Geometry=move_9.Geometry, Motion=X_3)  # -> Geometry, Transform
move_11 = Move(Geometry=move_10.Geometry, Motion=Y_2)  # -> Geometry, Transform
neg_6 = Negative(Value=X_6)
move_12 = Move(Geometry=move_11.Geometry, Motion=neg_6)  # -> Geometry, Transform
merge = Merge(
    Data1=move.Geometry,
    Data2=move_2.Geometry,
    Data3=move_3.Geometry,
    Data4=move_4.Geometry,
    Data5=move_5.Geometry,
    Data6=move_6.Geometry,
    Data7=move_7.Geometry,
    Data8=move_8.Geometry,
    Data9=move_9.Geometry,
    Data10=move_10.Geometry,
    Data11=move_11.Geometry,
    Data12=move_12.Geometry)
pline = PolyLine(Vertices=merge, Closed=False)
crv = Curve(pline)
mirror = Mirror(Geometry=crv, Plane=yz)  # -> Geometry, Transform
join = JoinCurves(Curves=[crv, mirror.Geometry], Preserve=False)
mirror_2 = Mirror(Geometry=join, Plane=xz)  # -> Geometry, Transform

C = ClusterOutput(join)

# ==== cluster HorizontalGripSlots
ply_thickness = ClusterInput()
tolerance = ClusterInput()
tool_size = ClusterInput()
ply_thickness_2 = Number(ply_thickness)
tolerance_2 = Number(tolerance)
tool_size_2 = Number(tool_size)
division = Division(A=tool_size_2, B=2)
pt = ConstructPoint(XCoordinate=0, YCoordinate=0, ZCoordinate=0)
tol_x2 = Multiplication(A=tolerance_2, B=2)
A = ClusterInput()
A_2 = ClusterInput()
X = UnitX(Factor=division)
X_2 = UnitX(Factor=division)
xz = XZPlane(Origin=Point(0, 0, 0))
xz_2 = XZPlane(Origin=Point(0, 0, 0))

# ----
# HORRIZONTAL GRIP SLOTS
# Hor Grip Width
# Hor Grip Width
# Ply Thk
# Tool Width
# Tool Width
# Tol
# Hor Grip Width
# Tool Width
# Ply Thk
# Tol
# Hor Grip Width
# Ply Thk
# Tool Width
# Tool Width
# Tol
# Hor Grip Width
# Tool Width
# Tool Depth
_2 = Number(2)
_2_2 = Number(2)
division_2 = Division(A=A, B=_2)
division_3 = Division(A=A_2, B=_2_2)
addition = Addition(A=division_2, B=division)
addition_2 = Addition(A=division_3, B=division)
pt_2 = Point(pt)
pt_3 = Point(pt)
neg = Negative(Value=tool_size_2)
neg_2 = Negative(Value=tool_size_2)
neg_3 = Negative(Value=division)
neg_4 = Negative(Value=division)
X_3 = UnitX(Factor=neg_3)
addition_3 = Addition(A=ply_thickness_2, B=tol_x2)
addition_4 = Addition(A=ply_thickness_2, B=tol_x2)
addition_5 = Addition(A=addition_3, B=division)
addition_6 = Addition(A=addition_4, B=division)
subtraction = Subtraction(A=addition_5, B=tool_size_2)
subtraction_2 = Subtraction(A=addition_6, B=tool_size_2)
neg_5 = Negative(Value=tool_size_2)
neg_6 = Negative(Value=tool_size_2)
X_4 = UnitX(Factor=neg_6)
subtraction_3 = Subtraction(A=division_2, B=tool_size_2)
subtraction_4 = Subtraction(A=division_3, B=tool_size_2)
_2_3 = Number(2)
_2_4 = Number(2)
addition_7 = Addition(A=ply_thickness_2, B=tol_x2)
_2_5 = Number(2)
division_4 = Division(A=addition_7, B=_2_5)

Y = UnitY(Factor=addition)
Y_2 = UnitY(Factor=addition_2)
X_5 = UnitX(Factor=neg)
X_6 = UnitX(Factor=neg_2)
Y_3 = UnitY(Factor=neg_3)
Y_4 = UnitY(Factor=neg_4)
X_7 = UnitX(Factor=subtraction_2)
X_8 = UnitX(Factor=subtraction)
Y_5 = UnitY(Factor=neg_6)
Y_6 = UnitY(Factor=neg_5)
Y_7 = UnitY(Factor=subtraction_4)
Y_8 = UnitY(Factor=subtraction_3)

move = Move(Geometry=pt_2, Motion=Y)  # -> Geometry, Transform
move_2 = Move(Geometry=pt_3, Motion=Y_2)  # -> Geometry, Transform
pt_4 = Point(move.Geometry)
pt_5 = Point(move_2.Geometry)
move_3 = Move(Geometry=pt_4, Motion=X_6)  # -> Geometry, Transform
move_4 = Move(Geometry=pt_5, Motion=X_5)  # -> Geometry, Transform
pt_6 = Point(move_3.Geometry)
pt_7 = Point(move_4.Geometry)
move_5 = Move(Geometry=pt_6, Motion=Y_3)  # -> Geometry, Transform
move_6 = Move(Geometry=pt_7, Motion=Y_4)  # -> Geometry, Transform
pt_8 = Point(move_5.Geometry)
pt_9 = Point(move_6.Geometry)
neg_7 = Negative(Value=X_8)
neg_8 = Negative(Value=X_7)
move_7 = Move(Geometry=pt_8, Motion=neg_7)  # -> Geometry, Transform
move_8 = Move(Geometry=pt_9, Motion=neg_8)  # -> Geometry, Transform
pt_10 = Point(move_7.Geometry)
pt_11 = Point(move_8.Geometry)
move_9 = Move(Geometry=pt_10, Motion=Y_6)  # -> Geometry, Transform
move_10 = Move(Geometry=pt_11, Motion=Y_5)  # -> Geometry, Transform
pt_12 = Point(move_9.Geometry)
pt_13 = Point(move_10.Geometry)
move_11 = Move(Geometry=pt_12, Motion=X)  # -> Geometry, Transform
move_12 = Move(Geometry=pt_13, Motion=X_2)  # -> Geometry, Transform
pt_14 = Point(move_11.Geometry)
pt_15 = Point(move_12.Geometry)
neg_9 = Negative(Value=Y_8)
neg_10 = Negative(Value=Y_7)
move_13 = Move(Geometry=pt_14, Motion=neg_9)  # -> Geometry, Transform
move_14 = Move(Geometry=pt_15, Motion=neg_10)  # -> Geometry, Transform
pt_16 = Point(move_13.Geometry)
pt_17 = Point(move_14.Geometry)
merge = Merge(Data1=pt_2, Data2=pt_4, Data3=pt_6, Data4=pt_8, Data5=pt_10, Data6=pt_12, Data7=pt_14, Data8=pt_16)
merge_2 = Merge(Data1=pt_3, Data2=pt_5, Data3=pt_7, Data4=pt_9, Data5=pt_11, Data6=pt_13, Data7=pt_15, Data8=pt_17)
pline = PolyLine(Vertices=flatten(merge), Closed=False)
pline_2 = PolyLine(Vertices=flatten(merge_2), Closed=False)
ln = Line(StartPoint=pt_2, EndPoint=pt_16)
ln_2 = Line(StartPoint=pt_3, EndPoint=pt_17)
crv = Curve(pline)
crv_2 = Curve(pline_2)
len = Length(Curve=ln)
len_2 = Length(Curve=ln_2)
division_5 = Division(A=len, B=_2_3)
division_6 = Division(A=len_2, B=_2_4)
eval = EvaluateLength(Curve=ln, Length=division_5, Normalized=False)  # -> Point, Tangent, Parameter
eval_2 = EvaluateLength(Curve=ln_2, Length=division_6, Normalized=False)  # -> Point, Tangent, Parameter
pl_origin = PlaneOrigin(Base=xz, Origin=eval.Point)
pl_origin_2 = PlaneOrigin(Base=xz_2, Origin=eval_2.Point)
mirror = Mirror(Geometry=crv, Plane=pl_origin)  # -> Geometry, Transform
mirror_2 = Mirror(Geometry=crv_2, Plane=pl_origin_2)  # -> Geometry, Transform
join = JoinCurves(Curves=flatten([crv, mirror.Geometry]), Preserve=False)
join_2 = JoinCurves(Curves=[crv_2, mirror_2.Geometry], Preserve=False)

X_9 = UnitX(Factor=division_4)
move_15 = Move(Geometry=join, Motion=X_9)  # -> Geometry, Transform
move_16 = Move(Geometry=join_2, Motion=X_9)  # -> Geometry, Transform
G = ClusterOutput(move_15.Geometry)

# ==== cluster VerticalGripSlots4
ply_thickness = ClusterInput()
grip_length = ClusterInput()
tool_size = ClusterInput()
tolerance = ClusterInput()
ply_thickness_2 = Number(ply_thickness)
grip_length_2 = Number(grip_length)
tool_size_2 = Number(tool_size)
tolerance_2 = Number(tolerance)
division = Division(A=tool_size_2, B=2)
pt = ConstructPoint(XCoordinate=0, YCoordinate=0, ZCoordinate=0)
Y = UnitY(Factor=division)
Y_2 = UnitY(Factor=division)

# ----
# VERTICAL GRIP SLOTS 4 (2 x PLY THK)
# Ply Thk
# Tol
# Grip Len
# Grip Len + Tol
num_2 = Number(2)
division_2 = Division(A=grip_length_2, B=num_2)
addition = Addition(A=division_2, B=tolerance_2)
pt_2 = Point(pt)
_1 = Number(1)
division_3 = Division(A=ply_thickness_2, B=_1)
addition_2 = Addition(A=division_3, B=tolerance_2)
X = UnitX(Factor=tool_size_2)
neg = Negative(Value=X)
subtraction = Subtraction(A=addition, B=tool_size_2)
neg_2 = Negative(Value=Y_2)
yz = YZPlane(Origin=Point(0, 0, 0))
xz = XZPlane(Origin=Point(0, 0, 0))

X_2 = UnitX(Factor=addition)
Y_3 = UnitY(Factor=addition_2)
X_3 = UnitX(Factor=subtraction)

move = Move(Geometry=pt_2, Motion=X_2)  # -> Geometry, Transform
move_2 = Move(Geometry=move.Geometry, Motion=Y_3)  # -> Geometry, Transform
move_3 = Move(Geometry=move_2.Geometry, Motion=Y)  # -> Geometry, Transform
move_4 = Move(Geometry=move_3.Geometry, Motion=neg)  # -> Geometry, Transform
move_5 = Move(Geometry=move_4.Geometry, Motion=neg_2)  # -> Geometry, Transform
neg_3 = Negative(Value=X_3)
move_6 = Move(Geometry=move_5.Geometry, Motion=neg_3)  # -> Geometry, Transform
merge = Merge(Data1=move.Geometry, Data2=move_3.Geometry, Data3=move_4.Geometry, Data4=move_5.Geometry, Data5=move_6.Geometry)
pline = PolyLine(Vertices=merge, Closed=False)
crv = Curve(pline)
mirror = Mirror(Geometry=crv, Plane=yz)  # -> Geometry, Transform
join = JoinCurves(Curves=[crv, mirror.Geometry], Preserve=False)
mirror_2 = Mirror(Geometry=join, Plane=xz)  # -> Geometry, Transform
join_2 = JoinCurves(Curves=[join, mirror_2.Geometry], Preserve=False)

C = ClusterOutput(join_2)

# ==== cluster DovetailSplit
number_slider = Slider(25, range=0..101)
pt = ConstructPoint(XCoordinate=0, YCoordinate=0, ZCoordinate=0)
F = ClusterInput()
subtraction = Subtraction(A=number_slider, B=Slider(20, range=0..101))
X = UnitX(Factor=number_slider)
neg = Negative(Value=X)
X_2 = UnitX(Factor=subtraction)
X_3 = UnitX(Factor=F)
neg_2 = Negative(Value=X_2)
neg_3 = Negative(Value=X_3)
Y = UnitY(Factor=Slider(20, range=0..101))
move = Move(Geometry=pt, Motion=X)  # -> Geometry, Transform
move_2 = Move(Geometry=pt, Motion=neg)  # -> Geometry, Transform
move_3 = Move(Geometry=pt, Motion=X_2)  # -> Geometry, Transform
move_4 = Move(Geometry=pt, Motion=neg_2)  # -> Geometry, Transform
move_5 = Move(Geometry=pt, Motion=X_3)  # -> Geometry, Transform
move_6 = Move(Geometry=pt, Motion=neg_3)  # -> Geometry, Transform
move_7 = Move(Geometry=[move.Geometry, move_2.Geometry], Motion=Y)  # -> Geometry, Transform
pt_2 = Point(flatten([move_5.Geometry, move_3.Geometry]))
pt_3 = Point(flatten([move_6.Geometry, move_4.Geometry]))
pline = PolyLine(Vertices=flatten([move_3.Geometry, move_7.Geometry, move_4.Geometry]), Closed=False)
pline_2 = PolyLine(Vertices=pt_2, Closed=False)
pline_3 = PolyLine(Vertices=pt_3, Closed=False)
join = JoinCurves(Curves=flatten([pline, pline_2, pline_3]), Preserve=False)
fillet = Fillet(Curve=join, Radius=Slider(5, range=0..101))
offset = Offset(Curve=fillet, Distance=Slider(0.5, range=0..1), Plane=PlaneXY(0, 0, 0), Corners=1)
geo = Geometry(flatten([offset, fillet]))
pt_4 = ClusterOutput(pt)
rotate = Rotate(Geometry=geo, Angle=degrees(90), Plane=PlaneXY(0, 0, 0))  # -> Geometry, Transform
xz = XZPlane(Origin=Point(0, 0, 0))
rotate_2 = Rotate(Geometry=rotate.Geometry, Angle=degrees(-90), Plane=xz)  # -> Geometry, Transform
G = ClusterOutput(rotate_2.Geometry)

# ==== cluster Labelling
geometry = ClusterInput()
geometry_2 = Geometry(geometry)
path_mapper = PathMapper(geometry_2, source="{A;B}", target="{A}")
path_mapper_2 = PathMapper(geometry_2, source="{A}", target="{A}")
geo = Geometry(flatten(path_mapper_2))
tstat = TreeStatistics(Tree=[path_mapper, path_mapper_2])  # -> Paths, Length, Count
split = TextSplit(Text=tstat.Paths, Separators="{")
item = ListItem(List=split, Index=1, Wrap=True)  # -> flatten(Item)
lng = ListLength(List=geometry_2)
split_2 = TextSplit(Text=item, Separators="}")
subtraction = Subtraction(A=lng, B=1)
item_2 = ListItem(List=split_2, Index=0, Wrap=True)  # -> flatten(Item)
dom = ConstructDomain(DomainStart=0, DomainEnd=subtraction)
panel = Panel("EW-")
wires = BrepWireframe(Brep=geometry_2, Density=-1)  # -> simplify(Wireframe)
panel_2 = Panel("/S-")
wall_label = ClusterInput()
range = Range(Domain=dom, Steps=subtraction)
join = JoinCurves(Curves=wires, Preserve=False)  # -> simplify(Curves)
concat = Concatenate(FragmentA=wall_label, FragmentB=item_2)
int = Integer(simplify(range))
addition = Addition(A=int, B=1)
path_mapper_3 = PathMapper(join, source="{A}", target="{A}")
path_mapper_4 = PathMapper(join, source="{A;B}", target="{A}")
part_label = ClusterInput()
concat_2 = Concatenate(FragmentA=wall_label, FragmentB=addition)  # -> simplify(Result)
area = Area(Geometry=geometry_2)  # -> Area, Centroid
text_size = ClusterInput()
merge = Merge(Data1=path_mapper_3, Data2=path_mapper_4)
concat_3 = Concatenate(FragmentA=concat_2, FragmentB=part_label)
xy = XYPlane(Origin=area.Centroid)
panel_3 = Panel(concat_3)
text = CreateText(Text=concat_3, Plane=xy, Size=text_size, Font="Arial", JustificationMode=65537)
subtraction_2 = Subtraction(A=text_size, B=Slider(15.107, range=0..61))
cir = Circle(Plane=xy, Radius=text_size)
len = TextLength(Text=text)
colom = CollisionOneMany(Collider=cir, Obstacles=merge)  # -> Collision, Index
multiplication = Multiplication(A=subtraction_2, B=len)
division = Division(A=text_size, B=2)
dispatch = Dispatch(List=text, DispatchPattern=colom.Collision)  # -> ListA, ListB
neg = Negative(Value=Slider(75, range=0..261))
division_2 = Division(A=multiplication, B=2)
neg_2 = Negative(Value=division)
collision = Geometry(dispatch.ListA)
neg_3 = Negative(Value=division_2)
no_collision = Geometry(dispatch.ListB)
Y = UnitY(Factor=neg)
move = Move(Geometry=collision, Motion=Y)  # -> Geometry, Transform
merge_2 = Merge(Data1=move.Geometry, Data2=no_collision)
Y_2 = UnitY(Factor=neg_2)
move_2 = Move(Geometry=text, Motion=Y_2)  # -> Geometry, Transform
X = UnitX(Factor=neg_3)
move_3 = Move(Geometry=move_2.Geometry, Motion=X)  # -> Geometry, Transform
geometry_3 = ClusterOutput(geometry_2)
G = ClusterOutput(move_3.Geometry)

# ==== cluster DogBonePocket_4
point = ClusterInput()
xz = XZPlane(Origin=point)

tool_size = Slider(10, range=0..20)
division = Division(A=tool_size, B="2")
multiplication = Multiplication(A=division, B=-1)
pt = Point(point)
X = UnitX(Factor=tool_size)

Z = UnitZ(Factor=multiplication)
rectangle = Rectangle(Plane=xz, XSize=tool_size, YSize=multiplication, Radius=0)  # -> Rectangle, Length

move = Move(Geometry=graft(pt), Motion=Z)  # -> Geometry, Transform
pt_2 = Point(flatten([pt, move.Geometry]))
move_2 = Move(Geometry=flatten(pt_2), Motion=X)  # -> Geometry, Transform
pt_3 = Point([pt_2, move_2.Geometry])
avr = Average(Input=pt_3)
xy = XYPlane(Origin=avr)
vec2pt = Vector2Pt(PointA=avr, PointB=pt_3, Unitize=False)  # -> Vector, Length
pcomp = PlaneComponents(Plane=xy)  # -> Origin, XAxis, YAxis, ZAxis
angle = Angle(VectorA=vec2pt.Vector, VectorB=pcomp.XAxis, Plane=xy)  # -> Angle, Reflex
sort = SortList(Keys=angle.Angle, ValuesA=pt_3)  # -> List, ValuesA
pt_4 = Point(sort.ValuesA)

cp = ControlPoints(Curve=rectangle.Rectangle)  # -> Points, Weights, Knots
points = PointList(Points=cp.Points)
item = ListItem(List=cp.Points, Index=[0, 1, 2], Wrap=True)
tool_size_2 = ClusterOutput(tool_size)
i = ClusterOutput(item)

# ==== cluster DogBonePocket_5
point = ClusterInput()
tool_size = Slider(10, range=0..20)
division = Division(A=tool_size, B="2")
xz = XZPlane(Origin=point)
multiplication = Multiplication(A=tool_size, B=-1)
multiplication_2 = Multiplication(A=division, B=-1)
Z = UnitZ(Factor=multiplication_2)
rectangle = Rectangle(Plane=xz, XSize=multiplication, YSize=division, Radius=0)  # -> Rectangle, Length
cp = ControlPoints(Curve=rectangle.Rectangle)  # -> Points, Weights, Knots
rev = ReverseList(List=cp.Points)
item = ListItem(List=rev, Index=[0, 1, 2], Wrap=True)
tool_size_2 = ClusterOutput(tool_size)
points = PointList(Points=rev)
i = ClusterOutput(item)

# ==== cluster RightWallRoofJointLocator
total_points_right_side = ClusterInput()
half_profile_curve = ClusterInput()
total_points_right_side_2 = Point(total_points_right_side)
split_profile_curve = Geometry(half_profile_curve)
true_false = ClusterInput()
sheet_length = ClusterInput()
d_joint_height = ClusterInput()
sheet_width = ClusterInput()
_2nd_floor_intersection_pt = ClusterInput()
column_intersection_pt = ClusterInput()
ply_thickness = ClusterInput()
fin_depth = ClusterInput()
number_slider = Slider(5, range=0..5)
eval = EvaluateLength(Curve=split_profile_curve, Length=0.5, Normalized=True)  # -> Point, Tangent, Parameter
devec = DeconstructVector(Vector=eval.Tangent)  # -> XComponent, YComponent, ZComponent
addition = Addition(A=devec.XComponent, B=number_slider)
panel = Panel(addition)
# Wall Curve
similar = Similarity(FirstNumber=addition, SecondNumber=number_slider, Threshold=0.1)  # -> Similarity, AbsoluteDifference
equals = Equality(FirstNumber=devec.XComponent, SecondNumber=0)  # -> Equality, Inequality
smaller = SmallerThan(FirstNumber=devec.XComponent, SecondNumber=0)  # -> SmallerThan, OrEqualTo
dispatch = Dispatch(List=split_profile_curve, DispatchPattern=similar.Similarity)  # -> ListA, ListB
lng = ListLength(List=dispatch.ListA)

# ----
# Roof Curve
# Roof 1st Section
geo = Geometry(dispatch.ListB)
item = ListItem(List=geo, Index=1, Wrap=True)
item_2 = ListItem(List=geo, Index=0, Wrap=True)
geo_2 = Geometry(item)
colom = CollisionOneMany(Collider=total_points_right_side_2, Obstacles=item_2)  # -> Collision, Index
dispatch_2 = Dispatch(List=total_points_right_side_2, DispatchPattern=colom.Collision)  # -> ListA, ListB
roof_1st_section_pts = Point(dispatch_2.ListA)

cps = ClosestPoints(Point=flatten(_2nd_floor_intersection_pt), Cloud=flatten(total_points_right_side_2), Count=2)  # -> ClosestPoint, CPIndex, Distance

l_or_w = Dispatch(List=sheet_width, DispatchPattern=true_false)  # -> ListA, ListB
# Wall Curve
# Base
# (2 Storey only)
l_or_w_2 = Dispatch(List=sheet_length, DispatchPattern=true_false)  # -> ListA, ListB
item_3 = ListItem(List=split_profile_curve, Index=0, Wrap=False)
division = Division(A=fin_depth, B=2)
flip = FlipCurve(Curve=item_3)  # -> Curve, Flag
len = Length(Curve=item_3)
addition_2 = Addition(A=division, B=ply_thickness)
panel_2 = Panel(len)
subtraction = Subtraction(A=[l_or_w.ListA, l_or_w_2.ListB], B=addition_2)
larger = LargerThan(FirstNumber=len, SecondNumber=sheet_length)  # -> LargerThan, OrEqualTo
panel_3 = Panel(subtraction)
subtraction_2 = Subtraction(A=subtraction, B=Slider(200, range=0..1001))
dispatch_3 = Dispatch(List=item_3, DispatchPattern=larger.OrEqualTo)  # -> ListA, ListB
eval_2 = EvaluateLength(Curve=item_3, Length=subtraction_2, Normalized=False)  # -> Point, Tangent, Parameter
eval_3 = EvaluateLength(Curve=dispatch_3.ListA, Length=len, Normalized=False)  # -> Point, Tangent, Parameter
cps_2 = ClosestPoints(Point=flatten(eval_2.Point), Cloud=flatten(total_points_right_side_2), Count=1)  # -> ClosestPoint, CPIndex, Distance

sort_pt = SortPoints(Points=cps.ClosestPoint)  # -> Points, Indices
item_4 = ListItem(List=sort_pt.Points, Index=1, Wrap=True)
item_5 = ListItem(List=sort_pt.Points, Index=0, Wrap=True)
null = NullItem(Item=sort_pt.Points)  # -> NullFlags, InvalidFlags, Description
dispatch_4 = Dispatch(List=item_4, DispatchPattern=null.NullFlags)  # -> ListA, ListB

subtraction_3 = Subtraction(A=lng, B=1)
l_or_w_3 = Dispatch(List=sheet_length, DispatchPattern=true_false)  # -> ListA, ListB
l_or_w_4 = Dispatch(List=sheet_width, DispatchPattern=true_false)  # -> ListA, ListB
item_6 = ListItem(List=dispatch.ListA, Index=subtraction_3, Wrap=True)
division_2 = Division(A=fin_depth, B=2)
len_2 = Length(Curve=item_6)
addition_3 = Addition(A=division_2, B=ply_thickness)
larger_2 = LargerThan(FirstNumber=len_2, SecondNumber=sheet_length)  # -> LargerThan, OrEqualTo
subtraction_4 = Subtraction(A=[l_or_w_4.ListA, l_or_w_3.ListB], B=addition_3)
panel_4 = Panel(len_2)
panel_5 = Panel(subtraction_4)
dispatch_5 = Dispatch(List=item_6, DispatchPattern=larger_2.OrEqualTo)  # -> ListA, ListB
subtraction_5 = Subtraction(A=subtraction_4, B=Slider(200, range=0..1001))
eval_4 = EvaluateLength(Curve=dispatch_5.ListA, Length=len_2, Normalized=False)  # -> Point, Tangent, Parameter
eval_5 = EvaluateLength(Curve=dispatch_5.ListA, Length=subtraction_5, Normalized=False)  # -> Point, Tangent, Parameter
dispatch_6 = Dispatch(List=eval_5.Point, DispatchPattern=null.NullFlags)  # -> ListA, ListB
cps_3 = ClosestPoints(Point=flatten([dispatch_6.ListA, dispatch_4.ListB]), Cloud=flatten(total_points_right_side_2), Count=1)  # -> ClosestPoint, CPIndex, Distance
dist = Distance(PointA=eval_4.Point, PointB=cps_3.ClosestPoint)

multiplication = Multiplication(A=d_joint_height, B=2)
subtraction_6 = Subtraction(A=sheet_length, B=multiplication)
Z = UnitZ(Factor=subtraction_6)
number_slider_2 = Slider(1200, range=0..2001)
multiplication_2 = Multiplication(A=d_joint_height, B=2)
subtraction_7 = Subtraction(A=sheet_length, B=multiplication_2)
join = JoinCurves(Curves=split_profile_curve, Preserve=False)
crv = Curve(join)

# ----
# Roof Apex
# Roof Corner
# Right
cps_4 = ClosestPoints(Point=flatten(column_intersection_pt), Cloud=flatten(total_points_right_side_2), Count=2)  # -> ClosestPoint, CPIndex, Distance
len_3 = Length(Curve=geo_2)
grndt_fl_wall_proximity_pts = Point(cps_2.ClosestPoint)
_2nd_fl_wall_proximity_pts = Point(sort_pt.Points)
eval_6 = EvaluateLength(Curve=geo_2, Length=len_3, Normalized=False)  # -> Point, Tangent, Parameter
column_roof_proximity_pts = Point(cps_4.ClosestPoint)
eval_7 = EvaluateLength(Curve=[dispatch_5.ListA, dispatch_5.ListB], Length=len_2, Normalized=False)  # -> Point, Tangent, Parameter
cps_5 = ClosestPoints(Point=flatten(eval_7.Point), Cloud=flatten(total_points_right_side_2), Count=2)  # -> ClosestPoint, CPIndex, Distance
cps_6 = ClosestPoints(Point=flatten(eval_6.Point), Cloud=flatten(total_points_right_side_2), Count=1)  # -> ClosestPoint, CPIndex, Distance
colom_2 = CollisionOneMany(Collider=_2nd_fl_wall_proximity_pts, Obstacles=item_6)  # -> Collision, Index
colom_3 = CollisionOneMany(Collider=cps_5.ClosestPoint, Obstacles=dispatch.ListB)  # -> Collision, Index
colom_4 = CollisionOneMany(Collider=column_roof_proximity_pts, Obstacles=item_2)  # -> Collision, Index
_1st_or_2nd_floor = Dispatch(List=_2nd_fl_wall_proximity_pts, DispatchPattern=colom_2.Collision)  # -> ListA, ListB
_2nd_floor_or_roof = Dispatch(List=cps_5.ClosestPoint, DispatchPattern=colom_3.Collision)  # -> ListA, ListB
dispatch_7 = Dispatch(List=column_roof_proximity_pts, DispatchPattern=colom_4.Collision)  # -> ListA, ListB
pt = Point(_2nd_floor_or_roof.ListB)
pt_2 = Point(_1st_or_2nd_floor.ListB)
pt_3 = Point(_2nd_floor_or_roof.ListA)
pt_4 = Point(_1st_or_2nd_floor.ListA)
pt_5 = Point(cps_6.ClosestPoint)
pt_6 = Point(dispatch_7.ListA)
pt_7 = Point(dispatch_7.ListB)
dist_2 = Distance(PointA=pt_2, PointB=grndt_fl_wall_proximity_pts)
dist_3 = Distance(PointA=pt, PointB=pt_4)
dist_4 = Distance(PointA=pt_6)
dist_5 = Distance(PointA=pt_5, PointB=pt_7)
larger_than_l = LargerThan(FirstNumber=dist_2, SecondNumber=sheet_length)  # -> LargerThan, OrEqualTo
larger_than_l_2 = LargerThan(FirstNumber=dist_3, SecondNumber=sheet_length)  # -> LargerThan, OrEqualTo
dist_6 = Distance(PointA=grndt_fl_wall_proximity_pts, PointB=eval_7.Point)
larger_than_l_3 = LargerThan(FirstNumber=dist_4, SecondNumber=sheet_length)  # -> LargerThan, OrEqualTo
larger_than_l_4 = LargerThan(FirstNumber=dist_5, SecondNumber=sheet_length)  # -> LargerThan, OrEqualTo
dispatch_8 = Dispatch(List=grndt_fl_wall_proximity_pts, DispatchPattern=larger_than_l.OrEqualTo)  # -> ListA, ListB
dispatch_9 = Dispatch(List=pt_2, DispatchPattern=larger_than_l.OrEqualTo)  # -> ListA, ListB
dispatch_10 = Dispatch(List=pt_6, DispatchPattern=larger_than_l_3.LargerThan)  # -> ListA, ListB
dispatch_11 = Dispatch(List=pt_6, DispatchPattern=larger_than_l_3.LargerThan)  # -> ListA, ListB
dispatch_12 = Dispatch(List=pt_7, DispatchPattern=larger_than_l_4.LargerThan)  # -> ListA, ListB
dispatch_13 = Dispatch(List=pt_5, DispatchPattern=larger_than_l_4.LargerThan)  # -> ListA, ListB
num = Number(sheet_width)
Z_2 = UnitZ(Factor=sheet_length)
avr = Average(Input=[dispatch_9.ListA, dispatch_8.ListA])
avr_2 = Average(Input=[dispatch_11.ListA, dispatch_10.ListA])
avr_3 = Average(Input=[dispatch_13.ListA, dispatch_12.ListA])
xz = XZPlane(Origin=Point(0, 0, 0))
cps_7 = ClosestPoints(Point=flatten(avr), Cloud=flatten(total_points_right_side_2), Count=1)  # -> ClosestPoint, CPIndex, Distance
cps_8 = ClosestPoints(Point=flatten(avr_2), Cloud=flatten(total_points_right_side_2), Count=1)  # -> ClosestPoint, CPIndex, Distance
cps_9 = ClosestPoints(Point=flatten(avr_3), Cloud=flatten(total_points_right_side_2), Count=1)  # -> ClosestPoint, CPIndex, Distance
angle = Angle(VectorA=eval_6.Tangent, VectorB=eval_7.Tangent, Plane=xz)  # -> Angle, Reflex
grnd_floor_1 = Point(grndt_fl_wall_proximity_pts)
grnd_floor_2 = Point(cps_7.ClosestPoint)
_2nd_roof_2 = Point(pt_5)
grnd_floor_2_2 = Point(pt_2)
_1st_roof_2 = Point(cps_8.ClosestPoint)
_2nd_roof_1 = Point(pt_7)
_2nd_roof_2_2 = Point(cps_9.ClosestPoint)
_1st_roof_2_2 = Point(pt_6)  # disabled
deg = Degrees(Radians=angle.Angle)
subtraction_8 = Subtraction(A=deg, B=Slider(90, range=0..1001))
multiplication_3 = Multiplication(A=subtraction_8, B=-1)
sin = Sine(Value=degrees(multiplication_3))
cos = Cosine(Value=degrees(multiplication_3))
panel_6 = Panel(multiplication_3)
multiplication_4 = Multiplication(A=fin_depth, B=1.5)
vec2pt = Vector2Pt(PointA=eval_7.Point, PointB=eval_6.Point, Unitize=False)  # -> Vector, Length
vdis = VectorDisplay(Anchor=eval_7.Point, Vector=vec2pt.Vector)

null_2 = NullItem(Item=_2nd_fl_wall_proximity_pts)  # -> NullFlags, InvalidFlags, Description
dispatch_14 = Dispatch(List=grndt_fl_wall_proximity_pts, DispatchPattern=null_2.NullFlags)  # -> ListA, ListB
dist_7 = Distance(PointA=eval_7.Point, PointB=grndt_fl_wall_proximity_pts)
larger_3 = LargerThan(FirstNumber=dist_7, SecondNumber=sheet_length)  # -> LargerThan, OrEqualTo
dispatch_15 = Dispatch(List=dispatch_14.ListA, DispatchPattern=larger_3.LargerThan)  # -> ListA, ListB
null_3 = NullItem(Item=pt_4)  # -> NullFlags, InvalidFlags, Description
move = Move(Geometry=dispatch_15.ListA, Motion=Z)  # -> Geometry, Transform
dispatch_16 = Dispatch(List=pt, DispatchPattern=larger_3.LargerThan)  # -> ListA, ListB
dispatch_17 = Dispatch(List=pt, DispatchPattern=null_3.NullFlags)  # -> ListA, ListB
cps_10 = ClosestPoints(Point=flatten(move.Geometry), Cloud=flatten(total_points_right_side_2), Count=1)  # -> ClosestPoint, CPIndex, Distance
pt_8 = Point(cps_10.ClosestPoint)
dispatch_18 = Dispatch(List=dist_6, DispatchPattern=true_false)  # -> ListA, ListB
dist_8 = Distance(PointA=eval_7.Point, PointB=[pt_8, pt_4, dispatch_16.ListB])
dispatch_19 = Dispatch(List=dist_8, DispatchPattern=true_false)  # -> ListA, ListB
smaller_2 = SmallerThan(FirstNumber=[dist_3, dist_8], SecondNumber=number_slider_2)  # -> SmallerThan, OrEqualTo
dispatch_20 = Dispatch(List=dispatch_19.ListB, DispatchPattern=smaller_2.SmallerThan)  # -> ListA, ListB
dispatch_21 = Dispatch(List=dispatch_17.ListB, DispatchPattern=smaller_2.SmallerThan)  # -> ListA, ListB

dist_9 = Distance(PointA=eval_7.Point, PointB=dispatch_17.ListB)
dispatch_22 = Dispatch(List=[pt_4, pt_8], DispatchPattern=larger_than_l_2.LargerThan)  # -> ListA, ListB
move_2 = Move(Geometry=dispatch_22.ListA, Motion=Z_2)  # -> Geometry, Transform
_2nd_floor_2 = Point(move_2.Geometry)
_2nd_floor_2_2 = Point(dispatch_21.ListB)  # disabled
_2nd_floor_1 = Point([pt_4, pt_8])
wall_points = Point([grnd_floor_1, grnd_floor_2, grnd_floor_2_2, _2nd_floor_1, _2nd_floor_2, _2nd_floor_2_2])
cps_11 = ClosestPoints(Point=flatten(wall_points), Cloud=flatten(roof_1st_section_pts), Count=1)  # -> flatten(ClosestPoint), CPIndex, Distance

dispatch_23 = Dispatch(List=[dist_9, dist_8], DispatchPattern=smaller_2.SmallerThan)  # -> ListA, ListB

larger_than_w = LargerThan(FirstNumber=[dispatch_23.ListB, dispatch_20.ListA, dispatch_18.ListA], SecondNumber=sheet_width)  # -> LargerThan, OrEqualTo
dispatch_24 = Dispatch(List=[dispatch_23.ListB, dispatch_20.ListA, dispatch_18.ListA], DispatchPattern=larger_than_w.OrEqualTo)  # -> ListA, ListB
# Calculating Roof Corner length
dispatch_25 = Dispatch(List=num, DispatchPattern=larger_than_w.OrEqualTo)  # -> ListA, ListB
multiplication_5 = Multiplication(A=dispatch_24.ListB, B=sin)
division_3 = Division(A=dispatch_25.ListA, B=cos)
length_y = Number(division_3)
length_x = Number(multiplication_5)
subtraction_9 = Subtraction(A=subtraction_7, B=length_x)
subtraction_10 = Subtraction(A=length_y, B=multiplication_4)
length_y_2 = Number(subtraction_9)
panel_7 = Panel(length_y_2)
amp = Amplitude(Vector=vec2pt.Vector, Amplitude=length_y_2)
amp_2 = Amplitude(Vector=vec2pt.Vector, Amplitude=subtraction_10)
move_3 = Move(Geometry=eval_7.Point, Motion=amp)  # -> Geometry, Transform
move_4 = Move(Geometry=eval_7.Point, Motion=amp_2)  # -> Geometry, Transform
cps_12 = ClosestPoints(Point=flatten(move_4.Geometry), Cloud=flatten(roof_1st_section_pts), Count=1)  # -> flatten(ClosestPoint), CPIndex, Distance; disabled

dist_10 = Distance(PointA=pt_5, PointB=[cps_11.ClosestPoint, cps_12.ClosestPoint])
smaller_3 = SmallerThan(FirstNumber=dist_10, SecondNumber=number_slider_2)  # -> SmallerThan, OrEqualTo
dispatch_26 = Dispatch(List=_2nd_roof_2, DispatchPattern=smaller_3.SmallerThan)  # -> ListA, ListB

roof_points = Point([_1st_roof_2, _1st_roof_2_2, _2nd_roof_1, _2nd_roof_2_2, dispatch_26.ListB])
cullpt = CullDuplicates(
    Points=flatten([wall_points, cps_11.ClosestPoint, cps_12.ClosestPoint, roof_points, _2nd_roof_2]),
    Tolerance=0.1,
    CullMode=3)  # -> Points, Indices, Valence

crv_cp = CurveClosestPoint(Point=flatten(cullpt.Points), Curve=graft(crv))  # -> Point, Parameter, Distance
eval_8 = EvaluateCurve(Curve=graft(crv), Parameter=crv_cp.Parameter)  # -> Point, Tangent, Angle
rev = Reverse(Vector=eval_8.Tangent)
points = ClusterOutput(eval_8.Point)
vectors = ClusterOutput(rev)

# ==== cluster Labelling_5
geometry = ClusterInput()
geometry_2 = Geometry(geometry)
path_mapper = PathMapper(geometry_2, source="{A;B}", target="{A}")
path_mapper_2 = PathMapper(geometry_2, source="{A}", target="{A}")
panel = Panel(geometry_2)
lng = ListLength(List=geometry_2)
subtraction = Subtraction(A=lng, B=1)
dom = ConstructDomain(DomainStart=0, DomainEnd=subtraction)
wires = BrepWireframe(Brep=geometry_2, Density=-1)  # -> simplify(Wireframe)
wall_label = ClusterInput()
part_label = ClusterInput()
range = Range(Domain=dom, Steps=subtraction)
join = JoinCurves(Curves=wires, Preserve=False)  # -> simplify(Curves)
int = Integer(simplify(range))
addition = Addition(A=int, B=1)
path_mapper_3 = PathMapper(join, source=["{A}", "{A;B}"], target=["{A}", "{A}"])
concat = Concatenate(FragmentA=wall_label, FragmentB=part_label)  # -> flatten(Result)
area = Area(Geometry=geometry_2)  # -> Area, Centroid
concat_2 = Concatenate(FragmentA=concat, FragmentB=flatten(addition))  # -> simplify(Result)
cullpt = CullDuplicates(Points=area.Centroid, Tolerance=0.1, CullMode=3)  # -> simplify(Points), Indices, Valence
text_size = ClusterInput()
xy = XYPlane(Origin=cullpt.Points)
text = CreateText(Text=concat_2, Plane=flatten(xy), Size=flatten(text_size), Font="Arial", JustificationMode=65537)  # -> simplify(Text)
panel_2 = Panel(text)
subtraction_2 = Subtraction(A=text_size, B=Slider(60.715, range=0..61))
cir = Circle(Plane=xy, Radius=text_size)
len = TextLength(Text=text)
colom = CollisionOneMany(Collider=cir, Obstacles=path_mapper_3)  # -> Collision, Index
multiplication = Multiplication(A=subtraction_2, B=len)
division = Division(A=text_size, B=2)
dispatch = Dispatch(List=text, DispatchPattern=colom.Collision)  # -> ListA, ListB
neg = Negative(Value=Slider(75, range=0..261))
division_2 = Division(A=multiplication, B=2)
neg_2 = Negative(Value=division)
collision = Geometry(dispatch.ListA)
neg_3 = Negative(Value=division_2)
no_collision = Geometry(dispatch.ListB)
Y = UnitY(Factor=neg)
Y_2 = UnitY(Factor=neg_2)
move = Move(Geometry=collision, Motion=Y)  # -> Geometry, Transform
merge = Merge(Data1=move.Geometry, Data2=no_collision)
move_2 = Move(Geometry=text, Motion=flatten(Y_2))  # -> simplify(Geometry), Transform
X = UnitX(Factor=neg_3)
move_3 = Move(Geometry=move_2.Geometry, Motion=X)  # -> Geometry, Transform
panel_3 = Panel(move_3.Geometry)
geometry_3 = ClusterOutput(geometry_2)
G = ClusterOutput(move_2.Geometry)

# ==== cluster Labelling_6
geometry = ClusterInput()
unique_panels = ClusterInput()
geometry_2 = Geometry(geometry)
data = Data(graft(unique_panels))
path_mapper = PathMapper(geometry_2, source="{A;B}", target="{A}")
null = NullItem(Item=path_mapper)  # -> NullFlags, InvalidFlags, Description
dispatch = Dispatch(List=geometry_2, DispatchPattern=null.NullFlags)  # -> flatten(ListA), ListB
geo = Geometry(geometry_2)
clean = CleanTree(RemoveNulls=True, RemoveInvalid=True, RemoveEmpty=True, Tree=dispatch.ListA)
wires = BrepWireframe(Brep=geo, Density=-1)  # -> simplify(Wireframe)
lng = ListLength(List=[clean, path_mapper])
join = JoinCurves(Curves=wires, Preserve=False)  # -> simplify(Curves)
subtraction = Subtraction(A=lng, B=flatten(1))
dom = ConstructDomain(DomainStart=0, DomainEnd=subtraction)
range = Range(Domain=dom, Steps=subtraction)
wall_label = ClusterInput()
part_label = ClusterInput()
int = Integer(simplify(range))
addition = Addition(A=int, B=flatten(1))
area = Area(Geometry=geometry_2)  # -> Area, Centroid
concat = Concatenate(FragmentA=wall_label, FragmentB=part_label)
null_2 = NullItem(Item=flatten(join))  # -> NullFlags, InvalidFlags, Description
concat_2 = Concatenate(FragmentA=flatten(concat), FragmentB=addition)  # -> simplify(graft(Result))
cullpt = CullDuplicates(Points=area.Centroid, Tolerance=0.1, CullMode=3)  # -> simplify(Points), Indices, Valence
dispatch_2 = Dispatch(List=concat_2, DispatchPattern=data)  # -> ListA, ListB
null_3 = NullItem(Item=data)  # -> NullFlags, InvalidFlags, Description
dispatch_3 = Dispatch(List=join, DispatchPattern=null_2.NullFlags)  # -> ListA, ListB
text_size = ClusterInput()
data_2 = Data(simplify(dispatch_2.ListB))
data_3 = Data(simplify(dispatch_2.ListA))
window_code = ClusterInput()
dispatch_4 = Dispatch(List=concat_2, DispatchPattern=null_3.NullFlags)  # -> ListA, ListB
clean_2 = CleanTree(RemoveNulls=True, RemoveInvalid=True, RemoveEmpty=True, Tree=dispatch_3.ListA)
clean_3 = CleanTree(RemoveNulls=True, RemoveInvalid=True, RemoveEmpty=True, Tree=data_3)
concat_3 = Concatenate(FragmentA=clean_3, FragmentB=window_code)
null_4 = NullItem(Item=clean_3)  # -> NullFlags, InvalidFlags, Description
xy = XYPlane(Origin=cullpt.Points)
dispatch_5 = Dispatch(List=concat_3, DispatchPattern=null_4.NullFlags)  # -> ListA, ListB
clean_4 = CleanTree(RemoveNulls=True, RemoveInvalid=True, RemoveEmpty=True, Tree=dispatch_5.ListB)
subtraction_2 = Subtraction(A=text_size, B=Slider(21.024, range=0..61))
cir = Circle(Plane=xy, Radius=text_size)
merge = Merge(Data1=clean_4, Data2=data_2)
text = CreateText(Text=[merge, dispatch_4.ListA], Plane=xy, Size=text_size, Font="Arial", JustificationMode=65537)
len = TextLength(Text=text)
colom = CollisionOneMany(Collider=cir, Obstacles=[join, clean_2])  # -> Collision, Index
multiplication = Multiplication(A=subtraction_2, B=len)
division = Division(A=text_size, B=2)
dispatch_6 = Dispatch(List=text, DispatchPattern=colom.Collision)  # -> ListA, ListB
neg = Negative(Value=Slider(75, range=0..261))
division_2 = Division(A=multiplication, B=2)
neg_2 = Negative(Value=division)
no_collision = Geometry(dispatch_6.ListB)
collision = Geometry(dispatch_6.ListA)
neg_3 = Negative(Value=division_2)
Y = UnitY(Factor=neg)
move = Move(Geometry=collision, Motion=flatten(Y))  # -> Geometry, Transform
clean_5 = CleanTree(RemoveNulls=True, RemoveInvalid=True, RemoveEmpty=True, Tree=no_collision)
clean_6 = CleanTree(RemoveNulls=True, RemoveInvalid=True, RemoveEmpty=True, Tree=move.Geometry)
Y_2 = UnitY(Factor=neg_2)
merge_2 = Merge(Data1=clean_6, Data2=clean_5)
X = UnitX(Factor=neg_3)
move_2 = Move(Geometry=merge_2, Motion=flatten(Y_2))  # -> Geometry, Transform
move_3 = Move(Geometry=move_2.Geometry, Motion=X)  # -> Geometry, Transform
path_mapper_2 = PathMapper(geometry_2, source=["{A}", "{A;B}"], target=["{A}", "{A}"])
path_mapper_3 = PathMapper(move_3.Geometry, source=["{A}", "{A;B}"], target=["{A}", "{A}"])
path_mapper_4 = ClusterOutput(path_mapper_2)
path_mapper_5 = ClusterOutput(path_mapper_3)

# ==== cluster WindowSystemV01
ply_thickness = Slider(18, range=0..111)
max_opening_width = ClusterInput()
grip_width = Slider(150, range=25..301)
spacing = Slider(300, range=0..2011)
ply_thickness_2 = ClusterInput()
width = ClusterInput()
number_slider = Slider(0.25, range=0..1)
num = Number(flatten(width))
num_2 = Number(flatten(max_opening_width))
profile_shapes = ClusterInput()
ply_thickness_3 = Number(ply_thickness)
tolerance = Slider(0, range=0..11)
tool_width = Slider(10, range=0..11)
offset = Offset(Curve=profile_shapes, Distance=ply_thickness_3, Plane=PlaneXY(0, 0, 0), Corners=1)
larger = LargerThan(FirstNumber=num, SecondNumber=num_2)  # -> LargerThan, OrEqualTo
ply_thickness_4 = Number(ply_thickness_3)
fin_depth = ClusterInput()
panel = Panel(larger.LargerThan)
geo = Geometry(flatten(profile_shapes))
box_depth = Number(fin_depth)
geo_2 = Geometry(graft(geo))
area = Area(Geometry=geo_2)  # -> Area, Centroid
Z = UnitZ(Factor=1)
Y = UnitY(Factor=1)
orient = OrientDirection(Geometry=geo_2, PointA=area.Centroid, DirectionA=Z, PointB=Point(0, 0, 0), DirectionB=Vector(0, 0, 1))  # -> simplify(Geometry), Transform
clean = CleanTree(RemoveNulls=True, RemoveInvalid=True, RemoveEmpty=True, Tree=orient.Geometry)
disc = Discontinuity(Curve=clean, Level=1)  # -> Points, simplify(Parameters)
wires = BrepWireframe(Brep=clean, Density=-1)  # -> simplify(Wireframe)
area_2 = Area(Geometry=clean)  # -> Area, Centroid
shatter = Shatter(Curve=simplify(clean), Parameters=disc.Parameters)  # -> simplify(Segments)
eval = EvaluateLength(Curve=wires, Length=0.5, Normalized=True)  # -> Point, Tangent, Parameter
panel_2 = Panel(area_2.Centroid)
avr = Average(Input=eval.Point)
orient_2 = OrientDirection(Geometry=shatter, PointA=area_2.Centroid, DirectionA=Vector(0, 0, 1), PointB=Point(0, 0, 0), DirectionB=Vector(0, 0, 1))  # -> simplify(Geometry), Transform
path_mapper = PathMapper(orient_2.Geometry, source="{A;B;C}", target="{A}")
path_mapper_2 = PathMapper(orient_2.Geometry, source="{A;B}", target="{A}")
path_mapper_3 = PathMapper(orient_2.Geometry, source="{A}", target="{A}")
branch = TreeBranch(Tree=simplify(orient.Geometry), Path=Slider(0, range=0..13), MaintainPaths=True)
pt = ConstructPoint(XCoordinate=0, YCoordinate=0, ZCoordinate=0)
merge = Merge(Data1=path_mapper, Data2=path_mapper_2, Data3=path_mapper_3)
join = JoinCurves(Curves=merge, Preserve=False)
boundary = BoundarySurfaces(Edges=join)
evalsrf = EvaluateSurface(Surface=boundary, Point=pt)  # -> Point, Normal, Frame
Z_2 = Slider(0, range=0..1)
devec = DeconstructVector(Vector=evalsrf.Normal)  # -> XComponent, YComponent, ZComponent
larger_2 = LargerThan(FirstNumber=devec.ZComponent, SecondNumber=Z_2)  # -> LargerThan, OrEqualTo
dispatch = Dispatch(List=merge, DispatchPattern=larger_2.LargerThan)  # -> ListA, ListB
geo_3 = Geometry(dispatch.ListA)
geo_4 = Geometry(dispatch.ListB)
flip = FlipCurve(Curve=geo_3)  # -> Curve, Flag
merge_2 = Merge(Data1=flip.Curve, Data2=geo_4)  # -> simplify(Result)
width_2 = Slider(60, range=25..301)
box_spacer_width = Number(width_2)
min = Minimum(A=grip_width, B=spacing)
join_2 = JoinCurves(Curves=merge_2, Preserve=False)
geo_5 = Geometry(simplify(merge_2))
geo_6 = Geometry(simplify(graft(geo_5)))
geo_7 = Geometry(simplify(graft(geo_5)))
slot_width = Slider(60, range=25..301)

geo_8 = Geometry(simplify(geo_6))
dispatch_2 = Dispatch(List=geo_8, DispatchPattern=larger.LargerThan)  # -> ListA, ListB
geo_9 = Geometry(dispatch_2.ListA)
geo_10 = Geometry(dispatch_2.ListB)
devec_2 = DeconstructVector(Vector=geo_9)  # -> XComponent, YComponent, ZComponent
similar = Similarity(FirstNumber=devec_2.XComponent, SecondNumber=0, Threshold=0.1)  # -> Similarity, AbsoluteDifference
dispatch_3 = Dispatch(List=geo_9, DispatchPattern=similar.Similarity)  # -> ListA, ListB
geo_11 = Geometry(dispatch_3.ListB)
geo_12 = Geometry(dispatch_3.ListA)
dispatch_4 = Dispatch(List=geo_11, DispatchPattern=larger.LargerThan)  # -> ListA, ListB
geo_13 = Geometry(simplify(dispatch_4.ListA))
merge_3 = Merge(Data1=geo_10, Data2=geo_12)  # -> simplify(Result)
merge_4 = Merge(Data2=geo_13)  # -> simplify(Result)

eval_2 = EvaluateLength(Curve=geo_7, Length=0.5, Normalized=True)  # -> Point, Tangent, Parameter
end = EndPoints(Curve=geo_7)  # -> Start, End
vdis = VectorDisplay(Anchor=eval_2.Point, Vector=eval_2.Tangent)
ln = Line(StartPoint=eval_2.Point, EndPoint=end.Start)
ln_2 = Line(StartPoint=eval_2.Point, EndPoint=end.End)
internal_slot = InternalSlot(tool_size=tool_width, A=tolerance, A_2=ply_thickness_3, slot_width=slot_width)
all_sides = Geometry(simplify(merge_3))
margin = Slider(100, range=0..2011)
len = Length(Curve=all_sides)
len_2 = Length(Curve=ln)
len_3 = Length(Curve=ln_2)
eval_3 = EvaluateLength(Curve=ln, Length=0.5, Normalized=True)  # -> Point, Tangent, Parameter
eval_4 = EvaluateLength(Curve=ln_2, Length=0.5, Normalized=True)  # -> Point, Tangent, Parameter
subtraction = Subtraction(A=len_2, B=margin)
subtraction_2 = Subtraction(A=len_3, B=margin)
vdis_2 = VectorDisplay(Anchor=eval_3.Point, Vector=eval_3.Tangent)
vdis_3 = VectorDisplay(Anchor=eval_4.Point, Vector=eval_4.Tangent)
eval_5 = EvaluateLength(Curve=ln, Length=subtraction, Normalized=False)  # -> Point, Tangent, Parameter
eval_6 = EvaluateLength(Curve=ln_2, Length=subtraction_2, Normalized=False)  # -> Point, Tangent, Parameter
addition = Addition(A=ply_thickness_4, B=box_spacer_width)
num_3 = Number(len)
ln_3 = Line(StartPoint=eval_2.Point, EndPoint=eval_6.Point)
ln_4 = Line(StartPoint=eval_2.Point, EndPoint=eval_5.Point)
grip_female = GripFemale(grip_width=min, ply_thickness=ply_thickness_3, slot_spacing=spacing)  # -> centre_point, geometry, tab_width
grip_male = GripMale(grip_width=min, ply_thickness=ply_thickness_3, slot_spacing=spacing)  # -> centre_point, geometry, tab_width
multiplication = Multiplication(A=ply_thickness_3, B=2)
connector_slot_wall = ConnectorSlotWall_2(ply_thickness=ply_thickness_4, slot_length=addition)
subtraction_3 = Subtraction(A=num_3, B=multiplication)
geo_14 = Geometry(ln_3)
geo_15 = Geometry(ln_4)
division = Division(A=subtraction_3, B=-2)
yz = YZPlane(Origin=Point(0, 0, 0))
merge_5 = Merge(Data1=geo_15, Data2=geo_14)
division_2 = Division(A=spacing, B=2)
xz = XZPlane(Origin=Point(0, 0, 0))
end_2 = EndPoints(Curve=all_sides)  # -> Start, End
Y_2 = UnitY(Factor=1)
# Y Axis - Side Panels
pt_2 = ConstructPoint(XCoordinate=0, YCoordinate=division, ZCoordinate=0)
X = UnitX(Factor=1)
divlength = DivideLength(Curve=merge_5, Length=flatten(division_2))  # -> simplify(Points), Tangents, Parameters
rotate = Rotate(Geometry=grip_male.geometry, Angle=degrees(90), Plane=xz)  # -> Geometry, Transform
rotate_2 = Rotate(Geometry=grip_female.geometry, Angle=degrees(-90), Plane=yz)  # -> Geometry, Transform
rotate_3 = Rotate(Geometry=grip_male.geometry, Angle=degrees(90), Plane=yz)  # -> Geometry, Transform
rotate_4 = Rotate(Geometry=grip_female.geometry, Angle=degrees(-90), Plane=xz)  # -> Geometry, Transform
panel_3 = Panel(merge_4)
line = LineSDL(Start=pt_2, Direction=Y_2, Length=subtraction_3)
division_3 = Division(A=ply_thickness_3, B=2)
geo_16 = Geometry(all_sides)
all_sides_2 = Geometry(simplify(graft(geo_6)))
eval_7 = EvaluateLength(Curve=rotate_2.Geometry, Length=0.5, Normalized=True)  # -> Point, Tangent, Parameter
orient_3 = OrientDirection(
    Geometry=connector_slot_wall,
    PointA=Point(0, 0, 0),
    DirectionA=Vector(0, 0, 1),
    PointB=eval_7.Point,
    DirectionB=Vector(0, 0, 1))  # -> Geometry, Transform
cull = CullPattern(List=divlength.Points, CullPattern=[True, False])
path_mapper_4 = PathMapper(cull, source="{A;B;C}", target="{A;B}")
path_mapper_5 = PathMapper(cull, source="{A;B}", target="{A;B}")
cullpt = CullDuplicates(Points=path_mapper_4, Tolerance=0.1, CullMode=3)  # -> simplify(Points), Indices, Valence
rotate_5 = Rotate(Geometry=rotate_2.Geometry, Angle=1.570796327, Plane=PlaneXY(0, 0, 0))  # -> Geometry, Transform
rotate_6 = Rotate(Geometry=rotate_3.Geometry, Angle=1.570796327, Plane=PlaneXY(0, 0, 0))  # -> Geometry, Transform
rotate_7 = Rotate(Geometry=rotate_2.Geometry, Angle=degrees(-90), Plane=PlaneXY(0, 0, 0))  # -> Geometry, Transform
offset_2 = Offset(Curve=geo_16, Distance=division_3, Plane=PlaneXY(0, 0, 0), Corners=1)
ccx = CurveCurve(CurveA=rotate_2.Geometry, CurveB=orient_3.Geometry)  # -> Points, ParamsA, ParamsB
path_mapper_6 = PathMapper(cull, source="{A;B;C}", target="{A;B}")
path_mapper_7 = PathMapper(cull, source="{A;B}", target="{A}")
crv_cp = CurveClosestPoint(Point=ccx.Points, Curve=rotate_2.Geometry)  # -> Point, Parameter, Distance
mirror = Mirror(Geometry=rotate_4.Geometry, Plane=PlaneYZ(0, 0, 0))  # -> Geometry, Transform
shatter_2 = Shatter(Curve=rotate_2.Geometry, Parameters=crv_cp.Parameter)
cullpt_2 = CullDuplicates(Points=[path_mapper_6, path_mapper_7], Tolerance=0.1, CullMode=3)  # -> simplify(Points), Indices, Valence
all_points = Point(simplify(cullpt_2.Points))
crv_cp_2 = CurveClosestPoint(Point=all_points, Curve=all_sides)  # -> Point, Parameter, Distance
dist = Distance(PointA=end_2.Start, PointB=crv_cp_2.Point)
subtraction_4 = Subtraction(A=dist, B=ply_thickness_3)
all_points_2 = Point(simplify(cullpt_2.Points))
null = NullItem(Item=all_points)  # -> NullFlags, InvalidFlags, Description
eval_8 = EvaluateLength(Curve=line, Length=subtraction_4, Normalized=False)  # -> Point, Tangent, Parameter
dispatch_5 = Dispatch(List=line, DispatchPattern=null.NullFlags)  # -> ListA, ListB
geo_17 = Geometry(simplify(dispatch_5.ListA))
geo_18 = Geometry(simplify(dispatch_5.ListB))
len_4 = Length(Curve=merge_3)
dispatch_6 = Dispatch(List=shatter_2, DispatchPattern=[True, False])  # -> ListA, ListB
orient_4 = OrientDirection(
    Geometry=flatten(mirror.Geometry),
    PointA=Point(0, 0, 0),
    DirectionA=Vector(0, 0, 1),
    PointB=eval_8.Point,
    DirectionB=eval_8.Tangent)  # -> Geometry, Transform
multiplication_2 = Multiplication(A=ply_thickness_3, B=2)
num_4 = Number(len_4)
merge_6 = Merge(Data1=offset_2)  # -> simplify(Result)
geo_19 = Geometry(dispatch_6.ListA)
end_3 = EndPoints(Curve=orient_4.Geometry)  # -> Start, End
merge_7 = Merge(Data1=geo_19, Data2=orient_3.Geometry)  # -> flatten(Result)
subtraction_5 = Subtraction(A=num_4, B=multiplication_2)
merge_8 = Merge(Data1=end_3.Start, Data2=end_3.End)  # -> simplify(Result)
join_3 = JoinCurves(Curves=merge_7, Preserve=False)
crv_cp_3 = CurveClosestPoint(Point=all_points_2, Curve=merge_3)  # -> Point, Parameter, Distance
end_4 = EndPoints(Curve=merge_3)  # -> Start, End
division_4 = Division(A=subtraction_5, B=-2)
crv_cp_4 = CurveClosestPoint(Point=merge_8, Curve=geo_18)  # -> Point, Parameter, Distance
rotate_8 = Rotate(Geometry=join_3, Angle=1.570796327, Plane=PlaneXY(0, 0, 0))  # -> Geometry, Transform
shatter_3 = Shatter(Curve=simplify(geo_18), Parameters=crv_cp_4.Parameter)
dist_2 = Distance(PointA=end_4.Start, PointB=crv_cp_3.Point)
Y_3 = UnitY(Factor=1)
pt_3 = ConstructPoint(XCoordinate=0, YCoordinate=division_4, ZCoordinate=0)
division_5 = Division(A=box_depth, B=2)
X_2 = UnitX(Factor=1)
dispatch_7 = Dispatch(List=shatter_3, DispatchPattern=[True, False])  # -> ListA, ListB
subtraction_6 = Subtraction(A=dist_2, B=ply_thickness_3)
geo_20 = Geometry(dispatch_7.ListA)
addition_2 = Addition(A=division_5, B=ply_thickness_3)
line_2 = LineSDL(Start=pt_3, Direction=Y_3, Length=subtraction_5)
merge_9 = Merge(Data1=simplify(orient_4.Geometry), Data2=simplify(geo_20))  # -> simplify(Result)
eval_9 = EvaluateLength(Curve=line_2, Length=subtraction_6, Normalized=False)  # -> Point, Tangent, Parameter
neg = Negative(Value=addition_2)
geo_21 = Geometry(geo_8)
geo_22 = Geometry(merge_3)
X_3 = UnitX(Factor=neg)
join_4 = JoinCurves(Curves=merge_9, Preserve=False)  # -> simplify(Curves)
eval_10 = EvaluateLength(Curve=merge_6, Length=0.5, Normalized=True)  # -> Point, Tangent, Parameter
merge_10 = Merge(Data1=join_4, Data2=geo_17)
devec_3 = DeconstructVector(Vector=eval_10.Tangent)  # -> XComponent, YComponent, ZComponent
path_mapper_8 = PathMapper(geo_21, source="{A}", target="{A}")
path_mapper_9 = PathMapper(geo_21, source="{A;B}", target="{A}")
eval_11 = EvaluateLength(Curve=geo_22, Length=0.5, Normalized=True)  # -> Point, Tangent, Parameter
move = Move(Geometry=merge_10, Motion=flatten(X_3))  # -> Geometry, Transform
similar_2 = Similarity(FirstNumber=devec_3.XComponent, SecondNumber=0, Threshold=0.1)  # -> Similarity, AbsoluteDifference
orient_5 = OrientDirection(
    Geometry=flatten(rotate_6.Geometry),
    PointA=Point(0, 0, 0),
    DirectionA=Vector(0, 0, 1),
    PointB=eval_9.Point,
    DirectionB=Vector(0, 0, 1))  # -> Geometry, Transform
pt_4 = ConstructPoint(XCoordinate=0, YCoordinate=0, ZCoordinate=0)
geo_23 = Geometry(flatten(path_mapper_8))
Y_4 = UnitY(Factor=1)
neg_2 = Negative(Value=division)
dog_bone_pocket = DogBonePocket_3(point=pt_4)  # -> pt_5, tool_size_2, size
dispatch_8 = Dispatch(List=move.Geometry, DispatchPattern=similar_2.Similarity)  # -> ListA, ListB
join_5 = JoinCurves(Curves=[geo_23, path_mapper_9], Preserve=False)
orient_6 = OrientDirection(Geometry=orient_5.Geometry, PointA=Point(0, 0, 0), DirectionA=Y_4, PointB=eval_11.Point, DirectionB=eval_11.Tangent)  # -> Geometry, Transform
addition_3 = Addition(A=neg_2, B=ply_thickness_3)
eval_12 = EvaluateLength(Curve=orient_6.Geometry, Length=0.5, Normalized=True)  # -> Point, Tangent, Parameter
horizontal = Geometry(dispatch_8.ListA)
vertical = Geometry(dispatch_8.ListB)
boundary_2 = BoundarySurfaces(Edges=join_5)
rotate_9 = Rotate(Geometry=dog_bone_pocket.pt_5, Angle=degrees(90), Plane=PlaneXY(0, 0, 0))  # -> Geometry, Transform
Y_5 = UnitY(Factor=neg_2)
colom = CollisionOneMany(Collider=eval_12.Point, Obstacles=boundary_2)  # -> Collision, Index
Y_6 = UnitY(Factor=addition_3)
ext = ExtendCurve(Curve=horizontal, Type=0, Start=ply_thickness_3, End=ply_thickness_3)
mirror_2 = Mirror(Geometry=rotate_9.Geometry, Plane=PlaneYZ(0, 0, 0))  # -> Geometry, Transform
dispatch_9 = Dispatch(List=orient_6.Geometry, DispatchPattern=colom.Collision)  # -> ListA, ListB
merge_11 = Merge(Data1=ext, Data2=vertical)
move_2 = Move(Geometry=mirror_2.Geometry, Motion=Y_5)  # -> Geometry, Transform
move_3 = Move(Geometry=pt_4, Motion=Y_6)  # -> Geometry, Transform
mirror_3 = Mirror(Geometry=merge_11, Plane=PlaneYZ(0, 0, 0))  # -> Geometry, Transform
ext_2 = ExtendCurve(Curve=merge_11, Type=0, Start=0, End=ply_thickness_3)
geo_24 = Geometry(dispatch_9.ListB)
eval_13 = EvaluateLength(Curve=geo_24, Length=0.5, Normalized=True)  # -> Point, Tangent, Parameter
amp = Amplitude(Vector=eval_13.Tangent, Amplitude=ply_thickness_3)
xy = XYPlane(Origin=eval_13.Point)
merge_12 = Merge(Data1=move_3.Geometry, Data2=move_2.Geometry)
end_5 = EndPoints(Curve=mirror_3.Geometry)  # -> Start, simplify(End)
end_6 = EndPoints(Curve=merge_11)  # -> Start, End
vrot = Rotate(Vector=amp, Axis=xy, Angle=degrees(-90))
move_4 = Move(Geometry=eval_13.Point, Motion=vrot)  # -> Geometry, Transform
merge_13 = Merge(Data1=simplify(merge_12), Data2=simplify(end_5.End))
ln_5 = Line(StartPoint=end_6.End, EndPoint=end_5.End)  # -> simplify(Line)
pline = PolyLine(Vertices=simplify(merge_13), Closed=False)
ln_6 = Line(StartPoint=move_3.Geometry, EndPoint=end_6.End)  # -> simplify(Line)
yz_2 = YZPlane(Origin=move_4.Geometry)
panel_4 = Panel(merge_11)
mirror_4 = Mirror(Geometry=geo_24, Plane=yz_2)  # -> Geometry, Transform
geo_25 = Geometry(dispatch_9.ListA)
xz_2 = XZPlane(Origin=Point(0, 0, 0))
join_6 = JoinCurves(Curves=ln_5, Preserve=False)
mirror_5 = Mirror(Geometry=join_6, Plane=PlaneYZ(0, 0, 0))  # -> Geometry, Transform
merge_14 = Merge(Data1=geo_25, Data2=mirror_4.Geometry)
clean_2 = CleanTree(RemoveNulls=True, RemoveInvalid=True, RemoveEmpty=False, Tree=merge_14)
end_7 = EndPoints(Curve=clean_2)  # -> Start, End
mirror_6 = Mirror(Geometry=mirror_5.Geometry, Plane=xz_2)  # -> Geometry, Transform
no_of_sides = Slider(1, range=0..51)
no_of_sides_2 = Slider(4, range=0..51)
merge_15 = Merge(Data1=end_7.Start, Data2=end_7.End)  # -> simplify(Result)
merge_16 = Merge(Data1=simplify(join_6), Data2=simplify(mirror_6.Geometry), Data3=simplify(merge_11), Data4=simplify(mirror_3.Geometry))
crv_cp_5 = CurveClosestPoint(Point=merge_15, Curve=merge_3)  # -> Point, Parameter, Distance
shatter_4 = Shatter(Curve=simplify(merge_3), Parameters=crv_cp_5.Parameter)
no_of_sides_3 = Slider(2, range=0..51)
join_7 = JoinCurves(Curves=merge_16, Preserve=False)  # -> simplify(Curves)
no_of_sides_4 = Slider(3, range=0..51)
dispatch_10 = Dispatch(List=shatter_4, DispatchPattern=[True, False])  # -> ListA, ListB
int = Integer(no_of_sides_2)
merge_17 = Merge(Data1=join_7)
int_2 = Integer(no_of_sides)
concat = Concatenate(FragmentA="{", FragmentB=int)
geo_26 = Geometry(simplify(dispatch_10.ListA))
panel_5 = Panel(merge_17)
boundary_3 = BoundarySurfaces(Edges=merge_17)
concat_2 = Concatenate(FragmentA=concat, FragmentB=";")
Z_3 = UnitZ(Factor=ply_thickness_3)
merge_18 = Merge(Data1=simplify(clean_2), Data2=simplify(geo_26), Data3=simplify(merge_4))
int_3 = Integer(no_of_sides_4)
int_4 = Integer(no_of_sides_3)
concat_3 = Concatenate(FragmentA=concat_2, FragmentB=int_2)
concat_4 = Concatenate(FragmentA="{", FragmentB=int_3)
extr = Extrude(Base=boundary_3, Direction=Z_3)
path_mapper_10 = PathMapper(merge_18, source="{A;B}", target="{A}")
xz_3 = XZPlane(Origin=Point(0, 0, 0))
join_8 = JoinCurves(Curves=merge_18, Preserve=False)  # -> simplify(Curves)
path_mapper_11 = PathMapper(merge_18, source="{A}", target="{A}")
concat_5 = Concatenate(FragmentA=concat_3, FragmentB="}")
concat_6 = Concatenate(FragmentA=concat_4, FragmentB=";")
rotate_10 = Rotate(Geometry=extr, Angle=1.570796327, Plane=xz_3)  # -> Geometry, Transform
yz_3 = YZPlane(Origin=Point(0, 0, 0))
eval_14 = EvaluateLength(Curve=merge_6, Length=0.5, Normalized=True)  # -> Point, Tangent, Parameter
path_mapper_12 = PathMapper(join_8, source="{A;B}", target="{A}")
concat_7 = Concatenate(FragmentA=concat_6, FragmentB=int_4)
X_4 = UnitX(Factor=division_3)
join_9 = JoinCurves(Curves=flatten(path_mapper_11), Preserve=False)  # -> simplify(flatten(Curves))
clean_3 = CleanTree(RemoveNulls=True, RemoveInvalid=True, RemoveEmpty=False, Tree=path_mapper_10)
branch_2 = TreeBranch(Tree=simplify(geo_22), Path=concat_5, MaintainPaths=True)
branch_3 = TreeBranch(Tree=simplify(eval_11.Tangent), Path=concat_5, MaintainPaths=True)
branch_4 = TreeBranch(Tree=simplify(eval_11.Point), Path=concat_5, MaintainPaths=True)
mirror_7 = Mirror(Geometry=rotate_10.Geometry, Plane=yz_3)  # -> Geometry, Transform
concat_8 = Concatenate(FragmentA=concat_7, FragmentB="}")
move_5 = Move(Geometry=rotate_10.Geometry, Motion=flatten(X_4))  # -> Geometry, Transform
join_10 = JoinCurves(Curves=clean_3, Preserve=False)  # -> simplify(Curves)
branch_5 = TreeBranch(Tree=simplify(crv_cp_4.Point), Path=concat_8, MaintainPaths=True)
branch_6 = TreeBranch(Tree=simplify(geo_20), Path=concat_8, MaintainPaths=True)
branch_7 = TreeBranch(Tree=simplify(line), Path=concat_8, MaintainPaths=True)
vdis_4 = VectorDisplay(Anchor=branch_4, Vector=branch_3)
Y_7 = UnitY(Factor=1)
merge_19 = Merge(Data1=join_9, Data2=join_10)  # -> simplify(Result)
panel_6 = Panel(branch_3)
orient_7 = OrientDirection(Geometry=move_5.Geometry, PointA=Point(0, 0, 0), DirectionA=Y_7, PointB=eval_14.Point, DirectionB=eval_14.Tangent)  # -> simplify(Geometry), Transform
panel_7 = Panel(orient_7.Geometry)
path_mapper_13 = PathMapper(orient_7.Geometry, source="{A}", target="{A}")
path_mapper_14 = PathMapper(orient_7.Geometry, source="{A;B}", target="{A}")
panel_8 = Panel(merge_19)
geo_27 = Geometry(flatten(path_mapper_13))
Z_4 = UnitZ(Factor=addition_2)
geo_28 = Geometry(path_mapper_14)
merge_20 = Merge(Data1=geo_27, Data2=geo_28)
move_6 = Move(Geometry=merge_20, Motion=flatten(Z_4))  # -> simplify(Geometry), Transform
branch_8 = TreeBranch(Tree=simplify(move_6.Geometry), Path=Slider(1, range=0..29), MaintainPaths=True)
panel_9 = Panel(move_6.Geometry)
branch_9 = TreeBranch(Tree=merge_19, Path=Slider(0, range=0..16), MaintainPaths=True)
reference_geo = Geometry(join_2)
sides = Geometry(merge_17)
faces = Geometry(merge_19)
pt_5 = ConstructPoint(XCoordinate=0, YCoordinate=0, ZCoordinate=0)
geo_29 = Geometry(move_6.Geometry)
area_3 = Area(Geometry=orient.Geometry)  # -> Area, Centroid
area_4 = Area(Geometry=join_2)  # -> Area, Centroid
centre_point = ClusterOutput(pt_5)
reference_geo_2 = ClusterOutput(reference_geo)
sides_2 = ClusterOutput(sides)
faces_2 = ClusterOutput(faces)
orient_8 = OrientDirection(Geometry=geo_29, PointA=area_4.Centroid, DirectionA=Vector(0, 0, 1), PointB=area_3.Centroid, DirectionB=Vector(0, 0, 1))  # -> simplify(Geometry), Transform
geo_30 = Geometry(simplify(orient_8.Geometry))
branch_10 = TreeBranch(Tree=simplify(geo_30), Path=Slider(0, range=0..29), MaintainPaths=True)
panel_10 = Panel(geo_30)
sides_3d_geo = ClusterOutput(geo_30)

# ==== cluster Labelling_7
geometry = ClusterInput()
geometry_2 = Geometry(geometry)
path_mapper = PathMapper(geometry_2, source="{A;B}", target="{A}")
path_mapper_2 = PathMapper(geometry_2, source="{A}", target="{A}")
panel = Panel(path_mapper_2)
tstat = TreeStatistics(Tree=[path_mapper, path_mapper_2])  # -> Paths, Length, Count
split = TextSplit(Text=tstat.Paths, Separators="{")
item = ListItem(List=split, Index=1, Wrap=True)  # -> flatten(Item)
lng = ListLength(List=geometry_2)
split_2 = TextSplit(Text=item, Separators="}")
subtraction = Subtraction(A=lng, B=1)
item_2 = ListItem(List=split_2, Index=0, Wrap=True)  # -> flatten(Item)
dom = ConstructDomain(DomainStart=0, DomainEnd=subtraction)
panel_2 = Panel("EW-")
wires = BrepWireframe(Brep=geometry_2, Density=-1)  # -> simplify(Wireframe)
wall_label = ClusterInput()
range = Range(Domain=dom, Steps=subtraction)
part_label = ClusterInput()
panel_3 = Panel("/S-")
join = JoinCurves(Curves=wires, Preserve=False)  # -> simplify(Curves)
int = Integer(simplify(range))
concat = Concatenate(FragmentA=wall_label, FragmentB=item_2)
addition = Addition(A=int, B=1)
concat_2 = Concatenate(FragmentA=wall_label, FragmentB=part_label)
path_mapper_3 = PathMapper(join, source="{A}", target="{A}")
path_mapper_4 = PathMapper(join, source="{A;B}", target="{A}")
concat_3 = Concatenate(FragmentA=concat_2, FragmentB=addition)  # -> simplify(Result)
merge = Merge(Data1=path_mapper_4, Data2=path_mapper_3)
text_size = ClusterInput()
area = Area(Geometry=geometry_2)  # -> Area, Centroid
cullpt = CullDuplicates(Points=area.Centroid, Tolerance=0.1, CullMode=3)  # -> simplify(Points), Indices, Valence
xy = XYPlane(Origin=cullpt.Points)
cir = Circle(Plane=xy, Radius=text_size)  # -> simplify(Circle)
text = CreateText(Text=concat_3, Plane=xy, Size=text_size, Font="Arial", JustificationMode=65537)
subtraction_2 = Subtraction(A=text_size, B=Slider(55.821, range=0..61))
rotate = Rotate(Geometry=text, Angle=degrees(-90), Plane=xy)  # -> simplify(graft(Geometry)), Transform
len = TextLength(Text=flatten(rotate.Geometry))
item_3 = ListItem(List=len, Index=0, Wrap=True)
colom = CollisionOneMany(Collider=cir, Obstacles=geometry_2)  # -> simplify(Collision), Index
multiplication = Multiplication(A=subtraction_2, B=item_3)
division = Division(A=text_size, B=2)
dispatch = Dispatch(List=rotate.Geometry, DispatchPattern=colom.Collision)  # -> ListA, ListB
neg = Negative(Value=Slider(75, range=0..261))
division_2 = Division(A=multiplication, B=2)
neg_2 = Negative(Value=division)
collision = Geometry(dispatch.ListA)
neg_3 = Negative(Value=division_2)
no_collision = Geometry(dispatch.ListB)
X = UnitX(Factor=neg)
move = Move(Geometry=collision, Motion=flatten(X))  # -> Geometry, Transform
merge_2 = Merge(Data1=move.Geometry, Data2=no_collision)
X_2 = UnitX(Factor=neg_2)
clean = CleanTree(RemoveNulls=True, RemoveInvalid=True, RemoveEmpty=True, Tree=merge_2)
Y = UnitY(Factor=neg_3)
move_2 = Move(Geometry=clean, Motion=flatten(X_2))  # -> Geometry, Transform
move_3 = Move(Geometry=move_2.Geometry, Motion=flatten(Y))  # -> Geometry, Transform
geometry_3 = ClusterOutput(geometry_2)
path_mapper_5 = PathMapper(move_3.Geometry, source=["{A}", "{A;B}"], target=["{A}", "{A}"])
panel_4 = Panel(path_mapper_5)
path_mapper_6 = ClusterOutput(path_mapper_5)

# ==== cluster Labelling_8
geometry = ClusterInput()
geometry_2 = Geometry(geometry)
path_mapper = PathMapper(geometry_2, source="{A;B}", target="{A}")
path_mapper_2 = PathMapper(geometry_2, source="{A}", target="{A}")
panel = Panel(geometry_2)
geo = Geometry(flatten(path_mapper_2))
tstat = TreeStatistics(Tree=[path_mapper, path_mapper_2])  # -> Paths, Length, Count
split = TextSplit(Text=tstat.Paths, Separators="{")
item = ListItem(List=split, Index=1, Wrap=True)  # -> flatten(Item)
lng = ListLength(List=geometry_2)
split_2 = TextSplit(Text=item, Separators="}")
subtraction = Subtraction(A=lng, B=1)
item_2 = ListItem(List=split_2, Index=0, Wrap=True)  # -> flatten(Item)
dom = ConstructDomain(DomainStart=0, DomainEnd=subtraction)
panel_2 = Panel("EW-")
wires = BrepWireframe(Brep=geometry_2, Density=-1)  # -> simplify(Wireframe)
wall_label = ClusterInput()
range = Range(Domain=dom, Steps=subtraction)
part_label = ClusterInput()
panel_3 = Panel("/S-")
join = JoinCurves(Curves=wires, Preserve=False)  # -> simplify(Curves)
int = Integer(simplify(range))
concat = Concatenate(FragmentA=wall_label, FragmentB=item_2)
addition = Addition(A=int, B=1)
path_mapper_3 = PathMapper(join, source="{A;B}", target="{A}")
concat_2 = Concatenate(FragmentA=wall_label, FragmentB=part_label)
concat_3 = Concatenate(FragmentA=concat_2, FragmentB=addition)  # -> simplify(Result)
text_size = ClusterInput()
area = Area(Geometry=geometry_2)  # -> Area, Centroid
cullpt = CullDuplicates(Points=area.Centroid, Tolerance=0.1, CullMode=3)  # -> simplify(Points), Indices, Valence
xy = XYPlane(Origin=cullpt.Points)
text = CreateText(Text=concat_3, Plane=xy, Size=text_size, Font="Arial", JustificationMode=65537)
rotate = Rotate(Geometry=text, Angle=degrees(-90), Plane=xy)  # -> Geometry, Transform
subtraction_2 = Subtraction(A=text_size, B=Slider(60.715, range=0..61))
cir = Circle(Plane=xy, Radius=text_size)
len = TextLength(Text=rotate.Geometry)
colom = CollisionOneMany(Collider=cir, Obstacles=path_mapper_3)  # -> Collision, Index
multiplication = Multiplication(A=subtraction_2, B=len)
division = Division(A=text_size, B=2)
dispatch = Dispatch(List=rotate.Geometry, DispatchPattern=colom.Collision)  # -> ListA, ListB
neg = Negative(Value=Slider(75, range=0..261))
division_2 = Division(A=multiplication, B=2)
neg_2 = Negative(Value=division)
collision = Geometry(dispatch.ListA)
neg_3 = Negative(Value=division_2)
no_collision = Geometry(dispatch.ListB)
X = UnitX(Factor=neg)
X_2 = UnitX(Factor=neg_2)
move = Move(Geometry=collision, Motion=X)  # -> Geometry, Transform
merge = Merge(Data1=move.Geometry, Data2=no_collision)
move_2 = Move(Geometry=merge, Motion=X_2)  # -> Geometry, Transform
Y = UnitY(Factor=neg_3)
move_3 = Move(Geometry=move_2.Geometry, Motion=Y)  # -> Geometry, Transform
geometry_3 = ClusterOutput(geometry_2)
G = ClusterOutput(move_3.Geometry)

# ==== cluster GripMale
pt = ConstructPoint(XCoordinate=0, YCoordinate=0, ZCoordinate=0)
grip_width = ClusterInput()
dog_bone_pocket = DogBonePocket_3(point=pt)  # -> pt_5, tool_size_2, size
num = Number(grip_width)
points = PointList(Points=dog_bone_pocket.pt_5)
yz = YZPlane(Origin=Point(0, 0, 0))
pt_2 = ConstructPoint(XCoordinate=0, YCoordinate=0, ZCoordinate=0)
rotate = Rotate(Geometry=dog_bone_pocket.pt_5, Angle=1.570796327, Plane=PlaneXY(0, 0, 0))  # -> Geometry, Transform
division = Division(A=num, B=2)
ply_thickness = ClusterInput()
rotate_2 = Rotate(Geometry=rotate.Geometry, Angle=1.570796327, Plane=yz)  # -> Geometry, Transform
slot_spacing = ClusterInput()
points_2 = PointList(Points=rotate_2.Geometry)
Z = UnitZ(Factor=ply_thickness)
division_2 = Division(A=slot_spacing, B=2)
addition = Addition(A=dog_bone_pocket.size, B=division)
yz_2 = YZPlane(Origin=Point(0, 0, 0))
subtraction = Subtraction(A=addition, B=division_2)
X = UnitX(Factor=subtraction)
neg = Negative(Value=X)
centre_point = ClusterOutput(pt)
num_2 = Number(num)
tab_width = ClusterOutput(num_2)

division_3 = Division(A=num, B=-2)
move = Move(Geometry=pt_2, Motion=Z)  # -> Geometry, Transform

X_2 = UnitX(Factor=division_3)

move_2 = Move(Geometry=rotate_2.Geometry, Motion=X_2)  # -> Geometry, Transform
move_3 = Move(Geometry=pt_2, Motion=X_2)  # -> Geometry, Transform
move_4 = Move(Geometry=move_3.Geometry, Motion=Z)  # -> Geometry, Transform
pline = PolyLine(Vertices=[move.Geometry, move_4.Geometry, move_2.Geometry], Closed=False)
mirror = Mirror(Geometry=pline, Plane=yz_2)  # -> Geometry, Transform
join = JoinCurves(Curves=[pline, mirror.Geometry], Preserve=False)

end = EndPoints(Curve=join)  # -> Start, End
move_5 = Move(Geometry=end.End, Motion=X)  # -> Geometry, Transform
move_6 = Move(Geometry=end.Start, Motion=neg)  # -> Geometry, Transform
ln = Line(StartPoint=move_6.Geometry, EndPoint=end.Start)
ln_2 = Line(StartPoint=end.End, EndPoint=move_5.Geometry)
join_2 = JoinCurves(Curves=join, Preserve=False)
geometry = ClusterOutput(join_2)

# ==== cluster GripFemale
tool_size = Slider(10, range=0..20)
grip_width = ClusterInput()
pt = ConstructPoint(XCoordinate=0, YCoordinate=0, ZCoordinate=0)
dog_bone_pocket = DogBonePocket_6(point=pt, tool_size=tool_size)  # -> pt_5, tool_size_3
num = Number(grip_width)
points = PointList(Points=dog_bone_pocket.pt_5)
ply_thickness = ClusterInput()
yz = YZPlane(Origin=Point(0, 0, 0))
rotate = Rotate(Geometry=dog_bone_pocket.pt_5, Angle=1.570796327, Plane=PlaneXY(0, 0, 0))  # -> Geometry, Transform
pt_2 = ConstructPoint(XCoordinate=0, YCoordinate=0, ZCoordinate=0)
rotate_2 = Rotate(Geometry=rotate.Geometry, Angle=1.570796327, Plane=yz)  # -> Geometry, Transform
division = Division(A=num, B=2)
neg = Negative(Value=ply_thickness)
mirror = Mirror(Geometry=rotate_2.Geometry, Plane=PlaneYZ(0, 0, 0))  # -> Geometry, Transform
Z = UnitZ(Factor=neg)
move = Move(Geometry=pt_2, Motion=Z)  # -> Geometry, Transform
move_2 = Move(Geometry=mirror.Geometry, Motion=Z)  # -> Geometry, Transform
slot_spacing = ClusterInput()
Z_2 = UnitZ(Factor=ply_thickness)
points_2 = PointList(Points=rotate_2.Geometry)
division_2 = Division(A=slot_spacing, B=2)
addition = Addition(B=division)
yz_2 = YZPlane(Origin=Point(0, 0, 0))
subtraction = Subtraction(A=addition, B=division_2)
X = UnitX(Factor=subtraction)
neg_2 = Negative(Value=X)
centre_point = ClusterOutput(pt)
num_2 = Number(num)
tab_width = ClusterOutput(num_2)

division_3 = Division(A=num, B=-2)

addition_2 = Addition(A=division_3, B=tool_size)
X_2 = UnitX(Factor=division_3)
X_3 = UnitX(Factor=division_3)

move_3 = Move(Geometry=move_2.Geometry, Motion=X_3)  # -> Geometry, Transform
move_4 = Move(Geometry=move.Geometry, Motion=X_2)  # -> Geometry, Transform
move_5 = Move(Geometry=move_4.Geometry, Motion=Z_2)  # -> Geometry, Transform

pline = PolyLine(Vertices=flatten([move_5.Geometry, move_3.Geometry, move.Geometry]), Closed=False)

mirror_2 = Mirror(Geometry=pline, Plane=yz_2)  # -> Geometry, Transform
join = JoinCurves(Curves=[pline, mirror_2.Geometry], Preserve=False)

end = EndPoints(Curve=join)  # -> Start, End
move_6 = Move(Geometry=end.End, Motion=X)  # -> Geometry, Transform
move_7 = Move(Geometry=end.Start, Motion=neg_2)  # -> Geometry, Transform
ln = Line(StartPoint=move_7.Geometry, EndPoint=end.Start)
ln_2 = Line(StartPoint=end.End, EndPoint=move_6.Geometry)
join_2 = JoinCurves(Curves=join, Preserve=False)
geometry = ClusterOutput(join_2)

# ==== cluster InternalSlot
slot_width = ClusterInput()
tool_size = ClusterInput()
tool_size_2 = Number(tool_size)
# Hor Grip Width
_2 = Number(2)
# Tool Width
division = Division(A=slot_width, B=_2)
A = ClusterInput()
# Hor Grip Width
division_2 = Division(A=tool_size_2, B=2)
tol_x2 = Multiplication(A=A, B=2)
pt = ConstructPoint(XCoordinate=0, YCoordinate=0, ZCoordinate=0)
addition = Addition(A=division, B=division_2)
pt_2 = Point(pt)
Y = UnitY(Factor=addition)
neg = Negative(Value=tool_size_2)
move = Move(Geometry=pt_2, Motion=Y)  # -> Geometry, Transform
X = UnitX(Factor=neg)
pt_3 = Point(move.Geometry)
move_2 = Move(Geometry=pt_3, Motion=X)  # -> Geometry, Transform
# Tool Width
neg_2 = Negative(Value=division_2)
Y_2 = UnitY(Factor=neg_2)
pt_4 = Point(move_2.Geometry)
move_3 = Move(Geometry=pt_4, Motion=Y_2)  # -> Geometry, Transform
pt_5 = Point(move_3.Geometry)
# Ply Thk
# Tol
A_2 = ClusterInput()
addition_2 = Addition(A=A_2, B=tol_x2)
# Tool Width
addition_3 = Addition(A=addition_2, B=division_2)
subtraction = Subtraction(A=addition_3, B=tool_size_2)
X_2 = UnitX(Factor=subtraction)
neg_3 = Negative(Value=X_2)
move_4 = Move(Geometry=pt_5, Motion=neg_3)  # -> Geometry, Transform
pt_6 = Point(move_4.Geometry)
neg_4 = Negative(Value=tool_size_2)
Y_3 = UnitY(Factor=neg_4)
move_5 = Move(Geometry=pt_6, Motion=Y_3)  # -> Geometry, Transform
pt_7 = Point(move_5.Geometry)
X_3 = UnitX(Factor=division_2)
subtraction_2 = Subtraction(A=division, B=tool_size_2)
move_6 = Move(Geometry=pt_7, Motion=X_3)  # -> Geometry, Transform
Y_4 = UnitY(Factor=subtraction_2)
pt_8 = Point(move_6.Geometry)
neg_5 = Negative(Value=Y_4)
move_7 = Move(Geometry=pt_8, Motion=neg_5)  # -> Geometry, Transform
pt_9 = Point(move_7.Geometry)
merge = Merge(Data1=pt_2, Data2=pt_3, Data3=pt_4, Data4=pt_5, Data5=pt_6, Data6=pt_7, Data7=pt_8, Data8=pt_9)
pline = PolyLine(Vertices=merge, Closed=False)
ln = Line(StartPoint=pt_2, EndPoint=pt_9)
crv = Curve(pline)
len = Length(Curve=ln)
_2_2 = Number(2)
division_3 = Division(A=len, B=_2_2)
eval = EvaluateLength(Curve=ln, Length=division_3, Normalized=False)  # -> Point, Tangent, Parameter
xz = XZPlane(Origin=Point(0, 0, 0))
pl_origin = PlaneOrigin(Base=xz, Origin=eval.Point)
mirror = Mirror(Geometry=crv, Plane=pl_origin)  # -> Geometry, Transform
join = JoinCurves(Curves=[crv, mirror.Geometry], Preserve=False)
mirror_2 = Mirror(Geometry=join, Plane=PlaneYZ(0, 0, 0))  # -> Geometry, Transform
_2d_geo = ClusterOutput(mirror_2.Geometry)

# ==== cluster ConnectorSlotWall_2
ply_thickness = ClusterInput()
tolerance = ClusterInput()
slot_length = ClusterInput()
panel = Panel(ply_thickness)
pt = ConstructPoint(XCoordinate=0, YCoordinate=0, ZCoordinate=0)
dog_bone_pocket = DogBonePocket(point=pt)  # -> pt_5, tool_size_2
points = PointList(Points=dog_bone_pocket.pt_5)

division = Division(A=ply_thickness, B=2)
addition = Addition(A=division, B=tolerance)
multiplication = Multiplication(A=addition, B=-1)
pt_2 = ConstructPoint(XCoordinate=0, YCoordinate=0, ZCoordinate=0)
X = UnitX(Factor=multiplication)
addition_2 = Addition(A=tolerance, B=slot_length)
multiplication_2 = Multiplication(A=addition_2, B=-1)
Y = UnitY(Factor=multiplication_2)
move = Move(Geometry=dog_bone_pocket.pt_5, Motion=X)  # -> Geometry, Transform
move_2 = Move(Geometry=pt_2, Motion=X)  # -> Geometry, Transform
move_3 = Move(Geometry=move.Geometry, Motion=Y)  # -> Geometry, Transform
move_4 = Move(Geometry=pt_2, Motion=Y)  # -> Geometry, Transform
geo = Geometry(flatten([move_4.Geometry, move_3.Geometry, move_2.Geometry]))
pline = PolyLine(Vertices=geo, Closed=False)
xz = XZPlane(Origin=Point(0, 0, 0))
mirror = Mirror(Geometry=pline, Plane=xz)  # -> Geometry, Transform
join = JoinCurves(Curves=[pline, mirror.Geometry], Preserve=False)
mirror_2 = Mirror(Geometry=join, Plane=PlaneYZ(0, 0, 0))  # -> Geometry, Transform
join_2 = JoinCurves(Curves=[mirror_2.Geometry, join], Preserve=False)
cp = ControlPoints(Curve=join_2)  # -> Points, Weights, Knots
pline_2 = PolyLine(Vertices=cp.Points, Closed=True)

mirror_3 = Mirror(Geometry=mirror.Geometry, Plane=PlaneYZ(0, 0, 0))  # -> Geometry, Transform
join_3 = JoinCurves(Curves=flatten([mirror.Geometry, mirror_3.Geometry]), Preserve=False)
xz_2 = XZPlane(Origin=Point(0, 0, 0))
mirror_4 = Mirror(Geometry=join_3, Plane=xz_2)  # -> Geometry, Transform
geometry = ClusterOutput(mirror_4.Geometry)

# ==== cluster DogBonePocket_6
tool_size = ClusterInput()
point = ClusterInput()
tool_size_2 = Number(tool_size)

division = Division(A=tool_size_2, B=2)
multiplication = Multiplication(A=division, B=-1)
pt = Point(point)
X = UnitX(Factor=multiplication)
Y = UnitY(Factor=tool_size_2)
move = Move(Geometry=graft(pt), Motion=X)  # -> Geometry, Transform
pt_2 = Point(flatten([pt, move.Geometry]))
move_2 = Move(Geometry=flatten(pt_2), Motion=Y)  # -> Geometry, Transform
pt_3 = Point([pt_2, move_2.Geometry])
avr = Average(Input=pt_3)
xy = XYPlane(Origin=avr)
vec2pt = Vector2Pt(PointA=avr, PointB=pt_3, Unitize=False)  # -> Vector, Length
pcomp = PlaneComponents(Plane=xy)  # -> Origin, XAxis, YAxis, ZAxis
angle = Angle(VectorA=vec2pt.Vector, VectorB=pcomp.XAxis, Plane=xy)  # -> Angle, Reflex
sort = SortList(Keys=angle.Angle, ValuesA=pt_3)  # -> List, ValuesA
pt_4 = Point(sort.ValuesA)

tool_size_3 = ClusterOutput(tool_size_2)
pt_5 = ClusterOutput(pt_4)
